# Grasshopper definition BuildingGeneration.gh (Grasshopper 1.0.7)
# plug-ins: DeCodingSpaces, Human, MetaHopper

# Description: DeCodingSpaces offers components that chained in a row allow the generation of blocks, parcels up to buildings. Try out the different parameters for each component:
# 1. Input Geoemtry
# 2. Settings for Block
# 3. Settings for Parcel
# 4. Settings for Building
document_info = DocumentInfo(AutoUpdate=False, Recursive=False)  # -> DocumentName, DocumentFilePath, Components, Params, _3rdPartyAssemblies
# text is internalised, if metahopper component is missing
not_internalised = Text(document_info._3rdPartyAssemblies)
internalised_text = Text(["DecodingSpacesAssembly, Version=1.0.0.0, Culture=neutral, PublicKeyToken=null", "MetaHopper, Version=1.0.8.0, Culture=neutral, PublicKeyToken=null"])
create_set = CreateSet(List=[internalised_text, not_internalised])  # -> Set, Map
# PARAMETRIC PLANNING CATALOGUE
# Building Generation
# v. 1.0 - Author: DeCodingSpaces
_3rd_party = Panel(create_set.Set)

# ----
# 1. Input Geometry
# 
# 2. Settings Block
# Buildings & Streets
# (for Visualisation)
number_slider = Slider(10, range=0..10)

# ---- group: Block Offset
number = Number(number_slider)

# ---- group: Min Block Area
number_2 = Number(Slider(1920, range=0..10000))

# ---- group: Boundary
boundary_polygon = Curve(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)

# ---- group: Initial Streets
initial_segments = Curve([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])

# ---- group: Buildings
mesh = Mesh([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])

# ---- group: Other Streets
crv = Curve([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])

# ---- group: Boundary
boundary_polygon_2 = Curve(boundary_polygon)

# ---- group: Initial Streets
initial_segments_2 = Curve(initial_segments)

# ----
# Generate Street Segments
number_slider_2 = Slider(9, range=0..20)
street_network_generator = StreetNetworkGenerator(
    Boundary=boundary_polygon_2,
    IniStreets=initial_segments_2,
    MinLength=30,
    MaxLength=100,
    MinDist=20,
    RandomAngle=10,
    MaxArms=4,
    TreeDepth=number_slider_2,
    ProbabilityToAddArms=1,
    SeedForRandom=-1)

# ---- group: Streets
crv_2 = Curve(street_network_generator)

crv_3 = Curve(crv_2)

# ---- group: Block Offset
number_3 = Number(number)

# ---- group: Min Block Area
number_4 = Number(number_2)

# ----
# Street Segments to Blocks
negative = Negative(Value=number_3)
customized_parameters = CustomizedParameters(
    ScalingFactor=1,
    MaxLength=100,
    MinLength=20,
    AngleRange=90,
    NChildren=3,
    TreeDepth=7,
    MinAngleD=10,
    MinDistance=1,
    MinBlockArea=number_4,
    BlockOffset=negative,
    MaxRank=4,
    Rank=0,
    MaxArea=20,
    ParcelDepth=5,
    ParcelWidth=5,
    SplitRate=0.5,
    Density=10,
    Seed=-1)
blocks = Blocks(CustomizedParameters=customized_parameters, StreetSegments=crv_3)  # -> Blocks, BlockStreetSegmentPairs

# ----
# 3. Settings Parcels
number_slider_3 = Slider(8, range=0..10)

# ---- group: Blocks
bl_street_blocks = Curve(simplify(graft(blocks.Blocks)))

# ---- group: Back Setback
number_5 = Number(number_slider_3)

# ---- group: PlotWidthThreshold
number_6 = Number(Slider(40, range=0..100))

# ---- group: Side Setback
number_7 = Number(Slider(8, range=0..10))

# ---- group: Road Setback
number_8 = Number(Slider(8, range=0..10))

# ---- group: PlotWidthThreshold
number_9 = Number(number_6)

# ---- group: Blocks
bl_street_blocks_2 = Curve(bl_street_blocks)

# ----
# Blocks to Parcels
# Street Offset has nearly same influence as the one used for blocks. However, the resulting tree structure does not work with the building  generation. Therefore, better keep it at 0.
parcels = Parcels(Polygons=bl_street_blocks_2, ConnectionDistance=1, StreetOffset=0, PlotWidthThreshold=number_9, Precision=100)

# ---- group: Parcels
bl_street_blocks_3 = Curve(parcels)

bl_street_blocks_4 = Curve(bl_street_blocks_3)

# ---- group: Road Setback
number_10 = Number(number_8)

# ---- group: Back Setback
number_11 = Number(number_5)

# ---- group: Blocks
bl_street_blocks_5 = Curve(bl_street_blocks)

# ---- group: Side Setback
number_12 = Number(number_7)

# ----
# Building Area on Parcel
buildable_area = BuildableArea(
    Parcels=simplify(bl_street_blocks_4),
    Blocks=simplify(bl_street_blocks_5),
    RoadSetback=number_10,
    SideSetback=number_12,
    BackSetback=number_11,
    Tolerance=0.7853981634)

# ----
# 4. Settings Building
minbuildingfootprintarea = Slider(50, range=0..100)

# ---- group: Buildable Area
bl_street_blocks_6 = Curve(buildable_area)

# ---- group: Min Building Footprint Area
number_13 = Number(minbuildingfootprintarea)

# ---- group: Building Depth
number_14 = Number(Slider(14, range=0..100))

# ---- group: Building Type
number_15 = Number(Slider(2, range=0..10))

# ---- group: Building Orientation
number_16 = Number(Slider(1, range=0..1))

# ---- group: FAR
number_17 = Number(Slider(0.5, range=0..1))

# ---- group: Parcels
bl_street_blocks_7 = Curve(bl_street_blocks_3)

# ---- group: Building Depth
number_18 = Number(number_14)

# ---- group: Building Type
number_19 = Number(number_15)

# ---- group: Building Orientation
number_20 = Number(number_16)

# ---- group: Blocks
bl_street_blocks_8 = Curve(bl_street_blocks)

# ---- group: FAR
number_21 = Number(number_17)

# ---- group: Buildable Area
bl_street_blocks_9 = Curve(bl_street_blocks_6)

# ----
# Buildings within Buildable Area
building_generation = BuildingGeneration(
    BuildableArea=bl_street_blocks_9,
    Parcels=bl_street_blocks_7,
    Blocks=bl_street_blocks_8,
    BuildingDepth=number_18,
    BuildingLength=20,
    BuildingType=number_19,
    Orientation=number_20,
    FAR=number_21,
    FloorHeight=4)  # -> BuildingFootprint, NumberOfFloors, BuildingHeight, FAR, GFA

# ---- group: Building Footprint
curve = Curve(building_generation.BuildingFootprint)

# ---- group: Building Height
number_22 = Number(building_generation.BuildingHeight)

# ---- group: Building Footprint
curve_2 = Curve(curve)

# ---- group: Min Building Footprint Area
number_23 = Number(number_13)

# ---- group: Building Height
number_24 = Number(number_22)

# ----
# Building Extrusion
boundary = BoundarySurfaces(Edges=curve_2)
area = Area(Geometry=boundary)  # -> Area, Centroid
larger_than = LargerThan(FirstNumber=area.Area, SecondNumber=number_23)  # -> LargerThan, OrEqualTo
cull_pattern = CullPattern(List=number_24, CullPattern=larger_than.LargerThan)
cull_pattern_2 = CullPattern(List=boundary, CullPattern=larger_than.LargerThan)
Z = UnitZ(Factor=cull_pattern)
extr = Extrude(Base=cull_pattern_2, Direction=Z)

# ---- group: Building Volume
brep = Brep(extr)

# ---- group: Boundary
boundary_polygon_3 = Curve(boundary_polygon)

# ---- group: Initial Streets
initial_segments_3 = Curve(initial_segments)

# ---- group: Streets
crv_4 = Curve(crv_2)

# ---- group: Buildings
mesh_2 = Mesh(mesh)

# ---- group: Building Footprint
curve_3 = Curve(curve)

# ---- group: Blocks
bl_street_blocks_10 = Curve(bl_street_blocks)

# ---- group: Parcels
bl_street_blocks_11 = Curve(bl_street_blocks_3)

# ---- group: Buildable Area
bl_street_blocks_12 = Curve(bl_street_blocks_6)

# ---- group: Building Volume
brep_2 = Brep(brep)

# ---- group: Other Streets
crv_5 = Curve(crv)

# ----
boundary_surfaces = BoundarySurfaces(Edges=bl_street_blocks_12)
boundary_surfaces_2 = BoundarySurfaces(Edges=bl_street_blocks_11)

number_slider_4 = Slider(2, range=0..10)
calc = ColourSwatch(SwatchColor=RGB(99, 197, 219))
vis = ColourSwatch(SwatchColor=RGBA(122, 64, 156, 150))
custom_preview_lineweights = CustomPreviewLineweights(
    Geometry=[boundary_polygon_3, initial_segments_3, crv_4],
    Shader=ColourSwatch(SwatchColor=RGB(157, 0, 255)),
    Thickness=number_slider_4,
    Absolute=False)
custom_preview_lineweights_2 = CustomPreviewLineweights(Geometry=crv_5, Shader=ColourSwatch(SwatchColor=RGB(181, 181, 181)), Thickness=number_slider_4, Absolute=False)
preview = CustomPreview(Geometry=boundary_surfaces_2, Shader=vis)
preview_2 = CustomPreview(Geometry=boundary_surfaces, Shader=ColourSwatch(SwatchColor=RGB(153, 0, 107)))
preview_3 = CustomPreview(Geometry=curve_3, Shader=ColourSwatch(SwatchColor=RGB(0, 0, 0)))
preview_4 = CustomPreview(Geometry=brep_2, Shader=calc)
preview_5 = CustomPreview(Geometry=mesh_2, Shader=ColourSwatch(SwatchColor=RGB(230, 230, 230)))
