# Grasshopper definition Template.gh (Grasshopper 1.0.7)
# plug-ins: MetaHopper

# PARAMETRIC PLANNING CATALOGUE
# TITLE
# v. 1.0 - Author: NAMES
# Description: Description of the script
document_info = DocumentInfo(AutoUpdate=False, Recursive=False)  # -> DocumentName, DocumentFilePath, Components, Params, _3rdPartyAssemblies
# text is internalised, if metahopper component is missing
not_internalised = Text(document_info._3rdPartyAssemblies)
internalised_text = Text(not_internalised)
create_set = CreateSet(List=[internalised_text, not_internalised])  # -> Set, Map
# 3rd Party Components might not be shown,
#  if Metahopper is not available. Therefore,
# the data of Not internalised should be
# connected to Internalised Text. Afterwards
# internalise the data to this component through
# rightclick. In this way the 3rd Party Assemblies
# should be shown even to people without
# Metahopper.
# Afterwards move the 3rd Party Panel over
#  those components to hide them.
_3rd_party = Panel(create_set.Set)

# ---- group: Another Parameter Name
# Input Group
# ---
# used for parameters such as Sliders
# or Geometry that do not have any input,
# since they store the data and only
# have an output.
point = Point(Point(0, 1, 0))

# ---- group: Parameter Name
point_2 = Point(Point(0, 0, 0))

# ---- group: Another Parameter Name
point_3 = Point(point)

# ---- group: Parameter Name
# Function Group
# ---
# A group that works within itself like a function
# with input and output parameters. It is similar
# to a Cluster, but helps us to keep a well
# structured definition.
# Input Parameters
point_4 = Point(point_2)

# ----
line = Line(StartPoint=point_4, EndPoint=point_3)

# ---- group: Resulting Line
# Output Parameters
line_2 = Line(line)

# ----
get_selected_objects = GetSelectedObjects()  # -> ComponentObjects, ParamObjects, OtherObjects
# Select a group you want to color.
# Afterwards click on the Select
# Button above the your color.
get_selected_objects_2 = GetSelectedObjects()  # -> ComponentObjects, ParamObjects, OtherObjects
get_selected_objects_3 = GetSelectedObjects()  # -> ComponentObjects, ParamObjects, OtherObjects
input = ColourSwatch(SwatchColor=RGBA(227, 5, 116, 150))
calc = ColourSwatch(SwatchColor=RGBA(99, 197, 219, 150))
vis = ColourSwatch(SwatchColor=RGBA(122, 64, 156, 150))

# ---- group: Output / Resulting Line
line_3 = Line(line_2)

# ---- group: Output
# Output Group
# ---
# Does not have any output parameters.
# Is used for visualisation, baking or similar
# "deadends" that do not need any
# further processing.
gradient = Gradient(
    LowerLimit=0,
    UpperLimit=1,
    stops=[0: RGB(0, 61, 89), 0.25: RGB(0, 155, 180), 0.5: RGB(148, 193, 28), 0.75: RGB(243, 154, 0), 1: RGB(183, 26, 73)])
color = ColourSwatch(SwatchColor=RGB(122, 64, 156))
color_2 = ColourSwatch(SwatchColor=RGB(99, 197, 219))
color_3 = ColourSwatch(SwatchColor=RGB(227, 5, 116))
custom_preview = CustomPreview(Geometry=line_3, Material=color_3)

# ----
# Toggle this button to automatically select all
# unnecessary parts of the template, afterwards
# hit delete and you have a clean template.
# 
# It will delete all comments!
# It will hide the 3rd party part. Remember
# to internalise 3rd party components into
# the text parameter after creating your own
# script! Otherwise people wont know, which
# ones they are missing!
set_group_properties = SetGroupProperties(Group=get_selected_objects.OtherObjects, Color=input)
set_group_properties_2 = SetGroupProperties(Group=get_selected_objects_2.OtherObjects, Color=calc)
set_group_properties_3 = SetGroupProperties(Group=get_selected_objects_3.OtherObjects, Color=vis)
boolean_toggle = BooleanToggle(False)
get_connected_objects = GetConnectedObjects(Objects=_3rd_party)
get_connected_objects_2 = GetConnectedObjects(Objects=internalised_text)
data = Data([null x29])
internalize_param_data = InternalizeParamData(Param=get_connected_objects_2, Internalize=boolean_toggle)
cluster = Cluster(B=boolean_toggle, objects=get_connected_objects)
stream_filter = StreamFilter(Gate=boolean_toggle, Stream1=data)
move_object = MoveObject(Objects=get_connected_objects, Positions=cluster)
select_gh_object = SelectGHObject(Object=stream_filter)

# ==== cluster Cluster
B = ClusterInput()
objects = ClusterInput()
object_info = ObjectInfo(Objects=objects)  # -> Name, NickName, Type, Pivot, Bounds, Value, Enabled, Preview
deconstuct_rectangle = DeconstuctRectangle(Rectangle=object_info.Bounds)  # -> BasePlane, XInterval, YInterval
deconstruct_domain = DeconstructDomain(Domain=deconstuct_rectangle.XInterval)  # -> Start, End
negative = Negative(Value=deconstruct_domain.End)
subtraction = Subtraction(A=Slider(2, range=0..10), B=B)
multiplication = Multiplication(A=subtraction, B=negative)
construct_point = ConstructPoint(XCoordinate=multiplication, YCoordinate=0, ZCoordinate=0)
point = ClusterOutput(construct_point)
