# Grasshopper definition Data Analysis.gh (Grasshopper 1.0.7)
# plug-ins: DeCodingSpaces, MetaHopper

# Description: A set of components based on R statistical language, and R.Net framework, to provide the functionalities of R into Grasshopper. Divided into 3 categories, Plotting, Computing, and scripting. plotting includes Histogram, Bar Chart, Box Chart,and Heatmap. Computing includes numerical summary, and Correlation. Scripting it text based that passes data and functions for R interface.​
document_info = DocumentInfo(AutoUpdate=False, Recursive=False)  # -> DocumentName, DocumentFilePath, Components, Params, _3rdPartyAssemblies
# text is internalised, if metahopper component is missing
not_internalised = Text(document_info._3rdPartyAssemblies)
internalised_text = Text(["DecodingSpacesAssembly, Version=1.0.0.0, Culture=neutral, PublicKeyToken=null", "MetaHopper, Version=1.0.8.0, Culture=neutral, PublicKeyToken=null"])
create_set = CreateSet(List=[internalised_text, not_internalised])  # -> Set, Map
# PARAMETRIC PLANNING CATALOGUE
# Data Analysis with R
# v. 1.0 - Author: DeCodingSpaces - Abdulmalik Abdulmawla
_3rd_party = Panel(create_set.Set)

# ----
# German Cities Population/Density report 2016: Alle politisch selbständigen Gemeinden mit ausgewählten Merkmalen am 31.12.2016 (4. Quartal)) published on 16.01.2017 by “Der Statistische Beirat” URL: https://www.destatis.de
boolean_toggle = BooleanToggle(False)

# ---- group: Raw Text
text = Text(["State ID,State,Cities,Area sq.km,Population,Male,Female,Density p/km", "1,Schleswig-Holstein,Flensburg Stadt,56.74,85942,42767,43175,1515", "1,Schleswig-Holstein,Kiel Landeshauptstadt,118.65,246306,119835,126471,2076", "1,Schleswig-Holstein,Lubeck Hansestadt,214.21,216253,103683,112570,1010", "1,Schleswig-Holstein,Neumunster Stadt,71.63,79197,39118,40079,1106", "1,Schleswig-Holstein,Brunsbuttel Stadt,65.23,12740,6430,6310,195"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])

# ---- group: Show Histogram
boolean = Boolean(boolean_toggle)

# ---- group: Show Barplot
boolean_2 = Boolean(Toggle(False))

# ---- group: Show Boxplot
boolean_3 = Boolean(Toggle(False))

# ---- group: Show Plot Data
boolean_4 = Boolean(Toggle(False))

# ---- group: Show Plot Heatmap
boolean_5 = Boolean(Toggle(False))

# ---- group: Show Linear Regression
boolean_6 = Boolean(Toggle(False))

# ---- group: Raw Text
text_2 = Text(text)

# ----
# Density is clamped at a value above 1000 in this example
cull_index = CullIndex(List=text_2, Indices=0, Wrap=True)
list_item = ListItem(List=text_2, Index=0, Wrap=True)
text_split = TextSplit(Text=cull_index, Separators=",")
text_split_2 = TextSplit(Text=list_item, Separators=",")
panel = Panel(text_split_2)
number_slider = Slider(1, range=0..1)
list_item_2 = ListItem(List=text_split, Index=number_slider, Wrap=True)  # -> flatten(Item)
list_item_3 = ListItem(List=panel, Index=number_slider, Wrap=True)  # -> flatten(Item)
list_item_4 = ListItem(List=text_split_2, Index=Slider(6, range=0..10), Wrap=True)  # -> flatten(Item)
list_item_5 = ListItem(List=text_split, Index=Slider(6, range=0..10), Wrap=True)  # -> flatten(Item)
list_item_6 = ListItem(List=panel, Index=Slider(7, range=0..10), Wrap=True)  # -> flatten(Item)
list_item_7 = ListItem(List=text_split, Index=Slider(7, range=0..10), Wrap=True)  # -> flatten(Item)
panel_2 = Panel(list_item_4)
panel_3 = Panel(list_item_6)
panel_4 = Panel(list_item_3)
german_cities_densities = Number(list_item_7)
number_slider_2 = Slider(1000, range=0..1000)
list_length = ListLength(List=german_cities_densities)
larger_than = LargerThan(FirstNumber=german_cities_densities, SecondNumber=number_slider_2)  # -> LargerThan, OrEqualTo
repeat_data = RepeatData(Data=number_slider_2, Length=list_length)
pick_n_choose = PickNChoose(Pattern=larger_than.OrEqualTo, Stream0=german_cities_densities, Stream1=repeat_data)

# ---- group: State Name
state_names_of_each_city = Text(list_item_2)

# ---- group: Density Per/KM
german_cities_densities_2 = Number(pick_n_choose)

# ---- group: Female Population
number = Number(list_item_5)

# ---- group: Get Data of two german states / Density Per/KM
german_cities_densities_3 = Number(pick_n_choose)

# ---- group: Get Data of two german states / State Name
state_names_of_each_city_2 = Text(state_names_of_each_city)

# ---- group: Get Data of two german states
sort_list = SortList(Keys=german_cities_densities_3, ValuesValuesA=state_names_of_each_city_2)  # -> Keys, ValuesValuesA
state_1 = Slider(0, range=0..15)
state_2 = Slider(1, range=0..15)
create_set_2 = CreateSet(List=sort_list.ValuesValuesA)  # -> Set, Map
equality = Equality(FirstNumber=create_set_2.Map, SecondNumber=state_1)  # -> Equality, Inequality
equality_2 = Equality(FirstNumber=create_set_2.Map, SecondNumber=state_2)  # -> Equality, Inequality
dispatch = Dispatch(List=sort_list.Keys, DispatchPattern=equality_2.Equality)  # -> ListA, ListB
dispatch_2 = Dispatch(List=sort_list.Keys, DispatchPattern=equality.Equality)  # -> ListA, ListB

# ---- group: Get Data of two german states / Density Per/KM State 1
german_cities_densities_4 = Number(dispatch_2.ListA)

# ---- group: Get Data of two german states / Density Per/KM State 2
german_cities_densities_5 = Number(dispatch.ListA)

# ---- group: computing and visualizing linear regression / Show Linear Regression
boolean_7 = Boolean(boolean_6)

# ---- group: computing and visualizing linear regression / Density Per/KM
german_cities_densities_6 = Number(german_cities_densities_2)

# ---- group: computing and visualizing linear regression / Female Population
number_2 = Number(number)

# ---- group: Boxplot: Plot multiple numerical data / Show Boxplot
boolean_8 = Boolean(boolean_3)

# ---- group: Boxplot: Plot multiple numerical data / Density Per/KM
german_cities_densities_7 = Number(german_cities_densities_2)

# ---- group: Plot heatmap / Density Per/KM State 2
german_cities_densities_8 = Number(german_cities_densities_5)

# ---- group: Boxplot: Plot multiple numerical data / State Name
state_names_of_each_city_3 = Text(state_names_of_each_city)

# ---- group: Boxplot: Plot multiple numerical data
series = Series(Start=0, Step=1, Count=16)
gradient = Gradient(
    LowerLimit="0",
    UpperLimit="16",
    Parameter=series,
    stops=[0: RGB(0, 61, 89), 0.25: RGB(0, 155, 180), 0.5: RGB(148, 193, 28), 0.75: RGB(243, 154, 0), 1: RGB(183, 26, 73)])
box_plot = BoxPlot(
    CategoricalData=state_names_of_each_city_3,
    NumericalData=german_cities_densities_7,
    MainTitle="German Cities - States Densities",
    XAxisTitle="States",
    YAxisTitle="Densities",
    ColorList=gradient,
    Enable=boolean_8)
panel_5 = Panel(box_plot)

# ---- group: Plot heatmap / Show Plot Heatmap
boolean_9 = Boolean(boolean_5)

# ---- group: Plot heatmap / Density Per/KM State 1
german_cities_densities_9 = Number(german_cities_densities_4)

# ---- group: Plot data / Density Per/KM State 2
german_cities_densities_10 = Number(german_cities_densities_5)

# ---- group: Barplot : plot categorical data / Show Barplot
boolean_10 = Boolean(boolean_2)

# ---- group: Plot data / Show Plot Data
boolean_11 = Boolean(boolean_4)

# ---- group: Plot data / Density Per/KM State 1
german_cities_densities_11 = Number(german_cities_densities_4)

# ---- group: Plot data
panel_6 = Panel("""5
10""")
gradient_2 = Gradient(
    LowerLimit="0",
    UpperLimit="16",
    Parameter=panel_6,
    stops=[0: RGB(0, 61, 89), 0.25: RGB(0, 155, 180), 0.5: RGB(148, 193, 28), 0.75: RGB(243, 154, 0), 1: RGB(183, 26, 73)])
panel_7 = Panel("""Random #1
Random #2""")
entwine = Entwine(Branch00=german_cities_densities_11, Branch01=german_cities_densities_10, FlattenInputs=True)  # -> simplify(Result)
integer = Integer([1, 2])
integer_2 = Integer([5, 1])
plot = Plot(
    NumericalDataTree=entwine,
    CurveNames=panel_7,
    MainTitle="German Cities - States Densities",
    LinesWeight=integer_2,
    LinesType=integer,
    ColorList=gradient_2,
    Enable=boolean_11)
panel_8 = Panel(plot)

# ---- group: Histogram : Plot numerical data / Show Histogram
boolean_12 = Boolean(boolean)

# ---- group: Histogram : Plot numerical data / Density Per/KM
german_cities_densities_12 = Number(german_cities_densities_2)

# ---- group: Barplot : plot categorical data / State Name
state_names_of_each_city_4 = Text(state_names_of_each_city)

# ---- group: Summary about numeric list / Female Population
number_3 = Number(number)

# ---- group: Summary about numeric list
summary = Summary(NumericData=number_3, Quartile=Slider(0.5, range=0..1))  # -> Count, Summation, Minimum, Maximum, Mean, StandardDiviation, InterquartileRange, DefaultQuartiles, SelectedQuartiles
panel_9 = Panel(summary.StandardDiviation)
panel_10 = Panel(summary.InterquartileRange)
panel_11 = Panel(summary.DefaultQuartiles)
panel_12 = Panel(summary.SelectedQuartiles)
panel_13 = Panel(summary.Count)
panel_14 = Panel(summary.Summation)
panel_15 = Panel(summary.Minimum)
panel_16 = Panel(summary.Maximum)
panel_17 = Panel(summary.Mean)

# ---- group: computing and visualizing linear regression
panel_18 = Panel("""Scatterplot 
The correlation between Density and female population""")
logarithm = Logarithm(Value=german_cities_densities_6)
logarithm_2 = Logarithm(Value=number_2)
correlation = Correlation(
    XData=logarithm,
    YData=logarithm_2,
    MainTitle=panel_18,
    XAxisTitle="Cities Dencities",
    YAxisTitle="Female Population",
    DotsSize=Slider(0.117, range=0..2),
    Color=ColourSwatch(SwatchColor=RGB(237, 117, 255)),
    Enable=boolean_7)  # -> PearsonCoef, SpearmanCoef, RSquared, PValue, SummaryOfPerson
panel_19 = Panel(correlation.SummaryOfPerson)
panel_20 = Panel(correlation.SpearmanCoef)
panel_21 = Panel(correlation.RSquared)
panel_22 = Panel(correlation.PValue)
panel_23 = Panel(correlation.PearsonCoef)

# ---- group: Plot heatmap
shortest_list = ShortestList(ListListA=german_cities_densities_9, ListListB=german_cities_densities_8, TrimMode=2)  # -> ListListA, ListListB
jitter = Jitter(List=shortest_list.ListListB, Jitter=1, Seed=2)  # -> Values, Indices
jitter_2 = Jitter(List=shortest_list.ListListB, Jitter=1, Seed=4)  # -> Values, Indices
jitter_3 = Jitter(List=shortest_list.ListListA, Jitter=1, Seed=2)  # -> Values, Indices
jitter_4 = Jitter(List=shortest_list.ListListA, Jitter=1, Seed=4)  # -> Values, Indices
entwine_2 = Entwine(
    Branch00=jitter_4.Values,
    Branch01=jitter_2.Values,
    Branch02=jitter_4.Values,
    Branch03=jitter_2.Values,
    FlattenInputs=True)  # -> simplify(Result)
panel_24 = Panel("""City I
City II
City II
City IV""")
panel_25 = Panel("""Feature #1
Feature #2
Feature #3
Feature #4""")
entwine_3 = Entwine(Branch00=jitter_3.Values, Branch01=jitter.Values, Branch02=jitter_3.Values, Branch03=jitter.Values, FlattenInputs=True)  # -> simplify(Result)
heatmap = Heatmap(
    ValuesOrXData=entwine_3,
    YData=entwine_2,
    XNames=panel_24,
    YNames=panel_25,
    MainTitle="Heatmap",
    XAxisTitle="Random Values #1",
    YAxisTitle="Random Values #2",
    Enable=boolean_9)  # -> PearsonCoef, SpearmanCoef, PValue, Summary
panel_26 = Panel(heatmap.SpearmanCoef)
panel_27 = Panel(heatmap.PearsonCoef)

# ---- group: Barplot : plot categorical data
series_2 = Series(Start=0, Step=1, Count=16)
gradient_3 = Gradient(
    LowerLimit="0",
    UpperLimit="16",
    Parameter=series_2,
    stops=[0: RGB(0, 61, 89), 0.25: RGB(0, 155, 180), 0.5: RGB(148, 193, 28), 0.75: RGB(243, 154, 0), 1: RGB(183, 26, 73)])
bar_plot = BarPlot(
    CategoricalList=state_names_of_each_city_4,
    MainTitle="German Cities - Number of citier per state",
    XAxisTitle="States",
    YAxisTitle="Number of Cities",
    ColorList=gradient_3,
    Enable=boolean_10)  # -> Categories, Counts, Ratios, Summary
panel_28 = Panel(bar_plot.Categories)
panel_29 = Panel(bar_plot.Counts)
panel_30 = Panel(bar_plot.Ratios)
panel_31 = Panel(bar_plot.Summary)

# ----
construct_domain = ConstructDomain(DomainStart=0, DomainEnd=Slider(431, range=0..10000))

# ---- group: Histogram : Plot numerical data
construct_domain_2 = ConstructDomain(DomainStart=0, DomainEnd=Slider(579, range=0..10000))
histogram = Histogram(
    NumericalData=german_cities_densities_12,
    Breaks=Slider(94, range=0..100),
    XLimits=construct_domain,
    CropLim=Toggle(True),
    YLimits=construct_domain_2,
    MainTitle="German Cities - Distribution of densities",
    XAxisTitle="Density pp/km",
    ColorList=ColourSwatch(SwatchColor=RGB(12, 204, 191)),
    Enable=boolean_12)  # -> ColumnsMids, Frequency, Density, Skewness, Kurtosis, Summary
panel_32 = Panel(histogram.ColumnsMids)
panel_33 = Panel(histogram.Skewness)
panel_34 = Panel(histogram.Kurtosis)
panel_35 = Panel(histogram.Summary)
panel_36 = Panel(histogram.Frequency)
panel_37 = Panel(histogram.Density)
