# Grasshopper definition IsovistField.gh (Grasshopper 1.0.7)
# plug-ins: DeCodingSpaces, MetaHopper

# PARAMETRIC PLANNING CATALOGUE
# Isovist - Field Analysis
# v. 1.0 - Author: DeCodingSpaces - Martin Bielik, Ekaterina Fuchkina
document_info = DocumentInfo(AutoUpdate=False, Recursive=False)  # -> DocumentName, DocumentFilePath, Components, Params, _3rdPartyAssemblies
# text is internalised, if metahopper component is missing
not_internalised = Text(document_info._3rdPartyAssemblies)
internalised_text = Text(["DecodingSpacesAssembly, Version=1.0.0.0, Culture=neutral, PublicKeyToken=null", "MetaHopper, Version=1.0.8.0, Culture=neutral, PublicKeyToken=null"])
create_set = CreateSet(List=[internalised_text, not_internalised])  # -> Set, Map
# Description: Calculate 2d isovist properties for multiple vantage points arranged on the grid. Change the grid size and observe how the high and low values for each measure are distributed throughout the space.
_3rd_party = Panel(create_set.Set)

viewing_range = Slider(100, range=1..200)
cell_size = Slider(2, range=1..10)

# ---- group: Fillpoint
vantange_point = Point(Point(-0.03235121601, -17.40401966, 0))

# ---- group: Analysis Frame
analysis_boundary = Rectangle({Plane=PlaneXY(-32.29911707, 9.584526229, 0), Size=Domain2(u=-77.38608775..77.38608775, v=-90.6444779..90.6444779)})

# ---- group: Buildings
mesh = Mesh([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])

# ---- group: Cell Size
number = Number(cell_size)

# ---- group: Obstacles
obstacles_polylines_crv = Curve([<curve referenced from the Rhino model> x261])

# ---- group: Viewing Range
number_2 = Number(viewing_range)

# ---- group: Viewing Angle
number_3 = Number(Slider(360, range=0..360))

# ---- group: Obstacles
obstacles_polylines_crv_2 = Curve(obstacles_polylines_crv)

# ---- group: Viewing Range
number_4 = Number(number_2)

# ---- group: Viewing Angle
number_5 = Number(number_3)

# ---- group: Cell Size
number_6 = Number(number)

# ---- group: Analysis Frame
analysis_boundary_2 = Rectangle(analysis_boundary)

# ---- group: Fillpoint
vantange_point_2 = Point(vantange_point)

# ----
explode = Explode(Curve=obstacles_polylines_crv_2, Recursive=True)  # -> Segments, Vertices
obstacles_line = Line(simplify(explode.Segments))
Y = UnitY(Factor=1)
explode_2 = Explode(Curve=analysis_boundary_2, Recursive=True)  # -> flatten(Segments), Vertices
analysis_grid = AnalysisGrid(ObstacleLines=flatten([explode_2.Segments, obstacles_line]), CellSize=number_6, FillPoint=vantange_point_2)  # -> AnalysisPoints, GridCells
isovist = Isovist(
    VantagePointS=analysis_grid.AnalysisPoints,
    ObstacleLines=flatten([obstacles_line, explode_2.Segments]),
    ViewingDirection=Y,
    ViewingRange=number_4,
    ViewingAngle=number_5,
    Precision=Slider(360, range=1..720),
    ShowPolygon=Toggle(True),
    ShowRadials=Toggle(True),
    UseGPU=Toggle(True))  # -> IsovistPolygon, Radials, ObstacleVisibility, IsovistProperties

# ---- group: Grid Cells
curve = Curve(analysis_grid.GridCells)

# ---- group: Isovist Properties
number_7 = Number(isovist.IsovistProperties)

# ---- group: Grid Cells
curve_2 = Curve(curve)

# ---- group: Isovist Properties
number_8 = Number(number_7)

# ---- group: Buildings
mesh_2 = Mesh(mesh)

# ----
list = ValueList({"Area": 0, "Area (Dist Weighted)": 1, "Perimeter": 2, "Compactness": 3, "Circularity": 4, "ConvexDeficiency": 5, "Occlusivity": 6, "Min Radial": 7, "Max Radial": 8, "Mean Radial": 9, "Standard Deviation": 10, "Variance": 11, "Skewness": 12, "Dispersion": 13, "Elongation": 14, "Drift Magnitude": 15, "Drift Angle": 16}, selected="Area")
item = ListItem(List=number_8, Index=list, Wrap=True)  # -> flatten(Item)
preview = CustomPreview(Geometry=mesh_2, Shader=ColourSwatch(SwatchColor=RGBA(204, 204, 204, 131)))
bnd = Bounds(Numbers=item)
dedomain = DeconstructDomain(Domain=bnd)  # -> Start, End
gradient = Gradient(
    LowerLimit=dedomain.Start,
    UpperLimit=dedomain.End,
    Parameter=item,
    stops=[0: RGB(0, 0, 139), 0.254: RGB(50, 178, 206), 0.501: RGB(87, 166, 31), 0.748: RGB(255, 215, 0), 1: RGB(255, 0, 0)])
boundary = BoundarySurfaces(Edges=graft(curve_2))  # -> flatten(Surfaces)
preview_2 = CustomPreview(Geometry=boundary, Shader=gradient)
