# Grasshopper definition IsovistObjectVisibility.gh (Grasshopper 1.0.7)
# plug-ins: DeCodingSpaces, MetaHopper

# PARAMETRIC PLANNING CATALOGUE
# Isovist - Object Visibility
# v. 1.0 - Author: DeCodingSpaces - Martin Bielik, Ekaterina Fuchkina
document_info = DocumentInfo(AutoUpdate=False, Recursive=False)  # -> DocumentName, DocumentFilePath, Components, Params, _3rdPartyAssemblies
# text is internalised, if metahopper component is missing
not_internalised = Text(document_info._3rdPartyAssemblies)
internalised_text = Text(["DecodingSpacesAssembly, Version=1.0.0.0, Culture=neutral, PublicKeyToken=null", "MetaHopper, Version=1.0.8.0, Culture=neutral, PublicKeyToken=null"])
create_set = CreateSet(List=[internalised_text, not_internalised])  # -> Set, Map
# Description: Basic setup the 2d isovist component. You can experiment with the view angle, direction, range parameters. Try to change the number of rays used to generate the isovist to speed up the calculation or increase the precision.
_3rd_party = Panel(create_set.Set)

angle_direction = Slider(0, range=0..6.28)
viewing_range = Slider(100, range=1..200)

# ---- group: Viewing Angle
number = Number(Slider(360, range=0..360))

# ---- group: Buildings
mesh = Mesh([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])

# ---- group: Viewing Direction
number_2 = Number(angle_direction)

# ---- group: Viewing Range
number_3 = Number(viewing_range)

# ---- group: Viewpoint
vantange_point = Point(Point(-0.03235121601, -17.40401966, 0))

# ---- group: Obstacles
obstacles_polylines_crv = Curve([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])

# ---- group: Viewpoint
vantange_point_2 = Point(vantange_point)

# ---- group: Obstacles
obstacles_polylines_crv_2 = Curve(obstacles_polylines_crv)

# ---- group: Viewing Direction
number_4 = Number(number_2)

# ---- group: Viewing Range
number_5 = Number(number_3)

# ---- group: Viewing Angle
number_6 = Number(number)

# ----
explode = Explode(Curve=obstacles_polylines_crv_2, Recursive=True)  # -> Segments, Vertices
Y = UnitY(Factor=1)
obstacles_line = Line(simplify(explode.Segments))
rotate = Rotate(Geometry=Y, Angle=number_4, Plane=PlaneXY(0, 0, 0))  # -> Geometry, Transform
isovist = Isovist(
    VantagePointS=vantange_point_2,
    ObstacleLines=flatten(obstacles_line),
    ViewingDirection=rotate.Geometry,
    ViewingRange=number_5,
    ViewingAngle=number_6,
    Precision=Slider(360, range=1..720),
    ShowPolygon=Toggle(True),
    ShowRadials=Toggle(True),
    UseGPU=False)  # -> IsovistPolygon, Radials, ObstacleVisibility, IsovistProperties

# ---- group: Obstacle Visibility Tree
object_visibility_int = Integer(isovist.ObstacleVisibility)

# ---- group: Obstacle Lines
obstacles_line_2 = Line(obstacles_line)

# ---- group: Obstacle Visibility Tree
object_visibility_int_2 = Integer(object_visibility_int)

# ---- group: Obstacle Lines
obstacles_line_3 = Line(obstacles_line_2)

obstacles_line_4 = Line(flatten(obstacles_line_2))

# ---- group: Buildings
mesh_2 = Mesh(mesh)

# ----
preview = CustomPreview(Geometry=mesh_2, Shader=ColourSwatch(SwatchColor=RGBA(204, 204, 204, 43)))

# ---- group: Obstacle Visibility Tree
object_visibility_int_3 = Integer(object_visibility_int)

# ---- group: Normalizing the number of ray hits by the lengt of the obstacle
len = Length(Curve=obstacles_line_4)
division = Division(A=object_visibility_int_3, B=len)
object_visibility_normalized_int = Integer(division)

# ----
bnd = Bounds(Numbers=object_visibility_normalized_int)
dedomain = DeconstructDomain(Domain=bnd)  # -> Start, End
gradient = Gradient(
    LowerLimit=dedomain.Start,
    UpperLimit=dedomain.End,
    Parameter=object_visibility_normalized_int,
    stops=[0: RGB(0, 0, 139), 0.0341: RGB(50, 178, 206), 0.0977: RGB(87, 166, 31), 0.198: RGB(255, 215, 0), 0.561: RGB(255, 0, 0)])
preview_2 = CustomPreview(Geometry=obstacles_line_4, Shader=gradient)

obstacles_polylines_crv_3 = Curve(graft(obstacles_polylines_crv))
unflatten = UnflattenTree(Tree=object_visibility_int_2, Guide=obstacles_line_3)
shift_paths = ShiftPaths(T=unflatten)
boundary = BoundarySurfaces(Edges=obstacles_polylines_crv_3)
ma = MassAddition(Input=shift_paths)  # -> Result, PartialResults
object_visibility_sum_int = Integer(ma.Result)

area = Area(Geometry=boundary)  # -> Area, Centroid
division_2 = Division(A=object_visibility_sum_int, B=area.Area)
object_visibility_sum_normalized_num = Number(division_2)

bnd_2 = Bounds(Numbers=flatten(object_visibility_sum_normalized_num))
dedomain_2 = DeconstructDomain(Domain=bnd_2)  # -> Start, End
gradient_2 = Gradient(
    LowerLimit=dedomain_2.Start,
    UpperLimit=dedomain_2.End,
    Parameter=object_visibility_sum_normalized_num,
    stops=[0: RGB(0, 0, 139), 0.0341: RGB(50, 178, 206), 0.0977: RGB(87, 166, 31), 0.198: RGB(255, 215, 0), 0.561: RGB(255, 0, 0)])
preview_3 = CustomPreview(Geometry=graft(boundary), Shader=gradient_2)

# ==== cluster ShiftPaths
T = ClusterInput()
tstat = TreeStatistics(Tree=T)  # -> Paths, Length, Count
dpath = DeconstructPath(Branch=tstat.Paths)
lng = ListLength(List=dpath)  # -> flatten(Length)
item = ListItem(List=lng, Index=0, Wrap=True)
subtraction = Subtraction(A=1, B=item)
pshift = ShiftPaths(Data=T, Offset=subtraction)
D = ClusterOutput(pshift)
