# Grasshopper definition IsovistOnPath.gh (Grasshopper 1.0.7)
# plug-ins: DeCodingSpaces, MetaHopper

# PARAMETRIC PLANNING CATALOGUE
# Isovist - On Path
# v. 1.0 - Author: DeCodingSpaces - Martin Bielik, Ekaterina Fuchkina
document_info = DocumentInfo(AutoUpdate=False, Recursive=False)  # -> DocumentName, DocumentFilePath, Components, Params, _3rdPartyAssemblies
# text is internalised, if metahopper component is missing
not_internalised = Text(document_info._3rdPartyAssemblies)
internalised_text = Text(["MetaHopper, Version=1.0.8.0, Culture=neutral, PublicKeyToken=null", "DecodingSpacesAssembly, Version=1.0.0.0, Culture=neutral, PublicKeyToken=null"])
create_set = CreateSet(List=[internalised_text, not_internalised])  # -> Set, Map
# Description: Constructing directed 2d isovist along predefined path. Construct your own path through the environment and try different settings for view angle and view range. Observe how the isovist measures are changing during the movement along the path
_3rd_party = Panel(create_set.Set)

point_on_curve = Slider(0.274, range=0..1)
walking_path = Curve(reparameterize(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))
viewing_range = Slider(100, range=1..200)
evaluate_curve = EvaluateCurve(Curve=walking_path, Parameter=point_on_curve)  # -> Point, Tangent, Angle

# ---- group: Viewing Angle
number = Number(Slider(360, range=0..360))

# ---- group: Viewing Direction
vector = Vector(evaluate_curve.Tangent)

# ---- group: Viewing Range
number_2 = Number(viewing_range)

# ---- group: Buildings
mesh = Mesh([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])

# ---- group: Viewpoint
vantange_point = Point(evaluate_curve.Point)

# ---- group: Obstacles
obstacles_polylines_crv = Curve([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])

# ---- group: Viewpoint
vantange_point_2 = Point(vantange_point)

# ---- group: Obstacles
obstacles_polylines_crv_2 = Curve(obstacles_polylines_crv)

# ---- group: Viewing Direction
vector_2 = Vector(vector)

# ---- group: Viewing Range
number_3 = Number(number_2)

# ---- group: Viewing Angle
number_4 = Number(number)

# ----
explode = Explode(Curve=obstacles_polylines_crv_2, Recursive=True)  # -> Segments, Vertices
obstacles_line = Line(simplify(explode.Segments))
isovist = Isovist(
    VantagePointS=vantange_point_2,
    ObstacleLines=flatten(obstacles_line),
    ViewingDirection=vector_2,
    ViewingRange=number_3,
    ViewingAngle=number_4,
    Precision=Slider(360, range=1..720),
    ShowPolygon=Toggle(True),
    ShowRadials=Toggle(True),
    UseGPU=False)  # -> IsovistPolygon, Radials, ObstacleVisibility, IsovistProperties

# ---- group: Isovist Polygon
isovist_srf = Surface(isovist.IsovistPolygon)

# ---- group: Isovist Rays
isovist_line = Line(isovist.Radials)

# ---- group: Isovist Properties
number_5 = Number(isovist.IsovistProperties)

# ---- group: Buildings
mesh_2 = Mesh(mesh)

# ---- group: Isovist Polygon
isovist_srf_2 = Surface(isovist_srf)

# ---- group: Isovist Properties
number_6 = Number(number_5)

# ---- group: Isovist Rays
isovist_line_2 = Line(isovist_line)

# ----
list = ValueList({"Area": 0, "Area (Dist Weighted)": 1, "Perimeter": 2, "Compactness": 3, "Circularity": 4, "ConvexDeficiency": 5, "Occlusivity": 6, "Min Radial": 7, "Max Radial": 8, "Mean Radial": 9, "Standard Deviation": 10, "Variance": 11, "Skewness": 12, "Dispersion": 13, "Elongation": 14, "Drift Magnitude": 15, "Drift Angle": 16}, selected="Area")
swatch = ColourSwatch(SwatchColor=RGBA(255, 174, 0, 235))
preview = CustomPreview(Geometry=mesh_2, Shader=ColourSwatch(SwatchColor=RGBA(204, 204, 204, 131)))
item = ListItem(List=number_6, Index=list, Wrap=True)  # -> flatten(Item)
preview_2 = CustomPreview(Geometry=isovist_srf_2, Shader=swatch)
preview_3 = CustomPreview(Geometry=isovist_line_2, Shader=swatch)
panel = Panel(item)
