# Grasshopper definition IsovistSinglePoint.gh (Grasshopper 1.0.7)
# plug-ins: DeCodingSpaces, MetaHopper

document_info = DocumentInfo(AutoUpdate=False, Recursive=False)  # -> DocumentName, DocumentFilePath, Components, Params, _3rdPartyAssemblies
# text is internalised, if metahopper component is missing
not_internalised = Text(document_info._3rdPartyAssemblies)
internalised_text = Text(["DecodingSpacesAssembly, Version=1.0.0.0, Culture=neutral, PublicKeyToken=null", "MetaHopper, Version=1.0.8.0, Culture=neutral, PublicKeyToken=null"])
create_set = CreateSet(List=[internalised_text, not_internalised])  # -> Set, Map
# PARAMETRIC PLANNING CATALOGUE
# Isovist - Single Point
# v. 1.0 - Author: DeCodingSpaces - Martin Bielik, Ekaterina Fuchkina
# Description: Basic setup the 2d isovist component. You can experiment with the view angle, direction, range parameters. Try to change the number of rays used to generate the isovist to speed up the calculation or increase the precision.
_3rd_party = Panel(create_set.Set)

angle_direction = Slider(0, range=0..6.28)
viewing_range = Slider(100, range=1..200)

# ---- group: Buildings
mesh = Mesh([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])

# ---- group: Viewing Angle
number = Number(Slider(360, range=0..360))

# ---- group: Viewing Direction
number_2 = Number(angle_direction)

# ---- group: Viewing Range
number_3 = Number(viewing_range)

# ---- group: Viewpoint
vantange_point = Point(Point(-0.03235121601, -17.40401966, 0))

# ---- group: Obstacles
obstacles_polylines_crv = Curve([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])

# ---- group: Viewpoint
vantange_point_2 = Point(vantange_point)

# ---- group: Viewing Direction
number_4 = Number(number_2)

# ---- group: Viewing Range
number_5 = Number(number_3)

# ---- group: Obstacles
obstacles_polylines_crv_2 = Curve(obstacles_polylines_crv)

# ---- group: Viewing Angle
number_6 = Number(number)

# ----
explode = Explode(Curve=obstacles_polylines_crv_2, Recursive=True)  # -> Segments, Vertices
Y = UnitY(Factor=1)
obstacles_line = Line(simplify(explode.Segments))
rotate = Rotate(Geometry=Y, Angle=number_4, Plane=PlaneXY(0, 0, 0))  # -> Geometry, Transform
isovist = Isovist(
    VantagePointS=vantange_point_2,
    ObstacleLines=flatten(obstacles_line),
    ViewingDirection=rotate.Geometry,
    ViewingRange=number_5,
    ViewingAngle=number_6,
    Precision=Slider(360, range=1..720),
    ShowPolygon=Toggle(True),
    ShowRadials=Toggle(True),
    UseGPU=False)  # -> IsovistPolygon, Radials, ObstacleVisibility, IsovistProperties

# ---- group: Isovist Properties
number_7 = Number(isovist.IsovistProperties)

# ---- group: Isovist Polygon
isovist_srf = Surface(isovist.IsovistPolygon)

# ---- group: Isovist Rays
isovist_line = Line(isovist.Radials)

# ---- group: Buildings
mesh_2 = Mesh(mesh)

# ---- group: Isovist Polygon
isovist_srf_2 = Surface(isovist_srf)

# ---- group: Isovist Properties
number_8 = Number(number_7)

# ---- group: Isovist Rays
isovist_line_2 = Line(isovist_line)

# ----
list = ValueList({"Area": 0, "Area (Dist Weighted)": 1, "Perimeter": 2, "Compactness": 3, "Circularity": 4, "ConvexDeficiency": 5, "Occlusivity": 6, "Min Radial": 7, "Max Radial": 8, "Mean Radial": 9, "Standard Deviation": 10, "Variance": 11, "Skewness": 12, "Dispersion": 13, "Elongation": 14, "Drift Magnitude": 15, "Drift Angle": 16}, selected="Area")
swatch = ColourSwatch(SwatchColor=RGBA(255, 174, 0, 235))
preview = CustomPreview(Geometry=mesh_2, Shader=ColourSwatch(SwatchColor=RGBA(204, 204, 204, 131)))
item = ListItem(List=number_8, Index=list, Wrap=True)  # -> flatten(Item)
preview_2 = CustomPreview(Geometry=isovist_srf_2, Shader=swatch)
preview_3 = CustomPreview(Geometry=isovist_line_2, Shader=swatch)
panel = Panel(item)
