# Grasshopper definition LandUseDistribution-students.gh (Grasshopper 1.0.7)
# plug-ins: DeCodingSpaces, Anemone, MetaHopper

# Land Use Distribution
# Simulates distribution of land uses. Each land use has a profile that determines decision making,
# on which parcel it is placed. The land uses are distributed iteratively and influence each other.
# Setup
# - In the beginnging, reduce the iterations to a small
# number, set Street Layout to Model Layout and Variant
# to Simplified Distance. This allows faster calculation.
# - Adjust profiles and other parameters, until they suit you
# - Now Change Street Layout to Layout from Layers
# - For more precise but slower calculation (minutes) consider
# increasing iterations, or the variant to more precise distance,
#  for precise calculation.
# 
# - Make sure streets are on layers PrimaryStreet,
# SecondardyStreet and Tertiary Street
# CAUTION: Use simple and clean street
# networks. The more parcels are generated,
# the longer the algorithm calculates.
# - Make sure plots are on layer Plots
# 
# Avanced:
# - Create additional Land Use Profiles and weight
# criteria how context or other Uses are
# influencing choosing of parcels.
# - Set Perceived Distance Function, which
# determines, how parcels in certain distance are
# subjectively perceived. -> Closer parcels can be
# more important than those far away.
docinfo = DocumentInfo(AutoUpdate=False, Recursive=False)  # -> DocumentName, DocumentFilePath, Components, Params, _3rdPartyAssemblies
# Required Plugins:
# 
# 1. Human, Version=1.7.0.0
# 2. DecodingSpacesAssembly, Version=1.0.0.0,
# 3. Anemone, Version=0.4.0.0,
# 4. MetaHopper
panel = Panel(docinfo._3rdPartyAssemblies)

# ---- group: Model Street
crv = Curve([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])

# ----
# Input Streets & Plots
geometry_pipeline = GeometryPipeline(
    GroupByLayer=False,
    GroupByType=False,
    IncludeHidden=True,
    IncludeLocked=True,
    LayerFilter="SecondaryStreet",
    NameFilter="*",
    SublayerFiltering=True,
    TypeFilter=4)
geometry_pipeline_2 = GeometryPipeline(
    GroupByLayer=False,
    GroupByType=False,
    IncludeHidden=True,
    IncludeLocked=True,
    LayerFilter="PrimaryStreet",
    NameFilter="*",
    SublayerFiltering=True,
    TypeFilter=4)
geometry_pipeline_3 = GeometryPipeline(
    GroupByLayer=False,
    GroupByType=False,
    IncludeHidden=True,
    IncludeLocked=True,
    LayerFilter="TertiaryStreet",
    NameFilter="*",
    SublayerFiltering=True,
    TypeFilter=4)
geometry_pipeline_4 = GeometryPipeline(
    GroupByLayer=False,
    GroupByType=False,
    IncludeHidden=True,
    IncludeLocked=True,
    LayerFilter="Plots",
    NameFilter="*",
    SublayerFiltering=True,
    TypeFilter=1073741848)
entwine = Entwine(Branch00=geometry_pipeline_2, Branch01=geometry_pipeline, Branch02=geometry_pipeline_3, FlattenInputs=True)

# ----
# Visualisation
# Land Use Profile Names
# and how much of Land Use
# is added each iteration
variant = ValueList({"Simplified Direct Distance - Fast (few seconds)": 0, "Precise Distance - Slow (few minutes)": 1}, selected="Simplified Direct Distance - Fast (few seconds)")
street_layout = ValueList({"Model Street Layout": 0, "Street Layout from Layers": 1}, selected="Street Layout from Layers")
iterations = Slider(30, range=0..1000)

# ---- group: Land Use Simulation Iterations
integer = Integer(iterations)

# ---- group: Calculation Variant
integer_2 = Integer(variant)

# ---- group: Street Layout
integer_3 = Integer(street_layout)

integer_4 = Integer(integer_3)

# ----
residential = Panel("""Residential
10000""")
residential_2 = Panel("""0.5
-0.25""")
residential_3 = Panel("""1
0.5
-0.75""")

commercial = Panel("""1
1""")
commercial_2 = Panel("""0.5
0.5
0.25""")
commercial_3 = Panel("""Commercial
5000""")

industry = Panel("""Industry
5000""")
industry_2 = Panel("""-1
1""")
industry_3 = Panel("""-0.5
0
1""")

new_profile = Panel("""Name
x""")
new_profile_2 = Panel("""x
x""")
new_profile_3 = Panel("""x
x
x
x""")

# ---- group: Land Use Simulation Iterations
integer_5 = Integer(integer)

# ---- group: Calculation Variant
integer_6 = Integer(integer_2)

# ---- group: Coefficients for combining Angular Metric and Custom Weight
number_slider = Slider(0.5, range=0..1)
number_slider_2 = Slider(0.5, range=0..1)
hierarchy_weighting = Slider(0.5, range=0..1)

# ---- group: i.e. Flat Area (Slope)
number = Number()

# ---- group: Land Use Simulation Iterations
integer_7 = Integer(integer)

# ----
proifle = Slider(0, range=0..2)
visualisation = ValueList({"Profile Distribution": 0, "Plot Attractivity": 1, "Weighted Values": 2}, selected="Plot Attractivity")

# ----
# Supporting Information: Perceived Distance
# The perception of people concerning things in
# a certain distance can be expressed in different ways:
# 
# Distances are normalized:
# Minimal distance = 0
# Maximal distance = 1
# Far distance important
# Close distance important
# Linear increase/decrease of importance
# Quadratic increase/decrease of importance
# Exponential increase/decrease of importance
# Falloff Function
# If distance above threshold 0.5
# use extreme value
panel_2 = Panel("dist")

simplify_curve = SimplifyCurve(Curve=crv)  # -> Curve, Simplified
polygons_from_lines = PolygonsFromLines(Lines=simplify_curve.Curve, MinBlockSize=0)  # -> Polygons, SynchronizedValues
percent_cells_not_filled = Slider(0.3, range=0..1)
stream_filter = StreamFilter(Gate=integer_4, Stream0=crv, Stream1=entwine)
list_length = ListLength(List=stream_filter)  # -> flatten(Length)
list_length_2 = ListLength(List=list_length)  # -> flatten(Length)
subtraction = Subtraction(A="1", B=percent_cells_not_filled)
series = Series(Start="1", Step=1, Count=list_length_2)  # -> reverse(Series)
division = Division(A="1", B=subtraction)
duplicate_data = DuplicateData(Data=graft(series), Number=graft(list_length), Order=True)

parcels = Parcels(Polygons=polygons_from_lines.Polygons, ConnectionDistance=1, StreetOffset=0, PlotWidthThreshold=50, Precision=100)

# ---- group: street hierarchy weight
number_2 = Number(duplicate_data)

# ---- group: streets by hierarchy
curve = Curve(stream_filter)

# ---- group: Streets
crv_2 = Curve(flatten(curve))

# ---- group: MainStreetSegments
line = Line(flatten(curve))

# ---- group: street hierarchy weight
number_3 = Number(flatten(number_2))

# ---- group: Streets
crv_3 = Curve(flatten(curve))

# ----
# Setup Land Use Profiles
# Weight Criteria & Relations:
# 
# Prefer: Set Value > 0
# Avoid: Set Value < 0
# No Influence: Set Value = 0
# Relations: To Residential
# To Commercial
# To Industry
# To New Profile!!!!!
panel_3 = Panel("R")
panel_4 = Panel("C")
panel_5 = Panel("I")
panel_6 = Panel("NP")
profile_settings = Panel("""Name
Max Population""")
weight_criteria = Panel("""Centrality (Closeness)
Accessibility (Betweeness)
---
---
additionally i.e. Flat Area(Slope)""")
# Add new Profile
# 1.
# Fill out all values.
# Add to Entwine Component
# (zoom in and press +)
entwine_2 = Entwine(Branch00=residential, Branch01=commercial_3, Branch02=industry, FlattenInputs=True)
entwine_3 = Entwine(
    Branch00=ColourSwatch(SwatchColor=RGB(255, 191, 102)),
    Branch01=ColourSwatch(SwatchColor=RGB(255, 102, 102)),
    Branch02=ColourSwatch(SwatchColor=RGB(189, 102, 255)),
    FlattenInputs=True)
entwine_4 = Entwine(Branch00=residential_2, Branch01=commercial, Branch02=industry_2, FlattenInputs=True)
entwine_5 = Entwine(Branch00=residential_3, Branch01=commercial_2, Branch02=industry_3, FlattenInputs=True)
tree_statistics = TreeStatistics(Tree=entwine_5)  # -> Paths, Length, Count
list_item = ListItem(List=entwine_2, Index=0, Wrap=True)  # -> flatten(Item), flatten(Item1)
mass_addition = MassAddition(Input=list_item.Item1)  # -> Result, PartialResults
division_2 = Division(A=list_item.Item1, B=integer_5)
equality = Equality(FirstNumber=tree_statistics.Length, SecondNumber=tree_statistics.Count)  # -> Equality, Inequality
addpopulationperprofile = Integer(division_2)
land_use_profiles = Text(list_item.Item)

# ----
# 2.
# Add Value to each Column
# for New Profile
all_columns_filled = Panel(equality.Equality)

# ---- group: max Population
maxdensity_per_parcel = Integer(mass_addition.Result)

maxdensity_per_parcel_2 = Integer(maxdensity_per_parcel)

# ----
boundary_surfaces = BoundarySurfaces(Edges=parcels)
stream_filter_2 = StreamFilter(Gate=integer_4, Stream0=boundary_surfaces, Stream1=geometry_pipeline_4)
area = Area(Geometry=stream_filter_2)  # -> Area, Centroid
mass_addition_2 = MassAddition(Input=area.Area)  # -> Result, PartialResults
division_3 = Division(A=area.Area, B=mass_addition_2.Result)
multiplication = Multiplication(A=division_3, B=maxdensity_per_parcel_2)
multiplication_2 = Multiplication(A=multiplication, B=division)

# ---- group: maxPop Per Plot
number_4 = Number(multiplication_2)

# ---- group: Plots
surface = Surface(stream_filter_2)

# ---- group: PlotArea
footprint_area = Number(area.Area)

# ---- group: PlotCenter
building_centroid = Point(area.Centroid)

# ---- group: Colour Land Use
colour = Colour(entwine_3)

# ---- group: Contextual Criteria Weights By Land Use Profile
weights = Number(entwine_4)

# ---- group: Attractivity Of Land Use Profiles
text = Text(entwine_5)

# ---- group: PlotArea
footprint_area_2 = Number(footprint_area)

# ---- group: PlotCenter
building_centroid_2 = Point(building_centroid)

# ----
# Assign Plots To Street Segments
lng = ListLength(List=crv_2)
curve_middle = CurveMiddle(Curve=crv_2)
series_2 = Series(Start=0, Step=1, Count=lng)
closest_point = ClosestPoint(Point=graft(building_centroid_2), Cloud=curve_middle)  # -> ClosestPoint, flatten(CPIndex), Distance
graft = GraftTree(Tree=series_2, IncludeEmptyLists=True, IncludeNullItems=True)  # -> simplify(Tree)
c_script = CSharpScript(x=closest_point.CPIndex, y=graft)  # -> out, A; inputs x: list of Int32, y: tree of Int32
# ---------- c_script: C# ----------
    DataTree<int> Out = new DataTree<int>();
    for(int i = 0; i < y.BranchCount; i++)
    {
      Out.EnsurePath(y.Paths[i]);
    }

    for(int i = 0; i < x.Count; i++)
    {
      Out.Add(i, new GH_Path(x[i]));
    }

    A = Out;
# ---------- end c_script ----------
item = ListItem(List=footprint_area_2, Index=c_script.A, Wrap=True)
ma = MassAddition(Input=item)  # -> flatten(Result), PartialResults

# ---- group: ParcelAreaAsWeighting
parcelarea_weighting_per_street = Number(ma.Result)

# ---- group: StreetSegmentPerParcel
integer_8 = Integer(closest_point.CPIndex)

# ---- group: ParcelAreaAsWeighting
parcelarea_weighting_per_street_2 = Number(parcelarea_weighting_per_street)

# ---- group: StreetSegmentPerParcel
integer_9 = Integer(integer_8)

# ---- group: Parcels
srf = Surface(surface)

# ---- group: Contextual Criteria Weights By Land Use Profile
weights_2 = Number(weights)

# ---- group: Attractivity Of Land Use Profiles
text_2 = Text(text)

# ---- group: maxPop Per Plot
number_5 = Number(number_4)

# ---- group: AddPopulationPerProfile
integer_10 = Integer(addpopulationperprofile)

# ---- group: Colour Land Use
colour_2 = Colour(flatten(colour))

# ---- group: maxPop Per Plot
number_6 = Number(graft(number_4))

# ---- group: PlotCenter
building_centroid_3 = Point(building_centroid)

# ---- group: PlotArea
buildarea_area = Number(footprint_area)

# ---- group: Plots
srf_2 = Surface(surface)

# ---- group: maxPop Per Plot
number_7 = Number(graft(number_4))

# ---- group: PlotArea
buildarea_area_2 = Number(footprint_area)

# ----
# Perceived Distance
# For supporting information doubleclick ->
exponent = Slider(2, range=2..6)
falloff_value = Slider(1, range=0..1)
distance_importance = ValueList({"Close": 0, "Far": 1}, selected="Close")
perceived_distance_function = ValueList({"Linear": 0, "Exponential": 1}, selected="Exponential")
integer_11 = Integer(distance_importance)
integer_12 = Integer(perceived_distance_function)
number_8 = Number(exponent)
number_9 = Number(falloff_value)

# ----
# Assemble Perceived Distance Formular
integer_13 = Integer(integer_11)
integer_14 = Integer(integer_12)
number_10 = Number(number_8)
number_11 = Number(number_9)
panel_7 = Panel("""1-dist
dist""")
panel_8 = Panel("""{0}
Pow({0}, {1})""")
list_item_2 = ListItem(List=panel_7, Index=integer_13, Wrap=True)
list_item_3 = ListItem(List=panel_8, Index=integer_14, Wrap=True)
format = Format(Format=list_item_3, Culture=127, Data0=list_item_2, Data1=number_10)
panel_9 = Panel(format)
format_2 = Format(Format="If(dist > {0}, {1}, {2})", Culture=127, Data0=number_11, Data1=integer_13, Data2=panel_9)
range = Range(Domain=Domain(0, 1), Steps=Slider(100, range=0..100))
panel_10 = Panel(format_2)
# Land Use Distribution
# Before Land Uses are distributed, decision making for each
# Land Use to choose another Parcel is calibrated:
# - Parcels are Weighted by Contextual Criteria Per Land Use Profile, such as accessibility
# - Distances from Parcel to Parcel are weighted by Perceived Distance Formular
# - Parcel Attractivity is calculated for each Land Use Profile by combining Contextual Criteria and
#  Perceived Distance as well as the distance to every other Land Use Profile on other Parcels.
evaluate = Evaluate(Expression=panel_10, dist=range)

number_12 = Number(range)
evaluate_2 = Evaluate(Expression=panel_2, dist=number_12)
evaluate_3 = Evaluate(Expression="Pow(dist, 6)", dist=number_12)
evaluate_4 = Evaluate(Expression="Pow(dist, 2)", dist=number_12)
quick_graph = QuickGraph(evaluate_2, SortOrder=0)
quick_graph_2 = QuickGraph(evaluate_3, SortOrder=0)
evaluate_5 = Evaluate(Expression="If(dist > 0.5, 1, Pow(dist,2))", dist=number_12)
quick_graph_3 = QuickGraph(evaluate_4, SortOrder=0)
quick_graph_4 = QuickGraph(evaluate_5, SortOrder=0)
evaluate_6 = Evaluate(Expression="1-dist", dist=number_12)
evaluate_7 = Evaluate(Expression="Pow(1 - dist, 6)", dist=number_12)
evaluate_8 = Evaluate(Expression="Pow(1 - dist, 2)", dist=number_12)
quick_graph_5 = QuickGraph(evaluate_6, SortOrder=0)
evaluate_9 = Evaluate(Expression="If(dist > 0.5, 0, Pow(1-dist,2))", dist=number_12)
quick_graph_6 = QuickGraph(evaluate_7, SortOrder=0)
quick_graph_7 = QuickGraph(evaluate_8, SortOrder=0)
quick_graph_8 = QuickGraph(evaluate_9, SortOrder=0)

quick_graph_9 = QuickGraph(evaluate, SortOrder=0)
panel_11 = Panel(format_2)

# ---- group: Perceived Distance Function
text_3 = Text(panel_10)

text_4 = Text(text_3)

# ----
# Network Centrality Analysis Per Street and Parcel
panel_12 = Panel("2")
integer_15 = Integer(panel_12)
_1_processgeometry = _1ProcessGeometry(Path=line, SegmentLength=10000)  # -> Object, Segments, Vectors, Ids
duplicate_data_2 = DuplicateData(Data=graft(number_3), Number=integer_15, Order=True)  # -> flatten(Data)
_2_buildgraph = _2BuildGraph(
    Object=_1_processgeometry.Object,
    LengthCoefficient=number_slider,
    AngularCoefficient=number_slider_2,
    AdditionalEdgeWeightCoefficient=hierarchy_weighting,
    AdditionalEdgeWeight=duplicate_data_2,
    CalculateDegree=False,
    CalculateInverseGraph=False,
    CopyObject=True)  # -> Object, InverseGraphEdges, Vertices, ReferencedEdges, DegreeCentrality
replace_nulls = ReplaceNulls(Items=parcelarea_weighting_per_street_2, Replacements=Slider(1, range=0..1))  # -> Items, Count
_3_shortestfloydwarshal = _3ShortestFloydWarshal(Object=_2_buildgraph.Object, CopyObject=True, IncludeMaA=False, UseGPU=True)
list_item_4 = ListItem(List=line, Index=integer_9, Wrap=True)
stream_gate = StreamGate(Stream=_3_shortestfloydwarshal, Gate=integer_6)  # -> Target0, Target1
_4_fwgetpaths = _4FWGetPaths(
    Object=stream_gate.Target1,
    Origins=list_item_4,
    Destinations=list_item_4,
    WeightsOrigin=replace_nulls.Items,
    WeightsDestination=replace_nulls.Items,
    PairwiseShortestPaths=False,
    Radius=0,
    CopyObject=True,
    MaskInputString="10011011",
    PathInfoForPoints=False,
    UseGPU=False)  # -> BetweennessCentrality, ClosenessCentrality, Gravity, BetweennessCentralityWeighted, ClosenessCentralityWeighted, BetweennessCentralityWeightedNormalized, SupplementaryGeometry, PathsInformation
_4_fwgetpaths_2 = _4FWGetPaths(
    Object=stream_gate.Target0,
    Origins=list_item_4,
    Destinations=list_item_4,
    WeightsOrigin=replace_nulls.Items,
    WeightsDestination=replace_nulls.Items,
    PairwiseShortestPaths=False,
    Radius=0,
    CopyObject=True,
    MaskInputString="00011011",
    PathInfoForPoints=False,
    UseGPU=True)  # -> BetweennessCentrality, ClosenessCentrality, Gravity, BetweennessCentralityWeighted, ClosenessCentralityWeighted, BetweennessCentralityWeightedNormalized, SupplementaryGeometry, PathsInformation
curve_middle_2 = CurveMiddle(Curve=_1_processgeometry.Segments)
c__distances = CSharpScript(Distance=_4_fwgetpaths.PathsInformation, idx=flatten(integer_9))  # -> out, DistTree; inputs Distance: tree of Double, idx: list of Int32
# ---------- c__distances: C# usings ----------
using System.IO;
using System.Linq;
using System.Data;
using System.Drawing;
using System.Reflection;
using System.Windows.Forms;
using System.Xml;
using System.Xml.Linq;
using System.Runtime.InteropServices;

using Rhino.DocObjects;
using Rhino.Collections;
using GH_IO;
using GH_IO.Serialization;
# ---------- c__distances: C# ----------
    //--- declare new data tree for the distances ---
    //*** background information on DataTrees: http://james-ramsden.com/data-trees-and-c-in-grasshopper/
    DataTree<double> distanceTree = new DataTree<double>();

    for(int i = 0; i < idx.Count; i++)
    {
      GH_Path curPath = new GH_Path(i);
      int vA = idx[i];

      for(int k = 0; k < idx.Count; k++)
      {
        int vB = idx[k];
        int[] vArr = {vA, vB, 1};
        GH_Path vPath = new GH_Path(vArr);

        if (vA == vB)
        {
          distanceTree.Add(0, curPath); // -- distance to itself = 0
        }

        else
        {
          double dist = Distance.Branch(vPath)[0]; // -- distance to another parcel
          distanceTree.Add(dist, curPath);
          //Print(vPath.ToString());
        }
      }
    }
    DistTree = distanceTree;
# ---------- end c__distances ----------
log = Logarithm(Value=_4_fwgetpaths_2.BetweennessCentrality)
item_2 = ListItem(List=_4_fwgetpaths_2.ClosenessCentrality, Index=integer_9, Wrap=True)  # -> flatten(Item)
item_3 = ListItem(List=log, Index=integer_9, Wrap=True)  # -> flatten(Item)
betweenessperparcel = Number(item_3)
closenessperstreet = Number(_4_fwgetpaths_2.ClosenessCentrality)
closenessperparcel = Number(item_2)
betweenessperstreet = Number(log)
bounds = Bounds(Numbers=closenessperparcel)
bounds_2 = Bounds(Numbers=betweenessperparcel)
remap_numbers = RemapNumbers(Value=closenessperparcel, Source=bounds, Target=Domain(0, 1))  # -> Mapped, Clipped
remap_numbers_2 = RemapNumbers(Value=betweenessperparcel, Source=bounds_2, Target=Domain(0, 1))  # -> Mapped, Clipped

# ----
# Street Network Preparation
# Prepares Streets and Plots and calculate the according values such as
# Betweeness and Closeness Centrality as well as all distances to each other.
list_item_5 = ListItem(List=curve_middle_2, Index=integer_9, Wrap=True)
distance = Distance(PointA=graft(list_item_5), PointB=list_item_5)
stream_filter_3 = StreamFilter(Gate=integer_6, Stream0=distance, Stream1=c__distances.DistTree)

# ----
# Visualize network centrality Per Plot and Street
num = Number(betweenessperstreet)
num_2 = Number(betweenessperparcel)
bnd = Bounds(Numbers=num_2)
bnd_2 = Bounds(Numbers=num)
remap = RemapNumbers(Value=num_2, Source=bnd, Target=Domain(0, 1))  # -> Mapped, Clipped
remap_2 = RemapNumbers(Value=num, Source=bnd_2, Target=Domain(0, 1))  # -> Mapped, Clipped
gradient = Gradient(
    LowerLimit=0,
    UpperLimit=1,
    Parameter=remap.Mapped,
    stops=[0: RGB(234, 38, 0), 0.25: RGB(234, 126, 0), 0.5: RGB(254, 244, 84), 0.75: RGB(173, 203, 249), 1: RGB(75, 107, 169)])
gradient_2 = Gradient(
    LowerLimit=Slider(1, range=0..1),
    UpperLimit=Slider(0.5, range=0..1),
    Parameter=remap_2.Mapped,
    stops=[0: RGB(234, 38, 0), 0.25: RGB(234, 126, 0), 0.5: RGB(254, 244, 84), 0.75: RGB(173, 203, 249), 1: RGB(75, 107, 169)])
preview = CustomPreview(Geometry=crv_3, Shader=gradient_2)
preview_2 = CustomPreview(Geometry=srf, Shader=gradient)

number_13 = Number(stream_filter_3)
bounds_3 = Bounds(Numbers=flatten(number_13))
remap_numbers_3 = RemapNumbers(Value=number_13, Source=bounds_3, Target=Domain(0, 1))  # -> Mapped, Clipped

# ---- group: Normalized Distances From Parcels To all Other Plots
number_14 = Number(remap_numbers_3.Mapped)

# ---- group: Normalized Betweeness Centrality
number_15 = Number(remap_numbers_2.Mapped)

# ---- group: Normalized Closeness Centrality
number_16 = Number(remap_numbers.Mapped)

number_17 = Number(number_16)

# ---- group: Normalized Betweeness Centrality
number_18 = Number(number_15)

# ---- group: Normalized Distances From Plots To all Other Plots
number_19 = Number(number_14)

# ---- group: Normalized Distances From Parcels To all Other Parcels
number_20 = Number(number_14)

# ----
# Setup Weight Contextual Criteria Values Per Plot
# Branches of Weight Values need to
# equal Branches of Weight Criteria.
# 
# Weight Values need to be in same order
# as Weight Criteria.
# 
# Weight Values should have as many
# values as there are plots.
# 
# To add more, zoom onto weight values
# component. vvvv
# Yes, everything seems to work fine.
weight_criteria_2 = Panel(weight_criteria)
entwine_6 = Entwine(Branch00=number_17, Branch01=number_18, FlattenInputs=True)  # -> simplify(Result)
flip_matrix = FlipMatrix(Data=weights_2)  # -> simplify(Data)
bounds_4 = Bounds(Numbers=entwine_6)
remap_numbers_4 = RemapNumbers(Value=entwine_6, Source=bounds_4, Target=Domain(0, 1))  # -> Mapped, Clipped
panel_13 = Panel("""No. Weight Values do not match Weights.
Doubleclick to jump to Error ->""")

# ---- group: Branches Weight Criteria
param_viewer = ParamViewer(flip_matrix)

# ---- group: Branches Weight Values
param_viewer_2 = ParamViewer(entwine_6)

# ---- group: Criteria Values Per Plot
weights_3 = Number(remap_numbers_4.Mapped)

# ----
list_length_3 = ListLength(List=param_viewer)
list_length_4 = ListLength(List=param_viewer_2)
equality_2 = Equality(FirstNumber=list_length_3, SecondNumber=list_length_4)  # -> Equality, Inequality
stream_filter_4 = StreamFilter(Gate=equality_2.Equality, Stream0=panel_13, Stream1=panel_13)
c_script_2 = CSharpScript(weights=flip_matrix, values=weights_3)  # -> out, A; inputs weights: list of Double, values: list of Double
# ---------- c_script_2: C# ----------
    DataTree<double> weightedValues = new DataTree<double>();

    for(int i = 0; i < weights.Count;i++){
      for(int j = 0; j < values.Count;j++){
        GH_Path path = new GH_Path(i, j);
        weightedValues.Add(weights[i] * values[j], path);
      }
    }
    A = weightedValues;
# ---------- end c_script_2 ----------
average = Average(Input=c_script_2.A)
shift_paths = ShiftPaths(Data=average, Offset=-1)
bnd_3 = Bounds(Numbers=flatten(shift_paths))
remap_3 = RemapNumbers(Value=shift_paths, Source=bnd_3, Target=Domain(0, 1))  # -> Mapped, Clipped

all_weights_set = Panel(stream_filter_4)

# ---- group: Weighted Contextual Values by Profile Per Plots
weights_4 = Number(remap_3.Mapped)

# ---- group: Weighted Values by Profile Per Plots
weights_5 = Number(weights_4)

# ---- group: Weighted Contextual Values by Profile Per Plots
weights_6 = Number(weights_4)

# ----
# First Distribution
bounds_5 = Bounds(Numbers=weights_6)
deconstruct_domain = DeconstructDomain(Domain=bounds_5)  # -> Start, End
equality_3 = Equality(FirstNumber=weights_6, SecondNumber=deconstruct_domain.End)  # -> Equality, Inequality

# ----
# Plot Attractivity
# Plots weighted by Distance, Weights and Attractivity per Profile
evaluate_10 = Evaluate(Expression=text_4, dist=number_19)
flip_matrix_2 = FlipMatrix(Data=simplify(text_2))
c_script_3 = CSharpScript(attract=flip_matrix_2, distance=evaluate_10, weights=weights_5)  # -> out, A; inputs attract: list of Double, distance: tree of Double, weights: list of Double
# ---------- c_script_3: C# ----------
    DataTree<double> attractivity = new DataTree<double>();
    for(int i = 0; i < attract.Count;i++){
      for(int m = 0; m < distance.BranchCount;m++){
        for(int n = 0; n < distance.Branch(m).Count;n++){
          double value = attract[i] * weights[m] * distance.Branch(m)[n];
          attractivity.Add(value, new GH_Path(new int[] {m, n, i}));
        }
      }
    }
    A = attractivity;
# ---------- end c_script_3 ----------

# ---- group: Attractivity Profile To Profile By Plot
# Tree Structure
# {Plot From, Plot To, Profile From, Profile To}(Attractivity)
number_21 = Number(graft(c_script_3.A))

# ---- group: First Profile Distribution
integer_16 = Integer(equality_3.Equality)

integer_17 = Integer(integer_16)

# ---- group: Attractivity Profile To Profile By Plot
# Tree Structure
# {Plot From, Plot To, Profile From, Profile To}(Attractivity)
number_22 = Number(simplify(number_21))

# ----
# Land Use Distribution Simulation
# Each Iteration Land Use Profiles
# are assigned to the Parcels and
# inform the next cycle.
# Strengthen
# Weaken
# effect of attractivity
list_length_5 = ListLength(List=flatten([integer_17, integer_7]))
loop_start = LoopStart(Repeat=integer_7, Trigger=list_length_5, ProfileDistrib=integer_17)  # -> port, Counter, ProfileDistrib
c_script_4 = CSharpScript(Attractivity=number_22, ProfileDistrib=loop_start.ProfileDistrib)  # -> out, parcelAttractivity; inputs Attractivity: tree of Double, ProfileDistrib: tree of Double
# ---------- c_script_4: C# usings ----------
using System.Linq;
# ---------- c_script_4: C# ----------
    int nrProfiles = ProfileDistrib.BranchCount;
    int nrParcels = ProfileDistrib.Branch(0).Count;
    DataTree<double> newAttractivity = new DataTree<double>();
    // ---------------------------------------------------------------------------
    // -- Attractivity stores the attractivity value from each parcel to all    --
    // -- other parcels for all profiles                                        --
    // -- the tree structure: {Parcel From, Parcel To, Profile From, Profile To}--
    // -- our iteration structure below: { j , m , i , n }                      --
    // -- by multipliying it with current distribution of profiles              --
    // -- we get the current attractivity of a parcel for each profile          --

    // ----------------------------------
    // -- iterate through each profile --
    for(int i = 0; i < nrProfiles; i++){
      // --------------------------------------------------------------------------
      // -- the list store the attractivity values for current profile           --
      List<double> curAttractivityList = new List<double>();

      // ----------------------------------
      // -- iterate through each parcel  --
      for(int j = 0; j < nrParcels; j++){
        // -- and calculate current attractivity for this parcel for the profile --
        double curAttractivity = 0;

        // -----------------------------------------------
        // -- To calculate Attractivity                 --
        // -- check relation to all other parcels       --
        // -- and their current profile distribution    --
        // -- high profile distribution value on parcel --
        // --               leads to                    --
        // -- high influence of attractivity value      --
        for(int m = 0; m < nrParcels; m++){
          for(int n = 0; n < nrProfiles; n++){
            //Get Profile Distribution on current Parcel
            double distribution = ProfileDistrib.Branch(n)[m];
            if(distribution > 0){
              //Get Attractivity Value from Tree
              GH_Path path = new GH_Path(new int[] {j, m, i, n});

                  double attractivityValue = Attractivity.Branch(path)[0];

                  //Multiply Attractivity with Distribution
                  curAttractivity += attractivityValue * distribution;
            }
          }
        }
        // -- collect the current values in the attractivity values lists:
        curAttractivityList.Add(curAttractivity);
      }
      //=======================================================
      // -- normalize the attractivity values for all profile lists --
      double minAtt = curAttractivityList.Min();
      double maxAtt = curAttractivityList.Max();
      // -- formula for normalization to the range [0; 1]:
      // -- normalized valueOfList = (valueOfList - minValueOfList) * 1 / maxValueOfList
      for(int j = 0; j < curAttractivityList.Count; j++)
      {
        curAttractivityList[j] = (curAttractivityList[j] - minAtt) * (1 / maxAtt);
      }
      newAttractivity.AddRange(curAttractivityList, new GH_Path(i));
    }
    parcelAttractivity = newAttractivity;
# ---------- end c_script_4 ----------
square = Square(Value=c_script_4.parcelAttractivity)
square_root = SquareRoot(Value=c_script_4.parcelAttractivity)
number_23 = Number(c_script_4.parcelAttractivity)
attractivity = CSharpScript(
    ProfileDistrib=loop_start.ProfileDistrib,
    parcelAttractivity=number_23,
    addPerProfile=integer_10,
    maxDensity=number_5,
    deterministic=Toggle(False))  # -> out, newProfileDistrib; inputs ProfileDistrib: tree of Int32, parcelAttractivity: tree of Double, addPerProfile: list of Int32, maxDensity: list of Int32, deterministic: Boolean
# ---------- attractivity: C# ----------
    int nrProfiles = ProfileDistrib.BranchCount;
    int nrParcels = ProfileDistrib.Branch(0).Count;
    // -- conditions -> could also be input parameters...

    // -- random number generator --
    Random rnd = new Random();

    //=================================================================
    // -- test if the slots are full --
    // -- maximum capacity is maxDensity. we test it against the sum of population + workplaces:
    int fullParcels = 0; // we count full cells here
    List<int> parcelCount = new List<int>();
    for(int i = 0; i < nrParcels; i++)
    {
      int distOnParcel = 0;
      for(int j = 0; j < nrProfiles; j++){
        distOnParcel += ProfileDistrib.Branch(j)[i];
      }
      parcelCount.Add(distOnParcel);
      if(distOnParcel >= maxDensity[i]){
        fullParcels++; // counter -> fullParcels++ is the same as: fullParcels = fullParcels + 1;
        for(int j = 0; j < nrProfiles; j++){
          parcelAttractivity.Branch(j)[i] = 0;
        }
      }
    }

    Print("full :" + fullParcels.ToString());

    //=================================================================
    // -- locate new popuation at the most attractive places --
    for(int i = 0; i < nrProfiles; i++){
      double sum = parcelAttractivity.Branch(i).Sum(); // sum of all values in the list

      for(int j = 0; j < addPerProfile[i]; j++)
      {
        // -- use a roulette-wheel to find the new location
        // -- higher attracitvity values are bigger slots on the wheel :)
        double rndVal = rnd.NextDouble() * sum;
        double tmpSum = 0;
        //if deterministic, do not use random value
        if(deterministic){
          tmpSum = parcelAttractivity.Branch(i).Max();
        }
        int slot = -1;
        for(int k = 0; k < parcelAttractivity.Branch(i).Count; k++)
        {
          //if deterministic, do not use random value
          if(deterministic && tmpSum == parcelAttractivity.Branch(i)[k])
          {
            slot = k; // this is the index of the parcel to which the new population is added
            break; // exit the loop, since we found our slot!
          }
          else{
            tmpSum = tmpSum + parcelAttractivity.Branch(i)[k];
            if(tmpSum > rndVal){
              slot = k; // this is the index of the parcel to which the new population is added
              break; // exit the loop, since we found our slot!
            }
          }
        }
        if(slot != -1) // check if we really found a slot, otherwise we skip this round
        {
          if(parcelCount[slot] < maxDensity[slot]) // *only add new ones if total number is smaller than maxDensity
          {                              // *should be adapted, otherwise we could stop growth evtl.
            ProfileDistrib.Branch(i)[slot] += 1; // add new population to the parcel
            parcelCount[slot]++;

          } else Print("SOMETHING WENT WRONG - with the density control!!");
        } else Print("SOMETHING WENT WRONG - with the roulette wheel!!");

      }
    }

    newProfileDistrib = ProfileDistrib;
# ---------- end attractivity ----------
loop_end = LoopEnd(
    port=loop_start.port,
    Exit=Toggle(False),
    ProfileDistrib=attractivity.newProfileDistrib,
    TimeOutVal=0,
    pausedState=False,
    state="Constant output")

# ---- group: ProfileDistrib
integer_18 = Integer(loop_end)

# ---- group: PlotAttractivity
number_24 = Number(number_23)

# ---- group: ProfileDistrib
weights_7 = Number(integer_18)

integer_19 = Integer(integer_18)

weights_8 = Number(integer_18)

# ---- group: Weighted Values by Profile Per Plots
weights_9 = Number(weights_4)

# ---- group: PlotAttractivity
number_25 = Number(number_24)

# ----
# Visualisation Weights, Attractivity, Distribution Per Land Use
land_use_profiles_2 = Text(land_use_profiles)
stream_filter_5 = StreamFilter(Gate=visualisation, Stream0=weights_8, Stream1=number_25, Stream2=weights_9)
tree_branch = TreeBranch(Tree=stream_filter_5, Path=proifle, MaintainPaths=True)
list_item_6 = ListItem(List=land_use_profiles_2, Index=proifle, Wrap=True)
number_26 = Number(tree_branch)
bnd_4 = Bounds(Numbers=number_26)
panel_14 = Panel(list_item_6)
remap_4 = RemapNumbers(Value=number_26, Source=bnd_4, Target="1 To 0")  # -> Mapped, Clipped
gradient_3 = Gradient(LowerLimit=0, UpperLimit=1, Parameter=remap_4.Mapped, stops=[0: RGB(255, 255, 255), 1: RGB(0, 0, 0)])
preview_3 = CustomPreview(Geometry=srf_2, Shader=gradient_3)

# ---- group: equal distribution on plots
mass_addition_3 = MassAddition(Input=integer_19)  # -> Result, PartialResults
list_length_6 = ListLength(List=integer_19)
division_4 = Division(A=mass_addition_3.Result, B=list_length_6)
duplicate_data_3 = DuplicateData(Data=division_4, Number=list_length_6, Order=True)

# ----
# Statistics
population = Slider(10000, range=0..10000)
persons_per_household = Slider(4, range=0..10)
c_script_5 = CSharpScript(Distances=number_20, ProfileDistrib=integer_19)  # -> out, EstimTripDist; inputs Distances: tree of Double, ProfileDistrib: tree of Int32
# ---------- c_script_5: C# ----------
    
    int nrProfiles = ProfileDistrib.BranchCount;
    int nrParcels = ProfileDistrib.Branch(0).Count;
    //======================================================
    // ----------- simple traffic estimation ---------------
    //======================================================    
    List<double> sumPerProfile = new List<double>();
    for(int i = 0; i < nrProfiles; i++)
    {
      sumPerProfile.Add(ProfileDistrib.Branch(i).Sum());
    }

    double tripsEstimate = 0;             // estimated trip distances
    
    //for each profile, estimate trip probability
    for(int i = 0; i < nrProfiles; i++)
    {
      //from each parcel
      for(int m = 0; m < nrParcels; m++){
        //to all other parcels
        for(int n = 0; n < nrParcels; n++)
        {
          double tripProbability = 0;
          //to all other functions
          for(int j = 0; j < nrProfiles; j++){
              if(j != i){
                tripProbability += ProfileDistrib.Branch(j)[n] / sumPerProfile[j];
                }
              }
            // -- distances to all parcels:
            // -- index m = from current parcel // index n = to other parcel
            double curDist = Distances.Branch(i)[n];
            
              // -- estimated trips = distance * population of function in parcel * tripProbability to other parcel
              tripsEstimate += curDist * ProfileDistrib.Branch(i)[m] * tripProbability;
            }
          }
        }

    //=======================================================
    // -- return the value:
    EstimTripDist = tripsEstimate;
# ---------- end c_script_5 ----------
c_script_6 = CSharpScript(Distances=number_20, ProfileDistrib=duplicate_data_3)  # -> out, EstimTripDist; inputs Distances: tree of Double, ProfileDistrib: tree of Int32; same code as c_script_5
mass_addition_4 = MassAddition(Input=flatten(integer_19))  # -> Result, PartialResults
mass_addition_5 = MassAddition(Input=flatten(number_7))  # -> Result, PartialResults
mass_addition_6 = MassAddition(Input=buildarea_area_2)  # -> Result, PartialResults
sort_list = SortList(Keys=integer_19)  # -> Keys, ValuesValuesA
listvalues = CSharpScript(values=integer_19)  # -> out, flatten(Max), flatten(Sum), Count; inputs values: list of Double
# ---------- listvalues: C# ----------
    Max = values.Max();
    Sum = values.Sum();
    Count = values.Count();
# ---------- end listvalues ----------
division_5 = Division(A=mass_addition_4.Result, B=mass_addition_5.Result)
graph = QuickGraph(sort_list.Keys, SortOrder=0)
maxvalueworkplaces = Panel(listvalues.Max)
c__recorder = CSharpScript(ProfileSum=listvalues.Sum, TraffEst=c_script_5.EstimTripDist, reset=loop_start.Counter)  # -> out, Profiles, Traffic; inputs ProfileSum: list of Int32, TraffEst: Double, reset: Int32
# ---------- c__recorder: C# ----------
    if (reset == 0) // reset the recording lists
    {
      AllProfiles = new DataTree <double> ();
      AllTraffic = new List <double> ();
    }
    for(int i = 0; i < ProfileSum.Count;i++){
      AllProfiles.Add(ProfileSum[i], new GH_Path(i));
    }
    AllTraffic.Add(TraffEst);

    Profiles = AllProfiles;
    Traffic = AllTraffic;
# ---------- c__recorder: C# additional code ----------
  // ---
  private static DataTree <double> AllProfiles = new DataTree <double> ();
  private static List <double> AllTraffic = new List <double> ();
# ---------- end c__recorder ----------
subtraction_2 = Subtraction(A=c_script_5.EstimTripDist, B=c_script_6.EstimTripDist)
division_6 = Division(A=population, B=persons_per_household)
multiplication_3 = Multiplication(A=mass_addition_6.Result, B=flatten(division_5))
allworkplaces = Panel(listvalues.Sum)
panel_15 = Panel([c_script_5.EstimTripDist, c_script_6.EstimTripDist, subtraction_2])
division_7 = Division(A=mass_addition_6.Result, B=population)
division_8 = Division(A=multiplication_3, B=population)
division_9 = Division(A=mass_addition_6.Result, B=division_6)
division_10 = Division(A=multiplication_3, B=division_6)
panel_16 = Panel("""Current Distribution
Equal Distriblution
Difference""")
graph_2 = QuickGraph([c__recorder.Profiles, c__recorder.Traffic], SortOrder=0)
gross_area_per_person_all_plots = Panel(division_7)
gross_area_per_household_all_plots = Panel(division_9)
net_area_per_household = Panel(division_10)
net_area_per_person = Panel(division_8)

# ----
# Visualisation of Land Uses
land_use_profiles_3 = Text(land_use_profiles)
radius_factor = Slider(0.5, range=0..1)
flip_matrix_3 = FlipMatrix(Data=weights_7)
bounding_box = BoundingBox(Content=building_centroid_3, Plane=PlaneXY(0, 0, 0), UnionBox=True)  # -> Box, Box_2
number_27 = Number("(2*PI)-0.01")
multiplication_4 = Multiplication(A=buildarea_area, B=radius_factor)
remap_numbers_5 = RemapNumbers(Value=flip_matrix_3, Source=number_6, Target=number_27)  # -> Mapped, Clipped
deconstruct_box = DeconstructBox(Box=bounding_box.Box)  # -> Plane, X, Y, Z
evaluate_11 = Evaluate(Expression="Sqrt(x / PI)", x=multiplication_4)
insert_items = InsertItems(List=remap_numbers_5.Mapped, Item="0", Indices="0", Wrap=True)
deconstruct_domain_2 = DeconstructDomain(Domain=deconstruct_box.X)  # -> Start, End
deconstruct_domain_3 = DeconstructDomain(Domain=deconstruct_box.Y)  # -> Start, End
consecutive_domains = ConsecutiveDomains(Numbers=insert_items, Additive=True)
subtraction_3 = Subtraction(A=deconstruct_domain_2.End, B=deconstruct_domain_2.Start)
subtraction_4 = Subtraction(A=deconstruct_domain_3.End, B=deconstruct_domain_3.Start)
arc = Arc(Plane=graft(building_centroid_3), Radius=graft(evaluate_11), Angle=consecutive_domains)  # -> simplify(Arc), Length
multiplication_5 = Multiplication(A=subtraction_3, B=Slider(0.4, range=0..1))
multiplication_6 = Multiplication(A=subtraction_4, B=Slider(0.04, range=0..0.1))
end_points = EndPoints(Curve=simplify(arc.Arc))  # -> Start, End
subtraction_5 = Subtraction(A=deconstruct_domain_2.End, B=multiplication_5)
subtraction_6 = Subtraction(A=deconstruct_domain_3.Start, B=multiplication_6)
larger_than = LargerThan(FirstNumber=arc.Length, SecondNumber="0.1")  # -> LargerThan, OrEqualTo
line_2 = Line(StartPoint=graft(building_centroid_3), EndPoint=end_points.Start)  # -> simplify(Line)
line_3 = Line(StartPoint=graft(building_centroid_3), EndPoint=end_points.End)  # -> simplify(Line)
construct_domain = ConstructDomain(DomainStart=deconstruct_domain_3.Start, DomainEnd=subtraction_6)
construct_domain_2 = ConstructDomain(DomainStart=subtraction_5, DomainEnd=deconstruct_domain_2.End)
curve_2 = Curve(arc.Arc)
merge = Merge(Data1=graft(curve_2), Data2=graft(line_2), Data3=graft(line_3))
rectangle = Rectangle(Plane=PlaneXY(0, 0, 0), XSize=construct_domain_2, YSize=construct_domain, Radius=0)  # -> Rectangle, Length
join_curves = JoinCurves(Curves=merge, Preserve=False)
shift_paths_2 = ShiftPaths(Data=simplify(join_curves), Offset=-1)
cull_pattern = CullPattern(List=shift_paths_2, CullPattern=larger_than.LargerThan)  # -> graft(List)
cull_pattern_2 = CullPattern(List=colour_2, CullPattern=larger_than.LargerThan)
mesh = Mesh(cull_pattern)
legend = Legend(Colour=colour_2, Tags=land_use_profiles_3, Rectangle=rectangle.Rectangle, LegendType=2)

# ----
# Visualisation & Statistics
move = Move(Geometry=mesh, Motion=Vector(0, 0, 10))  # -> Geometry, Transform

custom_preview = CustomPreview(Geometry=simplify(move.Geometry), Material=simplify(graft(cull_pattern_2)))
