# Grasshopper definition LandUseDistribution.v.0.1.gh (Grasshopper 1.0.7)
# plug-ins: DeCodingSpaces, Anemone, MetaHopper

# Land Use Distribution
# Simulates distribution of land uses. Each land use has a profile that determines decision making,
# on which parcel it is placed. The land uses are distributed iteratively and influence each other.
docinfo = DocumentInfo(AutoUpdate=False, Recursive=False)  # -> DocumentName, DocumentFilePath, Components, Params, _3rdPartyAssemblies
# Required Plugins:
# 
# 1. Human, Version=1.7.0.0
# 2. DecodingSpacesAssembly, Version=1.0.0.0,
# 3. Anemone, Version=0.4.0.0,
# 4. MetaHopper
panel = Panel(docinfo._3rdPartyAssemblies)

# ---- group: Streets
# Input Streets
crv = Curve([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])

# ----
network2segments = NetworkToSegments(NetworkGeometry=crv, ConvertCurves=True, ConversionAngle=0, Split=True)
# Street Network Preparation
# Prepares Streets to generate Parcels and calculate the according values such as
# Betweeness and Closeness Centrality as well as all distances to each other.
streets = Curve(network2segments)

# ----
# Create Parcels within Street Blocks
streets_2 = Curve(streets)
network_smooth = NetworkSmooth(Network=streets_2, SnapThreshold=3, SnapToAnchorPointsOnly=False)
line = Line(network_smooth)
extract_polygons = PolygonsFromLines(Lines=line, MinBlockSize=Slider(500, range=0..1000))  # -> Polygons, SynchronizedValues
parcels = Parcels(Polygons=extract_polygons.Polygons, ConnectionDistance=1, StreetOffset=0, PlotWidthThreshold=50, Precision=100)
srf = Surface(parcels)
area = Area(Geometry=srf)  # -> Area, Centroid

residential = Panel("""Residential
10""")
residential_2 = Panel("""0.5
-0.25""")
residential_3 = Panel("""1
0.5
-0.75""")

commercial = Panel("""1
1""")
commercial_2 = Panel("""0.5
0.5
0.25""")
commercial_3 = Panel("""Commercial
5""")

industry = Panel("""Industry
5""")
industry_2 = Panel("""-1
1""")
industry_3 = Panel("""-0.5
0
1""")

new_profile = Panel("""Name
x""")
new_profile_2 = Panel("""x
x""")
new_profile_3 = Panel("""x
x
x
x""")

# ---- group: Parcels
srf_2 = Surface(srf)

# ---- group: ParcelArea
buildarea_area = Number(area.Area)

# ---- group: ParcelCenter
building_centroid = Point(area.Centroid)

# ----
maxdensity = Slider(100, range=0..100)
iterations = Slider(30, range=0..1000)

# ---- group: Streets
crv_2 = Curve(streets)

# ---- group: ParcelArea
footprint_area = Number(buildarea_area)

# ---- group: ParcelCenter
building_centroid_2 = Point(building_centroid)

# ----
# Setup
# - Add street network
# CAUTION: Use simple and clean street
# networks. The more parcels are generated,
# the longer the algorithm calculates.
# - Create additional Land Use Profiles and weight
# criteria how context or other Uses are
# influencing choosing of parcels.
# - Set Perceived Distance Function, which
# determines, how parcels in certain distance are
# subjectively perceived. -> Closer parcels can be
# more important than those far away.
# Visualisation
# Land Use Profile Names
# and how much of Land Use
# is added each iteration
maxdensity_per_parcel = Integer(maxdensity)

# ---- group: Land Use Simulation Iterations
integer = Integer(iterations)

# ----
# Assign Parcels To Street Segments
crv_cp = CurveClosestPoint(Point=simplify(graft(building_centroid_2)), Curve=simplify(crv_2))  # -> Point, Parameter, Distance
lng = ListLength(List=crv_2)
series = Series(Start=0, Step=1, Count=lng)
sort = SortList(Keys=crv_cp.Distance, ValuesA=series)  # -> Keys, ValuesA
graft = GraftTree(Tree=series, IncludeEmptyLists=True, IncludeNullItems=True)  # -> simplify(Tree)
item = ListItem(List=sort.ValuesA, Index=0, Wrap=True)  # -> simplify(flatten(Item))
graft_2 = GraftTree(Tree=item, IncludeEmptyLists=True, IncludeNullItems=True)  # -> flatten(Tree)
c_script = CSharpScript(x=item, y=graft)  # -> out, A; inputs x: list of Int32, y: tree of Int32
# ---------- c_script: C# ----------
    DataTree<int> Out = new DataTree<int>();
    for(int i = 0; i < y.BranchCount; i++)
    {
      Out.EnsurePath(y.Paths[i]);
    }

    for(int i = 0; i < x.Count; i++)
    {
      Out.Add(i, new GH_Path(x[i]));
    }

    A = Out;
# ---------- end c_script ----------
item_2 = ListItem(List=footprint_area, Index=c_script.A, Wrap=True)
ma = MassAddition(Input=item_2)  # -> flatten(Result), PartialResults

# ---- group: StreetSegmentPerParcel
integer_2 = Integer(graft_2)

# ---- group: ParcelAreaAsWeighting
parcelarea_weighting_per_street = Number(ma.Result)

# ---- group: StreetSegmentPerParcel
integer_3 = Integer(integer_2)

# ---- group: MainStreetSegments
line_2 = Line(streets)

# ---- group: ParcelAreaAsWeighting
parcelarea_weighting_per_street_2 = Number(parcelarea_weighting_per_street)

# ---- group: Coefficients for combining Angular Metric and Custom Weight
number_slider = Slider(0.5, range=0..1)
number_slider_2 = Slider(0.5, range=0..1)

# ----
# Network Centrality Analysis Per Street and Parcel
_1_process_geometry = _1ProcessGeometry(Path=line_2, SegmentLength=10000, GenerateNewVisibilityPaths=False)  # -> B, Sg, DblSg, Ids
sg = Line(_1_process_geometry.Sg)
dblsg = Line(_1_process_geometry.DblSg)
ids = Integer(_1_process_geometry.Ids)
_2_build_graph = _2BuildGraph(
    Object=_1_process_geometry.B,
    LengthCoefficient=number_slider,
    AngularCoefficient=number_slider_2,
    AdditionalEdgeWeightCoefficient=0,
    CalculateDegree=False,
    CalculateInverseGraph=False,
    CopyObject=True)  # -> Object, GraphGeometry, Text, Vertices, DegreeCentrality
_3_shortest_path_floyd_warshal = _3ShortestFloydWarshal(Object=_2_build_graph.Object, CopyObject=True, IncludeMaA=False, UseGPU=False)
_4_f_w_get_paths = _4FWGetPaths(
    Object=_3_shortest_path_floyd_warshal,
    Origins=sg,
    Destinations=sg,
    WeightsOrigin=parcelarea_weighting_per_street_2,
    WeightsDestination=parcelarea_weighting_per_street_2,
    PairwiseShortestPaths=False,
    Radius=0,
    CopyObject=True,
    MaskInputString="10000011",
    PathInfoForPoints=False,
    UseGPU=True)  # -> BetweennessCentrality, ClosenessCentrality, Gravity, BetweennessCentralityWeighted, ClosenessCentralityWeighted, BetweennessCentralityWeightedNormalized, SupplementaryGeometry, PathsInformation
log = Logarithm(Value=_4_f_w_get_paths.BetweennessCentrality)
c__distances = CSharpScript(Distance=_4_f_w_get_paths.PathsInformation, idx=flatten(integer_3))  # -> out, DistTree; inputs Distance: tree of Double, idx: list of Int32
# ---------- c__distances: C# usings ----------
using System.IO;
using System.Linq;
using System.Data;
using System.Drawing;
using System.Reflection;
using System.Windows.Forms;
using System.Xml;
using System.Xml.Linq;
using System.Runtime.InteropServices;

using Rhino.DocObjects;
using Rhino.Collections;
using GH_IO;
using GH_IO.Serialization;
# ---------- c__distances: C# ----------
    //--- declare new data tree for the distances ---
    //*** background information on DataTrees: http://james-ramsden.com/data-trees-and-c-in-grasshopper/
    DataTree<double> distanceTree = new DataTree<double>();

    for(int i = 0; i < idx.Count; i++)
    {
      GH_Path curPath = new GH_Path(i);
      int vA = idx[i];

      for(int k = 0; k < idx.Count; k++)
      {
        int vB = idx[k];
        int[] vArr = {vA, vB, 1};
        GH_Path vPath = new GH_Path(vArr);

        if (vA == vB)
        {
          distanceTree.Add(0, curPath); // -- distance to itself = 0
        }

        else
        {
          double dist = Distance.Branch(vPath)[0]; // -- distance to another parcel
          distanceTree.Add(dist, curPath);
          //Print(vPath.ToString());
        }
      }
    }
    DistTree = distanceTree;
# ---------- end c__distances ----------
item_3 = ListItem(List=_4_f_w_get_paths.ClosenessCentrality, Index=integer_3, Wrap=True)  # -> flatten(Item)
item_4 = ListItem(List=log, Index=integer_3, Wrap=True)  # -> flatten(Item)
betweenessperparcel = Number(item_4)
closenessperstreet = Number(_4_f_w_get_paths.ClosenessCentrality)
closenessperparcel = Number(item_3)
betweenessperstreet = Number(log)
number = Number(c__distances.DistTree)
bounds = Bounds(Numbers=flatten(number))
bounds_2 = Bounds(Numbers=closenessperparcel)
bounds_3 = Bounds(Numbers=betweenessperparcel)
remap_numbers = RemapNumbers(Value=closenessperparcel, Source=bounds_2, Target=Domain(0, 1))  # -> Mapped, Clipped
remap_numbers_2 = RemapNumbers(Value=betweenessperparcel, Source=bounds_3, Target=Domain(0, 1))  # -> Mapped, Clipped
remap_numbers_3 = RemapNumbers(Value=number, Source=bounds, Target=Domain(0, 1))  # -> Mapped, Clipped

# ---- group: Streets
crv_3 = Curve(streets)

# ---- group: Parcels
srf_3 = Surface(srf_2)

# ----
# Visualize network centrality Per Parcel and Street
num = Number(betweenessperstreet)
num_2 = Number(betweenessperparcel)
log_2 = Logarithm(Value=num)
bnd = Bounds(Numbers=num_2)
bnd_2 = Bounds(Numbers=log_2)
remap = RemapNumbers(Value=num_2, Source=bnd, Target=Domain(0, 1))  # -> Mapped, Clipped
remap_2 = RemapNumbers(Value=log_2, Source=bnd_2, Target=Domain(0, 1))  # -> Mapped, Clipped
gradient = Gradient(
    LowerLimit=0,
    UpperLimit=1,
    Parameter=remap.Mapped,
    stops=[0: RGB(234, 38, 0), 0.25: RGB(234, 126, 0), 0.5: RGB(254, 244, 84), 0.75: RGB(173, 203, 249), 1: RGB(75, 107, 169)])
gradient_2 = Gradient(
    LowerLimit=Slider(1, range=0..1),
    UpperLimit=Slider(0.5, range=0..1),
    Parameter=remap_2.Mapped,
    stops=[0: RGB(234, 38, 0), 0.25: RGB(234, 126, 0), 0.5: RGB(254, 244, 84), 0.75: RGB(173, 203, 249), 1: RGB(75, 107, 169)])
preview = CustomPreview(Geometry=crv_3, Shader=gradient_2)
preview_2 = CustomPreview(Geometry=srf_3, Shader=gradient)

# ---- group: Normalized Betweeness Centrality
number_2 = Number(remap_numbers_2.Mapped)

# ---- group: Normalized Distances From Parcels To all Other Parcels
number_3 = Number(remap_numbers_3.Mapped)

# ---- group: Normalized Closeness Centrality
number_4 = Number(remap_numbers.Mapped)

number_5 = Number(number_4)

# ---- group: Normalized Betweeness Centrality
number_6 = Number(number_2)

# ---- group: i.e. Flat Area (Slope)
number_7 = Number()

# ---- group: Normalized Distances From Parcels To all Other Parcels
number_8 = Number(number_3)

# ---- group: Land Use Simulation Iterations
integer_4 = Integer(integer)

# ----
proifle = Slider(0, range=0..2)
visualisation = ValueList({"Profile Distribution": 0, "Parcel Attractivity": 1, "Weighted Values": 2}, selected="Parcel Attractivity")

# ---- group: ParcelCenter
building_centroid_3 = Point(building_centroid)

# ---- group: ParcelArea
buildarea_area_2 = Number(buildarea_area)

# ---- group: Normalized Distances From Parcels To all Other Parcels
number_9 = Number(number_3)

# ---- group: Parcels
srf_4 = Surface(srf_2)

# ----
# Supporting Information: Perceived Distance
# The perception of people concerning things in
# a certain distance can be expressed in different ways:
# 
# Distances are normalized:
# Minimal distance = 0
# Maximal distance = 1
# Far distance important
# Close distance important
# Linear increase/decrease of importance
# Quadratic increase/decrease of importance
# Exponential increase/decrease of importance
# Falloff Function
# If distance above threshold 0.5
# use extreme value
panel_2 = Panel("dist")

# ----
# Setup Land Use Profiles
# Weight Criteria & Relations:
# 
# Prefer: Set Value > 0
# Avoid: Set Value < 0
# No Influence: Set Value = 0
# Relations: To Residential
# To Commercial
# To Industry
# To New Profile!!!!!
panel_3 = Panel("R")
panel_4 = Panel("C")
panel_5 = Panel("I")
panel_6 = Panel("NP")
profile_settings = Panel("""Name
Add Per Iteration""")
weight_criteria = Panel("""Centrality (Closeness)
Accessibility (Betweeness)
---
---
additionally i.e. Flat Area(Slope)""")
# Add new Profile
# 1.
# Fill out all values.
# Add to Entwine Component
# (zoom in and press +)
entwine = Entwine(Branch00=residential, Branch01=commercial_3, Branch02=industry, FlattenInputs=True)
entwine_2 = Entwine(Branch00=residential_2, Branch01=commercial, Branch02=industry_2, FlattenInputs=True)
entwine_3 = Entwine(Branch00=residential_3, Branch01=commercial_2, Branch02=industry_3, FlattenInputs=True)
tree_statistics = TreeStatistics(Tree=entwine_3)  # -> Paths, Length, Count
list_item = ListItem(List=entwine, Index=0, Wrap=True)  # -> flatten(Item), flatten(Item1)
equality = Equality(FirstNumber=tree_statistics.Length, SecondNumber=tree_statistics.Count)  # -> Equality, Inequality
addpopulationperprofile = Integer(list_item.Item1)
land_use_profiles = Text(list_item.Item)

# ----
# 2.
# Add Value to each Column
# for New Profile
all_columns_filled = Panel(equality.Equality)

# ---- group: Contextual Criteria Weights By Land Use Profile
weights = Number(entwine_2)

# ---- group: Attractivity Of Land Use Profiles
text = Text(entwine_3)

# ---- group: Contextual Criteria Weights By Land Use Profile
weights_2 = Number(weights)

# ---- group: Attractivity Of Land Use Profiles
text_2 = Text(text)

# ---- group: AddPopulationPerProfile
integer_5 = Integer(addpopulationperprofile)

# ----
# Perceived Distance
# For supporting information doubleclick ->
distance_importance = ValueList({"Close": 0, "Far": 1}, selected="Close")
perceived_distance_function = ValueList({"Linear": 0, "Exponential": 1}, selected="Exponential")
exponent = Slider(2, range=2..6)
falloff_value = Slider(1, range=0..1)
integer_6 = Integer(distance_importance)
integer_7 = Integer(perceived_distance_function)
number_10 = Number(falloff_value)
number_11 = Number(exponent)

# ----
# Assemble Perceived Distance Formular
integer_8 = Integer(integer_6)
integer_9 = Integer(integer_7)
number_12 = Number(number_11)
number_13 = Number(number_10)
panel_7 = Panel("""1-dist
dist""")
panel_8 = Panel("""{0}
Pow({0}, {1})""")
list_item_2 = ListItem(List=panel_7, Index=integer_8, Wrap=True)
list_item_3 = ListItem(List=panel_8, Index=integer_9, Wrap=True)
format = Format(Format=list_item_3, Culture=127, Data0=list_item_2, Data1=number_12)
panel_9 = Panel(format)
format_2 = Format(Format="If(dist > {0}, {1}, {2})", Culture=127, Data0=number_13, Data1=integer_8, Data2=panel_9)
range = Range(Domain=Domain(0, 1), Steps=Slider(100, range=0..100))
panel_10 = Panel(format_2)
# Land Use Distribution
# Before Land Uses are distributed, decision making for each
# Land Use to choose another Parcel is calibrated:
# - Parcels are Weighted by Contextual Criteria Per Land Use Profile, such as accessibility
# - Distances from Parcel to Parcel are weighted by Perceived Distance Formular
# - Parcel Attractivity is calculated for each Land Use Profile by combining Contextual Criteria and
#  Perceived Distance as well as the distance to every other Land Use Profile on other Parcels.
evaluate = Evaluate(Expression=panel_10, dist=range)

number_14 = Number(range)
evaluate_2 = Evaluate(Expression=panel_2, dist=number_14)
evaluate_3 = Evaluate(Expression="Pow(dist, 6)", dist=number_14)
quick_graph = QuickGraph(evaluate_2, SortOrder=0)
evaluate_4 = Evaluate(Expression="Pow(dist, 2)", dist=number_14)
quick_graph_2 = QuickGraph(evaluate_3, SortOrder=0)
evaluate_5 = Evaluate(Expression="If(dist > 0.5, 1, Pow(dist,2))", dist=number_14)
quick_graph_3 = QuickGraph(evaluate_4, SortOrder=0)
quick_graph_4 = QuickGraph(evaluate_5, SortOrder=0)
evaluate_6 = Evaluate(Expression="1-dist", dist=number_14)
evaluate_7 = Evaluate(Expression="Pow(1 - dist, 6)", dist=number_14)
quick_graph_5 = QuickGraph(evaluate_6, SortOrder=0)
evaluate_8 = Evaluate(Expression="Pow(1 - dist, 2)", dist=number_14)
evaluate_9 = Evaluate(Expression="If(dist > 0.5, 0, Pow(1-dist,2))", dist=number_14)
quick_graph_6 = QuickGraph(evaluate_7, SortOrder=0)
quick_graph_7 = QuickGraph(evaluate_8, SortOrder=0)
quick_graph_8 = QuickGraph(evaluate_9, SortOrder=0)

quick_graph_9 = QuickGraph(evaluate, SortOrder=0)
panel_11 = Panel(format_2)

# ---- group: Perceived Distance Function
text_3 = Text(panel_10)

text_4 = Text(text_3)

# ----
# Setup Weight Contextual Criteria Values Per Parcel
# Branches of Weight Values need to
# equal Branches of Weight Criteria.
# 
# Weight Values need to be in same order
# as Weight Criteria.
# 
# Weight Values should have as many
# values as there are parcels.
# 
# To add more, zoom onto weight values
# component. vvvv
# Yes, everything seems to work fine.
weight_criteria_2 = Panel(weight_criteria)
entwine_4 = Entwine(Branch00=number_5, Branch01=number_6, FlattenInputs=True)  # -> simplify(Result)
flip_matrix = FlipMatrix(Data=weights_2)  # -> simplify(Data)
bounds_4 = Bounds(Numbers=entwine_4)
remap_numbers_4 = RemapNumbers(Value=entwine_4, Source=bounds_4, Target=Domain(0, 1))  # -> Mapped, Clipped
panel_12 = Panel("""No. Weight Values do not match Weights.
Doubleclick to jump to Error ->""")

# ---- group: Branches Weight Criteria
param_viewer = ParamViewer(flip_matrix)

# ---- group: Branches Weight Values
param_viewer_2 = ParamViewer(entwine_4)

# ---- group: Criteria Values Per Parcel
weights_3 = Number(remap_numbers_4.Mapped)

# ----
list_length = ListLength(List=param_viewer)
list_length_2 = ListLength(List=param_viewer_2)
equality_2 = Equality(FirstNumber=list_length, SecondNumber=list_length_2)  # -> Equality, Inequality
stream_filter = StreamFilter(Gate=equality_2.Equality, Stream0=panel_12, Stream1=panel_12)
c_script_2 = CSharpScript(weights=flip_matrix, values=weights_3)  # -> out, A; inputs weights: list of Double, values: list of Double
# ---------- c_script_2: C# ----------
    DataTree<double> weightedValues = new DataTree<double>();

    for(int i = 0; i < weights.Count;i++){
      for(int j = 0; j < values.Count;j++){
        GH_Path path = new GH_Path(i, j);
        weightedValues.Add(weights[i] * values[j], path);
      }
    }
    A = weightedValues;
# ---------- end c_script_2 ----------
average = Average(Input=c_script_2.A)
shift_paths = ShiftPaths(Data=average, Offset=-1)
bnd_3 = Bounds(Numbers=flatten(shift_paths))
remap_3 = RemapNumbers(Value=shift_paths, Source=bnd_3, Target=Domain(0, 1))  # -> Mapped, Clipped

all_weights_set = Panel(stream_filter)

# ---- group: Weighted Contextual Values by Profile Per Parcel
weights_4 = Number(remap_3.Mapped)

# ---- group: Weighted Values by Profile Per Parcel
weights_5 = Number(weights_4)

# ---- group: Weighted Contextual Values by Profile Per Parcel
weights_6 = Number(weights_4)

# ----
# First Distribution
bounds_5 = Bounds(Numbers=weights_6)
deconstruct_domain = DeconstructDomain(Domain=bounds_5)  # -> Start, End
equality_3 = Equality(FirstNumber=weights_6, SecondNumber=deconstruct_domain.End)  # -> Equality, Inequality

# ----
# Parcel Attractivity
# Parcels weighted by Distance, Weights and Attractivity per Profile
evaluate_10 = Evaluate(Expression=text_4, dist=number_8)
flip_matrix_2 = FlipMatrix(Data=simplify(text_2))
c_script_3 = CSharpScript(attract=flip_matrix_2, distance=evaluate_10, weights=weights_5)  # -> out, A; inputs attract: list of Double, distance: tree of Double, weights: list of Double
# ---------- c_script_3: C# ----------
    DataTree<double> attractivity = new DataTree<double>();
    for(int i = 0; i < attract.Count;i++){
      for(int m = 0; m < distance.BranchCount;m++){
        for(int n = 0; n < distance.Branch(m).Count;n++){
          double value = attract[i] * weights[m] * distance.Branch(m)[n];
          attractivity.Add(value, new GH_Path(new int[] {m, n, i}));
        }
      }
    }
    A = attractivity;
# ---------- end c_script_3 ----------

# ---- group: Attractivity Profile To Profile By Parcel
# Tree Structure
# {Parcel From, Parcel To, Profile From, Profile To}(Attractivity)
number_15 = Number(graft(c_script_3.A))

# ---- group: First Profile Distribution
integer_10 = Integer(equality_3.Equality)

integer_11 = Integer(integer_10)

# ---- group: Attractivity Profile To Profile By Parcel
# Tree Structure
# {Parcel From, Parcel To, Profile From, Profile To}(Attractivity)
number_16 = Number(simplify(number_15))

# ----
# Land Use Distribution Simulation
# Each Iteration Land Use Profiles
# are assigned to the Parcels and
# inform the next cycle.
# Strengthen
# Weaken
# effect of attractivity
maxdensity_per_parcel_2 = Integer(maxdensity_per_parcel)
list_length_3 = ListLength(List=flatten(integer_11))
loop_start = LoopStart(Repeat=integer_4, Trigger=list_length_3, ProfileDistrib=integer_11)  # -> port, Counter, ProfileDistrib
c_script_4 = CSharpScript(Attractivity=number_16, ProfileDistrib=loop_start.ProfileDistrib)  # -> out, parcelAttractivity; inputs Attractivity: tree of Double, ProfileDistrib: tree of Double
# ---------- c_script_4: C# usings ----------
using System.Linq;
# ---------- c_script_4: C# ----------
    int nrProfiles = ProfileDistrib.BranchCount;
    int nrParcels = ProfileDistrib.Branch(0).Count;
    DataTree<double> newAttractivity = new DataTree<double>();
    // ---------------------------------------------------------------------------
    // -- Attractivity stores the attractivity value from each parcel to all    --
    // -- other parcels for all profiles                                        --
    // -- the tree structure: {Parcel From, Parcel To, Profile From, Profile To}--
    // -- our iteration structure below: { j , m , i , n }                      --
    // -- by multipliying it with current distribution of profiles              --
    // -- we get the current attractivity of a parcel for each profile          --

    // ----------------------------------
    // -- iterate through each profile --
    for(int i = 0; i < nrProfiles; i++){
      // --------------------------------------------------------------------------
      // -- the list store the attractivity values for current profile           --
      List<double> curAttractivityList = new List<double>();

      // ----------------------------------
      // -- iterate through each parcel  --
      for(int j = 0; j < nrParcels; j++){
        // -- and calculate current attractivity for this parcel for the profile --
        double curAttractivity = 0;

        // -----------------------------------------------
        // -- To calculate Attractivity                 --
        // -- check relation to all other parcels       --
        // -- and their current profile distribution    --
        // -- high profile distribution value on parcel --
        // --               leads to                    --
        // -- high influence of attractivity value      --
        for(int m = 0; m < nrParcels; m++){
          for(int n = 0; n < nrProfiles; n++){
            //Get Profile Distribution on current Parcel
            double distribution = ProfileDistrib.Branch(n)[m];
            if(distribution > 0){
              //Get Attractivity Value from Tree
              GH_Path path = new GH_Path(new int[] {j, m, i, n});

                  double attractivityValue = Attractivity.Branch(path)[0];

                  //Multiply Attractivity with Distribution
                  curAttractivity += attractivityValue * distribution;
            }
          }
        }
        // -- collect the current values in the attractivity values lists:
        curAttractivityList.Add(curAttractivity);
      }
      //=======================================================
      // -- normalize the attractivity values for all profile lists --
      double minAtt = curAttractivityList.Min();
      double maxAtt = curAttractivityList.Max();
      // -- formula for normalization to the range [0; 1]:
      // -- normalized valueOfList = (valueOfList - minValueOfList) * 1 / maxValueOfList
      for(int j = 0; j < curAttractivityList.Count; j++)
      {
        curAttractivityList[j] = (curAttractivityList[j] - minAtt) * (1 / maxAtt);
      }
      newAttractivity.AddRange(curAttractivityList, new GH_Path(i));
    }
    parcelAttractivity = newAttractivity;
# ---------- end c_script_4 ----------
square = Square(Value=c_script_4.parcelAttractivity)
square_root = SquareRoot(Value=c_script_4.parcelAttractivity)
number_17 = Number(c_script_4.parcelAttractivity)
attractivity = CSharpScript(
    ProfileDistrib=loop_start.ProfileDistrib,
    parcelAttractivity=number_17,
    addPerProfile=integer_5,
    maxDensity=maxdensity_per_parcel_2,
    deterministic=Toggle(False))  # -> out, newProfileDistrib; inputs ProfileDistrib: tree of Int32, parcelAttractivity: tree of Double, addPerProfile: list of Int32, maxDensity: Int32, deterministic: Boolean
# ---------- attractivity: C# ----------
    int nrProfiles = ProfileDistrib.BranchCount;
    int nrParcels = ProfileDistrib.Branch(0).Count;
    // -- conditions -> could also be input parameters...

    // -- random number generator --
    Random rnd = new Random();

    //=================================================================
    // -- test if the slots are full --
    // -- maximum capacity is maxDensity. we test it against the sum of population + workplaces:
    int fullParcels = 0; // we count full cells here
    List<int> parcelCount = new List<int>();
    for(int i = 0; i < nrParcels; i++)
    {
      int distOnParcel = 0;
      for(int j = 0; j < nrProfiles; j++){
        distOnParcel += ProfileDistrib.Branch(j)[i];
      }
      parcelCount.Add(distOnParcel);
      if(distOnParcel >= maxDensity){
        fullParcels++; // counter -> fullParcels++ is the same as: fullParcels = fullParcels + 1;
        for(int j = 0; j < nrProfiles; j++){
          parcelAttractivity.Branch(j)[i] = 0;
        }
      }
    }

    Print("full :" + fullParcels.ToString());

    //=================================================================
    // -- locate new popuation at the most attractive places --
    for(int i = 0; i < nrProfiles; i++){
      double sum = parcelAttractivity.Branch(i).Sum(); // sum of all values in the list

      for(int j = 0; j < addPerProfile[i]; j++)
      {
        // -- use a roulette-wheel to find the new location
        // -- higher attracitvity values are bigger slots on the wheel :)
        double rndVal = rnd.NextDouble() * sum;
        double tmpSum = 0;
        //if deterministic, do not use random value
        if(deterministic){
          tmpSum = parcelAttractivity.Branch(i).Max();
        }
        int slot = -1;
        for(int k = 0; k < parcelAttractivity.Branch(i).Count; k++)
        {
          //if deterministic, do not use random value
          if(deterministic && tmpSum == parcelAttractivity.Branch(i)[k])
          {
            slot = k; // this is the index of the parcel to which the new population is added
            break; // exit the loop, since we found our slot!
          }
          else{
            tmpSum = tmpSum + parcelAttractivity.Branch(i)[k];
            if(tmpSum > rndVal){
              slot = k; // this is the index of the parcel to which the new population is added
              break; // exit the loop, since we found our slot!
            }
          }
          }
          if(slot != -1) // check if we really found a slot, otherwise we skip this round
          {
            if(parcelCount[slot] < maxDensity) // *only add new ones if total number is smaller than maxDensity
            {                              // *should be adapted, otherwise we could stop growth evtl.
              ProfileDistrib.Branch(i)[slot] += 1; // add new population to the parcel
              parcelCount[slot]++;

            } else Print("SOMETHING WENT WRONG - with the density control!!");
          } else Print("SOMETHING WENT WRONG - with the roulette wheel!!");

        }
      }

      newProfileDistrib = ProfileDistrib;
# ---------- end attractivity ----------
loop_end = LoopEnd(
    port=loop_start.port,
    Exit=Toggle(False),
    ProfileDistrib=attractivity.newProfileDistrib,
    TimeOutVal=0,
    pausedState=False,
    state="Constant output")

# ---- group: ProfileDistrib
integer_12 = Integer(loop_end)

# ---- group: ParcelAttractivity
number_18 = Number(number_17)

# ---- group: ProfileDistrib
weights_7 = Number(integer_12)

integer_13 = Integer(integer_12)

weights_8 = Number(integer_12)

# ---- group: Weighted Values by Profile Per Parcel
weights_9 = Number(weights_4)

# ---- group: ParcelAttractivity
number_19 = Number(number_18)

# ----
# Visualisation Weights, Attractivity, Distribution Per Land Use
land_use_profiles_2 = Text(land_use_profiles)
stream_filter_2 = StreamFilter(Gate=visualisation, Stream0=weights_8, Stream1=number_19, Stream2=weights_9)
tree_branch = TreeBranch(Tree=stream_filter_2, Path=proifle, MaintainPaths=True)
list_item_4 = ListItem(List=land_use_profiles_2, Index=proifle, Wrap=True)
number_20 = Number(tree_branch)
bnd_4 = Bounds(Numbers=number_20)
panel_13 = Panel(list_item_4)
remap_4 = RemapNumbers(Value=number_20, Source=bnd_4, Target="1 To 0")  # -> Mapped, Clipped
gradient_3 = Gradient(LowerLimit=0, UpperLimit=1, Parameter=remap_4.Mapped, stops=[0: RGB(255, 255, 255), 1: RGB(0, 0, 0)])
preview_3 = CustomPreview(Geometry=srf_4, Shader=gradient_3)

# ----
# Statistics
c_script_5 = CSharpScript(Distances=number_9, ProfileDistrib=integer_13)  # -> out, EstimTripDist; inputs Distances: tree of Double, ProfileDistrib: tree of Int32
# ---------- c_script_5: C# ----------
    
    int nrProfiles = ProfileDistrib.BranchCount;
    int nrParcels = ProfileDistrib.Branch(0).Count;
    //======================================================
    // ----------- simple traffic estimation ---------------
    //======================================================    
    List<double> sumPerProfile = new List<double>();
    for(int i = 0; i < nrProfiles; i++)
    {
      sumPerProfile.Add(ProfileDistrib.Branch(i).Sum());
    }

    double tripsEstimate = 0;             // estimated trip distances
    
    //for each profile, estimate trip probability
    for(int i = 0; i < nrProfiles; i++)
    {
      //from each parcel
      for(int m = 0; m < nrParcels; m++){
        //to all other parcels
        for(int n = 0; n < nrParcels; n++)
        {
          double tripProbability = 0;
          //to all other functions
          for(int j = 0; j < nrProfiles; j++){
              if(j != i){
                tripProbability += ProfileDistrib.Branch(j)[n] / sumPerProfile[j];
                }
              }
            // -- distances to all parcels:
            // -- index m = from current parcel // index n = to other parcel
            double curDist = Distances.Branch(i)[n];
            
              // -- estimated trips = distance * population of function in parcel * tripProbability to other parcel
              tripsEstimate += curDist * ProfileDistrib.Branch(i)[m] * tripProbability;
            }
          }
        }

    //=======================================================
    // -- return the value:
    EstimTripDist = tripsEstimate;
# ---------- end c_script_5 ----------
sort_list = SortList(Keys=integer_13)  # -> Keys, ValuesValuesA
listvalues = CSharpScript(values=integer_13)  # -> out, flatten(Max), flatten(Sum), Count; inputs values: list of Double
# ---------- listvalues: C# ----------
    Max = values.Max();
    Sum = values.Sum();
    Count = values.Count();
# ---------- end listvalues ----------
maxvalueworkplaces = Panel(listvalues.Max)
c__recorder = CSharpScript(ProfileSum=listvalues.Sum, TraffEst=c_script_5.EstimTripDist, reset=loop_start.Counter)  # -> out, Profiles, Traffic; inputs ProfileSum: list of Int32, TraffEst: Double, reset: Int32
# ---------- c__recorder: C# ----------
    if (reset == 0) // reset the recording lists
    {
      AllProfiles = new DataTree <double> ();
      AllTraffic = new List <double> ();
    }
    for(int i = 0; i < ProfileSum.Count;i++){
      AllProfiles.Add(ProfileSum[i], new GH_Path(i));
    }
    AllTraffic.Add(TraffEst);

    Profiles = AllProfiles;
    Traffic = AllTraffic;
# ---------- c__recorder: C# additional code ----------
  // ---
  private static DataTree <double> AllProfiles = new DataTree <double> ();
  private static List <double> AllTraffic = new List <double> ();
# ---------- end c__recorder ----------
allworkplaces = Panel(listvalues.Sum)
graph = QuickGraph(sort_list.Keys, SortOrder=0)
graph_2 = QuickGraph([c__recorder.Profiles, c__recorder.Traffic], SortOrder=0)

# ----
# Visualisation of Land Uses
radius_factor = Slider(0.5, range=0..1)
maxdensity_per_parcel_3 = Integer(maxdensity_per_parcel)
land_use_profiles_3 = Text(land_use_profiles)
flip_matrix_3 = FlipMatrix(Data=weights_7)
number_21 = Number("(2*PI)-0.01")
multiplication = Multiplication(A=buildarea_area_2, B=radius_factor)
list_length_4 = ListLength(List=flip_matrix_3)
remap_numbers_5 = RemapNumbers(Value=flip_matrix_3, Source=maxdensity_per_parcel_3, Target=number_21)  # -> Mapped, Clipped
evaluate_11 = Evaluate(Expression="Sqrt(x / PI)", x=multiplication)
list_item_5 = ListItem(List=flatten(list_length_4), Index=0, Wrap=True)
insert_items = InsertItems(List=remap_numbers_5.Mapped, Item="0", Indices="0", Wrap=True)
consecutive_domains = ConsecutiveDomains(Numbers=insert_items, Additive=True)
subtraction = Subtraction(A=list_item_5, B="1")
arc = Arc(Plane=graft(building_centroid_3), Radius=graft(evaluate_11), Angle=consecutive_domains)  # -> simplify(Arc), Length
range_2 = Range(Domain=Domain(0, 1), Steps=subtraction)
gradient_4 = Gradient(
    LowerLimit=0,
    UpperLimit=1,
    Parameter=range_2,
    stops=[0: RGB(234, 38, 0), 0.25: RGB(234, 126, 0), 0.5: RGB(254, 244, 84), 0.75: RGB(173, 203, 249), 1: RGB(75, 107, 169)])
end_points = EndPoints(Curve=simplify(arc.Arc))  # -> Start, End
larger_than = LargerThan(FirstNumber=arc.Length, SecondNumber="0.1")  # -> LargerThan, OrEqualTo
line_3 = Line(StartPoint=graft(building_centroid_3), EndPoint=end_points.Start)  # -> simplify(Line)
line_4 = Line(StartPoint=graft(building_centroid_3), EndPoint=end_points.End)  # -> simplify(Line)
curve = Curve(arc.Arc)
merge = Merge(Data1=graft(curve), Data2=graft(line_3), Data3=graft(line_4))
join_curves = JoinCurves(Curves=merge, Preserve=False)
shift_paths_2 = ShiftPaths(Data=simplify(join_curves), Offset=-1)
cull_pattern = CullPattern(List=shift_paths_2, CullPattern=larger_than.LargerThan)  # -> graft(List)
cull_pattern_2 = CullPattern(List=gradient_4, CullPattern=larger_than.LargerThan)
mesh = Mesh(cull_pattern)
legend = Legend(
    Colour=gradient_4,
    Tags=land_use_profiles_3,
    Rectangle={Plane=PlaneXY(227.5815318, -335.7238772, 0), Size=Domain2(u=-195.218885..195.218885, v=-12.51403109..12.51403109)},
    LegendType=2)

# ----
# Visualisation & Statistics
move = Move(Geometry=mesh, Motion=Vector(0, 0, 10))  # -> Geometry, Transform

custom_preview = CustomPreview(Geometry=simplify(move.Geometry), Material=simplify(graft(cull_pattern_2)))
