# Grasshopper definition NetworkEditing.gh (Grasshopper 1.0.7)
# plug-ins: DeCodingSpaces, Human, MetaHopper, DeCodingSpaces_StreetNetwork_Utilities

# Description: DeCodingSpaces offers components that can process and analyse street network.
# 
# Have a look at the blue boxes to see different processing steps on how to edit networks.
document_info = DocumentInfo(AutoUpdate=False, Recursive=False)  # -> DocumentName, DocumentFilePath, Components, Params, _3rdPartyAssemblies
# text is internalised, if metahopper component is missing
not_internalised = Text(document_info._3rdPartyAssemblies)
internalised_text = Text(["DecodingSpacesAssembly, Version=1.0.0.0, Culture=neutral, PublicKeyToken=null", "Snippets.scripting, Version=0.0.0.0, Culture=neutral, PublicKeyToken=null", "MetaHopper, Version=1.0.8.0, Culture=neutral, PublicKeyToken=null", "Human, Version=1.7.3.0, Culture=neutral, PublicKeyToken=null"])
create_set = CreateSet(List=[internalised_text, not_internalised])  # -> Set, Map
# PARAMETRIC PLANNING CATALOGUE
# Street Network Editing
# v. 1.0 - Author: DeCodingSpaces - Martin Bielik, Ekaterina Fuchkina
_3rd_party = Panel(create_set.Set)

# ----
# Input Geometry &
#  Settings
snap_threshold_smoothing = Slider(0, range=0..100)

# ---- group: Boundary
boundary_polygon = Curve(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)

# ---- group: Initial Streets
initial_segments = Curve([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])

# ---- group: Snap Threshold
number = Number(snap_threshold_smoothing)

# ---- group: Other Streets
crv = Curve([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])

# ---- group: Buildings
mesh = Mesh([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])

# ---- group: Boundary
boundary_polygon_2 = Curve(boundary_polygon)

# ---- group: Initial Streets
initial_segments_2 = Curve(initial_segments)

# ----
# Generate Street Segments
number_slider = Slider(10, range=0..20)
street_network_generator = StreetNetworkGenerator(
    Boundary=boundary_polygon_2,
    IniStreets=initial_segments_2,
    MinLength=30,
    MaxLength=100,
    MinDist=20,
    RandomAngle=10,
    MaxArms=4,
    TreeDepth=number_slider,
    ProbabilityToAddArms=1,
    SeedForRandom=-1)

# ---- group: Streets
crv_2 = Curve(street_network_generator)

# ---- group: Remove Short Segments / Streets
crv_3 = Curve(crv_2)

# ---- group: Remove Short Segments
tolerance = Slider(0.01, range=0..0.01)
length = Length(Curve=crv_3)
larger_than = LargerThan(FirstNumber=length, SecondNumber=tolerance)  # -> LargerThan, OrEqualTo
cull_pattern = CullPattern(List=crv_3, CullPattern=larger_than.LargerThan)

# ---- group: Remove Short Segments / Streets
crv_4 = Curve(cull_pattern)

# ---- group: Convert to segment / Streets
street_network = Curve(crv_4)

# ---- group: Convert to segment
network2segments = NetworkToSegments(NetworkGeometry=street_network, ConvertCurves=True, ConversionAngle=Slider(0.1, range=0..1), Split=Toggle(True))

# ---- group: Convert to segment / Street Segments
street_network_2 = Curve(network2segments)

# ---- group: remove dead ends / Street Segments
street_network_3 = Curve(street_network_2)

# ---- group: remove dead ends
cul_de_sac = CulDeSacRemoval(LineNetwork=street_network_3, Iterations=Slider(3, range=0..10))

# ---- group: remove dead ends / Street Segments
street_network_4 = Curve(cul_de_sac)

# ---- group: Simplify / Street Segments
street_network_5 = Curve(street_network_4)

# ---- group: Simplify / Snap Threshold
number_2 = Number(number)

# ---- group: Simplify
network_smooth = NetworkSmooth(Network=street_network_5, SnapThreshold=number_2, SnapToAnchorPointsOnly=False)

# ---- group: Simplify / Street Segments Simplified
line = Line(network_smooth)

# ---- group: Network to polyline and reduce polyline / Street Segments Simplified
line_2 = Line(line)

# ---- group: Network to polyline and reduce polyline
network_to_polylines = NetworkToPolylines(NetworkAsLines=line_2)

# ---- group: Network to polyline and reduce polyline / Street Segments Simplified
curve = Curve(network_to_polylines)

# ---- group: Streets
crv_5 = Curve(crv_4)

# ---- group: Other Streets
crv_6 = Curve(crv)

# ---- group: Street Segments Simplified
curve_2 = Curve(curve)

# ---- group: Buildings
mesh_2 = Mesh(mesh)

# ----
number_slider_2 = Slider(2, range=0..10)
preview = CustomPreview(Geometry=mesh_2, Shader=ColourSwatch(SwatchColor=RGB(230, 230, 230)))
custom_preview_lineweights = CustomPreviewLineweights(Geometry=curve_2, Shader=ColourSwatch(SwatchColor=RGB(157, 0, 255)), Thickness=Slider(3, range=0..10), Absolute=False)
custom_preview_lineweights_2 = CustomPreviewLineweights(Geometry=crv_5, Shader=ColourSwatch(SwatchColor=RGB(153, 153, 153)), Thickness=number_slider_2, Absolute=False)
custom_preview_lineweights_3 = CustomPreviewLineweights(Geometry=crv_6, Shader=ColourSwatch(SwatchColor=RGB(178, 178, 178)), Thickness=number_slider_2, Absolute=False)
