# Grasshopper definition NetworkOptimization.gh (Grasshopper 1.0.7)
# plug-ins: DeCodingSpaces, Anemone, Human, MetaHopper

# Description: 1. Run Optimization - if you do NOT have a NVIDIA GPU, CPU will be used and calculation takes longer!
# 
# 2. Exit Loop in case something does not work.
# 
# 3. Show one of the 10 best current variants
# 
# 4. Set the amount of generations that the algorithm should run for optimization.
# 
# 5. Set boundary and initial street segments
# 
# 6. Expert parameters to setup the genetic algorithm.
# Crossover-Rate: Defines percentage of chromosomes that are taken into the next generation.
# Mutation-Rate: Defines percentage of chromosomes being mutated each generation (meaning, their chromosome can be different to those of their parents)
# Nr. Offsprings: Children that are generated each generation.
# Nr. Parents: Number of chromosomes that can reproduce - the fittest of their generation.
document_info = DocumentInfo(AutoUpdate=False, Recursive=False)  # -> DocumentName, DocumentFilePath, Components, Params, _3rdPartyAssemblies
# text is internalised, if metahopper component is missing
not_internalised = Text(document_info._3rdPartyAssemblies)
internalised_text = Text(["DecodingSpacesAssembly, Version=1.0.0.0, Culture=neutral, PublicKeyToken=null", "Anemone, Version=0.4.0.0, Culture=neutral, PublicKeyToken=null", "Human, Version=1.7.3.0, Culture=neutral, PublicKeyToken=null"])
create_set = CreateSet(List=[internalised_text, not_internalised])  # -> Set, Map
# PARAMETRIC PLANNING CATALOGUE
# Street Network Optimization
# v. 1.0 - Author: DeCodingSpaces - Reinhard König, Martin Bielik, Ekaterina Fuchkina
_3rd_party = Panel(create_set.Set)

# ---- group: Boundary
boundary_polygon = Curve(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)

# ---- group: Initial Streets
initial_segments = Curve([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])

# ----
# 1.
# 2.
# 3.
# 4.
# 5.
# 6. Genetic Algorithm parameters
# Buildings Streets
# for visualisation
run = BooleanToggle(False)
exit_loop = BooleanToggle(False)
show_variant = Slider(0, range=0..9)
iterations_generations = Slider(1, range=0..100)
random_generation = Slider(0.1, range=0..1)
crossover_rate = Slider(0.8, range=0..1)
mutation_rate = Slider(0.1, range=0..1)
nr_offsprings = Slider(30, range=0..100)
nr_parents = Slider(10, range=0..100)
shuffle_chromosomes = BooleanToggle(False)
street_network_chromosome = StreetNetworkChromosome(
    Boundary=boundary_polygon,
    IniStreets=initial_segments,
    MinLength=30,
    MaxLength=100,
    MinDist=20,
    RandomAngle=10,
    MaxArms=4,
    TreeDepth=Slider(7, range=0..20),
    ProbabilityToAddArms=1,
    SeedForRandom=-1)
chromosomefactory = ChromosomeFactory(Chromosome=street_network_chromosome, Number=nr_parents)

# ---- group: Buildings
mesh = Mesh([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])

# ---- group: Other Streets
crv = Curve([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])

# ----
construct_point = ConstructPoint(XCoordinate=Slider(642, range=0..1000), YCoordinate=Slider(800, range=0..1000), ZCoordinate=0)
construct_point_2 = ConstructPoint(XCoordinate=Slider(688, range=0..1000), YCoordinate=Slider(733, range=0..1000), ZCoordinate=0)

stream_filter = StreamFilter(Gate=run, Stream1=chromosomefactory)

# ---- group: Exit Loop
boolean = Boolean(exit_loop)

# ---- group: Point of Interest
points = Point([Point(8079.243243, 5940.348211, 0), Point(7696.252114, 4869.607524, 0)])

# ---- group: Variant
integer = Integer(show_variant)

# ---- group: Nr Iterations
integer_2 = Integer(iterations_generations)

# ---- group: Shuffle Chromosome
boolean_2 = Boolean(shuffle_chromosomes)

# ---- group: Crossover Rate
number = Number(crossover_rate)

# ---- group: Mutation Rate
number_2 = Number(mutation_rate)

# ---- group: Random Generation
number_3 = Number(mutation_rate)

# ---- group: Nr Offsprings
integer_3 = Integer(nr_offsprings)

# ---- group: Nr Parents
integer_4 = Integer(nr_parents)

# ---- group: Variant Scale
number_4 = Number(Slider(70, range=0..1000))

# ---- group: Chart Screen Location
point = Point(construct_point_2)

# ---- group: Chart Scale
number_5 = Number(Slider(120, range=0..1000))

# ---- group: Variant Screen Location
point_2 = Point(construct_point)

# ---- group: Chromosomes
data = Data(stream_filter)

# ---- group: Nr Offsprings
integer_5 = Integer(integer_3)

# ---- group: Crossover Rate
number_6 = Number(number)

# ---- group: Mutation Rate
number_7 = Number(number_2)

# ---- group: Random Generation
number_8 = Number(number_3)

# ---- group: Shuffle Chromosome
boolean_3 = Boolean(boolean_2)

# ---- group: Nr Iterations
integer_6 = Integer(integer_2)

# ---- group: Chromosomes
data_2 = Data(data)

# ----
loop_start = LoopStart(Repeat=integer_6, Data=data_2)  # -> port, Counter, Data
offspringgenerator = OffspringGenerator(
    Parents=loop_start.Data,
    NrOffsprings=integer_5,
    CrossoverRate=number_6,
    MutationRate=number_7,
    RandomGeneration=number_8,
    ShuffleChromo=boolean_3)
panel = Panel(loop_start.Counter)
chromosomemapper = ChromosomeMapper(Chromosome=offspringgenerator)  # -> simplify(Phenotype)

# ---- group: Cur Iteration
integer_7 = Integer(loop_start.Counter)

# ---- group: Phenotype (Curves)
curve = Curve(chromosomemapper)

# ---- group: Genotype
data_3 = Data(offspringgenerator)

# ---- group: Point of Interest
points_2 = Point(points)

# ---- group: Phenotype (Curves)
curve_2 = Curve(curve)

# ---- group: Coefficients for combining Angular Metric and Custom Weight
number_slider = Slider(0.219, range=0..1)
number_slider_2 = Slider(1, range=0..1)

# ----
# Network Analysis
# all street have to be splited at intersection and represented as lines (No polylines or curves are supported)
# Every origin and destination can have its individual weighting representing its importance (e.g. Nr. of inhabitants, shop area)
network_smooth = NetworkSmooth(Network=curve_2, SnapThreshold=1, SnapToAnchorPointsOnly=False)
_1_processgeometry = _1ProcessGeometry(Path=network_smooth, SegmentLength=10000)  # -> Object, Segments, Vectors, Ids
sg = Line(_1_processgeometry.Segments)
_2_buildgraph = _2BuildGraph(
    Object=_1_processgeometry.Object,
    LengthCoefficient=number_slider,
    AngularCoefficient=number_slider_2,
    AdditionalEdgeWeightCoefficient=0,
    CalculateDegree=False,
    CalculateInverseGraph=False,
    CopyObject=True)  # -> Object, InverseGraphEdges, Vertices, ReferencedEdges, DegreeCentrality
custom_edge_weights = CustomEdgeWeights(segments=sg, pointsofinterest=points_2, customweights=Slider(100, range=0..1000), generalweight=Slider(1, range=0..1))
# Genetic Algorithm running a loop for each generation
_3_shortestfloydwarshal = _3ShortestFloydWarshal(Object=_2_buildgraph.Object, CopyObject=True, IncludeMaA=False, UseGPU=True)
_4_fwgetpaths = _4FWGetPaths(
    Object=_3_shortestfloydwarshal,
    Origins=sg,
    Destinations=sg,
    WeightsOrigin=custom_edge_weights,
    WeightsDestination=custom_edge_weights,
    PairwiseShortestPaths=False,
    Radius=0,
    CopyObject=True,
    MaskInputString="00000010",
    PathInfoForPoints=False,
    UseGPU=True)  # -> BetweennessCentrality, simplify(ClosenessCentrality), Gravity, BetweennessCentralityWeighted, ClosenessCentralityWeighted, SupplementaryGeometry, PathsInformation

# ---- group: Closeness Centrality
num = Number(_4_fwgetpaths.ClosenessCentrality)

# ---- group: Graph Segments
sg_2 = Line(sg)

# ---- group: Phenotype (Curves)
curve_3 = Curve(curve)

# ---- group: Closeness Centrality
num_2 = Number(num)

# ----
# Set Fitness Values ( Curve Length & Closeness Centrality)
len = Length(Curve=curve_3)
c__normalize = CSharpScript(L=num_2)  # -> out, minValue, maxValue; inputs L: list of Double
# ---------- c__normalize: C# ----------
    double minV = L.Min();
    double maxV = L.Max();

    minValue = minV;
    maxValue = maxV;
# ---------- end c__normalize ----------
ma = MassAddition(Input=len)  # -> flatten(Result), PartialResults
num_3 = Number(expr("(1/(x+0.000001))*10000", ma.Result))
f1 = Number(simplify(graft(num_3)))
merge = Merge(Data1=f1, Data2=c__normalize.maxValue)  # -> simplify(Result)
branch = TreeBranch(Tree=merge, Path="{0}", MaintainPaths=True)
lng = ListLength(List=branch)

# ---- group: Number of Objectives (Dimensions)
integer_8 = Integer(lng)

# ---- group: Fitness Values
number_9 = Number(merge)

# ---- group: Exit Loop
boolean_4 = Boolean(boolean)

# ---- group: Nr Offsprings
integer_9 = Integer(integer_3)

# ---- group: Genotype
data_4 = Data(data_3)

# ---- group: Nr Parents
integer_10 = Integer(integer_4)

# ---- group: Fitness Values
number_10 = Number(number_9)

# ---- group: Number of Objectives (Dimensions)
integer_11 = Integer(integer_8)

# ---- group: Cur Iteration
integer_12 = Integer(integer_7)

# ----
selection = Selection(
    Offspring=data_4,
    FitnessValues=number_10,
    Lambda=integer_9,
    Mu=integer_10,
    Dimensions=integer_11,
    SelectionAlgo=2,
    Reset=integer_12)  # -> Parents, Archive, Extremes, NonDominated, AllChromosomes, AllArchives
loop_end = LoopEnd(port=loop_start.port, Exit=boolean_4, Data=selection.Parents, TimeOutVal=0, pausedState=False, state="Constant & Record")  # -> flatten(Data)

# ---- group: All archived Chromosomes
data_5 = Data(selection.AllArchives)

# ---- group: Current archived Chromosomes
data_6 = Data(selection.Archive)

# ---- group: Current Chromosomes
data_7 = Data(selection.Parents)

# ---- group: Current archived Chromosomes
data_8 = Data(data_7)

data_9 = Data(data_6)

# ---- group: archived Chromosomes
data_10 = Data(data_5)

# ----
# Get Fitness Value Bounds (MIN MAX)
chromosomeinfo = ChromosomeInfo(Chromosome=[data_10, data_9, data_8])  # -> Chromosome, simplify(FitnessValues), ID, LastID, Age
flip = FlipMatrix(Data=chromosomeinfo.FitnessValues)
bounds = Bounds(Numbers=flip)

# ---- group: Fitness Value Bounds
domain = Domain(bounds)

# ---- group: Debugging! / Cur Iteration
integer_13 = Integer(integer_7)

# ---- group: Debugging! / Current archived Chromosomes
data_11 = Data(data_6)

# ---- group: Chart Scale
number_11 = Number(number_5)

# ---- group: Visualize network centrality / Variant
integer_14 = Integer(integer)

# ---- group: Visualize network centrality / Closeness Centrality
num_4 = Number(num)

# ---- group: Visualize network centrality / Graph Segments
sg_3 = Line(sg_2)

# ---- group: Visualize network centrality / Fitness Values
number_12 = Number(number_9)

# ---- group: Chart Screen Location
point_3 = Point(point)

# ---- group: Fitness Value Bounds
domain_2 = Domain(domain)

# ---- group: Current Chromosomes
data_12 = Data(data_7)

# ---- group: Variant Screen Location
point_4 = Point(point_2)

# ---- group: Buildings
mesh_2 = Mesh(mesh)

# ---- group: Variant Scale
number_13 = Number(number_4)

# ---- group: Other Streets
crv_2 = Curve(crv)

# ----
preview = CustomPreview(Geometry=mesh_2, Shader=ColourSwatch(SwatchColor=RGB(230, 230, 230)))
custom_preview_lineweights = CustomPreviewLineweights(Geometry=crv_2, Shader=ColourSwatch(SwatchColor=RGB(178, 178, 178)), Thickness=Slider(2, range=0..10), Absolute=False)

# ---- group: Chart Scale
number_14 = Number(number_5)

# ---- group: Fitness Value Bounds
domain_3 = Domain(domain)

# ---- group: Chart Screen Location
point_5 = Point(point)

# ---- group: Current archived Chromosomes
data_13 = Data(data_6)

data_14 = Data(data_7)

# ---- group: archived Chromosomes
data_15 = Data(data_5)

# ---- group: Debugging!
cluster = Cluster(C=data_11, reset=integer_13)  # -> L, f1rec, f2rec
c__recorder = CSharpScript(f1=cluster.f1rec, reset=integer_13)  # -> out, flatten(counter); inputs f1: list of Double, reset: Int32
# ---------- c__recorder: C# ----------
    if (reset == 0) // reset the recording lists
    {
      iterationCounter = 0;
    }

    iterationCounter++;

    counter = iterationCounter;
# ---------- c__recorder: C# additional code ----------
  // ---
  private static int iterationCounter = 0;
# ---------- end c__recorder ----------
panel_2 = Panel(cluster.L)
panel_3 = Panel(c__recorder.counter)
graph = QuickGraph(cluster.f2rec, SortOrder=0)
graph_2 = QuickGraph(cluster.f1rec, SortOrder=0)

# ---- group: Visualize network centrality
# Visualise 1 Variant of Phenotypes
tree_statistics = TreeStatistics(Tree=number_12)  # -> Paths, Length, Count
series = Series(Start=0, Step=1, Count=tree_statistics.Count)
group = Group(Objects=sg_3)
mass_addition = MassAddition(Input=number_12)  # -> Result, PartialResults
sort_list = SortList(Keys=flatten(mass_addition.Result), ValuesValuesA=flatten(series), ValuesA=flatten(group))  # -> Keys, ValuesValuesA, ValuesA
list_item = ListItem(List=sort_list.ValuesValuesA, Index=integer_14, Wrap=True)
tree_branch = TreeBranch(Tree=simplify(sg_3), Path=list_item, MaintainPaths=True)
tree_branch_2 = TreeBranch(Tree=simplify(num_4), Path=list_item, MaintainPaths=True)
num_5 = Number(tree_branch_2)
crv_3 = Curve(tree_branch)
log = Logarithm(Value=num_5)
bnd = Bounds(Numbers=log)
remap = RemapNumbers(Value=log, Source=bnd, Target=Domain(0, 1))  # -> Mapped, Clipped
gradient = Gradient(
    LowerLimit=0,
    UpperLimit=1,
    Parameter=remap.Mapped,
    stops=[0: RGB(0, 61, 89), 0.25: RGB(0, 155, 180), 0.5: RGB(148, 193, 28), 0.75: RGB(243, 154, 0), 1: RGB(183, 26, 73)])
custom_preview_lineweights_2 = CustomPreviewLineweights(Geometry=crv_3, Shader=gradient, Thickness=Slider(3, range=0..10), Absolute=False)

# ----
# Visualise best Phenotypes
chromosomeinfo_2 = ChromosomeInfo(Chromosome=data_12)  # -> Chromosome, simplify(FitnessValues), ID, LastID, Birth
branch_2 = TreeBranch(Tree=domain_2, Path="{0}", MaintainPaths=True)
branch_3 = TreeBranch(Tree=domain_2, Path="{1}", MaintainPaths=True)
chromosomemapper_2 = ChromosomeMapper(Chromosome=chromosomeinfo_2.Chromosome)
flip_2 = FlipMatrix(Data=chromosomeinfo_2.FitnessValues)
bounding_box = BoundingBox(Content=flatten(chromosomemapper_2), Plane=PlaneXY(0, 0, 0), UnionBox=True)  # -> Box, Box_2
branch_4 = TreeBranch(Tree=flip_2, Path="{1}", MaintainPaths=True)
branch_5 = TreeBranch(Tree=flip_2, Path="{0}", MaintainPaths=True)
tree_statistics_2 = TreeStatistics(Tree=chromosomemapper_2)  # -> Paths, Length, Count
box_properties = BoxProperties(Box=bounding_box.Box)  # -> Center, Diagonal, Area, Volume, Degeneracy
remap_numbers = RemapNumbers(Value=branch_4, Source=branch_3, Target=Domain(0, 1))  # -> Mapped, Clipped
remap_numbers_2 = RemapNumbers(Value=branch_5, Source=branch_2, Target=Domain(0, 1))  # -> Mapped, Clipped
deconstruct_vector = DeconstructVector(Vector=box_properties.Diagonal)  # -> XComponent, YComponent, ZComponent
construct_point_3 = ConstructPoint(XCoordinate=0, YCoordinate=0, ZCoordinate=0)
xyz = ColourXYZ(Alpha=1, X=remap_numbers_2.Mapped, Y=remap_numbers.Mapped, Z=Slider(1, range=0..1))  # -> simplify(graft(Colour))
vector_2pt = Vector2Pt(PointA=box_properties.Center, PointB=construct_point_3, Unitize=False)  # -> Vector, Length
series_2 = Series(Start=number_13, Step=number_13, Count=tree_statistics_2.Count)
division = Division(A=number_13, B=deconstruct_vector.XComponent)
scale = Scale(Geometry=chromosomemapper_2, Center=box_properties.Center, Factor=division)  # -> Geometry, Transform
construct_point_4 = ConstructPoint(XCoordinate=series_2, YCoordinate=0, ZCoordinate=0)
move = Move(Geometry=scale.Geometry, Motion=vector_2pt.Vector)  # -> Geometry, Transform
addition = Addition(A=construct_point_4, B=point_4)
render_curve_to_screen = RenderCurveToScreen(
    Curve=move.Geometry,
    Location=graft(addition),
    ScaleFactor=1,
    Color=xyz,
    Thickness=1,
    Depth=0.95,
    Fixed=True,
    m_scWithvp=True)

entwine = Entwine(Branch00=data_14, Branch01=data_13, Branch02=data_15, FlattenInputs=True)
chromosomeinfo_3 = ChromosomeInfo(Chromosome=entwine)  # -> Chromosome, simplify(FitnessValues), ID, LastID, Age
remap_numbers_3 = RemapNumbers(Value=chromosomeinfo_3.FitnessValues, Source=flatten(domain_3), Target=Domain(0, 1))  # -> Mapped, Clipped
list_item_2 = ListItem(List=remap_numbers_3.Mapped, Index=0, Wrap=True)  # -> Item, Item1
shift_paths = ShiftPaths(Data=list_item_2.Item, Offset=-1)
shift_paths_2 = ShiftPaths(Data=list_item_2.Item1, Offset=-1)
construct_point_5 = ConstructPoint(XCoordinate=shift_paths, YCoordinate=shift_paths_2, ZCoordinate=0)
xyz_2 = ColourXYZ(Alpha=1, X=shift_paths, Y=shift_paths_2, Z=Slider(1, range=0..1))  # -> simplify(Colour)
tree_statistics_3 = TreeStatistics(Tree=xyz_2)  # -> Paths, Length, Count
series_3 = Series(Start=Slider(1, range=0..1), Step=1, Count=tree_statistics_3.Count)  # -> reverse(graft(Series))
render_point_to_screen = RenderPointToScreen(
    Point=construct_point_5,
    Location=point_5,
    ScaleFactor=number_14,
    Color=xyz_2,
    Radius=series_3,
    Depth=0.95,
    Fixed=True,
    m_scWithvp=True)

# ----
# Chart Lines/Text
construct_point_6 = ConstructPoint(XCoordinate=0, YCoordinate=0, ZCoordinate=0)
unit_x = UnitX(Factor=1)
unit_y = UnitY(Factor=1)
negative = Negative(Value=number_11)
unit_x_2 = UnitX(Factor=number_11)
unit_y_2 = UnitY(Factor=negative)
move_2 = Move(Geometry=construct_point_6, Motion=unit_x)  # -> Geometry, Transform
move_3 = Move(Geometry=construct_point_6, Motion=unit_y)  # -> Geometry, Transform
move_4 = Move(Geometry=point_3, Motion=unit_x_2)  # -> Geometry, Transform
move_5 = Move(Geometry=point_3, Motion=unit_y_2)  # -> Geometry, Transform
line = Line(StartPoint=construct_point_6, EndPoint=move_2.Geometry)
line_2 = Line(StartPoint=construct_point_6, EndPoint=move_3.Geometry)
number_slider_3 = Slider(16, range=0..100)
# Visualise Points on 2D Chart - Possible, since we work with 2 Objectives/Dimensions
swatch = ColourSwatch(SwatchColor=RGB(0, 0, 0))
render_curve_to_screen_2 = RenderCurveToScreen(
    Curve=[line_2, line],
    Location=point_3,
    ScaleFactor=number_11,
    Color=swatch,
    Thickness=1,
    Depth=0.95,
    Fixed=True,
    m_scWithvp=True)
render_text_to_screen = RenderTextToScreen(
    Text="Street Length",
    Location=move_4.Geometry,
    Size=number_slider_3,
    Color=ColourSwatch(SwatchColor=RGB(255, 0, 187)),
    m_scWithvp=True)
render_text_to_screen_2 = RenderTextToScreen(
    Text="Centrality",
    Location=move_5.Geometry,
    Size=number_slider_3,
    Color=ColourSwatch(SwatchColor=RGB(0, 208, 255)),
    m_scWithvp=True)

# ==== cluster Cluster
C = ClusterInput()
reset = ClusterInput()
chromosomeinfo = ChromosomeInfo(Chromosome=C)  # -> Chromosome, simplify(FitnessValues), ID, LastID, Age
flip = FlipMatrix(Data=chromosomeinfo.FitnessValues)
branch = TreeBranch(Tree=flip, Path="{0}", MaintainPaths=True)
branch_2 = TreeBranch(Tree=flip, Path="{1}", MaintainPaths=True)
c__recorder = CSharpScript(f1=branch, f2=branch_2, reset=reset)  # -> out, F1rec, F2rec; inputs f1: list of Double, f2: list of Double, reset: Int32
# ---------- c__recorder: C# ----------
    if (reset == 0) // reset the recording lists
    {
      F1 = new List <double> ();
      F2 = new List <double> ();
    }

    F1.Add(f1.Min());
    F2.Add(f2.Min());

    F1rec = F1;
    F2rec = F2;
# ---------- c__recorder: C# additional code ----------
  // ---
  private static List <double> F1 = new List <double> ();
  private static List <double> F2 = new List <double> ();
# ---------- end c__recorder ----------
lng = ListLength(List=chromosomeinfo.Chromosome)
L = ClusterOutput(lng)
f1rec = ClusterOutput(c__recorder.F1rec)
f2rec = ClusterOutput(c__recorder.F2rec)

# ==== cluster CustomEdgeWeights: Creates lits for custom edge weighting. Each line segment can be assigned either custom or general weight. segments with custom weights are identifyied via custom weight point list
segments = ClusterInput()
pointsofinterest = ClusterInput()
customweights = ClusterInput()
generalweight = ClusterInput()
segments_2 = Line(segments)
generalweight_2 = Number(generalweight)
customweights_2 = Number(customweights)
pointsofinterest_2 = Point(pointsofinterest)
lng = ListLength(List=segments_2)
crv_cp = CurveClosestPoint(Point=graft(pointsofinterest_2), Curve=segments_2)  # -> Point, Parameter, Distance
series = Series(Start=0, Step=1, Count=lng)
sort = SortList(Keys=crv_cp.Distance, ValuesA=series)  # -> Keys, ValuesA
item = ListItem(List=sort.ValuesA, Index=0, Wrap=True)  # -> flatten(Item)
lng_2 = ListLength(List=item)
dup = DuplicateData(Data=customweights_2, Number=lng_2, Order=True)
c_script = CSharpScript(x=customweights_2, y=dup)  # -> out, A; inputs x: list of Double, y: list of Double
# ---------- c_script: C# usings ----------
using System.IO;
using System.Linq;
using System.Data;
using System.Drawing;
using System.Reflection;
using System.Windows.Forms;
using System.Xml;
using System.Xml.Linq;
using System.Runtime.InteropServices;

using Rhino.DocObjects;
using Rhino.Collections;
using GH_IO;
using GH_IO.Serialization;
# ---------- c_script: C# ----------
    if(x.Count == 1)
      A = y;
    else
      A = x;
# ---------- end c_script ----------
ids = Integer(item)
c_list = CSharpScript(edge_count=lng, ids=ids, weights=c_script.A, general_weight=generalweight_2)  # -> add_weight; inputs edge_count: Int32, ids: list of Int32, weights: list of Double, general_weight: Double
# ---------- c_list: C# ----------
    List<double> result = new List<double>(); //Enumerable.Repeat(general_weight, edge_count).ToList();

    for (int i = 0; i < edge_count * 2; i++)
    {
      result.Add(general_weight);
    }


    for (int i = 0; i < ids.Count; i++)
    {
      if(ids[i] * 2 + 1 < result.Count){
        result[ids[i] * 2] = weights[i];
        result[ids[i] * 2 + 1] = weights[i];
      }
    }

    add_weight = result;
# ---------- end c_list ----------
weight_list = Number(c_list)
weight_list_2 = ClusterOutput(weight_list)
