# Grasshopper definition NetworkShortestPath.gh (Grasshopper 1.0.7)
# plug-ins: DeCodingSpaces, Human, MetaHopper

# PARAMETRIC PLANNING CATALOGUE
# Street Network Shortest Path
# v. 1.0 - Author: DeCodingSpaces - Reinhard König, Martin Bielik, Ekaterina Fuchkina
document_info = DocumentInfo(AutoUpdate=False, Recursive=False)  # -> DocumentName, DocumentFilePath, Components, Params, _3rdPartyAssemblies
# text is internalised, if metahopper component is missing
not_internalised = Text(document_info._3rdPartyAssemblies)
internalised_text = Text(["MetaHopper, Version=1.0.8.0, Culture=neutral, PublicKeyToken=null", "DecodingSpacesAssembly, Version=1.0.0.0, Culture=neutral, PublicKeyToken=null", "Human, Version=1.7.3.0, Culture=neutral, PublicKeyToken=null"])
create_set = CreateSet(List=[internalised_text, not_internalised])  # -> Set, Map
# Description: DeCodingSpaces offers components that can process and analyse street network. To run a Betweeness Centrality Analysis, toggle the "Run Analysis" Button.
# 
# There are three different ways to calculate the shortest path. Move around for each the origin and destination to see the differences in speed.
_3rd_party = Panel(create_set.Set)

# ----
# 0. Run Calculation
# Calculates:
# shortest paths
# centrality measures
# =====================
# + it is simple to use
# ---------------------
# - it is slow
# 1. Shortest Path Simple SLOW
# 
# Select Origin or Destination
# and move them around.
# Calculates:
# shortest paths
# =====================
# + it fast fow calculation of few shortest paths
# ---------------------
# - it is slow if many or all shortest paths in graph should be calculated
# 2. Shortest Path Dijkstra FAST
# 
# Select Origin or Destination
# and move them around.
# Calculates:
# shortest paths
# centralities
# =====================
# + it is fast if many or all shortest paths in graph should be calculated
# + it is fast if centrality measures are calculated
# + GPU acceleration
# ---------------------
# - slow if only single shortest path should be calculated
# 3. Shortest Path Floyd Warshal
# SLOW in preparation, then FAST
# 
# Select Origin or Destination
# and move them around.
# Streets
# Buildings
# (only Visualisation)
run_calculation_takes_a_while = BooleanToggle(False)

# ---- group: Origin
point = Point(Point(-168.889975, 407.993175, 0))

# ---- group: Destination
point_2 = Point(Point(189.2715644, -509.6296859, 0))

# ---- group: Origin
point_3 = Point(Point(-168.889975, 407.993175, 0))

# ---- group: Destination
point_4 = Point(Point(165.4681754, -627.6629264, 0))

# ---- group: Origin
point_5 = Point(Point(-168.889975, 407.993175, 0))

# ---- group: Destination
point_6 = Point(Point(187.7981073, -533.3220427, 0))

# ---- group: Streets
crv = Curve([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])

# ---- group: Paths
initial_segments = Curve([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])

# ---- group: Buildings
mesh = Mesh([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])

# ---- group: Run Calculation
boolean = Boolean(run_calculation_takes_a_while)

# ---- group: Street Preparation / Run Calculation
boolean_2 = Boolean(boolean)

# ---- group: Street Preparation / Paths
initial_segments_2 = Curve(initial_segments)

# ---- group: Street Preparation / Streets
crv_2 = Curve(crv)

# ---- group: Street Preparation
# all street have to be splited at intersection and represented as lines (No polylines or curves are supported)
number_slider = Slider(0.5, range=0..1)
network_to_segments = NetworkToSegments(NetworkGeometry=[crv_2, initial_segments_2], ConvertCurves=True, ConversionAngle=0.2, Split=True)
network_smooth = NetworkSmooth(Network=network_to_segments, SnapThreshold=number_slider, SnapToAnchorPointsOnly=False)
stream_filter = StreamFilter(Gate=boolean_2, Stream1=network_smooth)

# ---- group: Street Preparation / Street Segments
park = Line(stream_filter)

# ---- group: Create Graph Object from Segments / Street Segments
park_2 = Line(park)

# ---- group: Create Graph Object from Segments
_1_processgeometry = _1ProcessGeometry(Path=park_2, SegmentLength=10000)  # -> Object, Segments, Vectors, Ids
graph_object = Data(_1_processgeometry.Object)
ids_directed_edges = Integer(_1_processgeometry.Ids)
vector = Vector(_1_processgeometry.Vectors)

# ---- group: Create Graph Object from Segments / Graph Segments
segments_undirected_edges = Line(_1_processgeometry.Segments)

# ---- group: Expert (Dijkstra) - calculate only shortest paths / Destination
point_7 = Point(point_4)

# ---- group: Expert (Floyd Warshal) / Destination
point_8 = Point(point_6)

# ---- group: Expert (Dijkstra) - calculate only shortest paths / Graph Segments
segments_undirected_edges_2 = Line(segments_undirected_edges)

# ---- group: Expert (Dijkstra) - calculate only shortest paths / Origin
point_9 = Point(point_3)

# ---- group: Expert (Dijkstra) - calculate only shortest paths
# 2. Shortest Path Dijkstra
graph_object_2 = Data(graph_object)
_2_buildgraph = _2BuildGraph(
    Object=graph_object_2,
    LengthCoefficient=Slider(0, range=0..1),
    AngularCoefficient=Slider(1, range=0..1),
    AdditionalEdgeWeightCoefficient=0,
    CalculateDegree=False,
    CalculateInverseGraph=False,
    CopyObject=True)  # -> Object, InverseGraphEdges, Vertices, ReferencedEdges, DegreeCentrality
_3_shortestdijkstra = _3ShortestDijkstra(Object=_2_buildgraph.Object, Origins=point_9, Destinations=point_7, UseGeneratedPath=False)
item = ListItem(List=segments_undirected_edges_2, Index=_3_shortestdijkstra, Wrap=True)

# ---- group: Expert (Floyd Warshal) / Origin
point_10 = Point(point_5)

# ---- group: Expert (Floyd Warshal) / Graph Segments
segments_undirected_edges_3 = Line(segments_undirected_edges)

# ---- group: Destination
point_11 = Point(point_2)

# ---- group: Street Segments
park_3 = Line(park)

# ---- group: Origin
point_12 = Point(point)

# ----
# 1. Shortest Path Simple
number_slider_2 = Slider(1, range=0..1)
citygraph = CityGraph(
    Path=park_3,
    LengthCoefficient=Slider(0, range=0..1),
    AngularCoefficient=number_slider_2,
    Origins=point_12,
    Destinations=point_11,
    PairwiseShortestPaths=False,
    Radius=0,
    MaskInputString="110000000",
    PathInfoForPoints=False,
    UseGPU=False)  # -> BetweennessCentrality, ClosenessCentrality, Gravity, BetweennessCentralityWeighted, ClosenessCentralityWeighted, BetweennessCentralityNormalized, SupplementaryGeometry, PathsInformation, OutputGeometry
list = ValueList({"shortest path segment IDs": 0, "shortest path custom costs": 1, "shortest path metric costs": 2}, selected="shortest path segment IDs")
pinfo_decompose = PInfoDecompose(PInf=citygraph.PathsInformation, type=list)  # -> A; inputs PInf: tree of Double, type: Int32
# ---------- pinfo_decompose: C# ----------
    DataTree<double> Out = new DataTree<double>();
    for(int i = type; i < PInf.BranchCount; i = i + 3)
    {
      GH_Path p = PInf.Paths[i];
      Out.AddRange(PInf.Branch(p), p);
    }
    A = Out;
# ---------- end pinfo_decompose ----------
item_2 = ListItem(List=citygraph.OutputGeometry, Index=pinfo_decompose, Wrap=True)

# ---- group: Expert (Floyd Warshal) / Coefficients for combining Angular Metric and Custom Weight
number_slider_3 = Slider(0, range=0..1)
number_slider_4 = Slider(1, range=0..1)

# ---- group: Expert (Floyd Warshal)
# 3. Floyd Warshal
graph_object_3 = Data(graph_object)
_2_buildgraph_2 = _2BuildGraph(
    Object=graph_object_3,
    LengthCoefficient=number_slider_3,
    AngularCoefficient=number_slider_4,
    AdditionalEdgeWeightCoefficient=0,
    CalculateDegree=False,
    CalculateInverseGraph=False,
    CopyObject=True)  # -> Object, InverseGraphEdges, Vertices, ReferencedEdges, DegreeCentrality
_3_shortestfloydwarshal = _3ShortestFloydWarshal(Object=_2_buildgraph_2.Object, CopyObject=True, IncludeMaA=False, UseGPU=False)
_4_fwgetpaths = _4FWGetPaths(
    Object=_3_shortestfloydwarshal,
    Origins=point_10,
    Destinations=point_8,
    PairwiseShortestPaths=False,
    Radius=0,
    CopyObject=True,
    MaskInputString="11000000",
    PathInfoForPoints=False,
    UseGPU=False)  # -> BetweennessCentrality, ClosenessCentrality, Gravity, BetweennessCentralityWeighted, ClosenessCentralityWeighted, SupplementaryGeometry, PathsInformation
list_2 = ValueList({"shortest path segment IDs": 0, "shortest path custom costs": 1, "shortest path metric costs": 2}, selected="shortest path segment IDs")
pinfo_decompose_2 = PInfoDecompose(PInf=_4_fwgetpaths.PathsInformation, type=list_2)  # -> A; inputs PInf: tree of Double, type: Int32; same code as pinfo_decompose
item_3 = ListItem(List=segments_undirected_edges_3, Index=pinfo_decompose_2, Wrap=True)

# ---- group: Expert (Dijkstra) - calculate only shortest paths / Shortest Path Dijkstra
curve = Curve(item)

# ---- group: Shortest Path Simple
curve_2 = Curve(item_2)

# ---- group: Expert (Floyd Warshal) / Shortest Path Floyd Warshal
curve_3 = Curve(item_3)

# ---- group: Visualize network centrality / Shortest Path Simple
curve_4 = Curve(curve_2)

# ---- group: Visualize network centrality / Shortest Path Dijkstra
curve_5 = Curve(curve)

# ---- group: Visualize network centrality / Buildings
mesh_2 = Mesh(mesh)

# ---- group: Visualize network centrality / Other Streets
crv_3 = Curve([crv, initial_segments])

# ---- group: Visualize network centrality / Shortest Path Floyd Warshal
curve_6 = Curve(curve_3)

# ---- group: Visualize network centrality
number_slider_5 = Slider(3, range=0..10)
preview = CustomPreview(Geometry=mesh_2, Shader=ColourSwatch(SwatchColor=RGBA(204, 204, 204, 131)))
custom_preview_lineweights = CustomPreviewLineweights(Geometry=crv_3, Shader=ColourSwatch(SwatchColor=RGB(178, 178, 178)), Thickness=Slider(2, range=0..10), Absolute=False)
calc = ColourSwatch(SwatchColor=RGB(99, 197, 219))
custom_preview_lineweights_2 = CustomPreviewLineweights(Geometry=curve_4, Shader=ColourSwatch(SwatchColor=RGB(255, 0, 187)), Thickness=number_slider_5, Absolute=False)
custom_preview_lineweights_3 = CustomPreviewLineweights(Geometry=curve_6, Shader=ColourSwatch(SwatchColor=RGB(157, 0, 255)), Thickness=number_slider_5, Absolute=False)
custom_preview_lineweights_4 = CustomPreviewLineweights(Geometry=curve_5, Shader=calc, Thickness=number_slider_5, Absolute=False)
