# Grasshopper definition NetworkSynthesis.gh (Grasshopper 1.0.7)
# plug-ins: DeCodingSpaces, Human, MetaHopper

# Description: DeCodingSpaces offers components that can process and analyse street network. To run a Betweeness Centrality Analysis, toggle the "Run Analysis" Button.
document_info = DocumentInfo(AutoUpdate=False, Recursive=False)  # -> DocumentName, DocumentFilePath, Components, Params, _3rdPartyAssemblies
# text is internalised, if metahopper component is missing
not_internalised = Text(document_info._3rdPartyAssemblies)
internalised_text = Text(["DecodingSpacesAssembly, Version=1.0.0.0, Culture=neutral, PublicKeyToken=null", "MetaHopper, Version=1.0.8.0, Culture=neutral, PublicKeyToken=null", "Human, Version=1.7.3.0, Culture=neutral, PublicKeyToken=null"])
create_set = CreateSet(List=[internalised_text, not_internalised])  # -> Set, Map
# PARAMETRIC PLANNING CATALOGUE
# Street Network Synthesis
# v. 1.0 - Author: DeCodingSpaces
_3rd_party = Panel(create_set.Set)

# ----
# 1. Run Analysis
# 2. Input Geometry &
#  Settings
# Buildings
# (for Visualisation)
run_analysis = BooleanToggle(False)

# ---- group: Run Analysis
boolean = Boolean(run_analysis)

# ---- group: Boundary
boundary_polygon = Curve(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)

# ---- group: Other Streets
crv = Curve([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])

# ---- group: Initial Streets
initial_segments = Curve([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])

# ---- group: Buildings
mesh = Mesh([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])

# ---- group: Boundary
boundary_polygon_2 = Curve(boundary_polygon)

# ---- group: Initial Streets
initial_segments_2 = Curve(initial_segments)

# ----
# Generate Street Segments
number_slider = Slider(9, range=0..20)
street_network_generator = StreetNetworkGenerator(
    Boundary=boundary_polygon_2,
    IniStreets=initial_segments_2,
    MinLength=30,
    MaxLength=100,
    MinDist=20,
    RandomAngle=10,
    MaxArms=4,
    TreeDepth=number_slider,
    ProbabilityToAddArms=1,
    SeedForRandom=-1)

# ---- group: Streets
crv_2 = Curve(street_network_generator)

crv_3 = Curve(crv_2)

# ---- group: Run Analysis
boolean_2 = Boolean(boolean)

# ---- group: Other Streets
crv_4 = Curve(crv)

# ----
# Prepare Street Geometries for Network Analysis
# (1. Line Network is smoothed: Close Points are
#  merged. 2: Network is split into seperate lines.)
stream_filter = StreamFilter(Gate=boolean_2, Stream1=flatten([crv_3, crv_4]))
explode = Explode(Curve=stream_filter, Recursive=True)  # -> reparameterize(flatten(Segments)), Vertices
network_smooth = NetworkSmooth(Network=explode.Segments, SnapThreshold=Slider(1, range=0..1), SnapToAnchorPointsOnly=False)
network2segments = NetworkToSegments(NetworkGeometry=network_smooth, ConvertCurves=True, ConversionAngle=0.2, Split=True)

# ---- group: Street Line Segments
line = Line(network2segments)

line_2 = Line(line)

# ----
# 3. Calculate all possible shortest Paths
# Network Analysis
# 2. Weight street segments
# 1. Create Graph Object from line segments
# 4. Calculate Betweeness Centrality
number_slider_2 = Slider(0, range=0..1)
_1_processgeometry = _1ProcessGeometry(Path=line_2, SegmentLength=10000)  # -> Object, Segments, Vectors, Ids
_2_buildgraph = _2BuildGraph(
    Object=_1_processgeometry.Object,
    LengthCoefficient=number_slider_2,
    AngularCoefficient=Slider(1, range=0..1),
    AdditionalEdgeWeightCoefficient=0,
    CalculateDegree=False,
    CalculateInverseGraph=False,
    CopyObject=True)  # -> Object, InverseGraphEdges, Vertices, ReferencedEdges, DegreeCentrality
_3_shortestfloydwarshal = _3ShortestFloydWarshal(Object=_2_buildgraph.Object, CopyObject=True, IncludeMaA=False, UseGPU=True)
_4_fwgetpaths = _4FWGetPaths(
    Object=_3_shortestfloydwarshal,
    Origins=_1_processgeometry.Segments,
    Destinations=_1_processgeometry.Segments,
    PairwiseShortestPaths=False,
    Radius=0,
    CopyObject=True,
    MaskInputString="00000001",
    PathInfoForPoints=False,
    UseGPU=True)  # -> BetweennessCentrality, ClosenessCentrality, Gravity, BetweennessCentralityWeighted, ClosenessCentralityWeighted, SupplementaryGeometry, PathsInformation

# ---- group: Betweeness Centrality
num = Number(_4_fwgetpaths.BetweennessCentrality)

# ---- group: Visualize network centrality / Betweeness Centrality
num_2 = Number(num)

# ---- group: Visualize network centrality / Street Line Segments
line_3 = Line(line)

# ---- group: Visualize network centrality / Buildings
mesh_2 = Mesh(mesh)

# ---- group: Visualize network centrality
log = Logarithm(Value=num_2)
preview = CustomPreview(Geometry=mesh_2, Shader=ColourSwatch(SwatchColor=RGBA(204, 204, 204, 131)))
bnd = Bounds(Numbers=log)
remap = RemapNumbers(Value=log, Source=bnd, Target=Domain(0, 1))  # -> Mapped, Clipped
gradient = Gradient(
    LowerLimit=0,
    UpperLimit=1,
    Parameter=remap.Mapped,
    stops=[0: RGB(0, 61, 89), 0.25: RGB(0, 155, 180), 0.5: RGB(148, 193, 28), 0.75: RGB(243, 154, 0), 1: RGB(183, 26, 73)])
custom_preview_lineweights = CustomPreviewLineweights(Geometry=line_3, Shader=gradient, Thickness=Slider(2, range=0..10), Absolute=False)
