# Grasshopper definition ParcelCustomOffset.gh (Grasshopper 1.0.7)
# plug-ins: DeCodingSpaces, Human, MetaHopper

# PARAMETRIC PLANNING CATALOGUE
# Parcels with Custom Offset
document_info = DocumentInfo(AutoUpdate=False, Recursive=False)  # -> DocumentName, DocumentFilePath, Components, Params, _3rdPartyAssemblies
# text is internalised, if metahopper component is missing
not_internalised = Text(document_info._3rdPartyAssemblies)
internalised_text = Text(["DecodingSpacesAssembly, Version=1.0.0.0, Culture=neutral, PublicKeyToken=null", "Human, Version=1.7.3.0, Culture=neutral, PublicKeyToken=null", "MetaHopper, Version=1.0.8.0, Culture=neutral, PublicKeyToken=null"])
create_set = CreateSet(List=[internalised_text, not_internalised])  # -> Set, Map
# v. 1.0 - Author: DeCodingSpaces - Martin Bielik
# Description: Offset individual polygon edges by custom values.
# 
# In this example a set of street segments is prepared for Network Centrality Analysis. The values of the analysis are used to define the offset of street segments.
# 
# 
# The Negative Offset toggle button is used to switch direction of the offset.
_3rd_party = Panel(create_set.Set)

# ----
# Paths
# Buildings & Streets
# (only Visualisation)
number_slider = Slider(18, range=0..100)
negative_offset = BooleanToggle(True)
negative = Negative(Value=negative_offset)
multiplication = Multiplication(A=negative, B=Slider(7, range=0..100))
multiplication_2 = Multiplication(A=negative, B=number_slider)

# ---- group: Buildings
mesh = Mesh([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])

# ---- group: Other Streets
crv = Curve([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])

# ---- group: Paths
initial_segments = Curve([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])

# ---- group: Offset Min
number = Number(multiplication)

# ---- group: Offset Max
number_2 = Number(multiplication_2)

# ---- group: Paths
initial_segments_2 = Curve(initial_segments)

# ----
network_to_segments = NetworkToSegments(NetworkGeometry=initial_segments_2, ConvertCurves=Toggle(True), ConversionAngle=Slider(0.517, range=0..1), Split=True)
network_smooth = NetworkSmooth(Network=network_to_segments, SnapThreshold=Slider(19, range=0..100), SnapToAnchorPointsOnly=False)

# ---- group: Smoothed Paths
line_segments = Line(network_smooth)

line_segments_2 = Line(line_segments)

# ----
citygraph = CityGraph(
    Path=line_segments_2,
    LengthCoefficient=1,
    AngularCoefficient=0,
    PairwiseShortestPaths=False,
    Radius=0,
    MaskInputString="000000001",
    PathInfoForPoints=False,
    UseGPU=False)  # -> BetweennessCentrality, ClosenessCentrality, Gravity, BetweennessCentralityWeighted, ClosenessCentralityWeighted, BetweennessCentralityNormalized, SupplementaryGeometry, PathsInformation, OutputGeometry

# ---- group: Betweenness Centrality
centrality = Number(citygraph.BetweennessCentrality)

# ---- group: Smoothed Paths
line_segments_3 = Line(line_segments)

# ---- group: Betweenness Centrality
centrality_2 = Number(centrality)

# ---- group: Offset Min
number_3 = Number(number)

# ---- group: Offset Max
number_4 = Number(number_2)

# ----
polygons_from_lines = PolygonsFromLines(Lines=line_segments_3, LineValues=centrality_2, MinBlockSize=0)  # -> Polygons, SynchronizedValues
construct_domain = ConstructDomain(DomainStart=number_3, DomainEnd=number_4)
bounds = Bounds(Numbers=centrality_2)
remap_numbers = RemapNumbers(Value=polygons_from_lines.SynchronizedValues, Source=bounds, Target=construct_domain)  # -> Mapped, Clipped
custom_offset = CustomOffset(Polygons=polygons_from_lines.Polygons, OffsetValues=remap_numbers.Mapped)  # -> OffsetedPolygons, Test
boundary = BoundarySurfaces(Edges=custom_offset.OffsetedPolygons)

# ---- group: Plot
surface = Surface(boundary)

# ---- group: Other Streets
crv_2 = Curve(crv)

# ---- group: Buildings
mesh_2 = Mesh(mesh)

# ---- group: Betweenness Centrality
centrality_3 = Number(centrality)

# ---- group: Smoothed Paths
line_segments_4 = Line(line_segments)

# ---- group: Plot
surface_2 = Surface(surface)

# ----
log = Logarithm(Value=centrality_3)
custom_preview = CustomPreview(Geometry=surface_2, Material=ColourSwatch(SwatchColor=RGB(157, 0, 255)))
preview = CustomPreview(Geometry=mesh_2, Shader=ColourSwatch(SwatchColor=RGBA(204, 204, 204, 131)))
bnd = Bounds(Numbers=log)
custom_preview_lineweights = CustomPreviewLineweights(Geometry=crv_2, Shader=ColourSwatch(SwatchColor=RGB(178, 178, 178)), Thickness=Slider(2, range=0..10), Absolute=False)
remap = RemapNumbers(Value=log, Source=bnd, Target=Domain(0, 1))  # -> Mapped, Clipped
gradient = Gradient(
    LowerLimit=0,
    UpperLimit=1,
    Parameter=remap.Mapped,
    stops=[0: RGB(0, 61, 89), 0.25: RGB(0, 155, 180), 0.5: RGB(148, 193, 28), 0.75: RGB(243, 154, 0), 1: RGB(183, 26, 73)])
custom_preview_lineweights_2 = CustomPreviewLineweights(Geometry=line_segments_4, Shader=gradient, Thickness=Slider(2, range=0..10), Absolute=False)
