# Grasshopper definition ParcellationByArea.gh (Grasshopper 1.0.7)
# plug-ins: DeCodingSpaces, Human, MetaHopper

# Description: 1. Assign street blocks
# 
# 2. Choose one of three algorithms to generate parcels.
document_info = DocumentInfo(AutoUpdate=False, Recursive=False)  # -> DocumentName, DocumentFilePath, Components, Params, _3rdPartyAssemblies
# text is internalised, if metahopper component is missing
not_internalised = Text(document_info._3rdPartyAssemblies)
internalised_text = Text(["Human, Version=1.7.3.0, Culture=neutral, PublicKeyToken=null", "DecodingSpacesAssembly, Version=1.0.0.0, Culture=neutral, PublicKeyToken=null"])
create_set = CreateSet(List=[internalised_text, not_internalised])  # -> Set, Map
# PARAMETRIC PLANNING CATALOGUE
# Parcellation by Area
# v. 1.0 - Author: DeCodingSpaces - Martin Dennemark
_3rd_party = Panel(create_set.Set)

# ---- group: Paths
initial_segments = Curve([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])

# ---- group: Streets
crv = Curve([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])

# ---- group: Buildings
mesh = Mesh([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])

# ---- group: Other Streets
crv_2 = Curve([crv, initial_segments])

# ---- group: Buildings
mesh_2 = Mesh(mesh)

# ----
# 1.
# 2.
# Buildings & Streets
# only for Visualisation
parcellation_option = ValueList({"Equal Area - cut by minimal distance": 0, "Equal Area - cut by vector direction": 1, "Inidividual Area - cut by minimal distance": 2}, selected="Equal Area - cut by minimal distance")
polygons_from_lines = PolygonsFromLines(Lines=initial_segments, MinBlockSize=0)  # -> Polygons, SynchronizedValues

# ---- group: Plots
curve = Curve(polygons_from_lines.Polygons)

# ----
stream_gate = StreamGate(Stream=curve, Gate=parcellation_option)  # -> Target0, Target1, Target2, Target3, Target4

# ----
# Cuts by individually set areas. Sum of areas needs to be 1 = 100%.
number_slider = Slider(7, range=0..10)
curve_2 = Curve(stream_gate.Target2)
range = Range(Domain=Domain(0, 1), Steps=number_slider)
mass_addition = MassAddition(Input=range)  # -> Result, PartialResults
consecutive_domains = ConsecutiveDomains(Numbers=range, Additive=True)
remap_numbers = RemapNumbers(Value=consecutive_domains, Source=mass_addition.Result, Target=Domain(0, 1))  # -> Mapped, Clipped
arealistgreedy = CSharpScript(pl=curve_2, area=remap_numbers.Mapped)  # -> out, A; inputs pl: Polyline, area: list of Double
# ---------- arealistgreedy: C# ----------
    
    
       /**
   * Polygon Splitting by Area developed by Martin Dennemark at Bauhaus University Weimar, DecodingSpaces & Form Follows You
   * Greatly based on Gediminas Rimša polyline split algorithm
   * https://github.com/grimsa/polysplit
   * which is derived from Sumit Khetarpal http://www.khetarpal.org/polygon-splitting/
   * Licensed under the MIT license.
   */
    if(!pl.IsClosed || !pl.IsValid){
      Print("Polyline is not valid");
    }
    if(area.Sum() > 1){
      Print("Sum of area should be less than 1!");
    }else{
      AreaMassProperties amp = AreaMassProperties.Compute(pl.ToNurbsCurve());
      List<Polyline> polylineParts = new List<Polyline>();
      Polyline remainingPoly = pl;
      for(int i = 0; i < area.Count; i++){
        remainingPoly = split(remainingPoly, polylineParts, area[i] * amp.Area);
      }
      polylineParts.Add(remainingPoly);
      A = polylineParts;
    }
# ---------- arealistgreedy: C# additional code ----------
  public Polyline split(Polyline polyline, List<Polyline> resultList, double singlePartArea){
    List<Line> segments = polyline.GetSegments().ToList();
    List<Cut> possibleCuts = new List<Cut>();
    AreaMassProperties amp = AreaMassProperties.Compute(polyline.ToNurbsCurve());

    for(int i = 0; i < segments.Count() - 2; i++){
      for(int j = i + 2; j < segments.Count();j++){
        int segmentsCovered = j - i + 1;
        if(segments.Count() == segmentsCovered){
          break;
        }
        Line edgeA = segments[i];
        Line edgeB = segments[j];

        EdgePair edgePair = new EdgePair(edgeA, edgeB);
        EdgePairSubpolylines subpolyline = edgePair.getSubpolylines();
        List<Cut> cutForCurrentEdgePair = subpolyline.getCuts(polyline, singlePartArea);
        possibleCuts.AddRange(cutForCurrentEdgePair);
      }
    }

    if(possibleCuts.Count > 0){
      Cut shortestCut = possibleCuts.Aggregate((minItem, nextItem) => minItem.getLength() < nextItem.getLength() ? minItem : nextItem);
      resultList.Add(shortestCut.getCutAway());

      return shortestCut.getCutRemain();}
    else return polyline;
  }
  public class Cut{
    private double length;
    private Polyline cutAway;
    private Polyline cutRemain;
    private Vector3d cutDirection;

    public Cut(double lengthOfCut, Polyline cutAway, Polyline cutRemain, Vector3d cutDirection){
      this.length = lengthOfCut;
      this.cutAway = cutAway;
      this.cutRemain = cutRemain;
      this.cutDirection = cutDirection;
    }

    public double getLength(){
      return length;
    }
    public Polyline getCutAway(){
      return cutAway;
    }
    public Polyline getCutRemain(){
      return cutRemain;
    }
    public Vector3d getCutDirection(){
      return cutDirection;
    }

  }

 /**
 * Represents a pair of edges on polygon's exterior ring.
 * Warning: direction of edges is assumed to be the same as in the polygon's exterior ring.
 *
 * Possible lines of cut are located in one of:
 *
 * T1 - First triangle, may not exist in some cases
 * Trapezoid - Trapezoid, always present
 * T2 - Second triangle, may not exist in some cases
 *
 *
 *                                edgeA
 *            edgeA.p0 .____________________________. edgeA.p1
 *                    /|                            |\
 *                   /                                \
 *   outsideEdge2   /  |                            |  \   outsideEdge1
 *                 /                                    \
 *                / T2 |        Trapezoid           | T1 \
 *               /                                        \
 *              .______.____________________________|______.
 *        edgeB.p1                edgeB                    edgeB.p0
 *                     ^                            ^
 *                 projected1                  projected0
 *
 */

  class EdgePair{

    private Line edgeA;
    private Line edgeB;

    private Point3d projected0;
    private Point3d projected1;

    public EdgePair(Line edgeA, Line edgeB){

      double ia, ib;
      Point3d interesectionPoint = new Point3d(double.MaxValue, double.MaxValue, double.MaxValue);
      if(Rhino.Geometry.Intersect.Intersection.LineLine(edgeA, edgeB, out ia, out ib))
        interesectionPoint = edgeA.PointAt(ia);
      bool intersectionOnEdge = false;
      if(ia >= 0 && ia <= 1) intersectionOnEdge = true;
      if(ib >= 0 && ib <= 1) intersectionOnEdge = true;

      this.edgeA = edgeA;
      this.edgeB = edgeB;

      projected0 = getProjectedPoint(edgeA.To, edgeB, interesectionPoint, intersectionOnEdge);
      if(projected0.X == double.MaxValue){
        projected0 = getProjectedPoint(edgeB.From, edgeA, interesectionPoint, intersectionOnEdge);
      }

      projected1 = getProjectedPoint(edgeB.To, edgeA, interesectionPoint, intersectionOnEdge);

      if(projected1.X == double.MaxValue){
        projected1 = getProjectedPoint(edgeA.From, edgeB, interesectionPoint, intersectionOnEdge);
      }
    }
    public EdgePairSubpolylines getSubpolylines() {
      return new EdgePairSubpolylines(edgeA, edgeB, projected0, projected1);
    }


    private Point3d getProjectedPoint(Point3d point, Line opposingEdge, Point3d intPt, bool intersectionOnEdge){
      if(intPt.X != double.MaxValue){
        if(intersectionOnEdge){
          Vector3d vecPerpendicular = Vector3d.CrossProduct(opposingEdge.UnitTangent, Vector3d.ZAxis);
          Line perpendicularLine = new Line(intPt, vecPerpendicular);
          int orientationIndexOfPoint = OrientationOfPoint(perpendicularLine, point);
          double p = opposingEdge.ClosestParameter(intPt);
          if(p >= 0 && p <= 1){
            int orientationIndexOfStart = OrientationOfPoint(perpendicularLine, opposingEdge.From);

            if (orientationIndexOfPoint == orientationIndexOfStart) {
              // Start of opposingEdge is on the same side as the vertex (thus we shorten the segment discarding p1)
              opposingEdge = new Line(opposingEdge.From, intPt);

            } else {
              // End of opposingEdge is on the same side as the vertex (thus we shorten the segment discarding p0)
              opposingEdge = new Line(intPt, opposingEdge.To);
            }
          }
          else {
            // the intersection point is outside of the edge
            int orientationIndexOfEdge = OrientationOfPoint(perpendicularLine, opposingEdge.To);   // -1 or +1

            // TODO: need to handle edge pairs better
            //                    boolean vertexIsOnPerpendicularLine = orientationIndexOfVertex == 0;             // this is needed to handle cases when both edges are perpendicular to each other
            bool vertexIsOnPerpendicularLine = false;
            if (!vertexIsOnPerpendicularLine && orientationIndexOfPoint != orientationIndexOfEdge) {
              // projection of vertex is located somewhere on the opposite side of the intersection point (not on the edge)
              return new Point3d(double.MaxValue, double.MaxValue, double.MaxValue);

            }
            // otherwise it is on the same side - proceed as usual
          }
        }
        double distanceOfPoint = point.DistanceTo(intPt);


        double distOfOpEdgePoint1 = intPt.DistanceTo(opposingEdge.From);
        double distOfOpEdgePoint2 = intPt.DistanceTo(opposingEdge.To);
        if(distanceOfPoint >= Math.Max(distOfOpEdgePoint1, distOfOpEdgePoint2) || distanceOfPoint <= Math.Min(distOfOpEdgePoint1, distOfOpEdgePoint2))
        {
          return new Point3d(double.MaxValue, double.MaxValue, double.MaxValue);
        }

        Point3d furtherPoint = getFurtherEnd(intPt, opposingEdge);
        Line extendedOpposingEdge = new Line(intPt, furtherPoint);
        return extendedOpposingEdge.PointAt(distanceOfPoint / extendedOpposingEdge.Length);
      } else {
        // In case of parallel lines, we do not have an intersection point
        double p = opposingEdge.ClosestParameter(point);       // a projection onto opposingEdge (extending to infinity)
        if(p >= 0 && p <= 1){
          return opposingEdge.PointAt(p);
        }else
        {
          return new Point3d(double.MaxValue, double.MaxValue, double.MaxValue);
        }

      }
    }
    private int OrientationOfPoint(Line line, Point3d point){
      Point3d testPt;
      Plane pl = new Plane(line.From, line.UnitTangent, Vector3d.ZAxis);
      pl.RemapToPlaneSpace(point, out testPt);
      if(testPt.Z < 0)
        return -1;
      else if (testPt.Z > 0) return 1;
      else return 0;

    }
    public Point3d getFurtherEnd(Point3d point, Line line)
    {
      return point.DistanceTo(line.From) > point.DistanceTo(line.To) ? line.From : line.To;
    }


  }


  class EdgePairSubpolylines {
    private Line edgeA;
    private Line edgeB;

    private Polyline triangle1;
    private Polyline trapezoid;
    private Polyline triangle2;
    private double triangle1Area = 0;
    private double trapezoidArea = 0;
    private double triangle2Area = 0;

    public EdgePairSubpolylines(Line edgeA, Line edgeB, Point3d projected0, Point3d projected1){
      this.edgeA = edgeA;
      this.edgeB = edgeB;
      if(projected0.X != double.MaxValue){
        List<Point3d> pts = new List<Point3d>();
        pts.Add(edgeA.To);
        pts.Add(projected0);
        pts.Add(edgeB.From);
        pts.Add(edgeA.To);
        triangle1Area = CalculateTriangleArea(pts[0], pts[1], pts[2]);
        triangle1 = new Polyline(pts);
      }
      if(projected1.X != double.MaxValue){
        List<Point3d> pts = new List<Point3d>();
        pts.Add(edgeA.From);
        pts.Add(projected1);
        pts.Add(edgeB.To);
        pts.Add(edgeA.From);
        triangle2Area = CalculateTriangleArea(pts[0], pts[1], pts[2]);
        triangle2 = new Polyline(pts);
      }
      List<Point3d> ptsTrapezoid = new List<Point3d>();

      double tolerance = 0.0001;
      if(projected1.DistanceTo(edgeA.ClosestPoint(projected1, true)) < tolerance &&
      projected1.X != double.MaxValue){ptsTrapezoid.Add(projected1); }
      else ptsTrapezoid.Add(edgeA.From);
      if(projected0.DistanceTo(edgeA.ClosestPoint(projected0, true)) < tolerance &&
        projected0.X != double.MaxValue) ptsTrapezoid.Add(projected0);
      else ptsTrapezoid.Add(edgeA.To);
      if(projected0.DistanceTo(edgeB.ClosestPoint(projected0, true)) < tolerance &&
        projected0.X != double.MaxValue) ptsTrapezoid.Add(projected0);
      else ptsTrapezoid.Add(edgeB.From);
      if(projected1.DistanceTo(edgeB.ClosestPoint(projected1, true)) < tolerance &&
        projected1.X != double.MaxValue) ptsTrapezoid.Add(projected1);
      else ptsTrapezoid.Add(edgeB.To);
      ptsTrapezoid.Add(ptsTrapezoid[0]);
      trapezoidArea = CalculateTriangleArea(ptsTrapezoid[0], ptsTrapezoid[1], ptsTrapezoid[2]);
      trapezoidArea += CalculateTriangleArea(ptsTrapezoid[0], ptsTrapezoid[3], ptsTrapezoid[2]);

      trapezoid = new Polyline(ptsTrapezoid);
    }
    public Polyline getTriangle1(){
      return triangle1;
    }
    public Polyline getTriangle2(){
      return triangle2;
    }
    public Polyline getTrapezoid(){
      return trapezoid;
    }
    public double getTotalArea(){
      return triangle1Area + triangle2Area + trapezoidArea;
    }

    /// <summary>
    ///
    /// </summary>
    /// <param name="polyline"></param>
    /// <param name="singlePartArea"></param>
    /// <returns></returns>
    public List<Cut> getCuts(Polyline polyline, double singlePartArea){
      List<Cut> cuts = new List<Cut>();
      List<Line> segments = polyline.GetSegments().ToList();
      int indexOfEdgeA = 0;
      int indexOfEdgeB = 0;
      for(int i = 0; i < segments.Count;i++){
        if(edgeA.PointAt(0.5).DistanceTo(segments[i].PointAt(0.5)) < 0.001){
          indexOfEdgeA = i;
        }
        else if(edgeB.PointAt(0.5).DistanceTo(segments[i].PointAt(0.5)) < 0.001){
          indexOfEdgeB = i;
        }
      }

      int segmentsCovered = indexOfEdgeB - indexOfEdgeA + 1;// number of segments covered by a LineRing starting with edgeA and ending with edgeB (including)
      // Polygon's exterior ring is equal to [edgeA + segmentsBetweenEdgePair + edgeB + segmentsOutsideEdgePair]
      int segmentCountBetweenEdgePair = segmentsCovered - 2;
      int segmentCountOutsideEdgePair = segments.Count - segmentsCovered;
      // if edges are not connected directly, polygon has extra area adjacent to them
      Polyline polylineOutside1 = new Polyline();
      Polyline polylineOutside2 = new Polyline();

      if (segmentCountBetweenEdgePair > 1) {
        // calculate extra area bounded by segmentsBetweenEdgePair
        for(int i = 0; i < segmentCountBetweenEdgePair + 1; i++){
          int ptIdx = indexOfEdgeA + 1 + i;
          if(ptIdx >= segments.Count) ptIdx -= segments.Count;
          polylineOutside1.Add(polyline[ptIdx]);
        }
        polylineOutside1.Add(polylineOutside1[0]);
      }
      if (segmentCountOutsideEdgePair > 1) {
        // calculate extra area bounded by segmentCountOutsideEdgePair
        for(int i = 0; i < segmentCountOutsideEdgePair + 1; i++){
          int ptIdx = indexOfEdgeB + 1 + i;
          if(ptIdx >= segments.Count) ptIdx -= segments.Count;
          polylineOutside2.Add(polyline[ptIdx]);

        }
        polylineOutside2.Add(polylineOutside2[0]);
      }
      double areaOutside1 = 0, areaOutside2 = 0;
      if(polylineOutside1 != null && polylineOutside1.IsValid && polylineOutside1.Length > 0.01){
        AreaMassProperties amp = AreaMassProperties.Compute(polylineOutside1.ToNurbsCurve());
        if(amp != null) areaOutside1 = amp.Area;
      }
      if(polylineOutside2 != null && polylineOutside2.IsValid && polylineOutside2.Length > 0.01){
        AreaMassProperties amp = AreaMassProperties.Compute(polylineOutside2.ToNurbsCurve());
        if(amp != null) areaOutside2 = amp.Area;
      }

      // check first direction (areaOutside1 + T1 + Trapezoid + T2)
      if(areaOutside1 <= singlePartArea){

        Line lineOfCut = new Line();
        if(areaOutside1 + triangle1Area > singlePartArea){
          double areaToCutAwayInTriangle = singlePartArea - areaOutside1;
          double fraction = areaToCutAwayInTriangle / triangle1Area;
          if(triangle1 != null){
            Point3d projected0 = triangle1[1];
            Line edgeWithPointOfCut = (edgeA.ClosestPoint(projected0, true).DistanceTo(projected0) < 0.000001) ? new Line(edgeA.To, projected0) : new Line(edgeB.From, projected0);
            Point3d pointOfCut = edgeWithPointOfCut.PointAt(fraction);
            lineOfCut = (edgeA.ClosestPoint(pointOfCut, true).DistanceTo(pointOfCut) < 0.000001) ? new Line(edgeB.From, pointOfCut) : new Line(pointOfCut, edgeA.To);
          }

        }else if(areaOutside1 + triangle1Area + trapezoidArea >= singlePartArea){

          Line trapezoidOnEdgeA = trapezoid.SegmentAt(0);
          Line trapezoidOnEdgeB = trapezoid.SegmentAt(2);
          trapezoidOnEdgeA.Flip();
          double areaToCutAway = singlePartArea - (areaOutside1 + triangle1Area);
          double fraction = areaToCutAway / trapezoidArea;

          double ia, ib;
          if(Rhino.Geometry.Intersect.Intersection.LineLine(trapezoidOnEdgeA, trapezoidOnEdgeB, out ia, out ib))
          {

            Point3d intersectionPoint = trapezoidOnEdgeA.PointAt(ia);
            double wholeDistance = intersectionPoint.DistanceTo(trapezoidOnEdgeA.From);
            double distTo = intersectionPoint.DistanceTo(trapezoidOnEdgeA.To);
            bool flip = true;
            if(distTo > wholeDistance){ wholeDistance = distTo; flip = false; fraction = 1 - fraction;}
            fraction = splitFractionTrapezoid(trapezoidOnEdgeA.Length, wholeDistance, trapezoidOnEdgeA.UnitTangent, fraction);
            if(!flip) fraction = 1 - fraction;
          }

          Point3d pointOfCutOnEdgeA = trapezoidOnEdgeA.PointAt(fraction);
          Point3d pointOfCutOnEdgeB = trapezoidOnEdgeB.PointAt(fraction);
          lineOfCut = new Line(pointOfCutOnEdgeB, pointOfCutOnEdgeA);


        }else if(areaOutside1 + getTotalArea() >= singlePartArea){

          double areaToCutAwayInTriangle = singlePartArea - (areaOutside1 + triangle1Area + trapezoidArea);
          double fraction = areaToCutAwayInTriangle / triangle2Area;
          if(triangle1 != null){
            Point3d projected1 = triangle2[1];
            Line edgeWithPointOfCut = (edgeA.ClosestPoint(projected1, true).DistanceTo(projected1) < 0.000001) ? new Line(projected1, edgeA.From) : new Line(projected1, edgeB.To);
            Point3d pointOfCut = edgeWithPointOfCut.PointAt(fraction);
            lineOfCut = (edgeA.ClosestPoint(pointOfCut, true).DistanceTo(pointOfCut) < 0.000001) ? new Line(edgeB.To, pointOfCut) : new Line(pointOfCut, edgeA.From);
          }
        }

        Rhino.Geometry.Intersect.CurveIntersections ci = Rhino.Geometry.Intersect.Intersection.CurveLine(polyline.ToNurbsCurve(), lineOfCut, 0.001, 0.001);
        int intCount = 0;
        foreach(Rhino.Geometry.Intersect.IntersectionEvent ie in ci) if(ie.IsPoint)intCount++;
        if(lineOfCut != null && intCount <= 2){

          PolylineCurve polyCurve = polyline.ToPolylineCurve();
          double t0, t1;
          polyCurve.ClosestPoint(lineOfCut.To, out t0);
          polyCurve.ClosestPoint(lineOfCut.From, out t1);

          if(t0 != t1){

            Curve cutAway = polyCurve.Trim(new Interval(t0, t1));
            if(cutAway != null){
              Polyline plCutAway = cutAway.ToPolyline(0.000001, 0.000001, 0.001, 1000000).ToPolyline();
              plCutAway.Add(plCutAway[0]);
              plCutAway.ReduceSegments(0.000001);
              Curve cutRemain = polyCurve.Trim(new Interval(t1, t0));
              if(cutRemain != null){
                Polyline plCutRemain = cutRemain.ToPolyline(0.000001, 0.000001, 0.001, 1000000).ToPolyline();
                plCutRemain.Add(plCutRemain[0]);
                plCutRemain.ReduceSegments(0.000001);
                cuts.Add(new Cut(lineOfCut.Length, plCutAway, plCutRemain, lineOfCut.UnitTangent));
              }
            }
          }
        }
      }

      // check first direction (areaOutside1 + T1 + Trapezoid + T2)
      if(areaOutside2 <= singlePartArea){

        Line lineOfCut = new Line();
        if(areaOutside2 + triangle2Area > singlePartArea){
          double areaToCutAwayInTriangle = singlePartArea - areaOutside2;

          double fraction = areaToCutAwayInTriangle / triangle2Area;
          if(triangle2 != null){
            Point3d projected1 = triangle2[1];
            Line edgeWithPointOfCut = (edgeA.ClosestPoint(projected1, true).DistanceTo(projected1) < 0.000001) ? new Line(edgeA.From, projected1) : new Line(edgeB.To, projected1);
            Point3d pointOfCut = edgeWithPointOfCut.PointAt(fraction);
            lineOfCut = (edgeA.ClosestPoint(pointOfCut, true).DistanceTo(pointOfCut) < 0.000001) ? new Line(pointOfCut, edgeB.To) : new Line(edgeA.From, pointOfCut);
          }


        }else if(areaOutside2 + triangle2Area + trapezoidArea >= singlePartArea){

          Line trapezoidOnEdgeA = trapezoid.SegmentAt(0);
          Line trapezoidOnEdgeB = trapezoid.SegmentAt(2);
          trapezoidOnEdgeB.Flip();

          double areaToCutAway = singlePartArea - (areaOutside2 + triangle2Area);
          double fraction = areaToCutAway / trapezoidArea;
          double ia, ib;
          if(Rhino.Geometry.Intersect.Intersection.LineLine(trapezoidOnEdgeA, trapezoidOnEdgeB, out ia, out ib))
          {

            Point3d intersectionPoint = trapezoidOnEdgeA.PointAt(ia);
            double wholeDistance = intersectionPoint.DistanceTo(trapezoidOnEdgeA.From);
            double distTo = intersectionPoint.DistanceTo(trapezoidOnEdgeA.To);
            bool flip = true;
            if(distTo > wholeDistance){ wholeDistance = distTo; flip = false; fraction = 1 - fraction;}
            fraction = splitFractionTrapezoid(trapezoidOnEdgeA.Length, wholeDistance, trapezoidOnEdgeA.UnitTangent, fraction);
            if(!flip) fraction = 1 - fraction;
          }

          Point3d pointOfCutOnEdgeA = trapezoidOnEdgeA.PointAt(fraction);
          Point3d pointOfCutOnEdgeB = trapezoidOnEdgeB.PointAt(fraction);
          lineOfCut = new Line(pointOfCutOnEdgeA, pointOfCutOnEdgeB);

        }else if(areaOutside2 + getTotalArea() >= singlePartArea){

          double areaToCutAwayInTriangle = singlePartArea - (areaOutside2 + triangle2Area + trapezoidArea);
          double fraction = areaToCutAwayInTriangle / triangle1Area;
          if(triangle1 != null){
            Point3d projected0 = triangle1[1];
            Line edgeWithPointOfCut = (edgeA.ClosestPoint(projected0, true).DistanceTo(projected0) < 0.000001) ? new Line(projected0, edgeA.To) : new Line(projected0, edgeB.From);
            Point3d pointOfCut = edgeWithPointOfCut.PointAt(fraction);
            lineOfCut = (edgeA.ClosestPoint(pointOfCut, true).DistanceTo(pointOfCut) < 0.000001) ? new Line(pointOfCut, edgeB.From) : new Line(edgeA.To, pointOfCut);
          }
        }
        Rhino.Geometry.Intersect.CurveIntersections ci = Rhino.Geometry.Intersect.Intersection.CurveLine(polyline.ToNurbsCurve(), lineOfCut, 0.001, 0.001);
        int intCount = 0;
        foreach(Rhino.Geometry.Intersect.IntersectionEvent ie in ci) if(ie.IsPoint)intCount++;
        if(lineOfCut != null && intCount <= 2){
          PolylineCurve polyCurve = polyline.ToPolylineCurve();
          double t0, t1;
          polyCurve.ClosestPoint(lineOfCut.To, out t0);
          polyCurve.ClosestPoint(lineOfCut.From, out t1);

          if(t0 != t1){

            Curve cutAway = polyCurve.Trim(new Interval(t0, t1));
            if(cutAway != null){
              Polyline plCutAway = cutAway.ToPolyline(0.000001, 0.000001, 0.001, 1000000).ToPolyline();
              plCutAway.Add(plCutAway[0]);
              plCutAway.ReduceSegments(0.000001);
              Curve cutRemain = polyCurve.Trim(new Interval(t1, t0));
              if(cutRemain != null){
                Polyline plCutRemain = cutRemain.ToPolyline(0.000001, 0.000001, 0.001, 1000000).ToPolyline();
                plCutRemain.Add(plCutRemain[0]);
                plCutRemain.ReduceSegments(0.000001);
                cuts.Add(new Cut(lineOfCut.Length, plCutAway, plCutRemain, lineOfCut.UnitTangent));
              }
            }
          }
        }
      }


      return cuts;


    }

    public double splitFractionTrapezoid(double distance, double wholeDistance, Vector3d dir, double fraction){
      dir.Unitize();
      double remainingDistance = wholeDistance - distance;
      Vector3d rotateVec = dir * remainingDistance;
      rotateVec.Rotate(Math.Acos(remainingDistance / wholeDistance), Vector3d.ZAxis);
      double projectedDistance = Math.Abs(Vector3d.Multiply(rotateVec, dir));
      double ankathete = wholeDistance - (fraction * (wholeDistance - projectedDistance));
      double gegenkathete = Math.Sqrt(Math.Pow(wholeDistance / 2.0, 2) - Math.Pow((wholeDistance / 2.0 - ankathete), 2));
      double hypothenuse = Math.Sqrt(Math.Pow(ankathete, 2) + Math.Pow((gegenkathete), 2));

      return (wholeDistance - hypothenuse) / distance;

    }
    private double CalculateTriangleArea(Point3d pt0, Point3d pt1, Point3d pt2){
      return Math.Abs(Vector3d.CrossProduct(new Vector3d(pt0 - pt2), new Vector3d(pt1 - pt2)).Length / 2);

    }
  }
# ---------- end arealistgreedy ----------
curve_3 = Curve(arealistgreedy.A)

# ----
# Cuts into equal segments. Cuts are chosen by Vector Direction.
# Simplified approach to get the vector of a polygon pointing away from longest line.
number_slider_2 = Slider(5, range=0..10)
curve_4 = Curve(stream_gate.Target1)
rebuild_curve = RebuildCurve(Curve=curve_4, Count=Slider(2, range=0..10), Tangents=False)
explode = Explode(Curve=rebuild_curve, Recursive=True)  # -> Segments, Vertices
length = Length(Curve=explode.Segments)
sort_list = SortList(Keys=length, ValuesValuesA=explode.Segments)  # -> Keys, reverse(ValuesValuesA)
unit_z = UnitZ(Factor=1)
list_item = ListItem(List=sort_list.ValuesValuesA, Index=0, Wrap=True)
cross_product = CrossProduct(VectorA=list_item, VectorB=unit_z, Unitize=False)  # -> flatten(Vector), Length
equalareavector = CSharpScript(pl=curve_4, n=number_slider_2, dir=cross_product.Vector)  # -> out, A; inputs pl: Polyline, n: Int32, dir: Vector3d
# ---------- equalareavector: C# ----------
    
       /**
   * Polygon Splitting by Area developed by Martin Dennemark at Bauhaus University Weimar, DecodingSpaces & Form Follows You
   * Greatly based on Gediminas Rimša polyline split algorithm
   * https://github.com/grimsa/polysplit
   * which is derived from Sumit Khetarpal http://www.khetarpal.org/polygon-splitting/
   * Licensed under the MIT license.
   */
  
    if(!pl.IsClosed || !pl.IsValid){
      Print("Polyline is not valid");
    }
    if(n < 2){
      Print("Number of parts should be greater than 1!");
    }
    AreaMassProperties amp = AreaMassProperties.Compute(pl.ToNurbsCurve());
    double singlePartArea = amp.Area / (double) n;
    List<Polyline> polylineParts = new List<Polyline>();
    Polyline remainingPoly = pl;
    for(int i = 0; i < n - 1; i++){
      remainingPoly = split(remainingPoly, polylineParts, singlePartArea, dir);
    }
    polylineParts.Add(remainingPoly);
    A = polylineParts;
# ---------- equalareavector: C# additional code ----------
  public Polyline split(Polyline polyline, List<Polyline> resultList, double singlePartArea, Vector3d dir){
    List<Line> segments = polyline.GetSegments().ToList();
    List<Cut> possibleCuts = new List<Cut>();
    AreaMassProperties amp = AreaMassProperties.Compute(polyline.ToNurbsCurve());

    for(int i = 0; i < segments.Count() - 2; i++){
      for(int j = i + 2; j < segments.Count();j++){
        int segmentsCovered = j - i + 1;
        if(segments.Count() == segmentsCovered){
          break;
        }
        Line edgeA = segments[i];
        Line edgeB = segments[j];

        EdgePair edgePair = new EdgePair(edgeA, edgeB);
        EdgePairSubpolylines subpolyline = edgePair.getSubpolylines();
        List<Cut> cutForCurrentEdgePair = subpolyline.getCuts(polyline, singlePartArea);
        possibleCuts.AddRange(cutForCurrentEdgePair);
      }
    }

    if(possibleCuts.Count > 0){
      Cut shortestCut = possibleCuts.Aggregate((minItem, nextItem) => Vector3d.VectorAngle(minItem.getCutDirection(), dir) < Vector3d.VectorAngle(nextItem.getCutDirection(), dir) ? minItem : nextItem);
      resultList.Add(shortestCut.getCutAway());

      return shortestCut.getCutRemain();}
    else return polyline;
  }
  public class Cut{
    private double length;
    private Polyline cutAway;
    private Polyline cutRemain;
    private Vector3d cutDirection;

    public Cut(double lengthOfCut, Polyline cutAway, Polyline cutRemain, Vector3d cutDirection){
      this.length = lengthOfCut;
      this.cutAway = cutAway;
      this.cutRemain = cutRemain;
      this.cutDirection = cutDirection;
    }

    public double getLength(){
      return length;
    }
    public Polyline getCutAway(){
      return cutAway;
    }
    public Polyline getCutRemain(){
      return cutRemain;
    }
    public Vector3d getCutDirection(){
      return cutDirection;
    }

  }

 /**
 * Represents a pair of edges on polygon's exterior ring.
 * Warning: direction of edges is assumed to be the same as in the polygon's exterior ring.
 *
 * Possible lines of cut are located in one of:
 *
 * T1 - First triangle, may not exist in some cases
 * Trapezoid - Trapezoid, always present
 * T2 - Second triangle, may not exist in some cases
 *
 *
 *                                edgeA
 *            edgeA.p0 .____________________________. edgeA.p1
 *                    /|                            |\
 *                   /                                \
 *   outsideEdge2   /  |                            |  \   outsideEdge1
 *                 /                                    \
 *                / T2 |        Trapezoid           | T1 \
 *               /                                        \
 *              .______.____________________________|______.
 *        edgeB.p1                edgeB                    edgeB.p0
 *                     ^                            ^
 *                 projected1                  projected0
 *
 */

  class EdgePair{

    private Line edgeA;
    private Line edgeB;

    private Point3d projected0;
    private Point3d projected1;

    public EdgePair(Line edgeA, Line edgeB){

      double ia, ib;
      Point3d interesectionPoint = new Point3d(double.MaxValue, double.MaxValue, double.MaxValue);
      if(Rhino.Geometry.Intersect.Intersection.LineLine(edgeA, edgeB, out ia, out ib))
        interesectionPoint = edgeA.PointAt(ia);
      bool intersectionOnEdge = false;
      if(ia >= 0 && ia <= 1) intersectionOnEdge = true;
      if(ib >= 0 && ib <= 1) intersectionOnEdge = true;

      this.edgeA = edgeA;
      this.edgeB = edgeB;

      projected0 = getProjectedPoint(edgeA.To, edgeB, interesectionPoint, intersectionOnEdge);
      if(projected0.X == double.MaxValue){
        projected0 = getProjectedPoint(edgeB.From, edgeA, interesectionPoint, intersectionOnEdge);
      }

      projected1 = getProjectedPoint(edgeB.To, edgeA, interesectionPoint, intersectionOnEdge);

      if(projected1.X == double.MaxValue){
        projected1 = getProjectedPoint(edgeA.From, edgeB, interesectionPoint, intersectionOnEdge);
      }
    }
    public EdgePairSubpolylines getSubpolylines() {
      return new EdgePairSubpolylines(edgeA, edgeB, projected0, projected1);
    }


    private Point3d getProjectedPoint(Point3d point, Line opposingEdge, Point3d intPt, bool intersectionOnEdge){
      if(intPt.X != double.MaxValue){
        if(intersectionOnEdge){
          Vector3d vecPerpendicular = Vector3d.CrossProduct(opposingEdge.UnitTangent, Vector3d.ZAxis);
          Line perpendicularLine = new Line(intPt, vecPerpendicular);
          int orientationIndexOfPoint = OrientationOfPoint(perpendicularLine, point);
          double p = opposingEdge.ClosestParameter(intPt);
          if(p >= 0 && p <= 1){
            int orientationIndexOfStart = OrientationOfPoint(perpendicularLine, opposingEdge.From);

            if (orientationIndexOfPoint == orientationIndexOfStart) {
              // Start of opposingEdge is on the same side as the vertex (thus we shorten the segment discarding p1)
              opposingEdge = new Line(opposingEdge.From, intPt);

            } else {
              // End of opposingEdge is on the same side as the vertex (thus we shorten the segment discarding p0)
              opposingEdge = new Line(intPt, opposingEdge.To);
            }
          }
          else {
            // the intersection point is outside of the edge
            int orientationIndexOfEdge = OrientationOfPoint(perpendicularLine, opposingEdge.To);   // -1 or +1

            // TODO: need to handle edge pairs better
            //                    boolean vertexIsOnPerpendicularLine = orientationIndexOfVertex == 0;             // this is needed to handle cases when both edges are perpendicular to each other
            bool vertexIsOnPerpendicularLine = false;
            if (!vertexIsOnPerpendicularLine && orientationIndexOfPoint != orientationIndexOfEdge) {
              // projection of vertex is located somewhere on the opposite side of the intersection point (not on the edge)
              return new Point3d(double.MaxValue, double.MaxValue, double.MaxValue);

            }
            // otherwise it is on the same side - proceed as usual
          }
        }
        double distanceOfPoint = point.DistanceTo(intPt);


        double distOfOpEdgePoint1 = intPt.DistanceTo(opposingEdge.From);
        double distOfOpEdgePoint2 = intPt.DistanceTo(opposingEdge.To);
        if(distanceOfPoint >= Math.Max(distOfOpEdgePoint1, distOfOpEdgePoint2) || distanceOfPoint <= Math.Min(distOfOpEdgePoint1, distOfOpEdgePoint2))
        {
          return new Point3d(double.MaxValue, double.MaxValue, double.MaxValue);
        }

        Point3d furtherPoint = getFurtherEnd(intPt, opposingEdge);
        Line extendedOpposingEdge = new Line(intPt, furtherPoint);
        return extendedOpposingEdge.PointAt(distanceOfPoint / extendedOpposingEdge.Length);
      } else {
        // In case of parallel lines, we do not have an intersection point
        double p = opposingEdge.ClosestParameter(point);       // a projection onto opposingEdge (extending to infinity)
        if(p >= 0 && p <= 1){
          return opposingEdge.PointAt(p);
        }else
        {
          return new Point3d(double.MaxValue, double.MaxValue, double.MaxValue);
        }

      }
    }
    private int OrientationOfPoint(Line line, Point3d point){
      Point3d testPt;
      Plane pl = new Plane(line.From, line.UnitTangent, Vector3d.ZAxis);
      pl.RemapToPlaneSpace(point, out testPt);
      if(testPt.Z < 0)
        return -1;
      else if (testPt.Z > 0) return 1;
      else return 0;

    }
    public Point3d getFurtherEnd(Point3d point, Line line)
    {
      return point.DistanceTo(line.From) > point.DistanceTo(line.To) ? line.From : line.To;
    }


  }


  class EdgePairSubpolylines {
    private Line edgeA;
    private Line edgeB;

    private Polyline triangle1;
    private Polyline trapezoid;
    private Polyline triangle2;
    private double triangle1Area = 0;
    private double trapezoidArea = 0;
    private double triangle2Area = 0;

    public EdgePairSubpolylines(Line edgeA, Line edgeB, Point3d projected0, Point3d projected1){
      this.edgeA = edgeA;
      this.edgeB = edgeB;
      if(projected0.X != double.MaxValue){
        List<Point3d> pts = new List<Point3d>();
        pts.Add(edgeA.To);
        pts.Add(projected0);
        pts.Add(edgeB.From);
        pts.Add(edgeA.To);
        triangle1Area = CalculateTriangleArea(pts[0], pts[1], pts[2]);
        triangle1 = new Polyline(pts);
      }
      if(projected1.X != double.MaxValue){
        List<Point3d> pts = new List<Point3d>();
        pts.Add(edgeA.From);
        pts.Add(projected1);
        pts.Add(edgeB.To);
        pts.Add(edgeA.From);
        triangle2Area = CalculateTriangleArea(pts[0], pts[1], pts[2]);
        triangle2 = new Polyline(pts);
      }
      List<Point3d> ptsTrapezoid = new List<Point3d>();

      double tolerance = 0.0001;
      if(projected1.DistanceTo(edgeA.ClosestPoint(projected1, true)) < tolerance &&
      projected1.X != double.MaxValue){ptsTrapezoid.Add(projected1); }
      else ptsTrapezoid.Add(edgeA.From);
      if(projected0.DistanceTo(edgeA.ClosestPoint(projected0, true)) < tolerance &&
        projected0.X != double.MaxValue) ptsTrapezoid.Add(projected0);
      else ptsTrapezoid.Add(edgeA.To);
      if(projected0.DistanceTo(edgeB.ClosestPoint(projected0, true)) < tolerance &&
        projected0.X != double.MaxValue) ptsTrapezoid.Add(projected0);
      else ptsTrapezoid.Add(edgeB.From);
      if(projected1.DistanceTo(edgeB.ClosestPoint(projected1, true)) < tolerance &&
        projected1.X != double.MaxValue) ptsTrapezoid.Add(projected1);
      else ptsTrapezoid.Add(edgeB.To);
      ptsTrapezoid.Add(ptsTrapezoid[0]);
      trapezoidArea = CalculateTriangleArea(ptsTrapezoid[0], ptsTrapezoid[1], ptsTrapezoid[2]);
      trapezoidArea += CalculateTriangleArea(ptsTrapezoid[0], ptsTrapezoid[3], ptsTrapezoid[2]);

      trapezoid = new Polyline(ptsTrapezoid);
    }
    public Polyline getTriangle1(){
      return triangle1;
    }
    public Polyline getTriangle2(){
      return triangle2;
    }
    public Polyline getTrapezoid(){
      return trapezoid;
    }
    public double getTotalArea(){
      return triangle1Area + triangle2Area + trapezoidArea;
    }

    /// <summary>
    ///
    /// </summary>
    /// <param name="polyline"></param>
    /// <param name="singlePartArea"></param>
    /// <returns></returns>
    public List<Cut> getCuts(Polyline polyline, double singlePartArea){
      List<Cut> cuts = new List<Cut>();
      List<Line> segments = polyline.GetSegments().ToList();
      int indexOfEdgeA = 0;
      int indexOfEdgeB = 0;
      for(int i = 0; i < segments.Count;i++){
        if(edgeA.PointAt(0.5).DistanceTo(segments[i].PointAt(0.5)) < 0.001){
          indexOfEdgeA = i;
        }
        else if(edgeB.PointAt(0.5).DistanceTo(segments[i].PointAt(0.5)) < 0.001){
          indexOfEdgeB = i;
        }
      }

      int segmentsCovered = indexOfEdgeB - indexOfEdgeA + 1;// number of segments covered by a LineRing starting with edgeA and ending with edgeB (including)
      // Polygon's exterior ring is equal to [edgeA + segmentsBetweenEdgePair + edgeB + segmentsOutsideEdgePair]
      int segmentCountBetweenEdgePair = segmentsCovered - 2;
      int segmentCountOutsideEdgePair = segments.Count - segmentsCovered;
      // if edges are not connected directly, polygon has extra area adjacent to them
      Polyline polylineOutside1 = new Polyline();
      Polyline polylineOutside2 = new Polyline();

      if (segmentCountBetweenEdgePair > 1) {
        // calculate extra area bounded by segmentsBetweenEdgePair
        for(int i = 0; i < segmentCountBetweenEdgePair + 1; i++){
          int ptIdx = indexOfEdgeA + 1 + i;
          if(ptIdx >= segments.Count) ptIdx -= segments.Count;
          polylineOutside1.Add(polyline[ptIdx]);
        }
        polylineOutside1.Add(polylineOutside1[0]);
      }
      if (segmentCountOutsideEdgePair > 1) {
        // calculate extra area bounded by segmentCountOutsideEdgePair
        for(int i = 0; i < segmentCountOutsideEdgePair + 1; i++){
          int ptIdx = indexOfEdgeB + 1 + i;
          if(ptIdx >= segments.Count) ptIdx -= segments.Count;
          polylineOutside2.Add(polyline[ptIdx]);

        }
        polylineOutside2.Add(polylineOutside2[0]);
      }
      double areaOutside1 = 0, areaOutside2 = 0;
      if(polylineOutside1 != null && polylineOutside1.IsValid && polylineOutside1.Length > 0.01){
        AreaMassProperties amp = AreaMassProperties.Compute(polylineOutside1.ToNurbsCurve());
        if(amp != null) areaOutside1 = amp.Area;
      }
      if(polylineOutside2 != null && polylineOutside2.IsValid && polylineOutside2.Length > 0.01){
        AreaMassProperties amp = AreaMassProperties.Compute(polylineOutside2.ToNurbsCurve());
        if(amp != null) areaOutside2 = amp.Area;
      }

      // check first direction (areaOutside1 + T1 + Trapezoid + T2)
      if(areaOutside1 <= singlePartArea){

        Line lineOfCut = new Line();
        if(areaOutside1 + triangle1Area > singlePartArea){
          double areaToCutAwayInTriangle = singlePartArea - areaOutside1;
          double fraction = areaToCutAwayInTriangle / triangle1Area;
          if(triangle1 != null){
            Point3d projected0 = triangle1[1];
            Line edgeWithPointOfCut = (edgeA.ClosestPoint(projected0, true).DistanceTo(projected0) < 0.000001) ? new Line(edgeA.To, projected0) : new Line(edgeB.From, projected0);
            Point3d pointOfCut = edgeWithPointOfCut.PointAt(fraction);
            lineOfCut = (edgeA.ClosestPoint(pointOfCut, true).DistanceTo(pointOfCut) < 0.000001) ? new Line(edgeB.From, pointOfCut) : new Line(pointOfCut, edgeA.To);
          }

        }else if(areaOutside1 + triangle1Area + trapezoidArea >= singlePartArea){

          Line trapezoidOnEdgeA = trapezoid.SegmentAt(0);
          Line trapezoidOnEdgeB = trapezoid.SegmentAt(2);
          trapezoidOnEdgeA.Flip();
          double areaToCutAway = singlePartArea - (areaOutside1 + triangle1Area);
          double fraction = areaToCutAway / trapezoidArea;

          double ia, ib;
          if(Rhino.Geometry.Intersect.Intersection.LineLine(trapezoidOnEdgeA, trapezoidOnEdgeB, out ia, out ib))
          {

            Point3d intersectionPoint = trapezoidOnEdgeA.PointAt(ia);
            double wholeDistance = intersectionPoint.DistanceTo(trapezoidOnEdgeA.From);
            double distTo = intersectionPoint.DistanceTo(trapezoidOnEdgeA.To);
            bool flip = true;
            if(distTo > wholeDistance){ wholeDistance = distTo; flip = false; fraction = 1 - fraction;}
            fraction = splitFractionTrapezoid(trapezoidOnEdgeA.Length, wholeDistance, trapezoidOnEdgeA.UnitTangent, fraction);
            if(!flip) fraction = 1 - fraction;
          }

          Point3d pointOfCutOnEdgeA = trapezoidOnEdgeA.PointAt(fraction);
          Point3d pointOfCutOnEdgeB = trapezoidOnEdgeB.PointAt(fraction);
          lineOfCut = new Line(pointOfCutOnEdgeB, pointOfCutOnEdgeA);


        }else if(areaOutside1 + getTotalArea() >= singlePartArea){

          double areaToCutAwayInTriangle = singlePartArea - (areaOutside1 + triangle1Area + trapezoidArea);
          double fraction = areaToCutAwayInTriangle / triangle2Area;
          if(triangle1 != null){
            Point3d projected1 = triangle2[1];
            Line edgeWithPointOfCut = (edgeA.ClosestPoint(projected1, true).DistanceTo(projected1) < 0.000001) ? new Line(projected1, edgeA.From) : new Line(projected1, edgeB.To);
            Point3d pointOfCut = edgeWithPointOfCut.PointAt(fraction);
            lineOfCut = (edgeA.ClosestPoint(pointOfCut, true).DistanceTo(pointOfCut) < 0.000001) ? new Line(edgeB.To, pointOfCut) : new Line(pointOfCut, edgeA.From);
          }
        }

        Rhino.Geometry.Intersect.CurveIntersections ci = Rhino.Geometry.Intersect.Intersection.CurveLine(polyline.ToNurbsCurve(), lineOfCut, 0.001, 0.001);
        int intCount = 0;
        foreach(Rhino.Geometry.Intersect.IntersectionEvent ie in ci) if(ie.IsPoint)intCount++;
        if(lineOfCut != null && intCount <= 2){

          PolylineCurve polyCurve = polyline.ToPolylineCurve();
          double t0, t1;
          polyCurve.ClosestPoint(lineOfCut.To, out t0);
          polyCurve.ClosestPoint(lineOfCut.From, out t1);

          if(t0 != t1){

            Curve cutAway = polyCurve.Trim(new Interval(t0, t1));
            if(cutAway != null){
              Polyline plCutAway = cutAway.ToPolyline(0.000001, 0.000001, 0.001, 1000000).ToPolyline();
              plCutAway.Add(plCutAway[0]);
              plCutAway.ReduceSegments(0.000001);

              Curve cutRemain = polyCurve.Trim(new Interval(t1, t0));
              Polyline plCutRemain = cutRemain.ToPolyline(0.000001, 0.000001, 0.001, 1000000).ToPolyline();
              plCutRemain.Add(plCutRemain[0]);
              plCutRemain.ReduceSegments(0.000001);
              cuts.Add(new Cut(lineOfCut.Length, plCutAway, plCutRemain, lineOfCut.UnitTangent));
            }
          }
        }
      }

      // check first direction (areaOutside1 + T1 + Trapezoid + T2)
      if(areaOutside2 <= singlePartArea){

        Line lineOfCut = new Line();
        if(areaOutside2 + triangle2Area > singlePartArea){
          double areaToCutAwayInTriangle = singlePartArea - areaOutside2;

          double fraction = areaToCutAwayInTriangle / triangle2Area;
          if(triangle2 != null){
            Point3d projected1 = triangle2[1];
            Line edgeWithPointOfCut = (edgeA.ClosestPoint(projected1, true).DistanceTo(projected1) < 0.000001) ? new Line(edgeA.From, projected1) : new Line(edgeB.To, projected1);
            Point3d pointOfCut = edgeWithPointOfCut.PointAt(fraction);
            lineOfCut = (edgeA.ClosestPoint(pointOfCut, true).DistanceTo(pointOfCut) < 0.000001) ? new Line(pointOfCut, edgeB.To) : new Line(edgeA.From, pointOfCut);
          }


        }else if(areaOutside2 + triangle2Area + trapezoidArea >= singlePartArea){

          Line trapezoidOnEdgeA = trapezoid.SegmentAt(0);
          Line trapezoidOnEdgeB = trapezoid.SegmentAt(2);
          trapezoidOnEdgeB.Flip();

          double areaToCutAway = singlePartArea - (areaOutside2 + triangle2Area);
          double fraction = areaToCutAway / trapezoidArea;
          double ia, ib;
          if(Rhino.Geometry.Intersect.Intersection.LineLine(trapezoidOnEdgeA, trapezoidOnEdgeB, out ia, out ib))
          {

            Point3d intersectionPoint = trapezoidOnEdgeA.PointAt(ia);
            double wholeDistance = intersectionPoint.DistanceTo(trapezoidOnEdgeA.From);
            double distTo = intersectionPoint.DistanceTo(trapezoidOnEdgeA.To);
            bool flip = true;
            if(distTo > wholeDistance){ wholeDistance = distTo; flip = false; fraction = 1 - fraction;}
            fraction = splitFractionTrapezoid(trapezoidOnEdgeA.Length, wholeDistance, trapezoidOnEdgeA.UnitTangent, fraction);
            if(!flip) fraction = 1 - fraction;
          }

          Point3d pointOfCutOnEdgeA = trapezoidOnEdgeA.PointAt(fraction);
          Point3d pointOfCutOnEdgeB = trapezoidOnEdgeB.PointAt(fraction);
          lineOfCut = new Line(pointOfCutOnEdgeA, pointOfCutOnEdgeB);

        }else if(areaOutside2 + getTotalArea() >= singlePartArea){

          double areaToCutAwayInTriangle = singlePartArea - (areaOutside2 + triangle2Area + trapezoidArea);
          double fraction = areaToCutAwayInTriangle / triangle1Area;
          if(triangle1 != null){
            Point3d projected0 = triangle1[1];
            Line edgeWithPointOfCut = (edgeA.ClosestPoint(projected0, true).DistanceTo(projected0) < 0.000001) ? new Line(projected0, edgeA.To) : new Line(projected0, edgeB.From);
            Point3d pointOfCut = edgeWithPointOfCut.PointAt(fraction);
            lineOfCut = (edgeA.ClosestPoint(pointOfCut, true).DistanceTo(pointOfCut) < 0.000001) ? new Line(pointOfCut, edgeB.From) : new Line(edgeA.To, pointOfCut);
          }
        }
        Rhino.Geometry.Intersect.CurveIntersections ci = Rhino.Geometry.Intersect.Intersection.CurveLine(polyline.ToNurbsCurve(), lineOfCut, 0.001, 0.001);
        int intCount = 0;
        foreach(Rhino.Geometry.Intersect.IntersectionEvent ie in ci) if(ie.IsPoint)intCount++;
        if(lineOfCut != null && intCount <= 2){
          PolylineCurve polyCurve = polyline.ToPolylineCurve();
          double t0, t1;
          polyCurve.ClosestPoint(lineOfCut.To, out t0);
          polyCurve.ClosestPoint(lineOfCut.From, out t1);

          if(t0 != t1){

            Curve cutAway = polyCurve.Trim(new Interval(t0, t1));
            if(cutAway != null){
              Polyline plCutAway = cutAway.ToPolyline(0.000001, 0.000001, 0.001, 1000000).ToPolyline();
              plCutAway.Add(plCutAway[0]);
              plCutAway.ReduceSegments(0.000001);
              Curve cutRemain = polyCurve.Trim(new Interval(t1, t0));
              Polyline plCutRemain = cutRemain.ToPolyline(0.000001, 0.000001, 0.001, 1000000).ToPolyline();
              plCutRemain.Add(plCutRemain[0]);
              plCutRemain.ReduceSegments(0.000001);
              cuts.Add(new Cut(lineOfCut.Length, plCutAway, plCutRemain, lineOfCut.UnitTangent));
            }
          }
        }
      }


      return cuts;


    }

    public double splitFractionTrapezoid(double distance, double wholeDistance, Vector3d dir, double fraction){
      dir.Unitize();
      double remainingDistance = wholeDistance - distance;
      Vector3d rotateVec = dir * remainingDistance;
      rotateVec.Rotate(Math.Acos(remainingDistance / wholeDistance), Vector3d.ZAxis);
      double projectedDistance = Math.Abs(Vector3d.Multiply(rotateVec, dir));
      double ankathete = wholeDistance - (fraction * (wholeDistance - projectedDistance));
      double gegenkathete = Math.Sqrt(Math.Pow(wholeDistance / 2.0, 2) - Math.Pow((wholeDistance / 2.0 - ankathete), 2));
      double hypothenuse = Math.Sqrt(Math.Pow(ankathete, 2) + Math.Pow((gegenkathete), 2));

      return (wholeDistance - hypothenuse) / distance;

    }
    private double CalculateTriangleArea(Point3d pt0, Point3d pt1, Point3d pt2){
      return Math.Abs(Vector3d.CrossProduct(new Vector3d(pt0 - pt2), new Vector3d(pt1 - pt2)).Length / 2);

    }
  }
# ---------- end equalareavector ----------
curve_5 = Curve(equalareavector.A)

# ----
# Cuts into equal segments. Cuts are chosen by minimal distance.
curve_6 = Curve(stream_gate.Target0)
equalareagreedy = CSharpScript(pl=curve_6, n=Slider(5, range=0..10))  # -> out, simplify(A); inputs pl: Polyline, n: Int32
# ---------- equalareagreedy: C# ----------
   /**
   * Polygon Splitting by Area developed by Martin Dennemark at Bauhaus University Weimar, DecodingSpaces & Form Follows You
   * Greatly based on Gediminas Rimša polyline split algorithm
   * https://github.com/grimsa/polysplit
   * which is derived from Sumit Khetarpal http://www.khetarpal.org/polygon-splitting/
   * Licensed under the MIT license.
   */
  
  
    if(!pl.IsClosed || !pl.IsValid){
      Print("Polyline is not valid");
    }
    if(n < 2){
      Print("Number of parts should be greater than 1!");
    }
    AreaMassProperties amp = AreaMassProperties.Compute(pl.ToNurbsCurve());
    double singlePartArea = amp.Area / (double) n;
    List<Polyline> polylineParts = new List<Polyline>();
    Polyline remainingPoly = pl;
    for(int i = 0; i < n - 1; i++){
      remainingPoly = split(remainingPoly, polylineParts, singlePartArea);
    }
    polylineParts.Add(remainingPoly);
    A = polylineParts;
# ---------- equalareagreedy: C# additional code ----------
  public Polyline split(Polyline polyline, List<Polyline> resultList, double singlePartArea){
    List<Line> segments = polyline.GetSegments().ToList();
    List<Cut> possibleCuts = new List<Cut>();
    AreaMassProperties amp = AreaMassProperties.Compute(polyline.ToNurbsCurve());

    for(int i = 0; i < segments.Count() - 2; i++){
      for(int j = i + 2; j < segments.Count();j++){
        int segmentsCovered = j - i + 1;
        if(segments.Count() == segmentsCovered){
          break;
        }
        Line edgeA = segments[i];
        Line edgeB = segments[j];

        EdgePair edgePair = new EdgePair(edgeA, edgeB);
        EdgePairSubpolylines subpolyline = edgePair.getSubpolylines();
        List<Cut> cutForCurrentEdgePair = subpolyline.getCuts(polyline, singlePartArea);
        possibleCuts.AddRange(cutForCurrentEdgePair);
      }
    }

    if(possibleCuts.Count > 0){
      Cut shortestCut = possibleCuts.Aggregate((minItem, nextItem) => minItem.getLength() < nextItem.getLength() ? minItem : nextItem);
      resultList.Add(shortestCut.getCutAway());

      return shortestCut.getCutRemain();}
    else return polyline;
  }
  public class Cut{
    private double length;
    private Polyline cutAway;
    private Polyline cutRemain;

    public Cut(double lengthOfCut, Polyline cutAway, Polyline cutRemain){
      this.length = lengthOfCut;
      this.cutAway = cutAway;
      this.cutRemain = cutRemain;
    }

    public double getLength(){
      return length;
    }
    public Polyline getCutAway(){
      return cutAway;
    }
    public Polyline getCutRemain(){
      return cutRemain;
    }

  }

 /**
 * Represents a pair of edges on polygon's exterior ring.
 * Warning: direction of edges is assumed to be the same as in the polygon's exterior ring.
 *
 * Possible lines of cut are located in one of:
 *
 * T1 - First triangle, may not exist in some cases
 * Trapezoid - Trapezoid, always present
 * T2 - Second triangle, may not exist in some cases
 *
 *
 *                                edgeA
 *            edgeA.p0 .____________________________. edgeA.p1
 *                    /|                            |\
 *                   /                                \
 *   outsideEdge2   /  |                            |  \   outsideEdge1
 *                 /                                    \
 *                / T2 |        Trapezoid           | T1 \
 *               /                                        \
 *              .______.____________________________|______.
 *        edgeB.p1                edgeB                    edgeB.p0
 *                     ^                            ^
 *                 projected1                  projected0
 *
 */

  class EdgePair{

    private Line edgeA;
    private Line edgeB;

    private Point3d projected0;
    private Point3d projected1;

    public EdgePair(Line edgeA, Line edgeB){

      double ia, ib;
      Point3d interesectionPoint = new Point3d(double.MaxValue, double.MaxValue, double.MaxValue);
      if(Rhino.Geometry.Intersect.Intersection.LineLine(edgeA, edgeB, out ia, out ib))
        interesectionPoint = edgeA.PointAt(ia);
      bool intersectionOnEdge = false;
      if(ia >= 0 && ia <= 1) intersectionOnEdge = true;
      if(ib >= 0 && ib <= 1) intersectionOnEdge = true;

      this.edgeA = edgeA;
      this.edgeB = edgeB;

      projected0 = getProjectedPoint(edgeA.To, edgeB, interesectionPoint, intersectionOnEdge);
      if(projected0.X == double.MaxValue){
        projected0 = getProjectedPoint(edgeB.From, edgeA, interesectionPoint, intersectionOnEdge);
      }

      projected1 = getProjectedPoint(edgeB.To, edgeA, interesectionPoint, intersectionOnEdge);

      if(projected1.X == double.MaxValue){
        projected1 = getProjectedPoint(edgeA.From, edgeB, interesectionPoint, intersectionOnEdge);
      }
    }
    public EdgePairSubpolylines getSubpolylines() {
      return new EdgePairSubpolylines(edgeA, edgeB, projected0, projected1);
    }


    private Point3d getProjectedPoint(Point3d point, Line opposingEdge, Point3d intPt, bool intersectionOnEdge){
      if(intPt.X != double.MaxValue){
        if(intersectionOnEdge){
          Vector3d vecPerpendicular = Vector3d.CrossProduct(opposingEdge.UnitTangent, Vector3d.ZAxis);
          Line perpendicularLine = new Line(intPt, vecPerpendicular);
          int orientationIndexOfPoint = OrientationOfPoint(perpendicularLine, point);
          double p = opposingEdge.ClosestParameter(intPt);
          if(p >= 0 && p <= 1){
            int orientationIndexOfStart = OrientationOfPoint(perpendicularLine, opposingEdge.From);

            if (orientationIndexOfPoint == orientationIndexOfStart) {
              // Start of opposingEdge is on the same side as the vertex (thus we shorten the segment discarding p1)
              opposingEdge = new Line(opposingEdge.From, intPt);

            } else {
              // End of opposingEdge is on the same side as the vertex (thus we shorten the segment discarding p0)
              opposingEdge = new Line(intPt, opposingEdge.To);
            }
          }
          else {
            // the intersection point is outside of the edge
            int orientationIndexOfEdge = OrientationOfPoint(perpendicularLine, opposingEdge.To);   // -1 or +1

            // TODO: need to handle edge pairs better
            //                    boolean vertexIsOnPerpendicularLine = orientationIndexOfVertex == 0;             // this is needed to handle cases when both edges are perpendicular to each other
            bool vertexIsOnPerpendicularLine = false;
            if (!vertexIsOnPerpendicularLine && orientationIndexOfPoint != orientationIndexOfEdge) {
              // projection of vertex is located somewhere on the opposite side of the intersection point (not on the edge)
              return new Point3d(double.MaxValue, double.MaxValue, double.MaxValue);

            }
            // otherwise it is on the same side - proceed as usual
          }
        }
        double distanceOfPoint = point.DistanceTo(intPt);


        double distOfOpEdgePoint1 = intPt.DistanceTo(opposingEdge.From);
        double distOfOpEdgePoint2 = intPt.DistanceTo(opposingEdge.To);
        if(distanceOfPoint >= Math.Max(distOfOpEdgePoint1, distOfOpEdgePoint2) || distanceOfPoint <= Math.Min(distOfOpEdgePoint1, distOfOpEdgePoint2))
        {
          return new Point3d(double.MaxValue, double.MaxValue, double.MaxValue);
        }

        Point3d furtherPoint = getFurtherEnd(intPt, opposingEdge);
        Line extendedOpposingEdge = new Line(intPt, furtherPoint);
        return extendedOpposingEdge.PointAt(distanceOfPoint / extendedOpposingEdge.Length);
      } else {
        // In case of parallel lines, we do not have an intersection point
        double p = opposingEdge.ClosestParameter(point);       // a projection onto opposingEdge (extending to infinity)
        if(p >= 0 && p <= 1){
          return opposingEdge.PointAt(p);
        }else
        {
          return new Point3d(double.MaxValue, double.MaxValue, double.MaxValue);
        }

      }
    }
    private int OrientationOfPoint(Line line, Point3d point){
      Point3d testPt;
      Plane pl = new Plane(line.From, line.UnitTangent, Vector3d.ZAxis);
      pl.RemapToPlaneSpace(point, out testPt);
      if(testPt.Z < 0)
        return -1;
      else if (testPt.Z > 0) return 1;
      else return 0;

    }
    public Point3d getFurtherEnd(Point3d point, Line line)
    {
      return point.DistanceTo(line.From) > point.DistanceTo(line.To) ? line.From : line.To;
    }


  }


  class EdgePairSubpolylines {
    private Line edgeA;
    private Line edgeB;

    private Polyline triangle1;
    private Polyline trapezoid;
    private Polyline triangle2;
    private double triangle1Area = 0;
    private double trapezoidArea = 0;
    private double triangle2Area = 0;

    public EdgePairSubpolylines(Line edgeA, Line edgeB, Point3d projected0, Point3d projected1){
      this.edgeA = edgeA;
      this.edgeB = edgeB;
      if(projected0.X != double.MaxValue){
        List<Point3d> pts = new List<Point3d>();
        pts.Add(edgeA.To);
        pts.Add(projected0);
        pts.Add(edgeB.From);
        pts.Add(edgeA.To);
        triangle1Area = CalculateTriangleArea(pts[0], pts[1], pts[2]);
        triangle1 = new Polyline(pts);
      }
      if(projected1.X != double.MaxValue){
        List<Point3d> pts = new List<Point3d>();
        pts.Add(edgeA.From);
        pts.Add(projected1);
        pts.Add(edgeB.To);
        pts.Add(edgeA.From);
        triangle2Area = CalculateTriangleArea(pts[0], pts[1], pts[2]);
        triangle2 = new Polyline(pts);
      }
      List<Point3d> ptsTrapezoid = new List<Point3d>();

      double tolerance = 0.0001;
      if(projected1.DistanceTo(edgeA.ClosestPoint(projected1, true)) < tolerance &&
      projected1.X != double.MaxValue){ptsTrapezoid.Add(projected1); }
      else ptsTrapezoid.Add(edgeA.From);
      if(projected0.DistanceTo(edgeA.ClosestPoint(projected0, true)) < tolerance &&
        projected0.X != double.MaxValue) ptsTrapezoid.Add(projected0);
      else ptsTrapezoid.Add(edgeA.To);
      if(projected0.DistanceTo(edgeB.ClosestPoint(projected0, true)) < tolerance &&
        projected0.X != double.MaxValue) ptsTrapezoid.Add(projected0);
      else ptsTrapezoid.Add(edgeB.From);
      if(projected1.DistanceTo(edgeB.ClosestPoint(projected1, true)) < tolerance &&
        projected1.X != double.MaxValue) ptsTrapezoid.Add(projected1);
      else ptsTrapezoid.Add(edgeB.To);
      ptsTrapezoid.Add(ptsTrapezoid[0]);
      trapezoidArea = CalculateTriangleArea(ptsTrapezoid[0], ptsTrapezoid[1], ptsTrapezoid[2]);
      trapezoidArea += CalculateTriangleArea(ptsTrapezoid[0], ptsTrapezoid[3], ptsTrapezoid[2]);

      trapezoid = new Polyline(ptsTrapezoid);
    }
    public Polyline getTriangle1(){
      return triangle1;
    }
    public Polyline getTriangle2(){
      return triangle2;
    }
    public Polyline getTrapezoid(){
      return trapezoid;
    }
    public double getTotalArea(){
      return triangle1Area + triangle2Area + trapezoidArea;
    }

    /// <summary>
    ///
    /// </summary>
    /// <param name="polyline"></param>
    /// <param name="singlePartArea"></param>
    /// <returns></returns>
    public List<Cut> getCuts(Polyline polyline, double singlePartArea){
      List<Cut> cuts = new List<Cut>();
      List<Line> segments = polyline.GetSegments().ToList();
      int indexOfEdgeA = 0;
      int indexOfEdgeB = 0;
      for(int i = 0; i < segments.Count;i++){
        if(edgeA.PointAt(0.5).DistanceTo(segments[i].PointAt(0.5)) < 0.001){
          indexOfEdgeA = i;
        }
        else if(edgeB.PointAt(0.5).DistanceTo(segments[i].PointAt(0.5)) < 0.001){
          indexOfEdgeB = i;
        }
      }

      int segmentsCovered = indexOfEdgeB - indexOfEdgeA + 1;// number of segments covered by a LineRing starting with edgeA and ending with edgeB (including)
      // Polygon's exterior ring is equal to [edgeA + segmentsBetweenEdgePair + edgeB + segmentsOutsideEdgePair]
      int segmentCountBetweenEdgePair = segmentsCovered - 2;
      int segmentCountOutsideEdgePair = segments.Count - segmentsCovered;
      // if edges are not connected directly, polygon has extra area adjacent to them
      Polyline polylineOutside1 = new Polyline();
      Polyline polylineOutside2 = new Polyline();

      if (segmentCountBetweenEdgePair > 1) {
        // calculate extra area bounded by segmentsBetweenEdgePair
        for(int i = 0; i < segmentCountBetweenEdgePair + 1; i++){
          int ptIdx = indexOfEdgeA + 1 + i;
          if(ptIdx >= segments.Count) ptIdx -= segments.Count;
          polylineOutside1.Add(polyline[ptIdx]);
        }
        polylineOutside1.Add(polylineOutside1[0]);
      }
      if (segmentCountOutsideEdgePair > 1) {
        // calculate extra area bounded by segmentCountOutsideEdgePair
        for(int i = 0; i < segmentCountOutsideEdgePair + 1; i++){
          int ptIdx = indexOfEdgeB + 1 + i;
          if(ptIdx >= segments.Count) ptIdx -= segments.Count;
          polylineOutside2.Add(polyline[ptIdx]);

        }
        polylineOutside2.Add(polylineOutside2[0]);
      }
      double areaOutside1 = 0, areaOutside2 = 0;
      if(polylineOutside1 != null && polylineOutside1.IsValid && polylineOutside1.Length > 0.01){
        AreaMassProperties amp = AreaMassProperties.Compute(polylineOutside1.ToNurbsCurve());
        if(amp != null) areaOutside1 = amp.Area;
      }
      if(polylineOutside2 != null && polylineOutside2.IsValid && polylineOutside2.Length > 0.01){
        AreaMassProperties amp = AreaMassProperties.Compute(polylineOutside2.ToNurbsCurve());
        if(amp != null) areaOutside2 = amp.Area;
      }

      // check first direction (areaOutside1 + T1 + Trapezoid + T2)
      if(areaOutside1 <= singlePartArea){

        Line lineOfCut = new Line();
        if(areaOutside1 + triangle1Area > singlePartArea){
          double areaToCutAwayInTriangle = singlePartArea - areaOutside1;
          double fraction = areaToCutAwayInTriangle / triangle1Area;
          if(triangle1 != null){
            Point3d projected0 = triangle1[1];
            Line edgeWithPointOfCut = (edgeA.ClosestPoint(projected0, true).DistanceTo(projected0) < 0.000001) ? new Line(edgeA.To, projected0) : new Line(edgeB.From, projected0);
            Point3d pointOfCut = edgeWithPointOfCut.PointAt(fraction);
            lineOfCut = (edgeA.ClosestPoint(pointOfCut, true).DistanceTo(pointOfCut) < 0.000001) ? new Line(edgeB.From, pointOfCut) : new Line(pointOfCut, edgeA.To);
          }

        }else if(areaOutside1 + triangle1Area + trapezoidArea >= singlePartArea){

          Line trapezoidOnEdgeA = trapezoid.SegmentAt(0);
          Line trapezoidOnEdgeB = trapezoid.SegmentAt(2);
          trapezoidOnEdgeA.Flip();
          double areaToCutAway = singlePartArea - (areaOutside1 + triangle1Area);
          double fraction = areaToCutAway / trapezoidArea;

          double ia, ib;
          if(Rhino.Geometry.Intersect.Intersection.LineLine(trapezoidOnEdgeA, trapezoidOnEdgeB, out ia, out ib))
          {

            Point3d intersectionPoint = trapezoidOnEdgeA.PointAt(ia);
            double wholeDistance = intersectionPoint.DistanceTo(trapezoidOnEdgeA.From);
            double distTo = intersectionPoint.DistanceTo(trapezoidOnEdgeA.To);
            bool flip = true;
            if(distTo > wholeDistance){ wholeDistance = distTo; flip = false; fraction = 1 - fraction;}
            fraction = splitFractionTrapezoid(trapezoidOnEdgeA.Length, wholeDistance, trapezoidOnEdgeA.UnitTangent, fraction);
            if(!flip) fraction = 1 - fraction;
          }

          Point3d pointOfCutOnEdgeA = trapezoidOnEdgeA.PointAt(fraction);
          Point3d pointOfCutOnEdgeB = trapezoidOnEdgeB.PointAt(fraction);
          lineOfCut = new Line(pointOfCutOnEdgeB, pointOfCutOnEdgeA);


        }else if(areaOutside1 + getTotalArea() >= singlePartArea){

          double areaToCutAwayInTriangle = singlePartArea - (areaOutside1 + triangle1Area + trapezoidArea);
          double fraction = areaToCutAwayInTriangle / triangle2Area;
          if(triangle1 != null){
            Point3d projected1 = triangle2[1];
            Line edgeWithPointOfCut = (edgeA.ClosestPoint(projected1, true).DistanceTo(projected1) < 0.000001) ? new Line(projected1, edgeA.From) : new Line(projected1, edgeB.To);
            Point3d pointOfCut = edgeWithPointOfCut.PointAt(fraction);
            lineOfCut = (edgeA.ClosestPoint(pointOfCut, true).DistanceTo(pointOfCut) < 0.000001) ? new Line(edgeB.To, pointOfCut) : new Line(pointOfCut, edgeA.From);
          }
        }

        Rhino.Geometry.Intersect.CurveIntersections ci = Rhino.Geometry.Intersect.Intersection.CurveLine(polyline.ToNurbsCurve(), lineOfCut, 0.001, 0.001);
        int intCount = 0;
        foreach(Rhino.Geometry.Intersect.IntersectionEvent ie in ci) if(ie.IsPoint)intCount++;
        if(lineOfCut != null && intCount <= 2){

          PolylineCurve polyCurve = polyline.ToPolylineCurve();
          double t0, t1;
          polyCurve.ClosestPoint(lineOfCut.To, out t0);
          polyCurve.ClosestPoint(lineOfCut.From, out t1);

          if(t0 != t1){

            Curve cutAway = polyCurve.Trim(new Interval(t0, t1));
            if(cutAway != null){
              Polyline plCutAway = cutAway.ToPolyline(0.000001, 0.000001, 0.001, 1000000).ToPolyline();
              plCutAway.Add(plCutAway[0]);
              plCutAway.ReduceSegments(0.000001);

              Curve cutRemain = polyCurve.Trim(new Interval(t1, t0));
              Polyline plCutRemain = cutRemain.ToPolyline(0.000001, 0.000001, 0.001, 1000000).ToPolyline();
              plCutRemain.Add(plCutRemain[0]);
              plCutRemain.ReduceSegments(0.000001);
              cuts.Add(new Cut(lineOfCut.Length, plCutAway, plCutRemain));
            }
          }
        }
      }

      // check first direction (areaOutside1 + T1 + Trapezoid + T2)
      if(areaOutside2 <= singlePartArea){

        Line lineOfCut = new Line();
        if(areaOutside2 + triangle2Area > singlePartArea){
          double areaToCutAwayInTriangle = singlePartArea - areaOutside2;

          double fraction = areaToCutAwayInTriangle / triangle2Area;
          if(triangle2 != null){
            Point3d projected1 = triangle2[1];
            Line edgeWithPointOfCut = (edgeA.ClosestPoint(projected1, true).DistanceTo(projected1) < 0.000001) ? new Line(edgeA.From, projected1) : new Line(edgeB.To, projected1);
            Point3d pointOfCut = edgeWithPointOfCut.PointAt(fraction);
            lineOfCut = (edgeA.ClosestPoint(pointOfCut, true).DistanceTo(pointOfCut) < 0.000001) ? new Line(pointOfCut, edgeB.To) : new Line(edgeA.From, pointOfCut);
          }


        }else if(areaOutside2 + triangle2Area + trapezoidArea >= singlePartArea){

          Line trapezoidOnEdgeA = trapezoid.SegmentAt(0);
          Line trapezoidOnEdgeB = trapezoid.SegmentAt(2);
          trapezoidOnEdgeB.Flip();

          double areaToCutAway = singlePartArea - (areaOutside2 + triangle2Area);
          double fraction = areaToCutAway / trapezoidArea;
          double ia, ib;
          if(Rhino.Geometry.Intersect.Intersection.LineLine(trapezoidOnEdgeA, trapezoidOnEdgeB, out ia, out ib))
          {

            Point3d intersectionPoint = trapezoidOnEdgeA.PointAt(ia);
            double wholeDistance = intersectionPoint.DistanceTo(trapezoidOnEdgeA.From);
            double distTo = intersectionPoint.DistanceTo(trapezoidOnEdgeA.To);
            bool flip = true;
            if(distTo > wholeDistance){ wholeDistance = distTo; flip = false; fraction = 1 - fraction;}
            fraction = splitFractionTrapezoid(trapezoidOnEdgeA.Length, wholeDistance, trapezoidOnEdgeA.UnitTangent, fraction);
            if(!flip) fraction = 1 - fraction;
          }

          Point3d pointOfCutOnEdgeA = trapezoidOnEdgeA.PointAt(fraction);
          Point3d pointOfCutOnEdgeB = trapezoidOnEdgeB.PointAt(fraction);
          lineOfCut = new Line(pointOfCutOnEdgeA, pointOfCutOnEdgeB);

        }else if(areaOutside2 + getTotalArea() >= singlePartArea){

          double areaToCutAwayInTriangle = singlePartArea - (areaOutside2 + triangle2Area + trapezoidArea);
          double fraction = areaToCutAwayInTriangle / triangle1Area;
          if(triangle1 != null){
            Point3d projected0 = triangle1[1];
            Line edgeWithPointOfCut = (edgeA.ClosestPoint(projected0, true).DistanceTo(projected0) < 0.000001) ? new Line(projected0, edgeA.To) : new Line(projected0, edgeB.From);
            Point3d pointOfCut = edgeWithPointOfCut.PointAt(fraction);
            lineOfCut = (edgeA.ClosestPoint(pointOfCut, true).DistanceTo(pointOfCut) < 0.000001) ? new Line(pointOfCut, edgeB.From) : new Line(edgeA.To, pointOfCut);
          }
        }
        Rhino.Geometry.Intersect.CurveIntersections ci = Rhino.Geometry.Intersect.Intersection.CurveLine(polyline.ToNurbsCurve(), lineOfCut, 0.001, 0.001);
        int intCount = 0;
        foreach(Rhino.Geometry.Intersect.IntersectionEvent ie in ci) if(ie.IsPoint)intCount++;
        if(lineOfCut != null && intCount <= 2){
          PolylineCurve polyCurve = polyline.ToPolylineCurve();
          double t0, t1;
          polyCurve.ClosestPoint(lineOfCut.To, out t0);
          polyCurve.ClosestPoint(lineOfCut.From, out t1);

          if(t0 != t1){

            Curve cutAway = polyCurve.Trim(new Interval(t0, t1));
            if(cutAway != null){
              Polyline plCutAway = cutAway.ToPolyline(0.000001, 0.000001, 0.001, 1000000).ToPolyline();
              plCutAway.Add(plCutAway[0]);
              plCutAway.ReduceSegments(0.000001);
              Curve cutRemain = polyCurve.Trim(new Interval(t1, t0));
              Polyline plCutRemain = cutRemain.ToPolyline(0.000001, 0.000001, 0.001, 1000000).ToPolyline();
              plCutRemain.Add(plCutRemain[0]);
              plCutRemain.ReduceSegments(0.000001);
              cuts.Add(new Cut(lineOfCut.Length, plCutAway, plCutRemain));
            }
          }
        }
      }


      return cuts;


    }

    public double splitFractionTrapezoid(double distance, double wholeDistance, Vector3d dir, double fraction){
      dir.Unitize();
      double remainingDistance = wholeDistance - distance;
      Vector3d rotateVec = dir * remainingDistance;
      rotateVec.Rotate(Math.Acos(remainingDistance / wholeDistance), Vector3d.ZAxis);
      double projectedDistance = Math.Abs(Vector3d.Multiply(rotateVec, dir));
      double ankathete = wholeDistance - (fraction * (wholeDistance - projectedDistance));
      double gegenkathete = Math.Sqrt(Math.Pow(wholeDistance / 2.0, 2) - Math.Pow((wholeDistance / 2.0 - ankathete), 2));
      double hypothenuse = Math.Sqrt(Math.Pow(ankathete, 2) + Math.Pow((gegenkathete), 2));

      return (wholeDistance - hypothenuse) / distance;

    }
    private double CalculateTriangleArea(Point3d pt0, Point3d pt1, Point3d pt2){
      return Math.Abs(Vector3d.CrossProduct(new Vector3d(pt0 - pt2), new Vector3d(pt1 - pt2)).Length / 2);

    }
  }
# ---------- end equalareagreedy ----------
curve_7 = Curve(equalareagreedy.A)

curve_8 = Curve(curve)
curve_9 = Curve([curve_7, curve_5, curve_3])
preview = CustomPreview(Geometry=mesh_2, Shader=ColourSwatch(SwatchColor=RGBA(204, 204, 204, 131)))
custom_preview_lineweights = CustomPreviewLineweights(Geometry=crv_2, Shader=ColourSwatch(SwatchColor=RGB(178, 178, 178)), Thickness=Slider(2, range=0..10), Absolute=False)
custom_preview_lineweights_2 = CustomPreviewLineweights(Geometry=curve_8, Shader=ColourSwatch(SwatchColor=RGB(0, 0, 0)), Thickness=Slider(3, range=0..4), Absolute=False)
custom_preview_lineweights_3 = CustomPreviewLineweights(Geometry=curve_9, Shader=ColourSwatch(SwatchColor=RGB(157, 0, 255)), Thickness=Slider(2, range=0..10), Absolute=False)
