# Grasshopper definition ParcellationSlicingTree.gh (Grasshopper 1.0.7)
# plug-ins: DeCodingSpaces, Human, MetaHopper

# Description: 1. Assign street blocks that should be divided into parcels.
document_info = DocumentInfo(AutoUpdate=False, Recursive=False)  # -> DocumentName, DocumentFilePath, Components, Params, _3rdPartyAssemblies
# text is internalised, if metahopper component is missing
not_internalised = Text(document_info._3rdPartyAssemblies)
internalised_text = Text(["Human, Version=1.7.3.0, Culture=neutral, PublicKeyToken=null", "DecodingSpacesAssembly, Version=1.0.0.0, Culture=neutral, PublicKeyToken=null"])
create_set = CreateSet(List=[internalised_text, not_internalised])  # -> Set, Map
# PARAMETRIC PLANNING CATALOGUE
# Parcellation - Slicing Tree
# v. 1.0 - Author: DeCodingSpaces - Martin Dennemark
_3rd_party = Panel(create_set.Set)

# ---- group: Paths
initial_segments = Curve([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])

# ----
# 1.
# Buildings & Streets
# only for Visualisation
polygons_from_lines = PolygonsFromLines(Lines=initial_segments, MinBlockSize=0)  # -> Polygons, SynchronizedValues

# ---- group: Buildings
mesh = Mesh([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])

# ---- group: Streets
crv = Curve([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])

# ---- group: Plots
curve = Curve(polygons_from_lines.Polygons)

# ----
# Slicing Tree - Keeps each parcel connected to the street.
number_slider = Slider(31, range=10..100)
curve_2 = Curve(curve)
customized_parameters = CustomizedParameters(
    ScalingFactor=1,
    MaxLength=100,
    MinLength=20,
    AngleRange=90,
    NChildren=3,
    TreeDepth=7,
    MinAngleD=10,
    MinDistance=1,
    MinBlockArea=800,
    BlockOffset=0,
    MaxRank=4,
    Rank=0,
    MaxArea=20,
    ParcelDepth=5,
    ParcelWidth=number_slider,
    SplitRate=0.5,
    Density=10,
    Seed=-1)
slicing_tree_structure_for_parcels = SlicingTreeStructureForParcels(CustomizsedParameters=customized_parameters, Blocks=curve_2)
curve_3 = Curve(slicing_tree_structure_for_parcels)

# ---- group: Other Streets
crv_2 = Curve([crv, initial_segments])

# ---- group: Buildings
mesh_2 = Mesh(mesh)

# ----
curve_4 = Curve(curve)
curve_5 = Curve(curve_3)
preview = CustomPreview(Geometry=mesh_2, Shader=ColourSwatch(SwatchColor=RGBA(204, 204, 204, 131)))
custom_preview_lineweights = CustomPreviewLineweights(Geometry=crv_2, Shader=ColourSwatch(SwatchColor=RGB(178, 178, 178)), Thickness=Slider(2, range=0..10), Absolute=False)
custom_preview_lineweights_2 = CustomPreviewLineweights(Geometry=curve_4, Shader=ColourSwatch(SwatchColor=RGB(0, 0, 0)), Thickness=Slider(3, range=0..4), Absolute=False)
custom_preview_lineweights_3 = CustomPreviewLineweights(Geometry=curve_5, Shader=ColourSwatch(SwatchColor=RGB(157, 0, 255)), Thickness=Slider(2, range=0..10), Absolute=False)
