# Grasshopper definition ParcellationVoronoi.gh (Grasshopper 1.0.7)
# plug-ins: DeCodingSpaces, Human, MetaHopper, TT Toolbox

# Description: 1. Assign street blocks that should be divided into parcels.
# 2. Toggle Run
document_info = DocumentInfo(AutoUpdate=False, Recursive=False)  # -> DocumentName, DocumentFilePath, Components, Params, _3rdPartyAssemblies
# text is internalised, if metahopper component is missing
not_internalised = Text(document_info._3rdPartyAssemblies)
internalised_text = Text(["Human, Version=1.7.3.0, Culture=neutral, PublicKeyToken=null", "DecodingSpacesAssembly, Version=1.0.0.0, Culture=neutral, PublicKeyToken=null"])
create_set = CreateSet(List=[internalised_text, not_internalised])  # -> Set, Map
# PARAMETRIC PLANNING CATALOGUE
# Parcellation - Voronoi
# v. 1.0 - Author: DeCodingSpaces - Martin Dennemark
_3rd_party = Panel(create_set.Set)

# ---- group: Paths
initial_segments = Curve([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])

# ----
# 1.
# 2.
# Buildings & Streets
# only for Visualisation
run_takes_a_while = BooleanToggle(False)
polygons_from_lines = PolygonsFromLines(Lines=initial_segments, MinBlockSize=0)  # -> Polygons, SynchronizedValues

stream_filter = StreamFilter(Gate=run_takes_a_while, Stream1=polygons_from_lines.Polygons)

# ---- group: Buildings
mesh = Mesh([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])

# ---- group: Snapping
number = Number(Slider(0.3, range=0.1..0.5))

# ---- group: Cell Distance
number_2 = Number(Slider(59, range=10..100))

# ---- group: Streets
crv = Curve([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])

# ---- group: Plots
curve = Curve(stream_filter)

# ---- group: Cell Distance
number_3 = Number(number_2)

# ---- group: Snapping
number_4 = Number(number)

# ----
# Voronois-based Parcellation - Keeps each parcel connected to the street.
curve_2 = Curve(curve)
divide_distance = DivideDistance(Curve=curve_2, Distance=number_3)  # -> Points, Tangents, Parameters
voronoi = Voronoi(Points=divide_distance.Points, BruteForceOverride=False)  # -> simplify(Cells)
trim_with_region = TrimWithRegion(Curve=voronoi, Region=graft(curve_2))  # -> Inside, Outside
shift_paths = ShiftPaths(Data=trim_with_region.Inside, Offset=-1)
explode = Explode(Curve=curve_2, Recursive=True)  # -> Segments, Vertices
curve_3 = Curve(graft(curve_2))
curve_curve = CurveCurve(CurveA=shift_paths, CurveB=curve_3)  # -> Points, ParamsA, ParamsB
shift_paths_2 = ShiftPaths(Data=curve_curve.Points, Offset=-1)
merge = Merge(Data1=simplify(shift_paths), Data2=simplify(curve_3))
multiplication = Multiplication(A=number_3, B=number_4)
merge_2 = Merge(Data1=simplify(explode.Vertices), Data2=simplify(shift_paths_2))
remove_duplicate_points = RemoveDuplicatePoints(InputPoints=merge_2, Tolerance=0.001)  # -> OutputPoints, FirstPointIndexes
network_to_segments = NetworkToSegments(NetworkGeometry=merge, ConvertCurves=True, ConversionAngle=0.2, Split=True)
network_smooth = NetworkSmooth(
    Network=simplify(network_to_segments),
    AnchorSnapPoints=simplify(remove_duplicate_points.OutputPoints),
    SnapThreshold=multiplication,
    SnapToAnchorPointsOnly=False)
curve_4 = Curve(network_smooth)

# ---- group: Other Streets
crv_2 = Curve([crv, initial_segments])

# ---- group: Buildings
mesh_2 = Mesh(mesh)

# ----
curve_5 = Curve(curve)
curve_6 = Curve(curve_4)
preview = CustomPreview(Geometry=mesh_2, Shader=ColourSwatch(SwatchColor=RGBA(204, 204, 204, 131)))
custom_preview_lineweights = CustomPreviewLineweights(Geometry=crv_2, Shader=ColourSwatch(SwatchColor=RGB(178, 178, 178)), Thickness=Slider(2, range=0..10), Absolute=False)
custom_preview_lineweights_2 = CustomPreviewLineweights(Geometry=curve_5, Shader=ColourSwatch(SwatchColor=RGB(0, 0, 0)), Thickness=Slider(3, range=0..4), Absolute=False)
custom_preview_lineweights_3 = CustomPreviewLineweights(Geometry=curve_6, Shader=ColourSwatch(SwatchColor=RGB(157, 0, 255)), Thickness=Slider(2, range=0..10), Absolute=False)
