# Grasshopper definition RainwaterRundownGismo.gh (Grasshopper 1.0.7)
# plug-ins: MetaHopper

document_info = DocumentInfo(AutoUpdate=False, Recursive=False)  # -> DocumentName, DocumentFilePath, Components, Params, _3rdPartyAssemblies
# text is internalised, if metahopper component is missing
not_internalised = Text(document_info._3rdPartyAssemblies)
internalised_text = Text("Gismo - see description")
create_set = CreateSet(List=[internalised_text, not_internalised])  # -> Set, Map
# PARAMETRIC PLANNING CATALOGUE
# Rainwater Rundown with Gismo Plugin
# v. 1.0 - Author: Credit goes to Djorde Spasic as the developer of Gismo!
# Description: Simple rainwater rundown calculation with awesome Gismo plugin (https://github.com/stgeorges/gismo).
# 
# Needs a terrain surface as input (1). Incureasing number of analysis points needs higher calculation time!
_3rd_party = Panel(create_set.Set)

# ----
# 1.
number_of_points = Slider(300, range=0..1000)
grid_false_random_true = BooleanToggle(False)
terrain = Surface(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)
gismo = Gismo_Gismo(gismoFolder="c:\gismo")  # -> out; plug-in component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

flowpaths = Gismo_FlowPaths(
    geometry=terrain,
    numOfInitialPts=number_of_points,
    initialPtsSpread=grid_false_random_true,
    stepSize=1,
    flowPathsType=0,
    bakeIt=False,
    runIt=Toggle(False))  # -> out, flowPaths, title, titleOrigin; inputs geometry: list, numOfInitialPts: Int32, initialPtsSpread: Int32, flowPathsType: Int32, bakeIt: Boolean, runIt: Boolean; plug-in component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
