# Grasshopper definition RingRoads.gh (Grasshopper 1.0.7)
# plug-ins: Human, MetaHopper, onScreen

# PARAMETRIC PLANNING CATALOGUE
# Ringroads
# v. 1.0 - Author: DeCodingSpaces - Ondřej Veselý, Martin Dennemark
document_info = DocumentInfo(AutoUpdate=False, Recursive=False)  # -> DocumentName, DocumentFilePath, Components, Params, _3rdPartyAssemblies
# text is internalised, if metahopper component is missing
not_internalised = Text(document_info._3rdPartyAssemblies)
internalised_text = Text(["onScreen, Version=1.0.0.0, Culture=neutral, PublicKeyToken=null", "Human, Version=1.7.3.0, Culture=neutral, PublicKeyToken=null"])
create_set = CreateSet(List=[internalised_text, not_internalised])  # -> Set, Map
# Description: Add terrain as surface, roads as curves and center point (1)
# 
# Generate Ringroads by Area (2)
# 
# Weight the influence of Distance to Center and Road, Slope and Height of Terrain (3)
# 
# Change Resolution of Grid (4)
_3rd_party = Panel(create_set.Set)

# ----
# 1.
# 2.
# 3.
# 4.
grid_resolution = Slider(50, range=0..100)
needed_area = Slider(386665, range=0..10000000)
needed_area_2 = Slider(1175109, range=0..10000000)
weightterrain = Slider(0, range=0..1)
weightcenter = Slider(0.86, range=0..1)
weightroad = Slider(0.6, range=0..1)
center = Point(Point(591.1971274, 889.0843321, 0))
terrain = Surface(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)
roads = Curve([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])
join_curves = JoinCurves(Curves=roads, Preserve=False)
weight_distance_to_center = Number(weightcenter)
weight_terrain = Number(weightterrain)
weight_road = Number(weightroad)
resolution = Integer(grid_resolution)
ringarea = Number([needed_area, needed_area_2])
roads_2 = Curve(join_curves)
terrain_2 = Surface(terrain)
center_2 = Point(center)

# ----
# Divide Terrain into Cells
terrain_3 = Surface(terrain_2)
resolution_2 = Integer(resolution)
divide_domain² = DivideDomain²(Domain=terrain_3, UCount=resolution_2, VCount=resolution_2)
isotrim = Isotrim(Surface=terrain_3, Domain=divide_domain²)
area = Area(Geometry=isotrim)  # -> Area, Centroid
cellcenters = Point(area.Centroid)
cellarea = Number(area.Area)
cells = Surface(isotrim)

# ----
# Calculate Slope for each Cell
# Smoothing Terrain to reduce small bumps. Makes boundary curve smoother.
cellcenters_2 = Point(cellcenters)
resolution_3 = Integer(resolution)
surface_from_points = SurfaceFromPoints(Points=flatten(cellcenters_2), UCount=resolution_3, Interpolate=False)
surface_closest_point = SurfaceClosestPoint(Point=cellcenters_2, Surface=surface_from_points)  # -> Point, UVPoint, Distance
evaluate_surface = EvaluateSurface(Surface=surface_from_points, Point=surface_closest_point.UVPoint)  # -> Point, Normal, UDirection, VDirection, Frame
unit_z = UnitZ(Factor=1)
angle = Angle(VectorA=unit_z, VectorB=evaluate_surface.Normal)  # -> Angle, Reflex
cellslope = Number(angle.Angle)

# ----
# Calculate Distance to Road for each Cell
roads_3 = Curve(roads_2)
cellcenters_3 = Point(cellcenters)
curve_closest_point = CurveClosestPoint(Point=graft(cellcenters_3), Curve=roads_3)  # -> Point, Parameter, Distance
sort_list = SortList(Keys=curve_closest_point.Distance)  # -> Keys, ValuesValuesA
list_item = ListItem(List=sort_list.Keys, Index=0, Wrap=True)  # -> flatten(Item)
celldistanceclosestroad = Number(list_item)

# ----
# Calculate Height Difference from Center for each Cell
cellcenters_4 = Point(cellcenters)
center_3 = Point(center_2)
deconstruct = Deconstruct(Point=center_3)  # -> XComponent, YComponent, ZComponent
deconstruct_2 = Deconstruct(Point=cellcenters_4)  # -> XComponent, YComponent, ZComponent
subtraction = Subtraction(A=deconstruct_2.ZComponent, B=deconstruct.ZComponent)
absolute = Absolute(Value=subtraction)
cellheight = Number(absolute)

# ----
# Calculate Distance to Center for each Cell
cellcenters_5 = Point(cellcenters)
center_4 = Point(center_2)
distance = Distance(PointA=center_4, PointB=cellcenters_5)
celldistancetocenter = Number(distance)

# ----
# Score each Cell by weighting Values for Terrain Slope, Height, Road and Center Distance
celldistanceclosestroad_2 = Number(celldistanceclosestroad)
celldistancetocenter_2 = Number(celldistancetocenter)
cellheight_2 = Number(cellheight)
weight_road_2 = Number(weight_road)
weight_distance_to_center_2 = Number(weight_distance_to_center)
weight_terrain_2 = Number(weight_terrain)
cellslope_2 = Number(cellslope)
entwine = Entwine(
    Branch00=weight_terrain_2,
    Branch01=weight_terrain_2,
    Branch02=weight_road_2,
    Branch03=weight_distance_to_center_2,
    FlattenInputs=True)  # -> flatten(Result)
entwine_2 = Entwine(
    Branch00=cellslope_2,
    Branch01=cellheight_2,
    Branch02=celldistanceclosestroad_2,
    Branch03=celldistancetocenter_2,
    FlattenInputs=True)
bounds = Bounds(Numbers=entwine_2)
remap_numbers = RemapNumbers(Value=entwine_2, Source=bounds, Target=Domain(0, 1))  # -> Mapped, Clipped
flip_matrix = FlipMatrix(Data=remap_numbers.Mapped)
weighted_average = WeightedAverage(Input=flip_matrix, Weights=entwine)  # -> flatten(ArithmeticMean)
cellscore = Number(weighted_average)

# ----
# Sort Cells by Score. Pick cells up until they reach necessary Area. Draw a line around them (AlphaShape)
ringarea_2 = Number(ringarea)
terrain_4 = Surface(terrain_2)
cells_2 = Surface(cells)
cellscore_2 = Number(cellscore)
cellarea_2 = Number(cellarea)
cellcenters_6 = Point(cellcenters)
dimensions = Dimensions(Surface=cells_2)  # -> UDimension, VDimension
sort_list_2 = SortList(Keys=cellscore_2, ValuesValuesA=cellarea_2, ValuesA=flatten(cellcenters_6), ValuesB=cells_2)  # -> Keys, ValuesValuesA, ValuesA, ValuesB
average = Average(Input=dimensions.UDimension)
mass_addition = MassAddition(Input=sort_list_2.ValuesValuesA)  # -> Result, PartialResults
smaller_than = SmallerThan(FirstNumber=mass_addition.PartialResults, SecondNumber=graft(ringarea_2))  # -> SmallerThan, OrEqualTo
multiplication = Multiplication(A=average, B=Slider(2, range=0..10))
cull_pattern = CullPattern(List=sort_list_2.ValuesA, CullPattern=smaller_than.SmallerThan)
alpha_shape = AlphaShape(Points=cull_pattern, Radius=multiplication, Plane=PlaneXY(0, 0, 0))
cull_pattern_2 = CullPattern(List=sort_list_2.ValuesB, CullPattern=smaller_than.SmallerThan)
smooth_polyline = SmoothPolyline(Polyline=alpha_shape, Strength=Slider(1, range=0..1), Times=1)
project = Project(Curve=smooth_polyline, Brep=terrain_4, Direction=Vector(0, 0, 1))
usedcells = Surface(cull_pattern_2)
ringroads = Curve(project)

usedcells_2 = Surface(usedcells)
ringroads_2 = Curve(ringroads)
tree_statistics = TreeStatistics(Tree=usedcells_2)  # -> Paths, Length, Count
move = Move(Geometry=ringroads_2, Motion=Vector(0, 0, 10))  # -> Geometry, Transform
range = Range(Domain=Domain(0, 1), Steps=tree_statistics.Count)
split_list = SplitList(List=range, Index="1")  # -> ListA, ListB
custom_preview_lineweights = CustomPreviewLineweights(Geometry=move.Geometry, Shader=ColourSwatch(SwatchColor=RGB(0, 0, 0)), Thickness=Slider(2, range=0..10), Absolute=False)
unit_z_2 = UnitZ(Factor=split_list.ListB)  # -> reverse(UnitVector)
gradient = Gradient(
    LowerLimit=0,
    UpperLimit=1,
    Parameter=split_list.ListB,
    stops=[0: RGB(0, 61, 89), 0.25: RGB(0, 155, 180), 0.5: RGB(148, 193, 28), 0.75: RGB(243, 154, 0), 1: RGB(183, 26, 73)])
move_2 = Move(Geometry=usedcells_2, Motion=graft(unit_z_2))  # -> Geometry, Transform
custom_preview = CustomPreview(Geometry=move_2.Geometry, Material=graft(gradient))
