# Grasshopper definition SerpentineRoads.gh (Grasshopper 1.0.7)
# plug-ins: SpiderWeb :: Graph Tools, Human, MetaHopper

document_info = DocumentInfo(AutoUpdate=False, Recursive=False)  # -> DocumentName, DocumentFilePath, Components, Params, _3rdPartyAssemblies
# text is internalised, if metahopper component is missing
not_internalised = Text(document_info._3rdPartyAssemblies)
internalised_text = Text(["SipderWeb, Version=0.0.4.2, Culture=neutral, PublicKeyToken=null", "Human, Version=1.7.3.0, Culture=neutral, PublicKeyToken=null"])
create_set = CreateSet(List=[internalised_text, not_internalised])  # -> Set, Map
# PARAMETRIC PLANNING CATALOGUE
# Serpentine Roads (Path by Steepness)
# v. 1.0 - Author: DeCodingSpaces - Martin Dennemark
# Description: Calculates serpentine path based on grid of lines on a terrain with SpiderWeb by Richard Schaffranek (https://www.food4rhino.com/app/spiderweb).
# 
# 1. Add terrain as surface.
# 2. Add start and end points and move them around (click on components and move them around in Rhino viewport)
# 3. Increase degrees for steep path!
# 4. Weight how much steepness influences shortes path calculation
# 5. Smooth path.
_3rd_party = Panel(create_set.Set)

# ----
# 1.
# 2.
# 3.
# 4.
# 0 : Only Steepness
# 1: Only Shortest Path
# 5.
degree_steepness = Slider(1, range=0..100)
weight_steepness = Slider(0, range=0..1)
smooth = Slider(2, range=1..10)
terrain = Surface(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)
point = Point(Point(-673.3696044, 1223.316086, 0))
point_2 = Point(Point(640.6304051, 309.0693872, 0))
number = Number(smooth)
integer = Integer(degree_steepness)
number_2 = Number(weight_steepness)

# ----
# Create Line Grid over Terrain
# -> Lines will be possible paths for shortest path algorithm.
# Create Graph for Shortest Path Calculation
# Calculate Steepness of Line Segment
# and check, if it is above or below "Degree Steepness" Threshold
# Modify Costs for Shortest Path Algorithm:
# Normally only Length:
# -> Long: Bad Value
# -> Short: Good Value
# Now Modified by Steepness
# -> Steep/Long: Bad Value
# -> Flat/Short: Good Value
# Since Shortest Path is based on Terrain Grid Points, the start and end points need to be connected to the input points.
# Points are projected onto Terrain
# through MeshRay Intersection
# Shortest Path Algorithm needs Index of Start and Endpoint -> Find Index with closest point component.
number_slider = Slider(50, range=0..100)
integer_2 = Integer(integer)
terrain_2 = Surface(terrain)
number_3 = Number(number)
number_4 = Number(number_2)
point_3 = Point(point)
point_4 = Point(point_2)
unit_z = UnitZ(Factor="-1000")
unit_z_2 = UnitZ(Factor="-1000")
divide_surface = DivideSurface(Surface=terrain_2, UCount=number_slider, VCount=number_slider)  # -> Points, Normals, Parameters
move = Move(Geometry=point_3, Motion=unit_z)  # -> Geometry, Transform
move_2 = Move(Geometry=point_4, Motion=unit_z_2)  # -> Geometry, Transform
reverse = Reverse(Vector=unit_z)
reverse_2 = Reverse(Vector=unit_z_2)
c_script = CSharpScript(x=divide_surface.Points)  # -> out, A; inputs x: tree of Point3d
# ---------- c_script: C# ----------
    List<Line> crvs = new List<Line>();
    int iLimit = x.BranchCount;
    int jLimit = x.Branch(0).Count;
    for(int i = 0; i < iLimit;i++){
      for(int j = 0; j < jLimit;j++){
        if(j < jLimit - 1) crvs.Add(new Line(x.Branch(i)[j], x.Branch(i)[j + 1]));
        if(i < iLimit - 1) crvs.Add(new Line(x.Branch(i)[j], x.Branch(i + 1)[j]));
        if(j < jLimit - 1 && i < iLimit - 1){
          crvs.Add(new Line(x.Branch(i)[j], x.Branch(i + 1)[j + 1]));
          crvs.Add(new Line(x.Branch(i + 1)[j], x.Branch(i)[j + 1]));
        }
      }
    }
    A = crvs;
# ---------- end c_script ----------
graphfromlines = GraphFromLines(ConnectionLines=c_script.A, undirected=True)  # -> Graph, GraphPoints
mesh_ray = MeshRay(Mesh=terrain_2, Point=move.Geometry, Direction=reverse)  # -> Point, Hit
mesh_ray_2 = MeshRay(Mesh=terrain_2, Point=move_2.Geometry, Direction=reverse_2)  # -> Point, Hit
display_graph = DisplayGraph(Graph=graphfromlines.Graph, GraphPoints=graphfromlines.GraphPoints)  # -> VertexCount, EdgeCount, Edge
deconstruct_vector = DeconstructVector(Vector=display_graph.Edge)  # -> XComponent, YComponent, ZComponent
graphtodatatree = GraphToDataTree(Graph=graphfromlines.Graph, methode=False)  # -> DataTree, flatten(Costs)
vector_xyz = VectorXYZ(XComponent=deconstruct_vector.XComponent, YComponent=deconstruct_vector.YComponent, ZComponent=0)  # -> Vector, Length
radians = Radians(Degrees=integer_2)
angle = Angle(VectorA=display_graph.Edge, VectorB=vector_xyz.Vector)  # -> Angle, Reflex
evaluate = Evaluate(Expression="if(x>y,PI*0.5,x)", x=angle.Angle, y=radians)
bounds = Bounds(Numbers=graphtodatatree.Costs)
bounds_2 = Bounds(Numbers=evaluate)
remap_numbers = RemapNumbers(Value=graphtodatatree.Costs, Source=bounds, Target=Domain(0, 1))  # -> Mapped, Clipped
remap_numbers_2 = RemapNumbers(Value=evaluate, Source=bounds_2, Target=Domain(0, 1))  # -> Mapped, Clipped
number_5 = Number("1")
subtraction = Subtraction(A=number_5, B=number_4)
multiplication = Multiplication(A=remap_numbers.Mapped, B=number_4)
multiplication_2 = Multiplication(A=remap_numbers_2.Mapped, B=subtraction)
addition = Addition(A=multiplication_2, B=multiplication)
closest_point = ClosestPoint(Point=mesh_ray.Point, Cloud=graphfromlines.GraphPoints)  # -> ClosestPoint, CPIndex, Distance
closest_point_2 = ClosestPoint(Point=mesh_ray_2.Point, Cloud=graphfromlines.GraphPoints)  # -> ClosestPoint, CPIndex, Distance
datatreetograph = DataTreeToGraph(DataTree=graphtodatatree.DataTree, Cost=graft(addition), methode=2)
cross_reference = CrossReference(ListListA=closest_point.CPIndex, ListListB=closest_point_2.CPIndex, CrossMode=1)  # -> ListListA, ListListB
panel = Panel("Shortest Path")
shortestpathbetweenpoints = ShortestPathBetweenPoints(
    Graph=datatreetograph,
    StartingPoint=graft(cross_reference.ListListA),
    EndPoint=graft(cross_reference.ListListB),
    methode=1)  # -> GraphEdgeIndex, GraphEdgeWeight, GraphVertexIndex, GraphVertexWeight
list_item = ListItem(List=display_graph.Edge, Index=shortestpathbetweenpoints.GraphEdgeIndex, Wrap=True)
join_curves = JoinCurves(Curves=list_item, Preserve=False)
cross_reference_2 = CrossReference(ListListA=mesh_ray.Point, ListListB=mesh_ray_2.Point, CrossMode=1)  # -> ListListA, ListListB
end_points = EndPoints(Curve=join_curves)  # -> Start, End
line = Line(StartPoint=graft(cross_reference_2.ListListA), EndPoint=end_points.Start)
line_2 = Line(StartPoint=end_points.End, EndPoint=graft(cross_reference_2.ListListB))
join_curves_2 = JoinCurves(Curves=[line, line_2, join_curves], Preserve=False)
smooth_polyline = SmoothPolyline(Polyline=join_curves_2, Strength=1, Times=number_3)
curve = Curve(smooth_polyline)

# ---- group: Result
curve_2 = Curve(curve)

# ----
custom_preview_lineweights = CustomPreviewLineweights(Geometry=curve_2, Shader=ColourSwatch(SwatchColor=RGB(0, 0, 0)), Thickness=Slider(2, range=0..10), Absolute=False)
