# Grasshopper definition Waterflow_Direction.gh (Grasshopper 1.0.7)
# plug-ins: Human, MetaHopper

# Description: Visualising Street Segments in relation to water flow direction.
# 
# Red: Steep Terrain leading to fast Waterflow as well as Road is perpendicular to the flow and therefore suffers a lot from it.
# 
# Blue: Terrain is flat or street goes with Water Flow Direction.
# 
# Grey Arrows: Show Waterflow Direction and can be used as recommendation for better direction of a street in steep terrain.
# 
# 1. Add Streets from Layer
# 2. Add Terrain as Surface
document_info = DocumentInfo(AutoUpdate=False, Recursive=False)  # -> DocumentName, DocumentFilePath, Components, Params, _3rdPartyAssemblies
# text is internalised, if metahopper component is missing
not_internalised = Text(document_info._3rdPartyAssemblies)
internalised_text = Text("Human, Version=1.7.3.0, Culture=neutral, PublicKeyToken=null")
create_set = CreateSet(List=[internalised_text, not_internalised])  # -> Set, Map
# Parametric Planning Catalogue
# Rainwater-oriented Street Analysis
# v. 1.0 - Author: DeCodingSpaces - Martin Dennemark
_3rd_party = Panel(create_set.Set)

# ----
# 1.
# 2.
geometry_pipeline = GeometryPipeline(
    GroupByLayer=False,
    GroupByType=False,
    IncludeHidden=True,
    IncludeLocked=True,
    LayerFilter="Streets",
    NameFilter="*",
    SublayerFiltering=True,
    TypeFilter=4)
geometry_pipeline_2 = GeometryPipeline(
    GroupByLayer=False,
    GroupByType=False,
    IncludeHidden=True,
    IncludeLocked=True,
    LayerFilter="Terrain",
    NameFilter="*",
    SublayerFiltering=True,
    TypeFilter=1073741848)
streets = Curve(geometry_pipeline)
terrain = Brep(geometry_pipeline_2)

# ----
# Data Preparation
# 
# Projecting Streets onto Terrain and dividing them into Segments.
# 
# Calculating Street Direction, Waterflow Direction, Terrain Direction for each street segment.
terrain_2 = Brep(terrain)
streets_2 = Curve(streets)
project = Project(Curve=streets_2, Brep=terrain_2, Direction=Vector(0, 0, 1))
explode = Explode(Curve=project, Recursive=True)  # -> flatten(Segments), Vertices
evaluate_curve = EvaluateCurve(Curve=reparameterize(explode.Segments), Parameter=Slider(0.5, range=0..1))  # -> Point, Tangent, Angle
surface_closest_point = SurfaceClosestPoint(Point=evaluate_curve.Point, Surface=terrain_2)  # -> Point, UVPoint, Distance
evaluate_surface = EvaluateSurface(Surface=terrain_2, Point=surface_closest_point.UVPoint)  # -> Point, Normal, UDirection, VDirection, Frame
project_2 = Project(Geometry=evaluate_curve.Tangent, Plane=PlaneXY(0, 0, 0))  # -> Geometry, Transform
project_3 = Project(Geometry=evaluate_surface.Normal, Plane=PlaneXY(0, 0, 0))  # -> Geometry, Transform
midpointstreetsegment = Point(evaluate_curve.Point)
waterflowdirection = Vector(unitize(project_3.Geometry))
streetdirection = Vector(unitize(project_2.Geometry))
streetsegments = Curve(explode.Segments)
terrainnormal = Vector(evaluate_surface.Normal)

# ----
# Calculating Deviation of Street to Waterflow Direction
streetdirection_2 = Vector(streetdirection)
waterflowdirection_2 = Vector(waterflowdirection)
inverts_street_direction_if_necessary = Panel("if(x>0.5*PI,PI-x,x)")
angle = Angle(VectorA=streetdirection_2, VectorB=waterflowdirection_2)  # -> Angle, Reflex
evaluate = Evaluate(Expression=inverts_street_direction_if_necessary, x=angle.Angle)
bounds = Bounds(Numbers=evaluate)
pi = Pi(Factor=Slider(0.5, range=0..1))
deconstruct_domain = DeconstructDomain(Domain=bounds)  # -> Start, End
remap_numbers = RemapNumbers(Value=evaluate, Source=pi, Target=Domain(0, 1))  # -> Mapped, Clipped
normaliseddeviationstreettowaterflow = Number(remap_numbers.Mapped)

# ----
# Calculating Steepness of Terrain
# Calculating Steepness of Terrain
# with Angle between Normal and Z-Direction
terrainnormal_2 = Vector(terrainnormal)
unit_z = UnitZ(Factor=1)
max_degrees = Slider(15, range=0..90)
angle_2 = Angle(VectorA=terrainnormal_2, VectorB=unit_z)  # -> Angle, Reflex
radians = Radians(Degrees=max_degrees)
remap_numbers_2 = RemapNumbers(Value=angle_2.Angle, Source=radians, Target=Domain(0, 1))  # -> Mapped, Clipped
normalisedsteepness = Number(remap_numbers_2.Mapped)

# ----
# Visualising Street Segments
# Red: Steep Terrain leading to fast Waterflow as well as Road is perpendicular to the flow and therefore suffers a lot from it.
# 
# Blue: Terrain is flat or street goes with Water Flow Direction.
normaliseddeviationstreettowaterflow_2 = Number(normaliseddeviationstreettowaterflow)
normalisedsteepness_2 = Number(normalisedsteepness)
streetsegments_2 = Curve(streetsegments)
multiplication = Multiplication(A=normaliseddeviationstreettowaterflow_2, B=normalisedsteepness_2)
gradient = Gradient(
    LowerLimit=0,
    UpperLimit=Slider(1, range=0..1),
    Parameter=multiplication,
    stops=[0: RGB(0, 61, 89), 0.25: RGB(0, 155, 180), 0.5: RGB(148, 193, 28), 0.75: RGB(243, 154, 0), 1: RGB(183, 26, 73)])
custom_preview_lineweights = CustomPreviewLineweights(Geometry=streetsegments_2, Shader=gradient, Thickness=Slider(8, range=0..10), Absolute=True)

# ----
# Visualising Waterflow Direction at Street Segment. Can be used as recommendation for better direction of street especially in steep terrain.
midpointstreetsegment_2 = Point(midpointstreetsegment)
waterflowdirection_3 = Vector(waterflowdirection)
terrain_3 = Brep(terrain)
multiplication_2 = Multiplication(A=waterflowdirection_3, B=Slider(50, range=0..100))
contour = Contour(Shape=terrain_3, Point=Point(0, 0, 0), Direction=Vector(0, 0, 1), Distance=Slider(20, range=0..100))
tree_statistics = TreeStatistics(Tree=contour)  # -> Paths, Length, Count
vector_display_ex = VectorDisplayEx(
    Point=midpointstreetsegment_2,
    Vector=multiplication_2,
    Colour=ColourSwatch(SwatchColor=RGB(255, 255, 255)),
    Width=Slider(1, range=0..1))
subtraction = Subtraction(A=tree_statistics.Count, B="1")
range = Range(Domain=Domain(0, 1), Steps=subtraction)
gradient_2 = Gradient(LowerLimit=0, UpperLimit=1, Parameter=range, stops=[0: RGB(211, 211, 211), 1: RGB(0, 0, 0)])
colour_hsl = ColourHSL(Alpha=1, Hue=0, Saturation="0", Luminance=range)  # -> reverse(Colour)
custom_preview_lineweights_2 = CustomPreviewLineweights(Geometry=contour, Shader=graft(gradient_2), Absolute=False)
