# Grasshopper definition StreetHierarchy.gh (Grasshopper 1.0.7)
# plug-ins: DeCodingSpaces, Human, MetaHopper

# PARAMETRIC PLANNING CATALOGUE
# Street Hierarchy
# v. 1.0 - Author: DeCodingSpaces - Martin Dennemark
document_info = DocumentInfo(AutoUpdate=False, Recursive=False)  # -> DocumentName, DocumentFilePath, Components, Params, _3rdPartyAssemblies
# text is internalised, if metahopper component is missing
not_internalised = Text(document_info._3rdPartyAssemblies)
internalised_text = Text(["DecodingSpacesAssembly, Version=1.0.0.0, Culture=neutral, PublicKeyToken=null", "Human, Version=1.7.3.0, Culture=neutral, PublicKeyToken=null"])
create_set = CreateSet(List=[internalised_text, not_internalised])  # -> Set, Map
# Description: Takes street segments and analyses them in regards to Betweeness Centrality, which shows
# how often street segments might be taken when commuting through the city.
# 
# To simulate flow of people, points of interests as well as city entrances get additional weights in
# the analysis, stating that they should be reached more often than other places.
# 
# 
# 1. Define points of interest PoI, such as the city center.
# 
# 2. Define Entrance Points to the City. Place them closest to the street segment that serves as entrance point.
# 
# 3. After defining put Streets, Calculation will start and the routine might slow down.
# 
# 4. Now weights for PoI, CityEntrance as well as primary, secondary and tertiary roads can be adjusted.
# 
# 5. When the assignment of street hierarchy seems reasonable, the Bake Button can be pressed to bake the streets on seperate layers in Rhino.
_3rd_party = Panel(create_set.Set)

# ---- group: PointsOfInterest
# 1.
cityentrancepoints = Point(Point(1556.200428, -46.84600002, 0))

# ---- group: CityEntrancePoints
# 2.
cityentrancepoints_2 = Point([Point(-1821.108094, -223.5648013, -410.9284559), Point(82.92130255, 1955.487046, -396.5405546)])

# ----
# 4.
# 5.
weight_point_of_interest = Slider(0.5, range=0..1)
weight_city_entrance = Slider(1, range=0..1)
weight_secondary_road = Slider(1, range=0..1)
weight_tertiary_road = Slider(1, range=0..1)
weight_primary_road = Slider(1, range=0..1)
bake_button = Button()
merge = Merge(Data1="0", Data2=weight_tertiary_road, Data3=weight_secondary_road, Data4=weight_primary_road)
mass_addition = MassAddition(Input=merge)  # -> Result, PartialResults
division = Division(A=merge, B=mass_addition.Result)
multiplication = Multiplication(A=division, B=Slider(1.001, range=0..10))
consecutive_domains = ConsecutiveDomains(Numbers=multiplication, Additive=True)
cityentrancepoints_3 = Point(cityentrancepoints_2)

# ---- group: Input Streets
# 3.
curve = Curve([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])

# ---- group: Bake
boolean = Boolean(bake_button)

# ---- group: Street Hierarchy Weights
domain = Domain(consecutive_domains)

# ---- group: Street Segments
curve_2 = Curve(curve)

# ---- group: PointsOfInterest
cityentrancepoints_4 = Point(cityentrancepoints)

# ---- group: Weight City Entrance
number = Number(weight_city_entrance)

# ---- group: Weight Point Of Interest
number_2 = Number(weight_point_of_interest)

# ---- group: PointsOfInterest
cityentrancepoints_5 = Point(cityentrancepoints_4)

# ---- group: Weight Point Of Interest
number_3 = Number(number_2)

# ---- group: Weight City Entrance
number_4 = Number(number)

# ---- group: Street Segments
curve_3 = Curve(curve_2)

# ----
# street segments closest to city entrance or points of interest get an additional weight to simulate ingoing and outgoing traffic.
# street segments closest to city entrance or points of interest get an additional weight to simulate ingoing and outgoing traffic.
cityentrancepoints_6 = Point(cityentrancepoints_3)
network_smooth = NetworkSmooth(Network=curve_3, SnapThreshold=Slider(2, range=0..10), SnapToAnchorPointsOnly=False)
panel = Panel("setup graph")
network_to_segments = NetworkToSegments(NetworkGeometry=network_smooth, ConvertCurves=True, ConversionAngle=0.2, Split=True)
_1_processgeometry = _1ProcessGeometry(Path=network_to_segments, SegmentLength=10000)  # -> Object, Segments, Vectors, Ids
number_slider = Slider(0.5, range=0..1)
list_length = ListLength(List=_1_processgeometry.Segments)
number_slider_2 = Slider(1, range=0..1)
_2_buildgraph = _2BuildGraph(
    Object=_1_processgeometry.Object,
    LengthCoefficient=number_slider,
    AngularCoefficient=number_slider,
    AdditionalEdgeWeightCoefficient=0,
    CalculateDegree=False,
    CalculateInverseGraph=False,
    CopyObject=True)  # -> Object, InverseGraphEdges, Vertices, ReferencedEdges, DegreeCentrality
multiplication_2 = Multiplication(A=number_3, B=list_length)
multiplication_3 = Multiplication(A=number_4, B=list_length)
custom_edge_weights = CustomEdgeWeights(
    segments=_1_processgeometry.Segments,
    pointsofinterest=cityentrancepoints_6,
    customweights=multiplication_3,
    generalweight=number_slider_2)
custom_edge_weights_2 = CustomEdgeWeights(
    segments=_1_processgeometry.Segments,
    pointsofinterest=cityentrancepoints_5,
    customweights=multiplication_2,
    generalweight=number_slider_2)
addition = Addition(A=custom_edge_weights_2, B=custom_edge_weights)
_3_shortestfloydwarshal = _3ShortestFloydWarshal(Object=_2_buildgraph.Object, CopyObject=True, IncludeMaA=False, UseGPU=True)
cull_nth = CullNth(List=addition, CullFrequency=2)
_4_fwgetpaths = _4FWGetPaths(
    Object=_3_shortestfloydwarshal,
    Origins=_1_processgeometry.Segments,
    Destinations=_1_processgeometry.Segments,
    WeightsOrigin=cull_nth,
    WeightsDestination=cull_nth,
    PairwiseShortestPaths=False,
    Radius=0,
    CopyObject=True,
    MaskInputString="00011000",
    PathInfoForPoints=False,
    UseGPU=True)  # -> BetweennessCentrality, ClosenessCentrality, Gravity, BetweennessCentralityWeighted, ClosenessCentralityWeighted, BetweennessCentralityWeightedNormalized, SupplementaryGeometry
logarithm = Logarithm(Value=_4_fwgetpaths.BetweennessCentralityWeighted)
number_5 = Number(logarithm)
bounds = Bounds(Numbers=number_5)
remap_numbers = RemapNumbers(Value=number_5, Source=bounds, Target=Domain(0, 1))  # -> Mapped, Clipped

# ---- group: Analysed Segments
curve_4 = Curve(_1_processgeometry.Segments)

# ---- group: Betweeness / Accessability
number_6 = Number(remap_numbers.Mapped)

# ---- group: Street Hierarchy Weights
domain_2 = Domain(domain)

# ---- group: Analysed Segments
curve_5 = Curve(curve_4)

# ---- group: Betweeness / Accessability
number_7 = Number(number_6)

# ---- group: Bake
boolean_2 = Boolean(boolean)

# ----
list_length_2 = ListLength(List=domain_2)
find_domain = FindDomain(Domains=domain_2, Number=number_7, Strict=False)  # -> Index, Neighbour
panel_2 = Panel("""PrimaryStreet
SecondaryStreet
TertiaryStreet""")
subtraction = Subtraction(A=list_length_2, B="1")
gradient = Gradient(
    LowerLimit=0,
    UpperLimit=subtraction,
    Parameter=find_domain.Index,
    stops=[0: RGB(0, 61, 89), 0.25: RGB(0, 155, 180), 0.5: RGB(148, 193, 28), 0.75: RGB(243, 154, 0), 1: RGB(183, 26, 73)])
create_set_2 = CreateSet(List=find_domain.Index)  # -> Set, Map
create_modify_layers = CreateModifyLayers(LayerName=reverse(panel_2), DeleteLayer=False, enableFullPath=False)  # -> LayerNames, LayerFullPath
sort_list = SortList(Keys=create_set_2.Set)  # -> Keys, ValuesValuesA
integer = Integer(sort_list.Keys)
createattributes = CreateAttributes(LayerName=graft(create_modify_layers.LayerNames), enableFullPath=False)
member_index = MemberIndex(Set=find_domain.Index, Member=integer)  # -> Index, Count
custom_preview_lineweights = CustomPreviewLineweights(Geometry=curve_5, Shader=gradient, Thickness=Slider(2, range=0..10), Absolute=False)
list_item = ListItem(List=curve_5, Index=member_index.Index, Wrap=True)
bake_geometry = BakeGeometry(
    Bake=boolean_2,
    Geometry=simplify(list_item),
    Attributes=simplify(createattributes),
    DeleteOldBakes=False,
    PreserveTrees=False)

# ==== cluster CustomEdgeWeights: Creates lits for custom edge weighting. Each line segment can be assigned either custom or general weight. segments with custom weights are identifyied via custom weight point list
segments = ClusterInput()
pointsofinterest = ClusterInput()
customweights = ClusterInput()
generalweight = ClusterInput()
segments_2 = Line(segments)
generalweight_2 = Number(generalweight)
customweights_2 = Number(customweights)
pointsofinterest_2 = Point(pointsofinterest)
lng = ListLength(List=segments_2)
crv_cp = CurveClosestPoint(Point=graft(pointsofinterest_2), Curve=segments_2)  # -> Point, Parameter, Distance
series = Series(Start=0, Step=1, Count=lng)
sort = SortList(Keys=crv_cp.Distance, ValuesA=series)  # -> Keys, ValuesA
item = ListItem(List=sort.ValuesA, Index=0, Wrap=True)  # -> flatten(Item)
lng_2 = ListLength(List=item)
dup = DuplicateData(Data=customweights_2, Number=lng_2, Order=True)
c_script = CSharpScript(x=customweights_2, y=dup)  # -> out, A; inputs x: list of Double, y: list of Double
# ---------- c_script: C# usings ----------
using System.IO;
using System.Linq;
using System.Data;
using System.Drawing;
using System.Reflection;
using System.Windows.Forms;
using System.Xml;
using System.Xml.Linq;
using System.Runtime.InteropServices;

using Rhino.DocObjects;
using Rhino.Collections;
using GH_IO;
using GH_IO.Serialization;
# ---------- c_script: C# ----------
    if(x.Count == 1)
      A = y;
    else
      A = x;
# ---------- end c_script ----------
ids = Integer(item)
c_list = CSharpScript(edge_count=lng, ids=ids, weights=c_script.A, general_weight=generalweight_2)  # -> add_weight; inputs edge_count: Int32, ids: list of Int32, weights: list of Double, general_weight: Double
# ---------- c_list: C# ----------
    List<double> result = new List<double>(); //Enumerable.Repeat(general_weight, edge_count).ToList();

    for (int i = 0; i < edge_count * 2; i++)
    {
      result.Add(general_weight);
    }


    for (int i = 0; i < ids.Count; i++)
    {
      result[ids[i]*2] = weights[i];
      result[ids[i]*2 + 1] = weights[i];
    }

    add_weight = result;
# ---------- end c_list ----------
weight_list = Number(c_list)
weight_list_2 = ClusterOutput(weight_list)
