# Grasshopper definition StreetsToPlots.gh (Grasshopper 1.0.7)
# plug-ins: DeCodingSpaces, Human, MetaHopper

# Description: Create Plots from Streets and filter those, that are situated on steep terrain.
# 
# 1. Assign Terrain
# 
# 2. Assign Streets
# 
# 3. Check if plot division works
# properly. If some street segments
# are not separating plots, try the
# alternative method.
# 
# 4. Set threshold for slope, to define
# if a plot is too steep and should not
#  be included.
# 
# 5. When you are satisfied, bake to layer.
document_info = DocumentInfo(AutoUpdate=False, Recursive=False)  # -> DocumentName, DocumentFilePath, Components, Params, _3rdPartyAssemblies
# text is internalised, if metahopper component is missing
not_internalised = Text(document_info._3rdPartyAssemblies)
internalised_text = Text(["DecodingSpacesAssembly, Version=1.0.0.0, Culture=neutral, PublicKeyToken=null", "Human, Version=1.7.3.0, Culture=neutral, PublicKeyToken=null"])
create_set = CreateSet(List=[internalised_text, not_internalised])  # -> Set, Map
# PARAMETRIC PLANNING CATALOGUE
# Streets To Plots
# v. 1.0 - Author: DeCodingSpaces - Martin Dennemark
_3rd_party = Panel(create_set.Set)

# ----
# 1.
# 2.
# 3.
# 4.
# 5.
bake_plots = Button()
plot_division = ValueList({"DeCodingSpaces (fast)": 0, "GH Split Surface (slow, maybe more accurate)": 1}, selected="DeCodingSpaces (fast)")
weightslope = Slider(1, range=0..1)
weight_slope = Number(weightslope)

# ---- group: Terrain
terrain = Surface(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)

# ---- group: street segments
curve = Curve([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])

# ---- group: Plot Division
integer = Integer(plot_division)

# ---- group: Bake Plots
boolean = Boolean(bake_plots)

# ---- group: street segments
curve_2 = Curve(flatten(curve))

# ---- group: Plot Division
integer_2 = Integer(integer)

# ---- group: Terrain
terrain_2 = Surface(terrain)

# ----
weight_slope_2 = Number(weight_slope)
network_to_segments = NetworkToSegments(NetworkGeometry=curve_2, ConvertCurves=True, ConversionAngle=0.2, Split=True)
stream_gate = StreamGate(Stream=network_to_segments, Gate=integer_2)  # -> Target0, Target1
project = Project(Geometry=stream_gate.Target1, Plane=PlaneXY(0, 0, 0))  # -> Geometry, Transform
polygons_from_lines = PolygonsFromLines(Lines=stream_gate.Target0, MinBlockSize=0)  # -> Polygons, SynchronizedValues
boundary_surfaces = BoundarySurfaces(Edges=project.Geometry)  # -> flatten(Surfaces)
surface_split = SurfaceSplit(Surface=boundary_surfaces, Curves=project.Geometry)
boundary_surfaces_2 = BoundarySurfaces(Edges=graft(polygons_from_lines.Polygons))  # -> flatten(Surfaces)
stream_filter = StreamFilter(Gate=integer_2, Stream0=boundary_surfaces_2, Stream1=surface_split)
polygon_center = PolygonCenter(Polyline=stream_filter)  # -> CenterV, CenterE, CenterA
unit_z = UnitZ(Factor="-500")
move = Move(Geometry=polygon_center.CenterV, Motion=unit_z)  # -> Geometry, Transform
unit_z_2 = UnitZ(Factor=1)
mesh_ray = MeshRay(Mesh=terrain_2, Point=move.Geometry, Direction=unit_z_2)  # -> Point, Hit
unit_z_3 = UnitZ(Factor=1)
brep_closest_point = BrepClosestPoint(Point=mesh_ray.Point, Brep=terrain_2)  # -> Point, Normal, Distance
angle = Angle(VectorA=unit_z_3, VectorB=brep_closest_point.Normal)  # -> Angle, Reflex
cellslope = Number(angle.Angle)
bounds = Bounds(Numbers=flatten(cellslope))
remap_numbers = RemapNumbers(Value=cellslope, Source=bounds, Target=Domain(0, 1))  # -> Mapped, Clipped
weight_slope_3 = Number(weight_slope_2)
smaller_than = SmallerThan(FirstNumber=remap_numbers.Mapped, SecondNumber=weight_slope_3)  # -> SmallerThan, OrEqualTo
cull_pattern = CullPattern(List=stream_filter, CullPattern=smaller_than.SmallerThan)

# ---- group: Plots
surface = Surface(cull_pattern)

surface_2 = Surface(surface)

# ---- group: Bake Plots
boolean_2 = Boolean(boolean)

# ----
list_length = ListLength(List=flatten(surface_2))
create_modify_layers = CreateModifyLayers(LayerName="Plots", DeleteLayer=False, enableFullPath=False)  # -> LayerNames, LayerFullPath
series = Series(Start=0, Step=1, Count=list_length)
createattributes = CreateAttributes(LayerName=create_modify_layers.LayerNames, enableFullPath=False)
gradient = Gradient(
    LowerLimit=0,
    UpperLimit=list_length,
    Parameter=series,
    stops=[0: RGB(0, 61, 89), 0.25: RGB(0, 155, 180), 0.5: RGB(148, 193, 28), 0.75: RGB(243, 154, 0), 1: RGB(183, 26, 73)])
custom_preview_lineweights = CustomPreviewLineweights(Geometry=flatten(surface_2), Shader=gradient, Absolute=False)
bake_geometry = BakeGeometry(Bake=boolean_2, Geometry=surface_2, Attributes=createattributes, DeleteOldBakes=False, PreserveTrees=False)
