# Grasshopper definition TerrainAnalysisGismo.gh (Grasshopper 1.0.7)
# plug-ins: MetaHopper

# PARAMETRIC PLANNING CATALOGUE
# Terrain Analysis with Gismo Plugin
# v. 1.0 - Author: Credit goes to Djorde Spasic as the developer of Gismo!
document_info = DocumentInfo(AutoUpdate=False, Recursive=False)  # -> DocumentName, DocumentFilePath, Components, Params, _3rdPartyAssemblies
# text is internalised, if metahopper component is missing
not_internalised = Text(document_info._3rdPartyAssemblies)
internalised_text = Text("Gismo - see description")
create_set = CreateSet(List=[internalised_text, not_internalised])  # -> Set, Map
# Description: Simple terrain analysis with Gismo plugin (https://github.com/stgeorges/gismo).
# 
# 1. Analyse terrain by different types.
# 
# 2. Assign terrain as surface
# 
# 3. Assign origin somewhere on terrain
# 
# 4. Run it
_3rd_party = Panel(create_set.Set)

# ----
# 1.
# 2.
# 3.
# 4.
gismo = Gismo_Gismo(gismoFolder="c:\gismo")  # -> out; plug-in component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
analysis_types = ValueList({"Slope": 0, "Grade": 1, "Aspect": 2, "Elevation": 3, "Visibility": 4, "Hillshade": 5, "TRI (Terrain Ruggedness Index by Riley)": 6, "TRI categories (Terrain Ruggedness Index categories by Riley)": 7, "SRF (Surface Roughness Factor by Hobson)": 8, "TPI (Topographic Position Index)": 9, "Mean curvature": 10}, selected="TPI (Topographic Position Index)")
terrain = Surface(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)
point = Point(Point(150.7556438, 486.4097419, 0))

terrainanalysis = Gismo_TerrainAnalysis(
    analysisType=analysis_types,
    terrain=terrain,
    origin=point,
    elevation=Slider(0, range=0..100),
    north=0,
    hypsoStrength=50,
    refine=False,
    bakeIt=False,
    runIt=Toggle(False))  # -> out, analysedTerrain, values, origin, title, legend, legendPlane; inputs analysisType: Int32, origin: Point3d, context: list, sunVector: Vector3d, refine: Boolean, legendBakePar: tree, bakeIt: Boolean, runIt: Boolean; plug-in component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
