# Grasshopper definition Urban_Water_Generative_Hydrology_Network_Analysisv.0.2.gh (Grasshopper 1.0.7)
# plug-ins: SpiderWeb :: Graph Tools, DeCodingSpaces, Anemone, Human

number_slider = Slider(1, range=0..3)

# ----
# Geometry Setup
# 
# (((Geometrical operations are a bit advanced here and can lead easily to issues if changed. Since street network need to consist of lines where each endpoint meets precisely with endpoints of connected lines. Be careful when changing - needs lots of trial and error.
# 
# The Setup does not necessarily make sense for a real scenario)))
geometry_pipeline = GeometryPipeline(
    GroupByLayer=False,
    GroupByType=False,
    IncludeHidden=True,
    IncludeLocked=True,
    LayerFilter="Terrain",
    NameFilter="*",
    SublayerFiltering=True,
    TypeFilter=1073741848)
geometry_pipeline_2 = GeometryPipeline(
    GroupByLayer=False,
    GroupByType=False,
    IncludeHidden=True,
    IncludeLocked=True,
    LayerFilter="Streets",
    NameFilter="*",
    SublayerFiltering=True,
    TypeFilter=4)
geometry_pipeline_3 = GeometryPipeline(
    GroupByLayer=False,
    GroupByType=False,
    IncludeHidden=True,
    IncludeLocked=True,
    LayerFilter="Watertank",
    NameFilter="*",
    SublayerFiltering=True,
    TypeFilter=1)
# TASK: Move the points of the water tank (blue) and city center (white) in the Rhino Viewport on the map and observe how water access improves or worsens for the households.
# 
# Green Heart: Water Access
# Red Cross: No Water Acess
# 
# 
# (The simulation only considers gravity. Normally, pumps could assist in distributing water to nodes without access.)
# Calculating Water Network
# 
# Moveable Markers:
# Blue = Water Tanks
# White = City Center with note on how long the water network is. Which can be used for Cost calculation.
# 
# Remaining Markers are Public Water Taps:
# Red = Not enough pressure to geet water
# Green = Just enough pressure
geometry_pipeline_4 = GeometryPipeline(
    GroupByLayer=False,
    GroupByType=False,
    IncludeHidden=True,
    IncludeLocked=True,
    LayerFilter="City Center",
    NameFilter="*",
    SublayerFiltering=True,
    TypeFilter=1)
network_to_segments = NetworkToSegments(NetworkGeometry=geometry_pipeline_2, ConvertCurves=True, ConversionAngle=0.2, Split=True)
end_points = EndPoints(Curve=flatten(network_to_segments))  # -> Start, End
projectpttosrf = ProjectPtToSrf(point=end_points.End, surface=reparameterize(geometry_pipeline))
projectpttosrf_2 = ProjectPtToSrf(point=end_points.Start, surface=reparameterize(geometry_pipeline))
line = Line(StartPoint=projectpttosrf_2, EndPoint=projectpttosrf)
projectpttosrf_3 = ProjectPtToSrf(point=geometry_pipeline_3, surface=reparameterize(geometry_pipeline))

polygons_from_lines = PolygonsFromLines(Lines=network_to_segments, MinBlockSize=0)  # -> Polygons, SynchronizedValues

parcels = Parcels(
    Polygons=polygons_from_lines.Polygons,
    ConnectionDistance=1,
    StreetOffset=0,
    PlotWidthThreshold=Slider(100, range=0..100),
    Precision=Slider(1000000, range=0..1000000))
network_to_segments_2 = NetworkToSegments(NetworkGeometry=flatten([parcels, network_to_segments]), ConvertCurves=True, ConversionAngle=0.2, Split=True)
removesmallsegments = RemoveSmallSegments(radiusthreshold=Slider(0.5, range=0..1), curvesegments=network_to_segments_2)
end_points_2 = EndPoints(Curve=flatten(removesmallsegments))  # -> Start, End
projectpttosrf_4 = ProjectPtToSrf(point=end_points_2.Start, surface=reparameterize(geometry_pipeline))
projectpttosrf_5 = ProjectPtToSrf(point=end_points_2.End, surface=reparameterize(geometry_pipeline))
line_2 = Line(StartPoint=projectpttosrf_4, EndPoint=projectpttosrf_5)

# ----
# Geometry Setup
# 
# Blocks closest to city center are chosen up until they reach an area that suits 5.000 inhabitants.
# 
# Their demand is calculated by the amount of households that fit onto each plot.
area = Area(Geometry=flatten(parcels))  # -> Area, Centroid
areaperhousehold = Slider(1000, range=50..1000)
demandperhousehold = Slider(35, range=0..100)
personperhousehold = Slider(3, range=0..10)
projectpttosrf_6 = ProjectPtToSrf(point=area.Centroid, surface=reparameterize(geometry_pipeline))
distance = Distance(PointA=geometry_pipeline_4, PointB=projectpttosrf_6)
division = Division(A=area.Area, B=areaperhousehold)
multiplication = Multiplication(A=demandperhousehold, B=division)
list_length = ListLength(List=distance)
series = Series(Start=0, Step=1, Count=list_length)
sort_list = SortList(Keys=distance, ValuesValuesA=division, ValuesA=series)  # -> Keys, ValuesValuesA, ValuesA
mass_addition = MassAddition(Input=sort_list.ValuesValuesA)  # -> Result, PartialResults
multiplication_2 = Multiplication(A=mass_addition.PartialResults, B=personperhousehold)
smaller_than = SmallerThan(FirstNumber=multiplication_2, SecondNumber=Slider(5000, range=0..10000))  # -> SmallerThan, OrEqualTo
project = Project(Curve=parcels, Brep=geometry_pipeline, Direction=Vector(0, 0, 1))
cull_pattern = CullPattern(List=sort_list.ValuesA, CullPattern=smaller_than.SmallerThan)
lps_to_lpd = Slider(5.787e-05, range=0..0.0001)
list_item = ListItem(List=flatten(project), Index=cull_pattern, Wrap=True)
list_item_2 = ListItem(List=multiplication, Index=cull_pattern, Wrap=True)
list_item_3 = ListItem(List=projectpttosrf_6, Index=cull_pattern, Wrap=True)
multiplication_3 = Multiplication(A=list_item_2, B=lps_to_lpd)

contour = Contour(Shape=geometry_pipeline, Point=Point(0, 0, 0), Direction=Vector(0, 0, 1), Distance=Slider(10, range=0..10))
tree_statistics = TreeStatistics(Tree=contour)  # -> Paths, Length, Count
subtraction = Subtraction(A=tree_statistics.Count, B="1")
colour_swatch = ColourSwatch(SwatchColor=RGB(255, 255, 255))
range = Range(Domain=Domain(0, 1), Steps=subtraction)
panel = Panel("0")
gradient = Gradient(
    LowerLimit=0,
    UpperLimit=1,
    Parameter=range,
    stops=[0: RGB(234, 38, 0), 0.25: RGB(234, 126, 0), 0.5: RGB(254, 244, 84), 0.75: RGB(173, 203, 249), 1: RGB(75, 107, 169)])
custom_preview_lineweights = CustomPreviewLineweights(Geometry=line, Shader=colour_swatch, Thickness=Slider(1, range=0..10), Absolute=False)
custom_preview = CustomPreview(Geometry=geometry_pipeline, Material=ColourSwatch(SwatchColor=RGB(125, 125, 125)))
custom_preview_lineweights_2 = CustomPreviewLineweights(Geometry=contour, Shader=graft(gradient), Absolute=False)
custom_preview_lineweights_3 = CustomPreviewLineweights(Geometry=list_item, Shader=colour_swatch, Thickness=Slider(3, range=0..10), Absolute=False)

# ----
# Spiderweb is used to calculated the shortest path from water tanks to consuming water taps.
# 
# (((A good water network would have redundant connections, that are not considered in this calculation.)))
graphfromlines = GraphFromLines(ConnectionLines=line_2, undirected=True)  # -> Graph, GraphPoints
closest_point = ClosestPoint(Point=list_item_3, Cloud=graphfromlines.GraphPoints)  # -> ClosestPoint, CPIndex, Distance
closest_point_2 = ClosestPoint(Point=projectpttosrf_3, Cloud=graphfromlines.GraphPoints)  # -> ClosestPoint, CPIndex, Distance
cross_reference = CrossReference(ListListA=closest_point_2.CPIndex, ListListB=closest_point.CPIndex, CrossMode=6)  # -> ListListA, ListListB
shortestpathbetweenpoints = ShortestPathBetweenPoints(Graph=graphfromlines.Graph, StartingPoint=cross_reference.ListListA, EndPoint=cross_reference.ListListB, methode=1)  # -> GraphEdgeIndex, GraphEdgeWeight, GraphVertexIndex, GraphVertexWeight
display_graph = DisplayGraph(Graph=graphfromlines.Graph, GraphPoints=graphfromlines.GraphPoints, hidden=True)  # -> VertexCount, EdgeCount, Edge
list_item_4 = ListItem(List=display_graph.Edge, Index=shortestpathbetweenpoints.GraphEdgeIndex, Wrap=True)
network_to_segments_3 = NetworkToSegments(NetworkGeometry=flatten(list_item_4), ConvertCurves=True, ConversionAngle=0.2, Split=True)
explode = Explode(Curve=network_to_segments_3, Recursive=True)  # -> Segments, Vertices
closest_point_3 = ClosestPoint(Point=projectpttosrf_3, Cloud=flatten(explode.Vertices))  # -> ClosestPoint, CPIndex, Distance
line_3 = Line(StartPoint=projectpttosrf_3, EndPoint=closest_point_3.ClosestPoint)
number_slider_2 = Slider(0.5, range=0..1)  # disabled

closest_point_4 = ClosestPoint(Point=list_item_3, Cloud=flatten(explode.Vertices))  # -> ClosestPoint, CPIndex, Distance
line_4 = Line(StartPoint=list_item_3, EndPoint=closest_point_4.ClosestPoint)

flatten_tree = FlattenTree(Tree=[network_to_segments_3, line_3, line_4], Path="{0}")
network_smooth = NetworkSmooth(Network=flatten_tree, SnapThreshold=number_slider_2, SnapToAnchorPointsOnly=False)  # disabled

# ----
# Looping through Water Analysis to find suitable pipe diameters.
# 
# Each iteration the flow velocity in each pipe is being checked. If the velocity is too high a higher pipe diameter is chosen. This is a simple way of automating the dimensioning of pipes.
# Loop to automatically dimension pipes
gene_pool = GenePool(Decimals=2, Maximum=0.5, Minimum=0, Value=[0.03, 0.06, 0.09, 0.12, 0.15])
curve = Curve(flatten_tree)
list_length_2 = ListLength(List=curve)
list_length_3 = ListLength(List=flatten([gene_pool, curve]))
iterations = Slider(4, range=0..5)
duplicate_data = DuplicateData(Data="0", Number=list_length_2, Order=True)
list_length_4 = ListLength(List=projectpttosrf_3)
addition = Addition(A=iterations, B=[list_length_3, number_slider])
duplicate_data_2 = DuplicateData(Data=Slider(5, range=0..100), Number=list_length_4, Order=True)
loop_start = LoopStart(Repeat=iterations, Trigger=addition, Data=duplicate_data)  # -> port, Counter, Data
list_item_5 = ListItem(List=gene_pool, Index=loop_start.Data, Wrap=True)
write_hydrology_network = WriteHydrologyNetwork(
    Lines=curve,
    LineDiameterM=list_item_5,
    LineRoughness=140,
    PumpPowerKw=1,
    Consumers=list_item_3,
    ConsumerDemandLPS=multiplication_3,
    Tanks=projectpttosrf_3,
    TankHeightM=duplicate_data_2,
    TankVolumeM³=Domain(50, 100))  # -> FilePath, ConsumerID, TankID, ReservoirID
node_values = ValueList({"Actual demand": 0, "Hydraulic Head": 1, "Pressure": 2}, selected="Pressure")
analyse_hydrology_network = AnalyseHydrologyNetwork(FilePath=write_hydrology_network.FilePath, Steps=1)  # -> PipeValues, PipeType, NodeValues, NodeType, NodeID
list_item_6 = ListItem(List=analyse_hydrology_network.NodeValues, Index=node_values, Wrap=True)  # -> flatten(Item)
pipe_values = ValueList({"Flow rate": 0, "Flow velocity": 1, "Head loss": 2, "Actual link status": 3, "Roughness": 4, "Energy expended": 5}, selected="Flow velocity")
round = Round(Number=list_item_6)  # -> Nearest, Floor, Ceiling
list_item_7 = ListItem(List=analyse_hydrology_network.PipeValues, Index=pipe_values, Wrap=True)  # -> flatten(Item)
division_2 = Division(A=round.Nearest, B=Slider(10, range=0..10))
larger_than = LargerThan(FirstNumber=list_item_7, SecondNumber=number_slider)  # -> LargerThan, OrEqualTo
consumer_values = ListItem(List=division_2, Index=write_hydrology_network.ConsumerID, Wrap=True)  # -> flatten(Item)
consumer_values_2 = ListItem(List=division_2, Index=write_hydrology_network.TankID, Wrap=True)  # -> flatten(Item)
addition_2 = Addition(A=loop_start.Data, B=larger_than.LargerThan)
loop_end = LoopEnd(port=loop_start.port, Exit=False, Data=addition_2, TimeOutVal=0, pausedState=False, state="Constant output")
list_item_8 = ListItem(List=gene_pool, Index=loop_end, Wrap=True)

# ----
# Water pressure below 1 bar is not enough. Above 16 bar is too much.
number_slider_3 = Slider(4, range=0..10)
panel_2 = Panel("Visualisation")
concatenate = Concatenate(FragmentA=consumer_values, FragmentB=" bar")
concatenate_2 = Concatenate(FragmentA=consumer_values_2, FragmentB=" bar")
length = Length(Curve=curve)
point = Point(projectpttosrf_3)
gradient_2 = Gradient(
    LowerLimit=0,
    UpperLimit=number_slider_3,
    Parameter=list_item_7,
    stops=[0: RGB(0, 61, 89), 0.25: RGB(0, 155, 180), 0.5: RGB(148, 193, 28), 0.75: RGB(243, 154, 0), 1: RGB(183, 26, 73)])
move = Move(Geometry=point, Motion=Vector(0, 0, 10))  # -> Geometry, Transform
mass_addition_2 = MassAddition(Input=length)  # -> Result, PartialResults
division_3 = Division(A=mass_addition_2.Result, B=Slider(100, range=0..100))
gradient_3 = Gradient(LowerLimit="0.99", UpperLimit="16.01", Parameter=consumer_values, stops=[0.00323: RGB(255, 0, 0), 0.991: RGB(0, 128, 0)])
round_2 = Round(Number=division_3)  # -> Nearest, Floor, Ceiling
smaller_than_2 = SmallerThan(FirstNumber=consumer_values, SecondNumber=Slider(1.02, range=0..10))  # -> SmallerThan, OrEqualTo
number_slider_4 = Slider(12.2, range=0..15)
colour_swatch_2 = ColourSwatch(SwatchColor=RGB(255, 255, 255))
number_slider_5 = Slider(15, range=0..100)
number_slider_6 = Slider(100, range=0..100)
panel_3 = Panel("""8
3""")
division_4 = Division(A=round_2.Nearest, B=Slider(10, range=0..100))
point_2 = Point(list_item_3)
move_2 = Move(Geometry=curve, Motion=Vector(0, 0, 10))  # -> Geometry, Transform
list_item_9 = ListItem(List=panel_3, Index=smaller_than_2.SmallerThan, Wrap=True)
boolean_toggle = BooleanToggle(True)
move_3 = Move(Geometry=point_2, Motion=Vector(0, 0, 10))  # -> Geometry, Transform
symbol_simple = SymbolSimple(Style=13, Size=number_slider_4, Rotation=0, Colour=colour_swatch_2)
concatenate_3 = Concatenate(FragmentA=division_4, FragmentB="km")
colour_swatch_3 = ColourSwatch(SwatchColor=RGB(0, 0, 0))
multiplication_4 = Multiplication(A=list_item_8, B=Slider(522, range=0..1000))
symbol_simple_2 = SymbolSimple(Style=13, Size=number_slider_4, Rotation=0, Colour=ColourSwatch(SwatchColor=RGB(0, 115, 255)))
symbol_simple_3 = SymbolSimple(Style=list_item_9, Size=Slider(7, range=0..10), Rotation=0, Colour=gradient_3)
screen_oriented_text = ScreenOrientedText(
    Text=concatenate,
    Justification=2,
    Location=move_3.Geometry,
    SizeFactor=number_slider_5,
    Color=colour_swatch_3,
    Depth=number_slider_6,
    Absolute=boolean_toggle)
screen_oriented_text_2 = ScreenOrientedText(
    Text=concatenate_3,
    Justification=2,
    Location=geometry_pipeline_4,
    SizeFactor=number_slider_5,
    Color=colour_swatch_2,
    Depth=number_slider_6,
    Absolute=boolean_toggle)
screen_oriented_text_3 = ScreenOrientedText(
    Text=concatenate_2,
    Justification=2,
    Location=move.Geometry,
    SizeFactor=Slider(19, range=0..100),
    Color=colour_swatch_3,
    Depth=number_slider_6,
    Absolute=boolean_toggle)
custom_preview_lineweights_4 = CustomPreviewLineweights(Geometry=move_2.Geometry, Shader=gradient_2, Thickness=multiplication_4, Absolute=boolean_toggle)
symbol_display = SymbolDisplay(Location=geometry_pipeline_4, Display=symbol_simple)
symbol_display_2 = SymbolDisplay(Location=move_3.Geometry, Display=symbol_simple_3)
symbol_display_3 = SymbolDisplay(Location=move.Geometry, Display=symbol_simple_2)

# ==== cluster ProjectPtToSrf
surface = ClusterInput()
point = ClusterInput()
surface_2 = Surface(reparameterize(surface))
point_2 = Point(point)
unit_z = UnitZ(Factor="-9999")
unit_z_2 = UnitZ(Factor=1)
move = Move(Geometry=point_2, Motion=unit_z)  # -> Geometry, Transform
mesh_ray = MeshRay(Mesh=surface_2, Point=move.Geometry, Direction=unit_z_2)  # -> Point, Hit
point_3 = Point(mesh_ray.Point)
point_4 = ClusterOutput(point_3)

# ==== cluster RemoveSmallSegments
radiusthreshold = ClusterInput()
curvesegments = ClusterInput()
curvesegments_2 = Curve(curvesegments)
radiusthreshold_2 = Number(radiusthreshold)
explode = Explode(Curve=curvesegments_2, Recursive=True)  # -> Segments, Vertices
point_groups = PointGroups(Points=flatten(explode.Vertices), Distance=radiusthreshold_2)  # -> Groups, Indices
average = Average(Input=point_groups.Groups)
list_length = ListLength(List=point_groups.Indices)
duplicate_data = DuplicateData(Data=average, Number=list_length, Order=True)  # -> flatten(Data)
sort_list = SortList(Keys=flatten(point_groups.Indices), ValuesValuesA=duplicate_data)  # -> Keys, ValuesValuesA
unflatten_tree = UnflattenTree(Tree=sort_list.ValuesValuesA, Guide=explode.Vertices)
polyline = PolyLine(Vertices=unflatten_tree, Closed=False)  # -> flatten(Polyline)
length = Length(Curve=polyline)
smaller_than = SmallerThan(FirstNumber=length, SecondNumber=Slider(0, range=0..100))  # -> SmallerThan, OrEqualTo
cull_pattern = CullPattern(List=polyline, CullPattern=invert(smaller_than.OrEqualTo))
curve = Curve(cull_pattern)
curve_2 = ClusterOutput(curve)
