# Grasshopper definition WaterbasedStreetGrowth.gh (Grasshopper 1.0.7)
# plug-ins: DeCodingSpaces, Anemone, Human, MetaHopper

# Description: Generate street network based on waterflow direction.
# 
# 1. Assign base data: Set location of city center, existing streets and add terrain as surface.
# 
# 2. Define growth boundary of city by changing weights for slope, height, distance to center. Define area of growth boundary via number of people, household and area per household sliders. Compare possible area to cover (growth boundary area) with needed area for population. If factor is above 1 chances are high, that street network will cover enough area.
# 
# 3. Run simulation. Limit generated street segments to max number to stop calculation at some point. Pause simulation if necessary.
# 
# 4. Advanced: Configure street network generation!
document_info = DocumentInfo(AutoUpdate=False, Recursive=False)  # -> DocumentName, DocumentFilePath, Components, Params, _3rdPartyAssemblies
# text is internalised, if metahopper component is missing
not_internalised = Text(document_info._3rdPartyAssemblies)
internalised_text = Text(["DecodingSpacesAssembly, Version=1.0.0.0, Culture=neutral, PublicKeyToken=null", "Human, Version=1.7.3.0, Culture=neutral, PublicKeyToken=null", "Anemone, Version=0.4.0.0, Culture=neutral, PublicKeyToken=null"])
create_set = CreateSet(List=[internalised_text, not_internalised])  # -> Set, Map
# PARAMETRIC PLANNING CATALOGUE
# Waterbased Street Growth
# v. 1.0 - Author: DeCodingSpaces - Martin Dennemark
_3rd_party = Panel(create_set.Set)

# ----
# 3.
street_segments = Slider(10000, range=0..10000)
# Description (Scrooooll): Growth algorithm generates each step a line segment, that tries to follow the guidelines such as waterflow direction and deviation angle. After x segments have been generated, they try to branch out. This leads to a bit abstract setting of parameters.
# 
# Street Block Size (SBS) & Segments Per Block Edge (SPBE):
# If we want to have a block of 200m (SBS), but our street segments have a length of around 40m, we need to generate 5 segments (SPBE) before it branches out.
# 
# MaxGrowthAngle (MGA) & GrowthAngle (GA):
# Each iteration the line segment searches for best possible growth direction. But for streets this angle should be limited (try out if you dont do it). This limit is MGA, i.e. 10° to left and right. And since the range of angles inbetween would be infinite, we need to set steps to check angles. So GA defines the angle by which MGA is divided, i.e. 5° would lead to angles -10°, -5°, 0°, 5° and 10° being tested.
# 
# JunctionType (JT) & InitialDirection (ID):
# Try them out. Crossing leads to branching in both direction of a street. Left starts with left side, right with right side, but both switch direction every next branch. With Initial Direction the growth of first elements can be controlled. This might be useful, if one wants to grow only within a predefined area and not in both sides.
# 
# PopulationThreshold:
# The street network grows on a grid with each cell having a value for its height and population. If the value for population is above this value, no street segment will grow in its direction. The example only uses values of 0 and 1, therefore population threshold does not really have an influence at this moment.
pause_simulation = BooleanToggle(False)
run_simulation = BooleanToggle(False)
boolean = Boolean(run_simulation)
integer = Integer(street_segments)
boolean_2 = Boolean(pause_simulation)

# ----
# 1.
city_center = Point(Point(88.78072628, 337.3880383, -407.8669506))
existing_streets = Curve([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])

# ---- group: Terrain
terrain = Surface(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)

# ----
input = ColourSwatch(SwatchColor=RGB(227, 5, 116))
symbol_simple = SymbolSimple(Style=13, Size=Slider(10, range=0..10), Rotation=0, Colour=input)
custom_preview_lineweights = CustomPreviewLineweights(Geometry=existing_streets, Shader=input, Absolute=False)
symbol_display = SymbolDisplay(Location=city_center, Display=symbol_simple)

# ---- group: Configuration Street Generation
# 4.
initialdirection = ValueList({"Both Directions": 0, "Left Side": 1, "Right Side": 2}, selected="Both Directions")
junction_type = ValueList({"Crossing": 0, "T-Junction Start Left": 1, "T-Junction Start Right": 2}, selected="Crossing")
streetblocksize = Slider(120, range=0..150)
segmentsperblockedge = Slider(2, range=0..10)
waterangleshift = Slider(0, range=0..45)
growthangle = Slider(1, range=1..5)
populationthreshold = Slider(0.85, range=0..1)
maxgrowthangle = Slider(10, range=0..90)
division = Division(A=streetblocksize, B=segmentsperblockedge)
division_2 = Division(A=maxgrowthangle, B=growthangle)
populationthreshold_2 = Number(populationthreshold)
angleresolution = Integer(division_2)
waterangleshift_2 = Number(waterangleshift)
segmentlength = Number(division)
branchingsteps = Integer(segmentsperblockedge)
streetblocksize_2 = Number(streetblocksize)
initialdirection_2 = Integer(initialdirection)
growthangle_2 = Number(maxgrowthangle)
junctiontype = Integer(junction_type)

# ---- group: Terrain
terrain_2 = Surface(terrain)

# ----
# Rotate terrain to order point grid correctly.
# Otherwise output might be messed up.
city_center_2 = Point(city_center)
existing_streets_2 = Curve(existing_streets)
panel = Panel("""0,0
1,1""")
evaluate_surface = EvaluateSurface(Surface=reparameterize(terrain_2), Point=panel)  # -> Point, Normal, UDirection, VDirection, Frame
average = Average(Input=evaluate_surface.Point)
list_item = ListItem(List=panel, Index=0, Wrap=True)  # -> Item, Item1
ghpython_script = GhPythonScript(x=evaluate_surface.Point)  # -> out, a; inputs x: list of Vector3d
# ---------- ghpython_script: Python ----------
__author__ = "MartinD"
__version__ = "2020.05.20"

import rhinoscriptsyntax as rs
import Rhino.Geometry as rg

vecX = (x[1].X - x[0].X)
vecX = vecX/abs(vecX)
vecY = (x[1].Y - x[0].Y)
vecY = vecY/abs(vecY)

a = rg.Vector3d(vecX,vecY,0)
# ---------- end ghpython_script ----------
angle = Angle(VectorA=list_item.Item1, VectorB=ghpython_script.a)  # -> Angle, Reflex
negative = Negative(Value=angle.Angle)
rotate = Rotate(Geometry=existing_streets_2, Angle=angle.Angle, Plane=average)  # -> Geometry, Transform
rotate_2 = Rotate(Geometry=city_center_2, Angle=angle.Angle, Plane=average)  # -> Geometry, Transform
rotate_3 = Rotate(Angle=negative, Plane=average)  # -> Geometry, Transform
rotate_4 = Rotate(Geometry=terrain_2, Angle=angle.Angle, Plane=average)  # -> Geometry, Transform
city_center_3 = Point(rotate_2.Geometry)
existing_streets_3 = Curve(rotate.Geometry)
terrain_3 = Surface(rotate_4.Geometry)

# ---- group: Rotate Backwards
rotatebackwards = Transform(rotate_3.Transform)

# ----
number_slider = Slider(100, range=0..100)
city_center_4 = Point(city_center_3)
terrain_4 = Surface(terrain_3)
unit_z = UnitZ(Factor="-500")
flow_paths = FlowPaths(Terrain=terrain_4, Smooth=Slider(0.5, range=0..1), UCount=number_slider, VCount=number_slider)  # -> FlowPathsShort, FlowPathsLong, Terrain
subtraction = Subtraction(A=Slider(200, range=0..1000), B=Slider(1, range=0..1))
move = Move(Geometry=city_center_4, Motion=unit_z)  # -> Geometry, Transform
divide_surface = DivideSurface(Surface=flow_paths.Terrain, UCount=subtraction, VCount=subtraction)  # -> Points, Normals, Parameters
dimensions = Dimensions(Surface=flow_paths.Terrain)  # -> UDimension, VDimension
unit_z_2 = UnitZ(Factor=1)
list_length = ListLength(List=flatten(divide_surface.Points))
contour = Contour(Shape=flow_paths.Terrain, Point=Point(0, 0, 0), Direction=Vector(0, 0, 1), Distance=Slider(10, range=0..10))
multiplication = Multiplication(A=dimensions.UDimension, B=dimensions.VDimension)
mesh_ray = MeshRay(Mesh=flow_paths.Terrain, Point=move.Geometry, Direction=unit_z_2)  # -> Point, Hit
division_3 = Division(A=multiplication, B=list_length)
projectedcitycenter = Point(mesh_ray.Point)
cellnormal = Point(divide_surface.Normals)
cellcenters = Point(divide_surface.Points)
cellarea = Number(division_3)
flowlines = Curve(flow_paths.FlowPathsShort)
curve = Curve(contour)

# ----
# Calculate Distance to Center for each Cell
projectedcitycenter_2 = Point(projectedcitycenter)
cellcenters_2 = Point(cellcenters)
distance = Distance(PointA=projectedcitycenter_2, PointB=cellcenters_2)
celldistancetocenter = Number(distance)

# ----
# Calculate Height Difference from Center for each Cell
projectedcitycenter_3 = Point(projectedcitycenter)
cellcenters_3 = Point(cellcenters)
deconstruct = Deconstruct(Point=projectedcitycenter_3)  # -> XComponent, YComponent, ZComponent
deconstruct_2 = Deconstruct(Point=cellcenters_3)  # -> XComponent, YComponent, ZComponent
bounds = Bounds(Numbers=flatten(deconstruct_2.ZComponent))
subtraction_2 = Subtraction(A=deconstruct_2.ZComponent, B=deconstruct.ZComponent)
remap_numbers = RemapNumbers(Value=deconstruct_2.ZComponent, Source=bounds, Target=Domain(0, 1))  # -> Mapped, Clipped
absolute = Absolute(Value=subtraction_2)
cellheight = Number(deconstruct_2.ZComponent)
cellheight_2 = Number(absolute)

# ----
# Setup Area, that can be covered with streets
# Calculate Slope for each Cell
cellnormal_2 = Point(cellnormal)
unit_z_3 = UnitZ(Factor=1)
angle_2 = Angle(VectorA=unit_z_3, VectorB=cellnormal_2)  # -> Angle, Reflex
cellslope = Number(angle_2.Angle)

# ---- group: Run
boolean_3 = Boolean(boolean)

# ---- group: No. of Street Segments
integer_2 = Integer(integer)

# ---- group: Rotate Backwards
rotatebackwards_2 = Transform(rotatebackwards)

rotatebackwards_3 = Transform(rotatebackwards)

# ----
# Visualise Water Flowlines
flowlines_2 = Curve(flowlines)
transform = Transform(Geometry=flowlines_2, Transform=rotatebackwards_2)
custom_preview_lineweights_2 = CustomPreviewLineweights(Geometry=transform, Shader=ColourSwatch(SwatchColor=RGB(17, 140, 255)), Absolute=False)

# ---- group: Rotate Backwards
rotatebackwards_4 = Transform(rotatebackwards)

# ----
# Visualise Terrain Height
cellcenters_4 = Point(cellcenters)
cellheight_3 = Number(cellheight_2)
bounds_2 = Bounds(Numbers=flatten(cellheight_3))
transform_2 = Transform(Geometry=cellcenters_4, Transform=rotatebackwards_4)
remap_numbers_2 = RemapNumbers(Value=cellheight_3, Source=bounds_2, Target=Domain(0, 1))  # -> Mapped, Clipped
gradient = Gradient(LowerLimit=0, UpperLimit=1, Parameter=remap_numbers_2.Mapped, stops=[0: RGB(255, 255, 255), 1: RGB(0, 0, 0)])
symbol_advanced = SymbolAdvanced(
    Style=5,
    SizePrimary=Slider(1, range=0..10),
    SizeSecondary=10,
    Rotation=0,
    Fill=gradient,
    Edge=gradient,
    Width=2,
    Adjust=False)
symbol_display_2 = SymbolDisplay(Location=flatten(transform_2), Display=flatten(symbol_advanced))

# ---- group: Rotate Backwards
rotatebackwards_5 = Transform(rotatebackwards)

rotatebackwards_6 = Transform(rotatebackwards)

# ----
curve_2 = Curve(curve)
transform_3 = Transform(Geometry=curve_2, Transform=rotatebackwards_6)
custom_preview_lineweights_3 = CustomPreviewLineweights(Geometry=transform_3, Shader=ColourSwatch(SwatchColor=RGB(158, 158, 158)), Absolute=False)

# ----
# 2.
number_people = Slider(10000, range=0..10000)
personperhousehold = Slider(3, range=0..10)
areaperhousehold = Slider(1000, range=50..1000)
weightcenter = Slider(0.3, range=0..1)
weightslope = Slider(0.5, range=0..1)
weightheight = Slider(0.75, range=0..1)
division_4 = Division(A=number_people, B=personperhousehold)
multiplication_2 = Multiplication(A=division_4, B=areaperhousehold)
division_5 = Division(A=multiplication_2, B="1000000")
needed_area_in_sqkm = Panel(division_5)
weight_distance_to_center = Number(weightcenter)
weight_height = Number(weightheight)
weight_slope = Number(weightslope)

# ----
# Score each Cell by weighting Values for Terrain Slope, Height, Road and Center Distance
celldistancetocenter_2 = Number(celldistancetocenter)
cellheight_4 = Number(cellheight_2)
cellslope_2 = Number(cellslope)
weight_slope_2 = Number(weight_slope)
weight_height_2 = Number(weight_height)
weight_distance_to_center_2 = Number(weight_distance_to_center)
entwine = Entwine(Branch00=cellslope_2, Branch01=cellheight_4, Branch02=celldistancetocenter_2, FlattenInputs=True)
entwine_2 = Entwine(Branch00=weight_slope_2, Branch01=weight_height_2, Branch02=weight_distance_to_center_2, FlattenInputs=True)  # -> flatten(Result)
bounds_3 = Bounds(Numbers=entwine)
remap_numbers_3 = RemapNumbers(Value=entwine, Source=bounds_3, Target=Domain(0, 1))  # -> Mapped, Clipped
flip_matrix = FlipMatrix(Data=remap_numbers_3.Mapped)
smaller_than = SmallerThan(FirstNumber=flip_matrix, SecondNumber=entwine_2)  # -> SmallerThan, OrEqualTo
mass_multiplication = MassMultiplication(Input=smaller_than.SmallerThan)  # -> Result, PartialResults
weighted_average = WeightedAverage(Input=flip_matrix, Weights=entwine_2)
unflatten_tree = UnflattenTree(Tree=mass_multiplication.Result, Guide=cellslope_2)
unflatten_tree_2 = UnflattenTree(Tree=weighted_average, Guide=cellslope_2)
cellstate = Boolean(unflatten_tree)
cellscore = Number(unflatten_tree_2)

# ----
# Visualise Filtered Area, that can be covered with streets
cellcenters_5 = Point(cellcenters)
cellscore_2 = Number(cellscore)
cellstate_2 = Number(cellstate)
cellarea_2 = Number(cellarea)
cull_pattern = CullPattern(List=cellcenters_5, CullPattern=cellstate_2)
cull_pattern_2 = CullPattern(List=cellscore_2, CullPattern=cellstate_2)
bounds_4 = Bounds(Numbers=flatten(cull_pattern_2))
list_length_2 = ListLength(List=flatten(cull_pattern))
remap_numbers_4 = RemapNumbers(Value=cull_pattern_2, Source=bounds_4, Target=Domain(0, 1))  # -> Mapped, Clipped
multiplication_3 = Multiplication(A=list_length_2, B=cellarea_2)
gradient_2 = Gradient(
    LowerLimit=0,
    UpperLimit=1,
    Parameter=remap_numbers_4.Mapped,
    stops=[0: RGB(234, 38, 0), 0.25: RGB(234, 126, 0), 0.5: RGB(254, 244, 84), 0.75: RGB(173, 203, 249), 1: RGB(75, 107, 169)])
possibleareatocover = Number(multiplication_3)
symbol_advanced_2 = SymbolAdvanced(
    Style=5,
    SizePrimary=Slider(1, range=0..10),
    SizeSecondary=10,
    Rotation=0,
    Fill=gradient_2,
    Edge=gradient_2,
    Width=2,
    Adjust=False)
transform_4 = Transform(Geometry=cull_pattern, Transform=rotatebackwards_3)
symbol_display_3 = SymbolDisplay(Location=flatten(transform_4), Display=flatten(symbol_advanced_2))

possibleareatocover_2 = Number(possibleareatocover)
division_6 = Division(A=possibleareatocover_2, B="1000000")
possible_area_to_cover_in_sqkm = Panel(division_6)
division_7 = Division(A=division_6, B=division_5)
possible_needed_area_needs_to_be_above_1 = Panel(division_7)

# ----
# Setting up water network configuration and
# iterating through street network generation.
projectedcitycenter_4 = Point(projectedcitycenter)
existing_streets_4 = Curve(existing_streets_3)
cellstate_3 = Boolean(invert(cellstate))
segmentlength_2 = Number(segmentlength)
growthangle_3 = Number(growthangle_2)
angleresolution_2 = Integer(angleresolution)
waterangleshift_3 = Number(waterangleshift_2)
branchingsteps_2 = Integer(branchingsteps)
junctiontype_2 = Integer(junctiontype)
populationthreshold_3 = Number(populationthreshold_2)
initialdirection_3 = Integer(initialdirection_2)
streetblocksize_3 = Number(streetblocksize_2)
cellcenters_6 = Point(cellcenters)
cellheight_5 = Number(cellheight)
boolean_4 = Boolean(boolean_2)
number = Number(cellstate_3)
curve_to_polyline = CurveToPolyline(Curve=existing_streets_4, ToleranceDistance=0, ToleranceAngle=0, MaxEdge=streetblocksize_3)  # -> Polyline, Segments
explode = Explode(Curve=curve_to_polyline.Polyline, Recursive=True)  # -> flatten(Segments), Vertices
wsgconfig = WaterbasedStreetGeneratorConfiguration(
    segmentLength=segmentlength_2,
    growthAngle=growthangle_3,
    angleResolution=angleresolution_2,
    waterAngleShift=waterangleshift_3,
    branchingSteps=branchingsteps_2,
    junctionType=junctiontype_2,
    populationThreshold=populationthreshold_3,
    initialDirection=initialdirection_3,
    heightGrid=cellheight_5,
    populationGrid=number,
    pointGrid=cellcenters_6)  # -> config; inputs angleResolution: Int32, branchingSteps: Int32, junctionType: Int32, initialDirection: Int32, heightGrid: tree, populationGrid: tree, pointGrid: tree of Point3d
# ---------- wsgconfig: Python ----------
"""Creates a Configuration for Water-based Street Network Generation.
    Inputs:
        segmentLength: Length a street grows each iteration. Default = 33.0
        growthAngle: Angle in growth direction to search for new segment. Default = 5.0
        angleResolution: Division of growthAngle into steps - higher is more accurate but smaller. Default = 7
        waterAngleShift: Default = 0: Tries to grow in waterflow direction and perpendicular to it. Shift optimal water angle by x degrees.
        branchingSteps: Segments branch after certain amount of steps. Default = 2.0
        junctionType: Default = 0: Crossings, 1: T-Junction starting Left, 2: T-Junction starting Right
        populationThreshold: Value from 0 to 1. If population heatmap is above this value, no streets grow.
        initialDirection: Default = 0: Segments in both directions, 1: First segment left side of curve, 2: First segment right side of curve
    Output:
        config: Config for Street Generation"""
ghenv.Component.Name = "Waterbased Street Generator Configuration"
ghenv.Component.NickName = 'WSGConfig'
ghenv.Component.IconDisplayMode = ghenv.Component.IconDisplayMode.application
ghenv.Component.Category = "DeCodingSpaces"
ghenv.Component.SubCategory = "Hydrology"
import rhinoscriptsyntax as rs
import Rhino.Geometry as rg
import math
__author__ = "MartinDennemark"
__version__ = "2020.05.15"
                        
class configuration:
    def __init__(self, segmentLength = None, growthAngle = None, angleResolution = None, waterAngleShift = None, branchingSteps = None, junctionType = None, populationThreshold = None, initialDirection = None, heatmap = [], population = [], boundingBox = None):
                                
        if segmentLength == None:
            self.SEGMENT_LENGTH = 33.0
        else:
            self.SEGMENT_LENGTH = segmentLength
                                    
        if growthAngle == None:
            self.BRANCH_ANGLE = 5.0
        else:
            self.BRANCH_ANGLE = growthAngle
                                    
        if angleResolution == None:
            self.BRANCH_ANGLE_STEPS = 7
        else:
            self.BRANCH_ANGLE_STEPS = angleResolution
                                    
        if waterAngleShift == None:
            self.WATER_ANGLE_SHIFT = 0.0
        else:
            self.WATER_ANGLE_SHIFT = waterAngleShift
                                
        if branchingSteps == None:
            self.BRANCH_STEP = 2
        else:
            self.BRANCH_STEP = branchingSteps
                                
        if junctionType != 0 and junctionType != 1 and junctionType != 2:
            junctionType = 0
        if junctionType == 0: # crossing
            self.BRANCH_STEP_LEFT = 0 #branching to left every x branches
            self.BRANCH_STEP_RIGHT = 0 #branching to right every x branches
        elif junctionType == 1: # t-junction start left
            self.BRANCH_STEP_LEFT = 0 
            self.BRANCH_STEP_RIGHT = math.ceil(float(self.BRANCH_STEP) / 2.0) 
        elif junctionType == 2: # t-junction start right
            self.BRANCH_STEP_LEFT = math.ceil(float(self.BRANCH_STEP) / 2.0)
            self.BRANCH_STEP_RIGHT = 0 
                        
        if populationThreshold == None:
            self.POPULATION_THRESHOLD = 0.85
        elif populationThreshold < 0.0:
            self.POPULATION_THRESHOLD = 0.0
        elif populationThreshold > 1.0:
            self.POPULATION_THRESHOLD = 1.0
        else:
            self.POPULATION_THRESHOLD = populationThreshold
                
        if initialDirection != 0 and initialDirection != 1 and initialDirection != 2:
            initialDirection = 0
        self.INITIAL_DIRECTION = initialDirection
        # ignore intersections with less than this degrees angle
        self.MINIMUM_INTERSECTION_DEVIATION = 10.0
        # maximum distance to connect roads
        self.ROAD_SNAP_DISTANCE_FACTOR = 0.9
        self.ROAD_SNAP_DISTANCE = self.SEGMENT_LENGTH * self.ROAD_SNAP_DISTANCE_FACTOR
        # close road with already similar direction..
        self.ROAD_SIMILARITY_DISTANCE_FACTOR = 0.66
        self.ROAD_SIMILARITY_DISTANCE = self.SEGMENT_LENGTH * self.BRANCH_STEP * self.ROAD_SIMILARITY_DISTANCE_FACTOR
        self.ROAD_SIMILARITY_MINIMUM_DEVIATION_ANGLE = 30.0
        self.HEATMAP = heatmap
        self.POPULATION = population
        self.BOUNDS = boundingBox
        # grow to the right and left initially
        
boundingBox = rg.BoundingBox(pointGrid.AllData())
heatmap = []
population = []
for i in range(heightGrid.BranchCount):
    heatmap.append(heightGrid.Branch(i))
    population.append(populationGrid.Branch(i))
config = configuration(segmentLength, growthAngle, angleResolution, waterAngleShift, branchingSteps, junctionType, populationThreshold, initialDirection, heatmap, population, boundingBox)
# ---------- end wsgconfig ----------
line = Line(flatten(explode.Segments))
list_length_3 = ListLength(List=line)
loop_start = LoopStart(Repeat=integer_2, Trigger=[list_length_3, boolean_3])  # -> port, Counter, GeneratorResult
gate_or = GateOr(A=invert(boolean_3), B=boolean_4)

wsgenerator = WaterbasedStreetGenerator(
    run=loop_start.Counter,
    config=wsgconfig,
    startPoint=projectedcitycenter_4,
    existingStreets=line,
    generatorResult=loop_start.GeneratorResult)  # -> simplify(generatorResult); inputs run: Boolean, startPoint: Point3d, existingStreets: list of Line
# ---------- wsgenerator: Python ----------
"""Water-based Street Network Generator.
    Inputs:
        run: Set to True to start Simulation. Connect i.e. to counter of Anemone to run iterations.
        config: Angle in growth direction to search for new segment. Default = 5.0
        startPoint: Division of growthAngle into steps - higher is more accurate but smaller. Default = 7
        existingStreets: Default = 0: Tries to grow in waterflow direction and perpendicular to it. Shift optimal water angle by x degrees.
        generatorResult: Use i.e. Anemone or Hoopsnake to take the output of this component as an input to iterate and grow streets!
    Output:
        generatorResult: Use i.e. Anemone or Hoopsnake to take the output of this component as an input to iterate and grow streets! Connect to WSGResult to show Rhino Lines."""
ghenv.Component.Name = "Waterbased Street Generator"
ghenv.Component.NickName = 'WSGenerator'
ghenv.Component.IconDisplayMode = ghenv.Component.IconDisplayMode.application
ghenv.Component.Category = "DeCodingSpaces"
ghenv.Component.SubCategory = "Hydrology"
        
__author__ = "MartinDennemark"
__version__ = "2020.05.15"
        
import rhinoscriptsyntax as rs
import scriptcontext as sc
import Rhino.Geometry as rg
import Grasshopper.Kernel as gh
import copy
import math
import random
import time
        
class Bounds:
    def __init__(self, x, y, width, height):
        self.x = x
        self.y = y
        self.width = width
        self.height = height
        
class Quadtree:
            
        
     # @param max_objects max objects a node can hold before splitting into 4 subnodes (default: 10)
     # @param max_levels total max levels inside root Quadtree (default: 4)
     # @param level	depth level (0 for root node)
             
    def __init__(self, bounds,  isLeaf = True, objects = [], objectsO = [], max_objects = 10, max_levels = 4, level = 0):
        self.bounds = bounds
        self.max_objects = max_objects
        self.max_levels = max_levels
        self.level = level
        self.objects = objects
        self.objectsO = objectsO
        self.isLeaf = isLeaf
        self.topRight = None
        self.topLeft = None
        self.bottomRight = None
        self.bottomLeft = None
         
    # split this node, moving all objects to their corresponding subnode
    def split(self):
                
        self.isLeaf = False
        level = self.level + 1
        width = self.bounds.width / 2.0
        height = self.bounds.height / 2.0
        x = self.bounds.x
        y = self.bounds.y
        self.topRight = Quadtree(Bounds(x+width, y, width, height),True, [], [], self.max_objects, self.max_levels, level)
        self.topLeft = Quadtree(Bounds(x, y, width, height), True, [], [],self.max_objects, self.max_levels, level)
        self.bottomLeft = Quadtree(Bounds(x, y+height, width, height), True, [], [],self.max_objects, self.max_levels, level)
        self.bottomRight = Quadtree(Bounds(x+width, y+height, width, height), True, [], [],self.max_objects, self.max_levels, level)
        for i in range(0, len(self.objects)):
            rect = self.objects[i]
            obj = self.objectsO[i]
            relevant_nodes =self.getRelevantNodes(rect)
            if(relevant_nodes[0]):
                self.topRight.insert(rect, obj)
            if(relevant_nodes[1]):
                self.topLeft.insert(rect, obj)
            if(relevant_nodes[2]):
                self.bottomLeft.insert(rect, obj)
            if(relevant_nodes[3]):
                self.bottomRight.insert(rect, obj)
        self.objects[:] = []
        self.objectsO[:] = []
            
    def getRelevantNodes(self, r):
        midX = self.bounds.x + (self.bounds.width / 2.0)
        midY = self.bounds.y + (self.bounds.height /2.0)
        qs = [False,False,False,False]
        isTop = False
        if r.y <= midY:
            isTop = True
        isBottom = False
        if r.y + r.height > midY:
            isBottom = True
        if r.x <= midX:
            if isTop:
                qs[1] = True
            if isBottom:
                qs[2] = True
        if r.x + r.width > midX:
            if isTop:
                qs[0] = True
            if isBottom:
                qs[3] = True
        return qs
        
    #Insert object into the tree.
	#If the tree exceeds the capacity, it will be split.
    def insert(self, pRect, obj):
        if not self.isLeaf:
            relevant_nodes =self.getRelevantNodes(pRect)
            if(relevant_nodes[0]):
                self.topRight.insert(pRect, obj)
            if(relevant_nodes[1]):
                self.topLeft.insert(pRect, obj)
            if(relevant_nodes[2]):
                self.bottomLeft.insert(pRect, obj)
            if(relevant_nodes[3]):
                self.bottomRight.insert(pRect, obj)
            return
        self.objects.append(pRect)
        self.objectsO.append(obj)
        if len(self.objects) > self.max_objects and self.level < self.max_levels:
            self.split()
        
    #Return all objects that could collide with the given bounds
    def retrieve(self, pRect):
        if self.isLeaf:
            return self.objectsO
        relevant = []
        relevant_nodes =self.getRelevantNodes(pRect)
        if(relevant_nodes[0] and self.topRight != None):
            relevant = relevant + self.topRight.retrieve(pRect)
        if(relevant_nodes[1] and self.topLeft != None):
            relevant = relevant + self.topLeft.retrieve(pRect)
        if(relevant_nodes[2] and self.bottomLeft != None):
            relevant = relevant + self.bottomLeft.retrieve(pRect)
        if(relevant_nodes[3] and self.bottomRight != None):
            relevant = relevant + self.bottomRight.retrieve(pRect)
                
        return relevant        
        
    def retrieveBounds(self):
        if self.isLeaf:
            return [self.bounds]
        relevant = []
        relevant_nodes =self.getRelevantNodes(self.bounds)
        if(relevant_nodes[0]):
            relevant = relevant + self.topRight.retrieveBounds()
        if(relevant_nodes[1]):
            relevant = relevant + self.topLeft.retrieveBounds()
        if(relevant_nodes[2]):
            relevant = relevant + self.bottomLeft.retrieveBounds()
        if(relevant_nodes[3]):
            relevant = relevant + self.bottomRight.retrieveBounds()
        return relevant
        
        
class Point:
    def __init__(self, x, y):
        self.x = x
        self.y = y
        
def subtractPoints(p1, p2):
    return Point(p1.x-p2.x, p1.y - p2.y)
        
def crossProduct(a, b):
    return a.x * b.y - a.y * b.x
        
def lineSegementsIntersect(p,p2,q, q2, omitEnds):
    r = subtractPoints(p2,p)
    s = subtractPoints(q2, q)
    uNumerator = crossProduct(subtractPoints(q, p), r)
    denominator = crossProduct(r, s)
    if 0.0==uNumerator and 0.0 == denominator:
        return False
    if 0.0 == denominator:
        return False
    u = uNumerator / denominator
    t = crossProduct(subtractPoints(q,p), s) / denominator
    intersect = False
    if omitEnds:
        intersect = 0.001 < t and (0.999 > t and (0.001 < u and 0.999 > u))
    else:
        intersect = 0.0 <= t and (1.0 >= t and (0.0 <= u and 1.0 >= u))
    if intersect:
        x = p.x + t * r.x
        y = p.y + t * r.y
        return {"point": Point(x, y),"t": t}
    else:
        return intersect
        
def minDegreeDifference(val1, val2):
    bottom = abs(val1 - val2) % 180.0
    return min(bottom, abs(bottom-180.0))
        
def equalV(a, b):
    e = subtractPoints(a, b)
    return 0.00001 > lengthV2(e)
        
def dotProduct(a, b):
    return a.x + b.x + a.y * b.y
        
def length(a, b):
    return lengthV(subtractPoints(b,a))
        
def length2(a, b):
    return lengthV2(subtractPoints(b,a))
        
def lengthV(a):
    return math.sqrt(lengthV2(a))
        
def lengthV2(a):
    return a.x * a.x + a.y * a.y
        
def angleBetween(a, b):
    if((lengthV(a) * lengthV(b)) > 0.0):
        angleRad = math.acos((a.x * b.x + a.y * b.y) / (lengthV(a) * lengthV(b)))
    else:
        angleRad = math.acos(0.0)
    return 180.0 * angleRad / math.pi
        
def sign(a):
    if 0.0 <= a:
        return 1
    elif 0.0 > a:
        return -1.0
    #else:
        #return 0.0
        
def fractionBetween(a, b, e):
    b = subtractPoints(b,a)
    x = a.x + b.x * e
    y = a.y + b.y * e
    return Point(x, y)
        
def randomRange(a, b):
    return random.random() * (b - a) + a
        
def addPoints(a, b):
    x = a.x + b.x
    y = a.y + b.y
    return Point(x, y)
        
def distanceToLine(a, b, e):
    d = subtractPoints(a,b)
    e = subtractPoints(e, b)
    proj = project(d, e)
    c = proj["projected"]
    b = addPoints(b, c)
    distance2 = length2(b, a)
    pointOnLine = b
    lineProj2 = sign(proj["dotProduct"]) * lengthV2(c)
    l2 = lengthV2(e)
    return {"distance2": distance2, "pointOnLine": pointOnLine, "lineProj2": lineProj2, "length2": l2}
        
def project(a, b):
    e = dotProduct(a, b)
    lv2 = lengthV2(b)
    projected = Point(0, 0)
    if(lv2 != 0):
        projected = multVScalar(b, e / lv2)
    return {"dotProduct": e, "projected": projected}
        
def multVScalar(a, b):
    x = a.x * b
    y = a.y * b
    return Point(x, y)
        
def divVScalar(a, b):
    x = a.x / b
    y = a.y / b
    return Point(x, y)
        
def lerp(a, b, t):
    return a * (1.0 - t) + b * t
        
def lerpV(a, b, t):
    x = lerp(a.x, b.x, t)
    y = lerp(a.y, b.y, t)
    return Point(x, y)
        
def randomNearCubic(b):
    d = math.pow(abs(b), 3.0)
    c = 0.0
    while c == 0.0 or random.random() < math.pow(abs(c), 3.0) / d:
        c = random.uniform(-b, b)
    return c
        
"""
        
        
Heatmap
        
        
"""
        
class Heatmap:
    def __init__(self, grid = [], minX=0.0, minY=0.0, maxX=1000.0, maxY = 1000.0):
        self.grid = grid
        self.gridXMax = len(grid)-1
        self.gridYMax = len(grid[0])-1
        self.minX = minX
        self.minY = minY
        self.maxX = maxX
        self.maxY = maxY
        self.boundsX = maxX-minX
        self.boundsY = maxY-minY
            
    def valueSegment(self, s):
        value = (self.valueAt(s.start.x, s.start.y) + self.valueAt(s.end.x, s.end.y)) / 2.0
        return value
        
    def valueAtClosest(self, x, y):
        # find closest neighbouring cells
        cellX = round(((x-self.minX)/self.boundsX)*self.gridXMax)
        if cellX > self.gridXMax:
            cellX = self.gridXMax
        elif cellX < 0:
            cellX = 0
        cellY = round(((y-self.minY)/self.boundsY)*self.gridYMax)
        if cellY > self.gridYMax:
            cellY = self.gridYMax
        elif cellY < 0:
            cellY = 0
        return self.grid[int(round(cellX))][int(round(cellY))]
        
    def valueAt(self, x, y):
        # find closest neighbouring cells
        cellX = ((x-self.minX)/self.boundsX)*self.gridXMax
        cellXLow = int(math.floor(cellX))
        cellXHigh = int(math.ceil(cellX))
        if(cellXLow < 0):
            cellXLow = 0
            cellXHigh = 1
        if(cellXHigh >= self.gridXMax):
            cellXHigh = self.gridXMax
            cellXLow = self.gridXMax-1
        
        cellY = ((y-self.minY)/self.boundsY)*self.gridYMax
        cellYLow = int(math.floor(cellY))
        cellYHigh = int(math.ceil(cellY))
        if(cellYLow < 0):
            cellYLow = 0
            cellYHigh = 1
        if(cellYHigh >= self.gridYMax):
            cellYHigh = self.gridYMax
            cellYLow = self.gridYMax-1
        
        # interpolation between closest neighbours
        weightCell0 = (1-((cellX - cellXLow) * (cellY - cellYLow)))
        weightCell1 = (1-((cellXHigh - cellX) * (cellY - cellYLow)))
        weightCell2 = (1-((cellXHigh - cellX) * (cellYHigh - cellY)))
        weightCell3 = (1-((cellX - cellXLow) * (cellYHigh - cellY)))
        valCell0 = self.grid[cellXLow][cellYLow] * weightCell0
        valCell1 = self.grid[cellXHigh][cellYLow] * weightCell1
        valCell2 = self.grid[cellXHigh][cellYHigh] * weightCell2
        valCell3 = self.grid[cellXLow][cellYHigh]  * weightCell3
        
        cellValueX = (valCell0 + valCell1 + valCell2 + valCell3) / (weightCell0 + weightCell1 + weightCell2 + weightCell3)
        return cellValueX
        
    def getFlattestDirection(self, segment, minAngle = -config.BRANCH_ANGLE, maxAngle = config.BRANCH_ANGLE, steps = 5, length = config.SEGMENT_LENGTH):
        steepness = 1
        bestAngle = 0.0
        startValue = self.valueAt(segment.end.x, segment.end.y)
        if(steps < 2):
            steps = 2
        for i in range(steps):
            curAngle = ((maxAngle-minAngle)/float(steps-1))*i + minAngle
            point = segment.pointInDirection(segment.end, segment.dir()+curAngle, length)
                    
            curSteepness = abs(startValue-self.valueAt(point.x, point.y))
            if(curSteepness < steepness):
                steepness = curSteepness
                bestAngle = curAngle
        return bestAngle
            
    def getSteepestDirection(self, segment, minAngle = -config.BRANCH_ANGLE, maxAngle = config.BRANCH_ANGLE, steps = 5, length = config.SEGMENT_LENGTH):
        steepness = 0
        bestAngle = 0.0
        startValue = self.valueAt(segment.end.x, segment.end.y)
        if(steps < 2):
            steps = 2
        for i in range(steps):
            curAngle = ((maxAngle-minAngle)/float(steps-1))*i + minAngle
            point = segment.pointInDirection(segment.end, segment.dir()+curAngle, length)
        
            curValue = self.valueAt(point.x, point.y)
            curSteepness = abs(startValue-curValue)
            if(curSteepness > steepness):
                steepness = curSteepness
                bestAngle = curAngle
        return bestAngle
            
    def getCloseToWaterDirection(self, segment, minAngle = -config.BRANCH_ANGLE, maxAngle = config.BRANCH_ANGLE, steps = config.BRANCH_ANGLE_STEPS, length = config.SEGMENT_LENGTH):
        minWaterAngle = float("inf")
        
        optimalWaterAngle = self.getWaterflowDirection(segment, 16, length) - config.WATER_ANGLE_SHIFT
        
        if(segment.q.perpendicular):
            optimalWaterAngle = optimalWaterAngle+90.0
        optimalWaterAngle = optimalWaterAngle % 180
        if(abs(optimalWaterAngle-180.0) < optimalWaterAngle):
            optimalWaterAngle -= 180.0
        bestAngle = 0.0
        startValue = self.valueAt(segment.end.x, segment.end.y)
        if(steps < 2):
            steps = 2
        if(maxAngle < optimalWaterAngle):
            bestAngle = maxAngle
        elif(minAngle > optimalWaterAngle):
            bestAngle = minAngle
        else:
            bestAngle = optimalWaterAngle
        return bestAngle
        
    def getWaterflowDirection(self, segment, steps = 16, length = config.SEGMENT_LENGTH):
        return self.getSteepestDirection(segment, -180+360/steps, 180, steps-1, length)
                
                
        
"""
        
        
Segment Metainfo
        
        
"""
        
        
class Metainfo:
    def __init__(self, severed = None, perpendicular = False, step = 0):
        self.severed = severed
        self.perpendicular = perpendicular
        self.step = step
        
"""
        
        
Segment 
        
        
"""
class Segment:
    links = {"b": [], "f" : []}
            
    def __init__(self, startPoint, endPoint, t, q = Metainfo()):
        self.start = copy.deepcopy(startPoint)
        self.end = copy.deepcopy(endPoint)
        self.q = copy.deepcopy(q)
        if self.q == None:
            self.q = Metainfo()
        self.t = t
        self.previousSegment = None
        
    def setupBranchLinks(self):
        if self.previousSegment != None and isinstance(self.previousSegment, Segment):
            previousSegment = self.previousSegment
            for link in previousSegment.links["f"]:
                self.links["b"].append(link)
                if previousSegment in link.links["b"]:
                    link.links["b"].append(self)
                elif previousSegment in link.links["f"]:
                    link.links["f"].append(self)
            previousSegment.links["f"].append(self)
            self.links["b"].append(previousSegment)
            return True #self.links["b"]
        else:
            return False
        
        
    def dir(self):
        vector = subtractPoints(self.end, self.start)
        return -1.0 * sign(crossProduct(Point(0.0, 1.0), vector)) * angleBetween(Point(0.0,1.0), vector)
        
    def length(self):
        return length(self.start, self.end)
        
    def length2(self):
        return length2(self.start, self.end)
            
    def limits(self):
        x = min(self.start.x, self.end.x)
        y = min(self.start.y, self.end.y)
        width = abs(self.start.x - self.end.x)
        height = abs(self.start.y - self.end.y)
        return Bounds(x,y,width,height)
            
    #def debugLinks()
        
    def startIsBackwards(self):
        if len(self.links["b"]) > 0:
            if equalV(self.links["b"][0].start, self.start) or equalV(self.links["b"][0].end, self.start):
                return True
            else:
                return False
        elif(len(self.links["f"]) > 0):
            if equalV(self.links["f"][0].start, self.end) or equalV(self.links["f"][0].end, self.end):
                return True
            else:
                return False
            
    def split(self, point, segment, segmentList, qTree):
        splitPart = self.clone(self.t, self.q)
        startIsBackwards = self.startIsBackwards()
        segmentList.append(splitPart)
        qTree.insert(splitPart.limits(), splitPart)
        splitPart.end = point
        self.start = point
        
        splitPart.links["b"] = self.links["b"][:1]
        splitPart.links["f"] = self.links["f"][:1]
        
        if startIsBackwards:
            firstSplit = splitPart
            secondSplit = self
            fixLinks = splitPart.links["b"]
        else:
            firstSplit = self
            secondSplit = splitPart
            fixLinks = splitPart.links["f"]
        for link in fixLinks:
            if self in link.links["b"]:
                index = link.links["b"].index(self)
                link.links["b"][index] = splitPart
            elif self in link.links["f"]:
                index = link.links["f"].index(self)
                link.links["f"][index] = splitPart
        firstSplit.links["f"] = [segment, secondSplit]
        secondSplit.links["b"] = [segment, firstSplit]
        segment.links["f"].append(firstSplit)
        segment.links["f"].append(secondSplit)
        
        
    def clone(self, t = None, q = None):
        if t == None:
            t = (self.t)
        if q == None:
            q = (self.q)
        return Segment((self.start), (self.end), t, q)
            
    @staticmethod
    def pointInDirection(start, dir = 90.0, length = config.SEGMENT_LENGTH):
        x = start.x + length * math.sin(dir * math.pi / 180.0)
        y = start.y + length * math.cos(dir * math.pi / 180.0)
        return Point(x, y)
        
    @staticmethod
    def usingDirection(startPoint, t, q, dir = 90.0, length = config.SEGMENT_LENGTH):
        x = startPoint.x + length * math.sin(dir * math.pi / 180.0)
        y = startPoint.y + length * math.cos(dir * math.pi / 180.0)
        endPoint = Point(x, y)
        return Segment(startPoint, endPoint, t, q)
            
    def intersectWith(self, s):
        return lineSegementsIntersect(self.start, self.end, s.start, s.end, True)
        
        
"""
        
        
Local Growth Constraints
        
        
"""
        
def localConstraints(segment, segments, qTree):
    action = {"priority": 0, "objects" : [None, None], "func" : {"intersection": False, "snapping": False, "radius": False}, "t" : None}       
    others = qTree.retrieve(segment.limits())
    for other in others:
        #intersection check
        if action["priority"] <= 4:
            intersection = segment.intersectWith(other)
            if intersection:
                if intersection["t"] > 0.01:
                    if action["t"] == None or intersection["t"] < action["t"]:
                        action["t"] = intersection["t"]
                        action["priority"] = 4
                        action["func"]["intersection"] = True
                        action["objects"] = [other, intersection["point"]] 
        #snap to crossing with radius check
        if action["priority"] <= 3:
            #current segment's start must have been checked to have been created.
            #other segment's start must have a corresponding end.
            if not equalV(segment.start, other.end) > 0.01:
                if length(segment.end, other.end) <= config.ROAD_SNAP_DISTANCE:
                    point = other.end
                    action["priority"] = 3
                    action["func"]["snapping"] = True
                    action["objects"] = [other, point]
        #intersection within radius check
        if action["priority"] <= 2:
            #make sure segment does not start on same line
            #might lead to BUG?
            if not equalV(segment.start, other.start) and not equalV(segment.start, other.end):
                distToLine = distanceToLine(segment.end, other.start, other.end)
                distance2 = distToLine["distance2"]
                pointOnLine = distToLine["pointOnLine"]
                lineProj2 = distToLine["lineProj2"]
                length2 = distToLine["length2"]
                if distance2 > 0.01 and not equalV(segment.start, pointOnLine):
                    if distance2 < config.ROAD_SNAP_DISTANCE * config.ROAD_SNAP_DISTANCE and lineProj2 >= 0.0 and lineProj2 <= length2:
                        point = pointOnLine
                        action["priority"] = 2
                        action["func"]["radius"] = True
                        action["objects"] = [other, point]
    if action["objects"][0] != None:
        if action["func"]["radius"] == True:
            other = action["objects"][0]
            point = action["objects"][1]
            segment.end = point
            segment.q.severed = True
            if minDegreeDifference(other.dir(), segment.dir()) < config.MINIMUM_INTERSECTION_DEVIATION:
                return False
            other.split(point, segment, segments, qTree)
            return True
        elif action["func"]["snapping"] == True:
            other = action["objects"][0]
            point = action["objects"][1]
            segment.end = point
            segment.q.severed = True
            links = []
            #check for duplicate lines, don't add if it exists
            if(equalV(other.start, segment.end) and equalV(other.end, segment.start) or equalV(other.start, segment.start) and equalV(other.end, segment.end)):
                return False
            #update links of otherSegment corresponding to other.r.end
            if other.startIsBackwards():
                links = other.links["f"]
            else:
                links = other.links["b"]
            #check for duplicate lines in links, don't add if it exists
            #this should be done before links are setup, to avoid having to undo that step
            for link in links:
                if(equalV(link.start, segment.end) and equalV(link.end, segment.start) or equalV(link.start, segment.start) and equalV(link.end, segment.end)):
                    return False
            for link in links:
                if other in link.links["b"]:
                    if(link.links["b"] != links):
                        link.links["b"].append(segment)
                elif other in link.links["f"]:
                    if(link.links["f"] != links):
                        link.links["f"].append(segment)
                segment.links["f"].append(link)
            links.append(segment)
            segment.links["f"].append(other)
                        
            return True
        elif action["func"]["intersection"] == True:
            other = action["objects"][0]
            intersection = action["objects"][1]
            if minDegreeDifference(other.dir(), segment.dir()) < config.MINIMUM_INTERSECTION_DEVIATION:
                return False
            other.split(intersection, segment, segments, qTree)
            segment.end = intersection
            segment.q.severed = True
            return True
        else:
            return True
    else:
        return True
        
        
"""
        
        
Branching Constraints
        
        
"""
        
def branchConstraints(segment, qTree):
    #close similar branch
    others = qTree.retrieve(segment.limits())
    for other in others:
        #if  not same start
        if not equalV(segment.start, other.start):
            #if segment close enough
            if length2(segment.end, other.end) <= config.ROAD_SIMILARITY_DISTANCE * config.ROAD_SIMILARITY_DISTANCE or length2(segment.end, other.start) <= config.ROAD_SIMILARITY_DISTANCE*config.ROAD_SIMILARITY_DISTANCE:
                #if direction is similar
                if minDegreeDifference(other.dir(), segment.dir()) < config.ROAD_SIMILARITY_MINIMUM_DEVIATION_ANGLE:
                    return True
    return False
        
"""
        
        
Global Goals
        
        
"""
        
def globalGoalsGenerate(previousSegment, heatmap, qTree):
    newBranches = []
        
    if previousSegment.q != None and not previousSegment.q.severed:
        def template(direction, length, t, q):
            return Segment.usingDirection(previousSegment.end, t, q, previousSegment.dir() + direction, length)
        def templateContinue(direction):
            q = Metainfo(previousSegment.q.severed, previousSegment.q.perpendicular, previousSegment.q.step+1)
            return template(direction, previousSegment.length(), 0.0, q)
        def templateBranch(direction):
            q = Metainfo(None, not previousSegment.q.perpendicular, 0)
            return template(direction, config.SEGMENT_LENGTH, 0.0, q)
        #get best water direction straight
        bestDir = heatmap.getCloseToWaterDirection(previousSegment, -config.BRANCH_ANGLE, config.BRANCH_ANGLE, config.BRANCH_ANGLE_STEPS, previousSegment.length())
        continueStraight = templateContinue(bestDir)
        newBranches.append(continueStraight)
        if previousSegment.q.step >= config.BRANCH_STEP:
            #get best water direction right
            if (previousSegment.q.step - config.BRANCH_STEP_RIGHT) % config.BRANCH_STEP == 0:
                bestDir = heatmap.getCloseToWaterDirection(previousSegment, +90.0 - config.BRANCH_ANGLE, 90.0 + config.BRANCH_ANGLE, config.BRANCH_ANGLE_STEPS, previousSegment.length())       
                newSegment = templateBranch(bestDir)
                newBranches.append(newSegment)
            #get best water direction left
            if (previousSegment.q.step - config.BRANCH_STEP_LEFT) % config.BRANCH_STEP == 0:
                bestDir = heatmap.getCloseToWaterDirection(previousSegment, -90.0 -config.BRANCH_ANGLE, -90.0 + config.BRANCH_ANGLE, config.BRANCH_ANGLE_STEPS, previousSegment.length())
                newSegment = templateBranch(bestDir) 
                newBranches.append(newSegment)
        
    for branch in newBranches:
        #setup links between each current branch and each existing branch stemming from the previous segment
        branch.previousSegment = previousSegment
    return newBranches
        
"""
        
        
Priority Queue
        
        
"""
class PriorityQueue:
    ####
    # 
    # 
    # 
    # def __init__()
    # *ele allows providing multiple arguments
    def __init__(self):
        self.elements = []
        
    def getPriority(self, ele):
        return ele.t
        
    def enqueue(self, ele): #*
        if isinstance(ele, Segment):
            ele = [ele]
        for el in ele:
            self.elements.append(el)
        
    def dequeue(self):
        minT = float("inf")
        minT_i = 0
        for i in range(len(self.elements)):
            t = self.getPriority(self.elements[i])
            if t < minT:
                minT = t
                minT_i = i
        el = self.elements[minT_i:minT_i+1][0]
        self.elements = self.elements [:minT_i] + self.elements [minT_i+1:]
        return el
            
    def empty(self):
        return len(self.elements) == 0
        
        
        
def makeInitialSegments(rootSegment, heatmap):
    if config.INITIAL_DIRECTION == 1:
        return [rootSegment]
        
    oppositeDirection = rootSegment.clone(0.0, Metainfo(False, rootSegment.q.perpendicular, 0))
    newEnd = Point(rootSegment.start.x - (rootSegment.end.x-rootSegment.start.x), rootSegment.start.y - (rootSegment.end.y-rootSegment.start.y))
    oppositeDirection.end = newEnd
    if config.INITIAL_DIRECTION == 2:
        return [oppositeDirection]
            
    oppositeDirection.links["b"].append(rootSegment)
    rootSegment.links["b"].append(oppositeDirection)
    return [rootSegment, oppositeDirection]
        
        
def makeExistingSegments(x,y,heatmap, population, segments = [], qTree = None):
    length = config.SEGMENT_LENGTH
    initialSegments = []
    if(len(segments)<=0):
        initialSegment = Segment(Point(x-length, y), Point(x,y), 0.0, Metainfo(False, False, 0))
        direction = heatmap.getWaterflowDirection(initialSegment,32, length)
        initialSegments.append(Segment.usingDirection(initialSegment.start, 0.0, Metainfo(False, initialSegment.q.perpendicular, 0), initialSegment.dir() + direction, -length))
    else:
        center = Point(x,y)
        sortedSegments = []
        toLeft = False
        toRight = False
        if config.INITIAL_DIRECTION == 0 or config.INITIAL_DIRECTION == 1:
            toLeft = True
        if config.INITIAL_DIRECTION == 0 or config.INITIAL_DIRECTION == 2:
            toRight = True
        for i in range(len(segments)):
            curDirection = heatmap.getWaterflowDirection(segments[i], 32, length)
            if(curDirection > 45.0):
                segments[i].q.perpendicular = True
            qTree.insert(segments[i].limits(), segments[i])
            #create branches
            initialSegment = Segment.usingDirection(segments[i].start, 0.0, Metainfo(False, not segments[i].q.perpendicular, 0), segments[i].dir()-90, length)
        
            direction = heatmap.getCloseToWaterDirection(initialSegment, -config.BRANCH_ANGLE, config.BRANCH_ANGLE, 16, length)
                    
            if (i - config.BRANCH_STEP_RIGHT) % (config.BRANCH_STEP) == 0 and toRight == True:
                initialSegments.append(Segment.usingDirection(initialSegment.start, 0.0, Metainfo(False, initialSegment.q.perpendicular, 0), initialSegment.dir() + direction, -length))
            if (i - config.BRANCH_STEP_LEFT) % (config.BRANCH_STEP) == 0 and toLeft == True:
                initialSegments.append(Segment.usingDirection(initialSegment.start, 0.0, Metainfo(False, initialSegment.q.perpendicular, 0), initialSegment.dir() + direction, length))
    filteredSegments = []
    for segment in initialSegments:
        if(populationMap.valueAtClosest(segment.end.x, segment.end.y) <= config.POPULATION_THRESHOLD):
            filteredSegments.append(segment)
    return filteredSegments
        
def generationStep(priorityQ, segments, qTree, heatmap, populationMap):
    newSegments = []
    if( not priorityQ.empty()):
                
        minSegment = priorityQ.dequeue()
        
        accepted = localConstraints(minSegment, segments, qTree)
        if(populationMap.valueAtClosest(minSegment.end.x, minSegment.end.y) > config.POPULATION_THRESHOLD):
            accepted = False
        if accepted and minSegment.q.step == 0:
            accepted = not branchConstraints(minSegment, qTree)
        if accepted:
                    
            if minSegment.previousSegment != None and isinstance(minSegment.previousSegment, Segment) and len(minSegment.links["b"]) == 0:
                minSegment.setupBranchLinks()
        
            segments.append(minSegment)
            newSegments.append(minSegment)
            qTree.insert(minSegment.limits(), minSegment)
            for newSegment in globalGoalsGenerate(minSegment, heatmap, qTree):
                newSegment.t = minSegment.t + 1.0 + newSegment.t
                priorityQ.enqueue(newSegment)
    return newSegments
        
"""
        
        
Generator Results
        
        
"""
class GeneratorResult:
    def __init__(self, segments, priorityQ, qTree, terrainHeightMap, populationMap):
        self.segments = segments
        self.priorityQ = priorityQ
        self.qTree = qTree
        self.terrainHeightMap = terrainHeightMap
        self.populationMap = populationMap
        
        
segments = []
if generatorResult == None:
    msg = "Use i.e. Anemone or Hoopsnake to take the GeneratorResult Output of this component as an Input to iterate and grow streets!"
    w = gh.GH_RuntimeMessageLevel.Warning
    ghenv.Component.AddRuntimeMessage(w, msg)
if run == False or run == 0 or run == None:
        
    terrainHeightMap = Heatmap(config.HEATMAP, config.BOUNDS.Min.X, config.BOUNDS.Min.Y, config.BOUNDS.Max.X, config.BOUNDS.Max.Y)
    populationMap = Heatmap(config.POPULATION, config.BOUNDS.Min.X, config.BOUNDS.Min.Y, config.BOUNDS.Max.X, config.BOUNDS.Max.Y)
    QUADTREE_PARAMS = Bounds(-2000.0,-2000.0,4000.0,4000.0)
    QUADTREE_MAX_OBJECTS = 10
    QUADTREE_MAX_LEVELS = 10
    quadtree = Quadtree(QUADTREE_PARAMS, True,[], [], QUADTREE_MAX_OBJECTS, QUADTREE_MAX_LEVELS, 0)
            
    results = GeneratorResult([], PriorityQueue(), quadtree, terrainHeightMap, populationMap)
        
    for segment in existingStreets:
        segments.append(Segment(Point(segment.From.X, segment.From.Y), Point(segment.To.X, segment.To.Y), 0.0, Metainfo(False, False, 0)))
    initialSegments = makeExistingSegments(startPoint.X, startPoint.Y, results.terrainHeightMap , results.populationMap, segments, results.qTree)
    segments.extend(initialSegments)
    results.priorityQ.enqueue(initialSegments)
    for segment in segments:
        results.segments.append(segment)
else:
    results = generatorResult
            
    startTime = time.time()
    segments.extend(generationStep(results.priorityQ, results.segments, results.qTree, results.terrainHeightMap, results.populationMap))
        
    lines = []
    colors = []
        
generatorResult = results
# ---------- end wsgenerator ----------

loop_end = LoopEnd(
    port=loop_start.port,
    Exit=gate_or,
    GeneratorResult=wsgenerator,
    TimeOutVal=0,
    pausedState=False,
    state="Constant output")

wsgresults = WaterbasedStreetGeneratorResults(generatorResult=loop_end)  # -> segments, segmentStep, segmentSevered, segmentPerpendicular, segmentPriority
# ---------- wsgresults: Python ----------
"""Shows results of Waterbased Street Generator.
    Inputs:
        generatorResult: Input of Waterbased Street Generator.
    Output:
        segments: Rhino Lines
        segmentStep: Steps a street took, after branching. Each Branch starts with step 0.
        segmentSevered: True, if a branch stopped.
        segmentPerpendicular: Segment running parallel or perpendicular to waterflow direction.
        segmentPriority: Priority Value for each segment, highest will continue to grow."""
ghenv.Component.Name = "Waterbased Street Generator Results"
ghenv.Component.NickName = 'WSGResults'
ghenv.Component.IconDisplayMode = ghenv.Component.IconDisplayMode.application
ghenv.Component.Category = "DeCodingSpaces"
ghenv.Component.SubCategory = "Hydrology"

__author__ = "MartinDennemark"
__version__ = "2020.05.15"


import rhinoscriptsyntax as rs
import Rhino.Geometry as rg

segments = []
segmentType = []
segmentStep = []
segmentSevered = []
segmentPerpendicular = []
segmentPriority = []


for segment in generatorResult.segments:
    if(segment.length2 > 0.00001):
        segments.append(rg.Line(rg.Point3d(segment.start.x, segment.start.y, generatorResult.terrainHeightMap.valueAt(segment.start.x, segment.start.y)), rg.Point3d(segment.end.x, segment.end.y, generatorResult.terrainHeightMap.valueAt(segment.end.x, segment.end.y))))
        segmentStep.append(segment.q.step)
        segmentSevered.append(segment.q.severed)
        segmentPerpendicular.append(segment.q.perpendicular)
        segmentPriority.append(segment.t)
# ---------- end wsgresults ----------
transform_5 = Transform(Geometry=wsgresults.segments, Transform=rotatebackwards_5)
number_2 = Number(wsgresults.segmentPerpendicular)
bounds_5 = Bounds(Numbers=number_2)
remap_numbers_5 = RemapNumbers(Value=number_2, Source=bounds_5, Target=Domain(0, 1))  # -> Mapped, Clipped
gradient_3 = Gradient(
    LowerLimit=0,
    UpperLimit=1,
    Parameter=remap_numbers_5.Mapped,
    stops=[0: RGB(0, 61, 89), 0.25: RGB(0, 155, 180), 0.5: RGB(148, 193, 28), 0.75: RGB(243, 154, 0), 1: RGB(183, 26, 73)])
custom_preview_lineweights_4 = CustomPreviewLineweights(Geometry=transform_5, Shader=gradient_3, Thickness=Slider(3, range=0..10), Absolute=False)
