# Grasshopper definition WaterNetworkAnalysis.gh (Grasshopper 1.0.7)
# plug-ins: DeCodingSpaces, MetaHopper

# Description: Please read through the notes of the file to understand the algorithm. Try out different parameters to see how the water network analysis behaves.
# 
# 
# 
# The Hydrology Tools "Write/Analyse/Read Hydrology Network" make use of the EPANET Library. It makes use of textfiles as network databases and for reports. The presented tools can analyse and read these files as well as create a simplified version of them - meaning less parameters.
# 
# "The EPANET Open-Source Library is a pressurized pipe network hydraulic and water quality analysis toolkit, originally developed by USEPA, written in C."
# 
# Find its source code here: https://github.com/OpenWaterAnalytics/EPANET
# Example Epanet Network Files here: https://github.com/OpenWaterAnalytics/EPANET/tree/master/example-networks
# And a PDF-Manual here: https://nepis.epa.gov/Adobe/PDF/P1007WWU.pdf
document_info = DocumentInfo(AutoUpdate=False, Recursive=False)  # -> DocumentName, DocumentFilePath, Components, Params, _3rdPartyAssemblies
# text is internalised, if metahopper component is missing
not_internalised = Text(document_info._3rdPartyAssemblies)
internalised_text = Text(["DecodingSpacesAssembly, Version=1.0.0.0, Culture=neutral, PublicKeyToken=null", "MetaHopper, Version=1.0.8.0, Culture=neutral, PublicKeyToken=null"])
create_set = CreateSet(List=[internalised_text, not_internalised])  # -> Set, Map
# PARAMETRIC PLANNING CATALOGUE
# Water Network Analysis
# v. 1.0 - Author: DeCodingSpaces - Martin Dennemark
_3rd_party = Panel(create_set.Set)

# ----
# Example: This example analyses the pressure of consuming nodes in a water network.
# 
# Pink nodes have too less pressure to get water. As you can see even nodes that follow these, can still have enough pressure, which is physically impossible. This is, because Epanet calculates values for each node, but not iteratively. This might be changed in a later version.
# 
# Play around with the parameters and see how it behaves.
networksegments = Slider(10, range=0..100)
networkheight = Slider(30, range=0..100)
networklength = Slider(100, range=0..1000)
range = Range(Domain=Domain(0, 1), Steps=networksegments)
graph_mapper = GraphMapper(
    range,
    x0=0,
    x1=1,
    y0=0,
    y1=1,
    container_name="Bezier",
    cpx=[0, 0.2318840623, 0.5130434036, 1],
    cpy=[0.6213768125, 0.2608695626, 1, 0.455072403])
demand_liter_per_second = Slider(100, range=0..1000)
pipe_values = ValueList({"Flow rate": 0, "Flow velocity": 1, "Head loss": 2, "Actual link status": 3, "Roughness": 4, "Energy expended": 5}, selected="Flow rate")
pump_power_in_kilowatt = Slider(1, range=1..20)
node_values = ValueList({"Actual demand": 0, "Hydraulic head": 1, "Pressure": 2}, selected="Pressure")
lineroughness = Slider(120, range=120..160)
linediameter = Slider(0.9, range=0..10)
pump_index = Slider(0.99, range=0..0.99)
tankvolume = Slider(395, range=0..1000)
tankheight = Slider(6, range=0..10)
network_file_name = Panel("Testnet")
cluster = Cluster(A_2=graph_mapper, list=graph_mapper, A=range, B_2=networkheight, B=networklength)  # -> segments, list_a, result
lines = Line(cluster.segments)

# ---- group: Consumer
consumers = Point(cluster.result)

# ---- group: Tanks
tank = Point(cluster.list_a)

# ---- group: Line Diameter
number = Number(linediameter)

# ---- group: Pump Power in kw
number_2 = Number(pump_power_in_kilowatt)

# ---- group: Node Value Type
integer = Integer(node_values)

# ---- group: Epanet Filename (stored in location of GH file)
text = Text(network_file_name)

# ---- group: Line Roughness
number_3 = Number(lineroughness)

# ---- group: Pump Index
number_4 = Number(pump_index)

# ---- group: Consumer Demand (LPS)
number_5 = Number(demand_liter_per_second)

# ---- group: Tank Height
number_6 = Number(tankheight)

# ---- group: Tank Volume
number_7 = Number(tankvolume)

# ---- group: Pipe Value Type
integer_2 = Integer(pipe_values)

# ---- group: Line Roughness
number_8 = Number(number_3)

# ---- group: Pump Index
number_9 = Number(number_4)

# ---- group: Consumer Demand (LPS)
number_10 = Number(number_5)

# ---- group: Tanks
tank_2 = Point(tank)

# ---- group: Tank Height
number_11 = Number(number_6)

# ---- group: Epanet Filename (stored in location of GH file)
text_2 = Text(text)

# ---- group: Line Diameter
number_12 = Number(number)

# ---- group: Pump Power in kw
number_13 = Number(number_2)

# ---- group: Consumer
consumers_2 = Point(consumers)

# ---- group: Tank Volume
number_14 = Number(number_7)

# ----
# Analyse Epanet-File: Analyses a given Epanet-File and writes in the same directory a Report File.
# 
# Steps are only worth using, if the Epanet-File makes use of time. If the Epanet file is written by the GH-Component "Write Hydrology Network" (as shown here) there is no timing included.
# 
# Output needs to be sorted.
# Write Epanet-File: Name: Filename. An Epanet .inp file is saved directly next to the GH-File (it needs to exist).
# 
# Lines: Define the network. All lines need to connect to one network. Connecting lines need to be drawn precise to create network nodes!
# 
# Diameter & Roughness: Need values for each line.
# 
# Pumps: Defined by index of line in network. All other lines are pipes.
# 
# Power: Needs value for each pump and defines strength of it.
# 
# Consumers: Defined by points. Finds closest node in network and if there is already a consumer, their demand is summed up.
# 
# Demand in Liters per Second: Needs value for each consumer.
# 
# Tank: Similarly defined as consumer by a point.
# 
# Height & Volume: Need values for each tank.
# 
# Reservoir: Similar to tank, but with indefinite source of water.
# Read Epanet-File: Reads geometry out of a given Epanet-File.
lines_2 = Line(lines)
multiplication = Multiplication(A=networksegments, B=number_9)
list_length = ListLength(List=consumers_2)
list_length_2 = ListLength(List=lines_2)
round = Round(Number=multiplication)  # -> Nearest, Floor, Ceiling
duplicate_data = DuplicateData(Data=number_12, Number=list_length_2, Order=True)
duplicate_data_2 = DuplicateData(Data=number_8, Number=list_length_2, Order=True)
duplicate_data_3 = DuplicateData(Data=number_10, Number=list_length, Order=True)
pump_index_2 = Panel(round.Floor)
write_hydrology_network = WriteHydrologyNetwork(
    Name=text_2,
    Lines=flatten(lines_2),
    LineDiameterM=duplicate_data,
    LineRoughness=duplicate_data_2,
    Pumps=round.Floor,
    PumpPowerKw=number_13,
    Consumers=consumers_2,
    ConsumerDemandLPS=duplicate_data_3,
    Tanks=tank_2,
    TankHeightM=number_11,
    TankVolumeMВі=number_14)  # -> FilePath, ConsumerID, TankID, ReservoirID
analyse_hydrology_network = AnalyseHydrologyNetwork(FilePath=write_hydrology_network.FilePath, Steps=1)  # -> PipeValues, PipeType, NodeValues, NodeType, NodeID
read_hydrology_network = ReadHydrologyNetwork(FilePath=write_hydrology_network.FilePath)  # -> Lines, Nodes, NodeTypes, Pipes, Pumps, Tanks, Reservoirs
pumps = Brep(read_hydrology_network.Pumps)
pipes = Brep(read_hydrology_network.Pipes)
tanks = Brep(read_hydrology_network.Tanks)

# ---- group: Pipe Values
number_15 = Number(analyse_hydrology_network.PipeValues)

# ---- group: Pipe Value Type
integer_3 = Integer(analyse_hydrology_network.PipeType)

# ---- group: Node Values
number_16 = Number(analyse_hydrology_network.NodeValues)

# ---- group: Node ID
integer_4 = Integer(analyse_hydrology_network.NodeID)

# ---- group: Consumer ID
integer_5 = Integer(write_hydrology_network.ConsumerID)

# ---- group: Tank ID
integer_6 = Integer(write_hydrology_network.TankID)

# ---- group: Node Values
number_17 = Number(number_16)

# ---- group: Node ID
integer_7 = Integer(integer_4)

# ---- group: Node Value Type
integer_8 = Integer(integer)

# ---- group: Tank ID
integer_9 = Integer(integer_6)

# ---- group: Consumer ID
integer_10 = Integer(integer_5)

# ---- group: Pipe Values
number_18 = Number(number_15)

# ---- group: Pipe Value Type
integer_11 = Integer(integer_2)

# ---- group: Pipe Type
integer_12 = Integer(integer_3)

# ----
# Sort pipes and pumps
list_item = ListItem(List=number_18, Index=integer_11, Wrap=True)  # -> flatten(Item)
bounds = Bounds(Numbers=list_item)
remap_numbers = RemapNumbers(Value=list_item, Source=bounds, Target=Domain(0, 1))  # -> Mapped, Clipped
gradient = Gradient(
    LowerLimit=0,
    UpperLimit=1,
    Parameter=remap_numbers.Mapped,
    stops=[0: RGB(234, 38, 0), 0.25: RGB(234, 126, 0), 0.5: RGB(254, 244, 84), 0.75: RGB(173, 203, 249), 1: RGB(75, 107, 169)])
sort_pipes_and_pumps = Dispatch(List=gradient, DispatchPattern=integer_12)  # -> ListA, ListB

# ----
# Sets the minimum pressure a consumer needs to have. All above are coloured pink
min_pressure = Slider(1, range=0..100)

# ----
# Sort node values by ID and get tanks and consumer nodes.
list_item_2 = ListItem(List=number_17, Index=integer_8, Wrap=True)  # -> flatten(Item)
sort_list = SortList(Keys=integer_7, ValuesValuesA=list_item_2)  # -> Keys, ValuesValuesA
consumer = ListItem(List=sort_list.ValuesValuesA, Index=integer_10, Wrap=True)
tank_3 = ListItem(List=sort_list.ValuesValuesA, Index=integer_9, Wrap=True)
bounds_2 = Bounds(Numbers=[consumer, tank_3])
remap_numbers_2 = RemapNumbers(Value=consumer, Source=bounds_2, Target=Domain(0, 1))  # -> Mapped, Clipped
list_length_3 = ListLength(List=consumer)
remap_numbers_3 = RemapNumbers(Value=tank_3, Source=bounds_2, Target=Domain(0, 1))  # -> Mapped, Clipped
smaller_than = SmallerThan(FirstNumber=consumer, SecondNumber=min_pressure)  # -> SmallerThan, OrEqualTo
series = Series(Start=0, Step=1, Count=list_length_3)
gradient_2 = Gradient(LowerLimit=0, UpperLimit=1, Parameter=remap_numbers_2.Mapped, stops=[0: RGB(255, 255, 255), 1: RGB(0, 0, 0)])
gradient_3 = Gradient(LowerLimit=0, UpperLimit=1, Parameter=remap_numbers_3.Mapped, stops=[0: RGB(255, 255, 255), 1: RGB(0, 0, 0)])
cull_pattern = CullPattern(List=series, CullPattern=smaller_than.SmallerThan)
input = ColourSwatch(SwatchColor=RGB(227, 5, 116))
replace_items = ReplaceItems(List=gradient_2, Item=input, Indices=cull_pattern, Wrap=False)

# ---- group: Colour Pumps
colour = Colour(sort_pipes_and_pumps.ListA)

# ---- group: Colour Pipes
colour_2 = Colour(sort_pipes_and_pumps.ListB)

# ---- group: Colour Consumers
colour_3 = Colour(replace_items)

# ---- group: Colour Tanks
colour_4 = Colour(gradient_3)

# ---- group: Consumer
consumers_3 = Point(consumers)

# ---- group: Colour Consumers
colour_5 = Colour(colour_3)

# ---- group: Colour Tanks
colour_6 = Colour(colour_4)

# ---- group: Colour Pumps
colour_7 = Colour(colour)

# ---- group: Colour Pipes
colour_8 = Colour(colour_2)

# ----
pipes_2 = Brep(pipes)
pumps_2 = Brep(pumps)
tanks_2 = Brep(tanks)
custom_preview = CustomPreview(Geometry=pumps_2, Shader=colour_7)
custom_preview_2 = CustomPreview(Geometry=pipes_2, Shader=colour_8)
dot_display = DotDisplay(Point=consumers_3, Colour=colour_5, Size=1)
custom_preview_3 = CustomPreview(Geometry=tanks_2, Shader=colour_6)

# ==== cluster Cluster
A = ClusterInput()
B = ClusterInput()
multiplication = Multiplication(A=A, B=B)
list = ClusterInput()
list_item = ListItem(List=list, Index=0, Wrap=True)
A_2 = ClusterInput()
subtraction = Subtraction(A=A_2, B=list_item)
bounds = Bounds(Numbers=subtraction)
deconstruct_domain = DeconstructDomain(Domain=bounds)  # -> Start, End
subtraction_2 = Subtraction(A=deconstruct_domain.Start, B=deconstruct_domain.End)
absolute = Absolute(Value=subtraction_2)
division = Division(A=subtraction, B=absolute)
B_2 = ClusterInput()
multiplication_2 = Multiplication(A=division, B=B_2)
construct_point = ConstructPoint(XCoordinate=0, YCoordinate=multiplication, ZCoordinate=multiplication_2)
polyline = PolyLine(Vertices=construct_point, Closed=False)
explode = Explode(Curve=polyline, Recursive=True)  # -> Segments, Vertices
segments = ClusterOutput(explode.Segments)
split_list = SplitList(List=explode.Vertices, Index=Slider(1, range=0..10))  # -> ListA, ListB
merge = Merge(Data1=split_list.ListB)  # -> flatten(Result)
list_a = ClusterOutput(split_list.ListA)
result = ClusterOutput(merge)
