# Grasshopper definition WaterNetworkGenerationAndAnalysis.gh (Grasshopper 1.0.7)
# plug-ins: SpiderWeb :: Graph Tools, DeCodingSpaces, Anemone, Human, MetaHopper

# PARAMETRIC PLANNING CATALOGUE
# Water Network Generation and Analysis
# v. 1.0 - Author: DeCodingSpaces - Martin Dennemark
document_info = DocumentInfo(AutoUpdate=False, Recursive=False)  # -> DocumentName, DocumentFilePath, Components, Params, _3rdPartyAssemblies
# text is internalised, if metahopper component is missing
not_internalised = Text(document_info._3rdPartyAssemblies)
internalised_text = Text(["SipderWeb, Version=0.0.4.2, Culture=neutral, PublicKeyToken=null", "DecodingSpacesAssembly, Version=1.0.0.0, Culture=neutral, PublicKeyToken=null", "Anemone, Version=0.4.0.0, Culture=neutral, PublicKeyToken=null", "Human, Version=1.7.3.0, Culture=neutral, PublicKeyToken=null"])
create_set = CreateSet(List=[internalised_text, not_internalised])  # -> Set, Map
# Description: Generates water network for given street network. Assigns consumer water demand to plots and calculates performance for water network running from water tank to all consumers.
# 
# Water network is based on street network. It takes the shortest path from water tank to consumers.
# Water Networks are more resilient if they have loops. Therefore, this algorithm takes two kinds of shortest paths:
# 1. Shortest path by length of path
# 2. Shortest path with preferance of main streets.
# This leads to an efficient water network in terms of loops as well as in terms of costs, since the water network length is kept short.
# 
# 
# Moveable Marker:
# Blue = Water Tank on Rhino Layer Watertank
# 
# Remaining Markers are Public Water Taps:
# Red = Not enough pressure to get water
# Green = Just enough pressure
# 
# 
# Takes data from layers. (1)
# Water tank on layer Watertank
# Primary, Secondary, Tertiary Streets (primary streets are preferred for water lines)
# Terrain as Surface
# 
# So far water demand is set for residential areas only. Takes area of plots, assigns households according to area per household and with it water demand (2)
_3rd_party = Panel(create_set.Set)

# ----
# Geometry Setup
# 
# Preparing Street Network.
# Assign Weight for Streets by their Hierarchy
# Assign Water Demand per Street Block
# Project Water Tank and Consumer Points to Surface
# 1.
# 2.
geometry_pipeline = GeometryPipeline(
    GroupByLayer=False,
    GroupByType=False,
    IncludeHidden=True,
    IncludeLocked=True,
    LayerFilter="SecondaryStreet",
    NameFilter="*",
    SublayerFiltering=True,
    TypeFilter=4)
geometry_pipeline_2 = GeometryPipeline(
    GroupByLayer=False,
    GroupByType=False,
    IncludeHidden=True,
    IncludeLocked=True,
    LayerFilter="TertiaryStreet",
    NameFilter="*",
    SublayerFiltering=True,
    TypeFilter=4)
geometry_pipeline_3 = GeometryPipeline(
    GroupByLayer=False,
    GroupByType=False,
    IncludeHidden=True,
    IncludeLocked=True,
    LayerFilter="PrimaryStreet",
    NameFilter="*",
    SublayerFiltering=True,
    TypeFilter=4)
geometry_pipeline_4 = GeometryPipeline(
    GroupByLayer=False,
    GroupByType=False,
    IncludeHidden=True,
    IncludeLocked=True,
    LayerFilter="Terrain",
    NameFilter="*",
    SublayerFiltering=True,
    TypeFilter=1073741848)
geometry_pipeline_5 = GeometryPipeline(
    GroupByLayer=False,
    GroupByType=False,
    IncludeHidden=True,
    IncludeLocked=True,
    LayerFilter="Watertank",
    NameFilter="*",
    SublayerFiltering=True,
    TypeFilter=1)
weights_per_street_hierarchy = Panel("""1
2
3""")
list_length = ListLength(List=geometry_pipeline)
list_length_2 = ListLength(List=geometry_pipeline_2)
list_length_3 = ListLength(List=geometry_pipeline_3)
merge = Merge(Data1=flatten(geometry_pipeline_3), Data2=flatten(geometry_pipeline), Data3=flatten(geometry_pipeline_2))
merge_2 = Merge(Data1=flatten(list_length_3), Data2=flatten(list_length), Data3=flatten(list_length_2))
polygons_from_lines = PolygonsFromLines(Lines=merge, MinBlockSize=0)  # -> Polygons, SynchronizedValues
end_points = EndPoints(Curve=merge)  # -> Start, End
duplicate_data = DuplicateData(Data=graft(weights_per_street_hierarchy), Number=graft(merge_2), Order=True)  # -> flatten(Data)
projectpttosrf = ProjectPtToSrf(point=end_points.Start, surface=reparameterize(geometry_pipeline_4))
projectpttosrf_2 = ProjectPtToSrf(point=end_points.End, surface=reparameterize(geometry_pipeline_4))
area = Area(Geometry=flatten(polygons_from_lines.Polygons))  # -> Area, Centroid
projectpttosrf_3 = ProjectPtToSrf(point=geometry_pipeline_5, surface=reparameterize(geometry_pipeline_4))
projectpttosrf_4 = ProjectPtToSrf(point=area.Centroid, surface=reparameterize(geometry_pipeline_4))
line = Line(StartPoint=projectpttosrf, EndPoint=projectpttosrf_2)
areaperhousehold = Slider(1000, range=50..1000)
demandperhousehold = Slider(35, range=0..100)
division = Division(A=area.Area, B=areaperhousehold)
# Anecdote: Keep this value.
# 
# Once calculation was not working. Everything was setup correctly, but just water demand was not fitting. I was trying out different values and found one close to this one. Then our water engineer passed by and I asked him, how I need to calibrate it. He told me, just convert Liters Per Second to Liters Per Day. Done!  Conclusion: For real cases, better ask an water engineer to double check your water tools ;)
liters_per_second_to_liters_per_day = Panel("0.00005787")
multiplication = Multiplication(A=demandperhousehold, B=division)
multiplication_2 = Multiplication(A=multiplication, B=liters_per_second_to_liters_per_day)

# ----
# Water network is based on street network. It takes the shortest path from water tank to consumers.
# Water Networks are more resilient if they have loops. Therefore, this algorithm takes two kinds of shortest paths:
# 1. Shortest path by length of path
# 2. Shortest path with preferance of main streets.
# This leads to an efficient water network in terms of loops as well as in terms of costs, since the water network length is kept short.
# Find shortest path by length and by street hierachy.
# link watertank to all customer positions
# calculate shortest path by length of street segments
# create graph structure of street network to conduct shortest path calculations
# Reference the weight values of streets with their edge in the graph.
# Multiply the weight (street hierarchy) of the edge with its costs (length).
# -> Costs of primary streets are reduced compared to secondary or tertiary streets.
# -> Shortest Path Algorithm will consider street hierarchy
# calculate shortes path in consideration of street hierarchy -> prefer primary streets
graphfromlines = GraphFromLines(ConnectionLines=line, undirected=True)  # -> Graph, GraphPoints
display_graph = DisplayGraph(Graph=graphfromlines.Graph, GraphPoints=graphfromlines.GraphPoints)  # -> VertexCount, EdgeCount, Edge
closest_point = ClosestPoint(Point=projectpttosrf_3, Cloud=graphfromlines.GraphPoints)  # -> ClosestPoint, CPIndex, Distance
closest_point_2 = ClosestPoint(Point=projectpttosrf_4, Cloud=graphfromlines.GraphPoints)  # -> ClosestPoint, CPIndex, Distance
curve_middle = CurveMiddle(Curve=display_graph.Edge)
curve_middle_2 = CurveMiddle(Curve=line)
cross_reference = CrossReference(ListListA=closest_point.CPIndex, ListListB=closest_point_2.CPIndex, CrossMode=6)  # -> ListListA, ListListB
closest_point_3 = ClosestPoint(Point=curve_middle, Cloud=curve_middle_2)  # -> ClosestPoint, CPIndex, Distance
graphtodatatree = GraphToDataTree(Graph=graphfromlines.Graph, methode=False)  # -> DataTree, Costs
list_item = ListItem(List=duplicate_data, Index=closest_point_3.CPIndex, Wrap=True)  # -> graft(Item)
multiplication_3 = Multiplication(A=graphtodatatree.Costs, B=list_item)
datatreetograph = DataTreeToGraph(DataTree=graphtodatatree.DataTree, Cost=multiplication_3, methode=2)
shortestpathbetweenpoints = ShortestPathBetweenPoints(
    Graph=datatreetograph,
    StartingPoint=graft(cross_reference.ListListA),
    EndPoint=graft(cross_reference.ListListB),
    methode=1)  # -> GraphEdgeIndex, GraphEdgeWeight, GraphVertexIndex, GraphVertexWeight
shortestpathbetweenpoints_2 = ShortestPathBetweenPoints(
    Graph=graphfromlines.Graph,
    StartingPoint=graft(cross_reference.ListListA),
    EndPoint=graft(cross_reference.ListListB),
    methode=1)  # -> GraphEdgeIndex, GraphEdgeWeight, GraphVertexIndex, GraphVertexWeight

# ----
# Combine both Shortest Paths to create Water Network
create_set_2 = CreateSet(List=flatten(shortestpathbetweenpoints.GraphEdgeIndex))  # -> Set, Map
length = Length(Curve=display_graph.Edge)
set_difference = SetDifference(SetA=shortestpathbetweenpoints_2.GraphEdgeIndex, SetB=create_set_2.Set)
list_item_2 = ListItem(List=length, Index=set_difference, Wrap=True)
list_item_3 = ListItem(List=display_graph.Edge, Index=set_difference, Wrap=True)
list_item_4 = ListItem(List=display_graph.Edge, Index=shortestpathbetweenpoints.GraphEdgeIndex, Wrap=True)
mass_addition = MassAddition(Input=list_item_2)  # -> Result, PartialResults
bounds = Bounds(Numbers=flatten(mass_addition.Result))
remap_numbers = RemapNumbers(Value=mass_addition.Result, Source=bounds, Target=Domain(0, 1))  # -> Mapped, Clipped
smaller_than = SmallerThan(FirstNumber=remap_numbers.Mapped, SecondNumber=Slider(0.8, range=0..1))  # -> SmallerThan, OrEqualTo
cull_pattern = CullPattern(List=simplify(list_item_3), CullPattern=simplify(smaller_than.OrEqualTo))
network_to_segments = NetworkToSegments(NetworkGeometry=flatten([list_item_4, cull_pattern]), ConvertCurves=True, ConversionAngle=0.2, Split=True)

# ----
# Loop to automatically dimension pipes
used_pipe_diameters = GenePool(Decimals=2, Maximum=0.5, Minimum=0, Value=[0.03, 0.06, 0.09, 0.12, 0.15])
# Automated Pipe Dimensioning:
# 
# Looping through Water Analysis to find suitable pipe diameters.
# 
# Each iteration the flow velocity in each pipe is being checked.
# If the velocity is too high a higher pipe diameter is chosen.
# This is a simple way of automating the dimensioning of pipes.
panel = Panel("Used Pipe Diameters")
curve = Curve(network_to_segments)
iterations = Slider(4, range=0..5)
list_length_4 = ListLength(List=flatten([used_pipe_diameters, curve]))
list_length_5 = ListLength(List=curve)
tank_height = Slider(10, range=0..100)
duplicate_data_2 = DuplicateData(Data="0", Number=list_length_5, Order=True)
list_length_6 = ListLength(List=projectpttosrf_3)
duplicate_data_3 = DuplicateData(Data=tank_height, Number=list_length_6, Order=True)
node_values = ValueList({"Actual demand": 0, "Hydraulic Head": 1, "Pressure": 2}, selected="Pressure")
pipe_values = ValueList({"Flow rate": 0, "Flow velocity": 1, "Head loss": 2, "Actual link status": 3, "Roughness": 4, "Energy expended": 5}, selected="Flow velocity")
max_velocity = Slider(1.5, range=0..10)
addition = Addition(A=iterations, B=list_length_4, C=max_velocity)
loop_start = LoopStart(Repeat=iterations, Trigger=addition, Data=duplicate_data_2)  # -> port, Counter, Data
list_item_5 = ListItem(List=used_pipe_diameters, Index=loop_start.Data, Wrap=True)
write_hydrology_network = WriteHydrologyNetwork(
    Lines=curve,
    LineDiameterM=list_item_5,
    LineRoughness=140,
    PumpPowerKw=1,
    Consumers=projectpttosrf_4,
    ConsumerDemandLPS=multiplication_2,
    Tanks=projectpttosrf_3,
    TankHeightM=duplicate_data_3,
    TankVolumeM³=Domain(50, 100))  # -> FilePath, ConsumerID, TankID, ReservoirID
analyse_hydrology_network = AnalyseHydrologyNetwork(FilePath=write_hydrology_network.FilePath, Steps=1)  # -> PipeValues, PipeType, NodeValues, NodeType, NodeID
list_item_6 = ListItem(List=analyse_hydrology_network.NodeValues, Index=node_values, Wrap=True)  # -> flatten(Item)
round = Round(Number=list_item_6)  # -> Nearest, Floor, Ceiling
list_item_7 = ListItem(List=analyse_hydrology_network.PipeValues, Index=pipe_values, Wrap=True)  # -> flatten(Item)
division_2 = Division(A=round.Nearest, B=Slider(10, range=0..10))
larger_than = LargerThan(FirstNumber=list_item_7, SecondNumber=max_velocity)  # -> LargerThan, OrEqualTo
consumer_values = ListItem(List=division_2, Index=write_hydrology_network.ConsumerID, Wrap=True)  # -> flatten(Item)
consumer_values_2 = ListItem(List=division_2, Index=write_hydrology_network.TankID, Wrap=True)  # -> flatten(Item)
addition_2 = Addition(A=loop_start.Data, B=larger_than.LargerThan)
loop_end = LoopEnd(port=loop_start.port, Exit=False, Data=addition_2, TimeOutVal=0, pausedState=False, state="Constant output")
list_item_8 = ListItem(List=used_pipe_diameters, Index=loop_end, Wrap=True)

# ----
# Water pressure below 1 bar is not enough and colored red. Above 16 bar is too much and colored purple.
number_slider = Slider(20, range=0..20)
move = Move(Geometry=projectpttosrf_3, Motion=Vector(0, 0, 10))  # -> Geometry, Transform
concatenate = Concatenate(FragmentA=consumer_values, FragmentB=" bar")
concatenate_2 = Concatenate(FragmentA=consumer_values_2, FragmentB=" bar")
contour = Contour(Shape=geometry_pipeline_4, Point=Point(0, 0, 0), Direction=Vector(0, 0, 1), Distance=number_slider)
gradient = Gradient(LowerLimit="0.99", UpperLimit="16.01", Parameter=consumer_values, stops=[0: RGB(255, 0, 0), 0.994: RGB(0, 128, 0)])
gradient_2 = Gradient(
    LowerLimit=0,
    UpperLimit=Slider(4, range=0..10),
    Parameter=list_item_7,
    stops=[0: RGB(0, 61, 89), 0.25: RGB(0, 155, 180), 0.5: RGB(148, 193, 28), 0.75: RGB(243, 154, 0), 1: RGB(183, 26, 73)])
tree_statistics = TreeStatistics(Tree=contour)  # -> Paths, Length, Count
multiplication_4 = Multiplication(A=list_item_8, B=Slider(300, range=0..1000))
subtraction = Subtraction(A=tree_statistics.Count, B="1")
colour_swatch = ColourSwatch(SwatchColor=RGB(0, 234, 255))
range = Range(Domain=Domain(0, 1), Steps=subtraction)
panel_2 = Panel("0")
symbol_advanced = SymbolAdvanced(
    Style=13,
    SizePrimary=Slider(25, range=0..100),
    SizeSecondary=0,
    Rotation=0,
    Fill=gradient,
    Edge=gradient,
    Width=2,
    Adjust=True)
symbol_advanced_2 = SymbolAdvanced(
    Style=13,
    SizePrimary=Slider(50, range=0..110),
    SizeSecondary=0,
    Rotation=0,
    Fill=colour_swatch,
    Edge=colour_swatch,
    Width=2,
    Adjust=True)
move_2 = Move(Geometry=projectpttosrf_4, Motion=Vector(0, 0, 10))  # -> Geometry, Transform
colour_swatch_2 = ColourSwatch(SwatchColor=RGB(0, 0, 0))
number_slider_2 = Slider(100, range=0..100)
gradient_3 = Gradient(LowerLimit=0, UpperLimit=1, Parameter=range, stops=[0: RGB(211, 211, 211), 1: RGB(128, 128, 128)])
custom_preview_lineweights = CustomPreviewLineweights(Geometry=contour, Shader=graft(gradient_3), Absolute=False)
screen_oriented_text = ScreenOrientedText(
    Text=concatenate,
    Justification=2,
    Location=move_2.Geometry,
    SizeFactor=Slider(7, range=0..100),
    Color=colour_swatch_2,
    Depth=number_slider_2,
    Absolute=False)
screen_oriented_text_2 = ScreenOrientedText(
    Text=concatenate_2,
    Justification=2,
    Location=move.Geometry,
    SizeFactor=Slider(20, range=0..100),
    Color=colour_swatch_2,
    Depth=number_slider_2,
    Absolute=False)
custom_preview_lineweights_2 = CustomPreviewLineweights(Geometry=network_to_segments, Shader=gradient_2, Thickness=multiplication_4, Absolute=True)
symbol_display = SymbolDisplay(Location=projectpttosrf_4, Display=symbol_advanced)
symbol_display_2 = SymbolDisplay(Location=move.Geometry, Display=symbol_advanced_2)

# ==== cluster ProjectPtToSrf
surface = ClusterInput()
point = ClusterInput()
surface_2 = Surface(reparameterize(surface))
point_2 = Point(point)
unit_z = UnitZ(Factor="-9999")
unit_z_2 = UnitZ(Factor=1)
move = Move(Geometry=point_2, Motion=unit_z)  # -> Geometry, Transform
mesh_ray = MeshRay(Mesh=surface_2, Point=move.Geometry, Direction=unit_z_2)  # -> Point, Hit
point_3 = Point(mesh_ray.Point)
point_4 = ClusterOutput(point_3)
