# Grasshopper definition WindDirection.gh (Grasshopper 1.0.7)
# plug-ins: MetaHopper

# PARAMETRIC PLANNING CATALOGUE
# Wind Direction
# v. 1.0 - Author: DeCodingSpaces - Martin Dennemark
document_info = DocumentInfo(AutoUpdate=False, Recursive=False)  # -> DocumentName, DocumentFilePath, Components, Params, _3rdPartyAssemblies
# text is internalised, if metahopper component is missing
not_internalised = Text(document_info._3rdPartyAssemblies)
internalised_text = Text()
create_set = CreateSet(List=[internalised_text, not_internalised])  # -> Set, Map
# Description: Calculate possible Air Pollution by Parcel with the help of Wind Direction Frequency
# 
# 
# Go to https://globalwindatlas.info/
# 1. & 2. Select your location.
# 3. Download all "Plot data"
# 4. Unzip
# 5. Reference windFrequencyRose.json
# 
# 
# 6. Choose to calc wind direction or pollution.
# Select Parcel for calculation
# of air pollution on other parcels.
# Flip Wind From and To inputs to
#  do the opposite and see how
# other parcels pollute the selected one.
# 
# 7. Pollution Falloff Function
# Non-scientific - based on
# random paper that measured
#  pollution close to roads.
# 
# 8. Set location of additional wind rose.
_3rd_party = Panel(create_set.Set)
image_sampler = ImageSampler(Filter="Colour", Interpolate=True, Umax=923, Umin=1, Vmax=352, Vmin=1, Wrap=1)
srf = Surface([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])

# ---- group: Reference Wind Frequency Rose File
file_path = FilePath("C:\Users\MartinD\Downloads\gwa-plot-data_2020-08-25T12 06 33\windFrequencyRose.json")

# ---- group: Parcels
srf_2 = Surface(srf)

srf_3 = Surface(srf_2)

# ----
# 5.
# 6.
# 7.
# 8.
distance_falloff = Panel("Exp(-0.02*x)")
parcel_index = Slider(61, range=0..100)
winddirection_false_pollution_true = BooleanToggle(False)
area = Area(Geometry=srf)  # -> Area, Centroid
falloff_radius = Slider(432, range=0..1000)
range = Range(Domain=falloff_radius, Steps=10)
windrosescale = Slider(400, range=0..1000)
evaluate = Evaluate(Expression=distance_falloff, x=range)
quick_graph = QuickGraph(evaluate, SortOrder=0)
windroseposition = Point(Point(1556.372501, 1160.266219, 0))

# ---- group: ParcelCenter
building_centroid = Point(area.Centroid)

# ----
list_item = ListItem(List=building_centroid, Index=parcel_index, Wrap=True)

# ---- group: WindRoseScale
number = Number(windrosescale)

# ---- group: Distance Falloff Function
falloff_function = Text(distance_falloff)

# ---- group: Air Pollution Travel Distance
number_2 = Number(falloff_radius)

# ---- group: Wind From
building_centroid_2 = Point(list_item)

# ---- group: windDirectionOrPollution
boolean = Boolean(winddirection_false_pollution_true)

# ---- group: Wind To
building_centroid_3 = Point(building_centroid)

# ---- group: WindRoseScale
number_3 = Number(number)

# ---- group: Industry Pollution / Wind From
building_centroid_4 = Point(simplify(graft(building_centroid_2)))

# ---- group: Industry Pollution / Reference Air Pollution Travel Distance
number_4 = Number(number_2)

# ---- group: Industry Pollution / Wind To
building_centroid_5 = Point(building_centroid_3)

# ---- group: Industry Pollution / Distance Falloff Function
falloff_function_2 = Text(falloff_function)

# ---- group: Industry Pollution / windDirectionOrPollution
boolean_2 = Boolean(winddirection_false_pollution_true)

# ----
# Windrose
windroseposition_2 = Point(windroseposition)
file_path_2 = FilePath(file_path)
read_file = ReadFile(File=file_path_2, PerLineParse=False)
unit_y = UnitY(Factor=1)
unit_x = UnitX(Factor=1)
ghpython_script = GhPythonScript(jsonDB=read_file)  # -> out, values, angles, angle
# ---------- ghpython_script: Python ----------
__author__ = "MartinD"
__version__ = "2020.04.28"

import json

db = json.loads(jsonDB)
values = []
angles = []
smallestAngle = 360
for entry in db:
    values.append(entry["value"])
    curAngle = entry["center_degrees"]
    if(curAngle<smallestAngle):
        smallestAngle = curAngle
    angles.append(curAngle-180)
angle = smallestAngle
# ---------- end ghpython_script ----------
bounds = Bounds(Numbers=ghpython_script.values)
construct_plane = ConstructPlane(Origin=windroseposition_2, XAxis=unit_y, YAxis=unit_x)
subtraction = Subtraction(A=Slider(180, range=0..1000), B=ghpython_script.angle)
addition = Addition(A=ghpython_script.angles, B=subtraction)
division = Division(A=ghpython_script.angle, B="2")
number_slider = Slider(5, range=0..10)
subtraction_2 = Subtraction(A=addition, B=division)
addition_2 = Addition(A=addition, B=division)
radians = Radians(Degrees=addition)
radians_2 = Radians(Degrees=addition_2)
radians_3 = Radians(Degrees=subtraction_2)
list_length = ListLength(List=addition)
division_2 = Division(A="1", B=number_slider)
point_cylindrical = PointCylindrical(BasePlane=construct_plane, Angle=radians_3, Radius="0", Elevation=0)
radial = Radial(Plane=construct_plane, Size=division_2, ExtentR=number_slider, ExtentP=list_length)  # -> Cells, Points
radians_4 = Radians(Degrees=division)
flip_matrix = FlipMatrix(Data=radial.Points)
list_item_2 = ListItem(List=reverse(flip_matrix), Index=0, Wrap=True)  # -> flatten(Item)
rotate = Rotate(Geometry=radial.Cells, Angle=radians_4, Plane=construct_plane)  # -> Geometry, Transform
scale = Scale(Geometry=rotate.Geometry, Center=construct_plane, Factor=number_3)  # -> Geometry, Transform
scale_2 = Scale(Geometry=list_item_2, Center=construct_plane, Factor=number_3)  # -> Geometry, Transform
panel = Panel("""E


N


W


S""")
text_tag = TextTag(Location=scale_2.Geometry, Text=panel, Colour=ColourSwatch(SwatchColor=RGB(0, 0, 0)))

deconstruct_domain = DeconstructDomain(Domain=bounds)  # -> Start, End

remap_numbers = RemapNumbers(Value=ghpython_script.values, Source=deconstruct_domain.End, Target=Domain(0, 1))  # -> Mapped, Clipped
point_cylindrical_2 = PointCylindrical(BasePlane=construct_plane, Angle=radians_3, Radius=remap_numbers.Mapped, Elevation=0)
point_cylindrical_3 = PointCylindrical(BasePlane=construct_plane, Angle=radians, Radius=remap_numbers.Mapped, Elevation=0)
point_cylindrical_4 = PointCylindrical(BasePlane=construct_plane, Angle=radians_2, Radius=remap_numbers.Mapped, Elevation=0)
merge = Merge(
    Data1=simplify(graft(point_cylindrical)),
    Data2=simplify(graft(point_cylindrical_2)),
    Data3=simplify(graft(point_cylindrical_4)),
    Data4=simplify(graft(point_cylindrical)))
polyline = PolyLine(Vertices=merge, Closed=False)
boundary_surfaces = BoundarySurfaces(Edges=polyline)
scale_3 = Scale(Geometry=boundary_surfaces, Center=construct_plane, Factor=number_3)  # -> Geometry, Transform
vector_2pt = Vector2Pt(PointA=point_cylindrical, PointB=point_cylindrical_3, Unitize=False)  # -> unitize(Vector), Length

# ---- group: Wind Sector Angle
number_5 = Number(ghpython_script.angle)

# ---- group: Wind Sector Frequency
number_6 = Number(remap_numbers.Mapped)

# ---- group: Wind Sector Directions
vector = Vector(vector_2pt.Vector)

# ---- group: Industry Pollution / Wind Sector Frequency
number_7 = Number(number_6)

# ---- group: Industry Pollution / Wind Sector Directions
vector_2 = Vector(vector)

# ---- group: Industry Pollution / Wind Sector Angle
number_8 = Number(number_5)

# ---- group: Industry Pollution
# wind sector * factor, to increase possible wind angle - if angle is between two wind directions, it will take both and calculate average.
vector_2pt_2 = Vector2Pt(PointA=building_centroid_4, PointB=building_centroid_5, Unitize=False)  # -> Vector, Length
# check angle to each wind direction
angle = Angle(VectorA=graft(vector_2pt_2.Vector), VectorB=vector_2)  # -> Angle, Reflex
multiplication = Multiplication(A=number_8, B=Slider(1.25, range=0..10))
number_9 = Number("2")
degrees = Degrees(Radians=angle.Angle)
division_3 = Division(A=multiplication, B=number_9)
# check if angle is within wind sector
smaller_than = SmallerThan(FirstNumber=degrees, SecondNumber=division_3)  # -> SmallerThan, simplify(OrEqualTo)
evaluate_2 = Evaluate(Expression=falloff_function_2, x=vector_2pt_2.Length)  # -> simplify(graft(Result))
evaluate_3 = Evaluate(Expression=falloff_function_2, x=number_4)
cull_pattern = CullPattern(List=number_7, CullPattern=smaller_than.OrEqualTo)
match_tree = MatchTree(Tree=cull_pattern, Guide=smaller_than.OrEqualTo)  # -> simplify(Tree)
list_length_2 = ListLength(List=match_tree)
# multiply with falloff funcion. pollution gets less over distance
cull_pattern_2 = CullPattern(List=evaluate_2, CullPattern=list_length_2)
multiplication_2 = Multiplication(A=match_tree, B=cull_pattern_2)
panel_2 = Panel("""0: winddirection
1: falloff""")

# ----
stream_filter = StreamFilter(Gate=boolean_2, Stream0="1", Stream1=evaluate_3)
stream_filter_2 = StreamFilter(Gate=boolean_2, Stream0=match_tree, Stream1=multiplication_2)

# ---- group: Industry Pollution (continued)
# create weighted average of wind directions to get rough estimation of wind pollution
weighted_average = WeightedAverage(Input=stream_filter_2, Weights=match_tree)
max = Number(stream_filter)

# ---- group: Industry Pollution / Wind/Pollution Probability
number_10 = Number(simplify(weighted_average))

# ---- group: Wind/Pollution Probability
number_11 = Number(flatten(number_10))

# ----
max_2 = Number(max)
gradient = Gradient(
    LowerLimit=0,
    UpperLimit=max_2,
    Parameter=number_11,
    stops=[0: RGB(0, 61, 89), 0.25: RGB(0, 155, 180), 0.5: RGB(148, 193, 28), 0.75: RGB(243, 154, 0), 1: RGB(183, 26, 73)])
custom_preview = CustomPreview(Geometry=srf_3, Material=gradient)
